# Grasshopper definition UR5_Print.ghx (Grasshopper 1.0.7)

print_bed_ur5 = Geometry(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)
column = Geometry(<curve referenced from the Rhino model>)
cluster = Cluster()

# ----
# Input
py = PythonScript()  # -> path
# ---------- py: Python ----------
import sys
import os

ghComp = ghenv.Component
ghDoc = ghComp.OnPingDocument()

# the full path of the gh file
path = ghDoc.FilePath
# the current directory 
#path = os.path.abspath(os.path.join(path, ".."))
path = os.path.abspath(os.path.join(path, "..", "..","02_4D_fabric","grasshopper"))

print path
# ---------- end py ----------

flip = FlipCurve(Curve=column)  # -> Curve, Flag
cp = ControlPoints(Curve=flip.Curve)  # -> Points, Weights, Knots

geo = Geometry()
safe_frame = Safe_frame(C=geo, C_2=Slider(3, range=0..10))  # -> P, T
direct_4dp_settings = Direct_4DP_settings(
    data=cp.Points,
    D=Slider(5, range=0..100),
    F=Slider(30, range=0..100),
    D_2=Slider(1, range=0..1),
    D_3=Slider(17, range=0..100),
    X=Slider(0, range=0..1000),
    Y=Slider(0, range=0..1000),
    A=Slider(0, range=0..100))  # -> G, D_4, D_5, D_6, pl

panel = Panel(direct_4dp_settings.D_5)

tcp_z = Slider(150.2, range=0..1000)
fabrication = GhPythonScript(
    points=direct_4dp_settings.G,
    blend_radiuses=direct_4dp_settings.D_4,
    extruder_toggles=direct_4dp_settings.D_5,
    velosities=direct_4dp_settings.D_6,
    myTCP_z=tcp_z,
    send=Toggle(True))  # -> out, rhino_base_way_planes, robot_planes, script; inputs points: list, blend_radiuses: list, extruder_toggles: list, velosities: list
# ---------- fabrication: Python ----------
from compas_rhino import unload_modules
unload_modules('simple_ur_script')
unload_modules('simple_comm')

import Rhino.Geometry as rg
import simple_comm as c
import simple_ur_script as ur

import math as m


def tcp(script):
    """ This funktion sets tcp 
    """
    script += ur.set_tcp_by_angles(
        float(0.0), float(0.0), float(myTCP_z), m.radians(0.0), m.radians(180.0), m.radians(90))
    return script

def set_robot_base_plane_from_pts():

    pt_0 = rg.Point3d(350, 230, 0)  # base plane origin
    # point on base plane positive x direction
    pt_1 = rg.Point3d(499, 230, 0)
    pt_2 = rg.Point3d(499, 499, 0)  # point on base plane positive xy

    robot_base = rg.Plane(pt_0, pt_1-pt_0, pt_2-pt_0)
    return robot_base

def rhino_to_robot_space(rhino_plane):
    """ this funktion translates planes from the rhino cordinate system to
    the robot cordinate system 
    """
    robot_plane = rhino_plane.Clone()
    _r_matrix = rg.Transform.PlaneToPlane(
        rg.Plane.WorldXY, set_robot_base_plane_from_pts())
    
    robot_plane.Transform(_r_matrix)
    return robot_plane
    

def point_to_rhino_plane(point):
    rhino_plane = rg.Plane(point, rg.Vector3d.XAxis, rg.Vector3d.YAxis)
    return rhino_plane

def extrude(plane, vel, blend_radi, extr, script):
    newval = 0
    vel = vel/1000
    blend_radi = blend_radi/1000
    script += ur.move_l_blend(plane, vel, blend_radi)
    
    if extr ==1:
        extr = False
        newval = True
    else:
        extr = True
        newval = False
    script += ur.set_digital_out(5, extr)
    #script += ur.set_digital_out(6,newval)
    script += ur.set_digital_out(7,newval)
    
    
    return script 


""" Robotic fabrication procedure
"""
script = ""

script = tcp(script)


"""Create rhino planes
"""

rhino_base_way_planes = []
for point in points:
    rhino_base_way_planes.append(point_to_rhino_plane(point))

"""Translate rhino planes to robot_plabe 
"""

robot_planes = []

for rhino_plane in (rhino_base_way_planes):
    robot_planes.append(rhino_to_robot_space(rhino_plane))
#    print rhino_plane.Origin
    
"""Create comands
"""

cnt = 0
for plane, velocity, blend_radi, extruder_toggle in zip(robot_planes, velosities,blend_radiuses, extruder_toggles):
    cnt += 1
    if cnt < 20000:
       script = extrude(plane, velocity, blend_radi, extruder_toggle, script)

if send:
    script = c.concatenate_script(script)
    #print script
    c.send_script(script, "192.168.10.10")
# ---------- end fabrication ----------
write_to_file = GhPythonScript(script=fabrication.script)  # -> out
# ---------- write_to_file: Python ----------
f = open("Z:/Desktop/20201207_fabrication.txt", "w")   # 'r' for reading and 'w' for writing
f.write(script)  
f.close()                                # Close file 


f = open("Z:/Desktop/20201207_fabrication.txt", "r")   # 'r' for reading and 'w' for writing
print f.read()                           # Write inside file 
f.close()                                # Close file
# ---------- end write_to_file ----------
geometry = Geometry(fabrication.robot_planes)

pline = PolyLine(Vertices=geometry, Closed=False)

data_folder_name = Panel("data")

# ---- group: Folder name
data = Data(data_folder_name)

# ----
# Load Printpoints
panel_2 = Panel("out_printpoints.json")
csloadprintpoints = CsLoadPrintpoints(recompute=Button(), json_name=panel_2, path=py, folder_name=data)  # -> out, geometry, points, frames, layer_heights, up_vectors, mesh_normals, closest_support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; inputs recompute: Boolean
# ---------- csloadprintpoints: Python ----------
"""
Loads a dictionaly of Printpoints from a json file in the 'output' folder.

"""

import compas_slicer_ghpython.visualization as gh_compas_slicer
gh_compas_slicer = reload(gh_compas_slicer)


if path and folder_name and json_name:
    points, frames, layer_heights, up_vectors, mesh_normals, closest_support, velocities, wait_times, \
    blend_radiuses, extruder_toggles = \
        gh_compas_slicer.load_printpoints(path, folder_name, json_name)
    
else:
    gh_compas_slicer.missing_input()
# ---------- end csloadprintpoints ----------

frames = Plane(csloadprintpoints.frames)
points = Point(csloadprintpoints.points)
layer_heights = Number(csloadprintpoints.layer_heights)
up_vectors = Vector(csloadprintpoints.up_vectors)
mesh_normals = Vector(csloadprintpoints.mesh_normals)
cpts = Point(csloadprintpoints.closest_support)

panel_3 = Panel(csloadprintpoints.out)
vdis = VectorDisplay(Anchor=points, Vector=expr("x*5", up_vectors))

velocities = Number(csloadprintpoints.velocities)
wait_times = Number(csloadprintpoints.wait_times)
blend_radiuses = Number(csloadprintpoints.blend_radiuses)
extruder_toggles = Number(csloadprintpoints.extruder_toggles)

pline_2 = PolyLine(Vertices=points, Closed=False)

# ==== cluster Safe_frame
C = ClusterInput()
C_2 = ClusterInput()
offset = OffsetCurve(Curve=C, Distance=[Slider(8, range=0..10), Slider(17, range=0..100)], Plane=PlaneXY(0, 0, 0), Corners=1)
divide = DivideCurve(Curve=offset, Count=Slider(76, range=0..100), Kinks=False)  # -> Points, Tangents, Parameters
series = Series(Start=0, Step=1.2, Count=C_2)
bang = ExplodeTree(Data=divide.Points)  # -> Branch0, Branch1
bang_2 = ExplodeTree(Data=offset)  # -> Branch0, Branch1
weave = Weave(Pattern=[0, 1], Stream0=bang.Branch0, Stream1=bang.Branch1, NullGaps=False)
pline = PolyLine(Vertices=weave, Closed=True)
merge = Merge(Data1=bang_2.Branch0, Data2=pline, Data3=bang_2.Branch1)
Z = UnitZ(Factor=series)
move = Move(Geometry=merge, Motion=Z)  # -> Geometry, Transform
bang_3 = ExplodeTree(Data=move.Geometry)  # -> Branch0, Branch1, Branch2
weave_2 = Weave(Pattern=[0, 1, 2], Stream0=bang_3.Branch0, Stream1=bang_3.Branch1, Stream2=bang_3.Branch2, NullGaps=False)
flatten = FlattenTree(Tree=weave_2, Path="{0}")
cp = ControlPoints(Curve=flatten)  # -> flatten(Points), Weights, Knots
T = ClusterOutput(flatten)
P = ClusterOutput(cp.Points)

# ==== cluster Direct_4DP_settings
data = ClusterInput()
data_2 = Data(data)
F = ClusterInput()
A = ClusterInput()
X = ClusterInput()
Y = ClusterInput()
item = ListItem(List=data_2, Index=0, Wrap=True)
Z = UnitZ(Factor=F)
vec = VectorXYZ(XComponent=X, YComponent=Y, ZComponent=0)  # -> Vector, Length
move = Move(Geometry=item, Motion=Z)  # -> Geometry, Transform
ins = InsertItems(List=data_2, Item=move.Geometry, Indices=Slider(0, range=0..100), Wrap=True)
move_2 = Move(Geometry=ins, Motion=vec.Vector)  # -> Geometry, Transform
lng = ListLength(List=move_2.Geometry)
D = ClusterInput()
D_2 = ClusterInput()
D_3 = ClusterInput()
rotate = Rotate(Geometry=move_2.Geometry, Angle=degrees(A), Plane=PlaneXY(0, 0, 0))  # -> Geometry, Transform
repeat = RepeatData(Data=D, Length=lng)
repeat_2 = RepeatData(Data=D_2, Length=lng)
repeat_3 = RepeatData(Data=D_3, Length=lng)
pline = PolyLine(Vertices=rotate.Geometry, Closed=False)
pl = ClusterOutput(pline)
G = ClusterOutput(rotate.Geometry)
D_4 = ClusterOutput(repeat)
D_5 = ClusterOutput(repeat_2)
D_6 = ClusterOutput(repeat_3)

# ==== cluster Cluster
data = Data([Point(200, 33.3, 0), Point(133.3333333, -33.3, 0), Point(66.66666667, 33.3, 0), Point(0, -33.3, 0), Point(0, 99.96666667, 0), Point(66.66666667, 33.36666667, 0), Point(133.3333333, 99.96666667, 0), Point(200, 33.36666667, 0), Point(200, 166.6333333, 0), Point(133.3333333, 100.0333333, 0), Point(66.66666667, 166.6333333, 0), Point(0, 100.0333333, 0), Point(0, 233.3, 0), Point(66.66666667, 166.7, 0), Point(133.3333333, 233.3, 0), Point(200, 166.7, 0)])
data_2 = Data([Point(200, 20, 0), Point(194.8954309, 15.12058605, 0), Point(189.7199645, 10.31585246, 0), Point(184.7057164, 5.344266179, 0), Point(180.0382043, 0.04703556138, 0), Point(175.7302114, -5.54813779, 0)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])
data_3 = Data([Point(200, 19.7, 0), Point(194.8978387, 14.89597564, 0), Point(189.7258651, 10.16660907, 0), Point(184.7122358, 5.270858307, 0), Point(180.0404947, 0.0491054987, 0), Point(175.7247173, -5.472140462, 0)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])
data_4 = Data(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)
outedge = Data(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)
