# Grasshopper definition 6.15_ur_printing_script_r7_gj.gh (Grasshopper 1.0.7)
# Copyright: ©2018 GNU General Public License
# plug-ins: Pufferfish, LunchBox, Kangaroo2 Components

number_of_lines = Slider(7, range=0..10)
offset_distance = Slider(3, range=0..10)
curves_intensity = Panel("""50
50
50
50
-50
-50
-50
-50""")
cluster = Cluster_5(D=offset_distance, X=Slider(750, range=0..1000), N=number_of_lines, Y=Slider(250, range=0..1000), F=curves_intensity)
pr_folder_name = Panel("data")

# ---- group: Folder name
data = Data(pr_folder_name)

# ----
crv = Curve(<curve referenced from the Rhino model>)
number_slider = Slider(4, range=0..10)

# ----
# Input
py = PythonScript(foldername=data)  # -> path
# ---------- py: Python ----------
import sys
import os

ghComp = ghenv.Component
ghDoc = ghComp.OnPingDocument()

# the full path of the gh file
path = ghDoc.FilePath
# the current directory 
path = os.path.abspath(os.path.join(path, "..." , "..." , "data" ,foldername))

print path
# ---------- end py ----------

boundary = BoundarySurfaces(Edges=crv)
number_slider_2 = Slider(1, range=0..1)
panel = Panel("""0
-25
-25
-25
0
25
25
25
0""")
sdivide = DivideSurface(Surface=crv, UCount=Slider(8, range=0..10), VCount=Slider(2, range=0..10))  # -> Points, Normals, Parameters
panel_2 = Panel(py)
list = ValueList({"Lidar Forward Kinematic": 0, "Lidar Inverse Kinematic": 1}, selected="Lidar Inverse Kinematic")
quads = QuadPanels(Surface=boundary, UDivisions=number_slider, VDivisions=number_slider)
item = ListItem(List=sdivide.Points, Index=number_slider_2, Wrap=True)
X = UnitX(Factor=panel)
debrep = DeconstructBrep(Brep=quads)  # -> Faces, Edges, Vertices
list_2 = ValueList({"LiDAR": 0, "Depthscan": 1}, selected="Depthscan")
move = Move(Geometry=flatten(item), Motion=X)  # -> graft(Geometry), Transform
join = JoinCurves(Curves=debrep.Edges, Preserve=False)
neg = Negative(Value=Slider(3.25, range=0..10))
replace = ReplaceItems(List=sdivide.Points, Item=move.Geometry, Indices=number_slider_2, Wrap=False)
panel_3 = Panel(sdivide.Points)
offset = OffsetCurve(Curve=join, Distance=neg, Plane=PlaneXY(0, 0, 0), Corners=1)

# ----
# SET YOUR IP AND ROBOT IP
# 1a
server_address = ValueList({"192.168.10.11", "192.168.10.45"}, selected="192.168.10.45")
ur_ip = ValueList({"192.168.10.13"}, selected="192.168.10.13")
# Settings
server_port = Integer(30003)
globals = PythonScript(server_address=server_address, server_port=server_port, ur_ip=ur_ip)  # inputs server_port: Int32
# ---------- globals: Python ----------
from scriptcontext import sticky as st

st["server_address"] = server_address
st["server_port"] = server_port

st["ur_ip"] = ur_ip
# ---------- end globals ----------

get_scan_tcp = BooleanToggle(True)

move_to_pos = Button()
get_pos = Button()
close = Button()
number_slider_3 = Slider(1000, range=0..1000)
pos_z = Slider(150, range=0..1500)
linear_axis = GhPythonScript(move_to_pos=move_to_pos, pos_x=number_slider_3, pos_z=pos_z, get_pos=get_pos, close=close)  # -> out
# ---------- linear_axis: Python ----------
__author__ = "joburger"
__version__ = "2018.09.20"

from eggshell.linear_axis import siemens as s

if move_to_pos:
    p = s.SiemensPortal(2)
    
    try:
         p.set_x(pos_x)
         p.set_z(pos_z)
         # p.wait_ext_axis()
    
    finally:
         p.close()

if close:
    try:
        p.close()
        p = s.SiemensPortal(2)
    finally:
        p.close()

#position_data = None

position_data = "NO DATA"
if get_pos:
    try:
        p = s.SiemensPortal(2)
        position_data = "NO DATA"
        position_data = "AXIS POSITION \nX:" + str(p.get_x()) + " Z:" + str(p.get_z())
        print "hmm"
    finally:
        p.close()

try:
    print position_data
except RuntimeError:
    print "Something did not work"
# ---------- end linear_axis ----------

# ----
# 1c
panel_4 = Panel("""ORIGIN
LINEAR 
AXIS""")

panel_5 = Panel("LINEAR AXIS PARAMETERS")

# ----
# Check if UR is available
ping = Button()
py_2 = PythonScript(ip=ur_ip, ping=ping)  # -> out
# ---------- py_2: Python ----------
from scriptcontext import sticky as st
import platform    # For getting the operating system name
import subprocess  # For executing a shell command

def ping(host):
    """
    Returns True if host (str) responds to a ping request.
    Remember that a host may not respond to a ping (ICMP) request even if the host name is valid.
    """

    # Option for the number of packets as a function of
    param = '-n' if platform.system().lower()=='windows' else '-c'

    # Building the command. Ex: "ping -c 1 google.com"
    command = ['ping', param, '1', host]

    return subprocess.call(command) == 0

guid = str(ghenv.Component.InstanceGuid)
txt_key = "txt_" + guid
if txt_key not in st:
    st[txt_key] = ""
ur_ip = st["ur_ip"]

if ping:
    
    available = ping(ur_ip)
    
    if available:
        st[txt_key] = "%s is up!" % ur_ip
    else:
        st[txt_key] = "%s is down!" % ur_ip

print st[txt_key]
# ---------- end py_2 ----------
panel_6 = Panel(py_2)

# ----
# 2a
# In order for the components in this file to work, you need to add the correct folder to your paths in Rhino.
# In Rhino, type "EditPythonScript", go to Tools > Options > Add to search path and add the following folder:
# <path>/compas_slicer/src/grasshopper_visualization'
# Output
panel_7 = Panel("Load Print Points")
pt = ConstructPoint(XCoordinate=0, YCoordinate=0, ZCoordinate=0)

# ---- group: Linear axis geometry
brep = Brep(<brep referenced from the Rhino model>)
subtraction = Subtraction(A="1000", B=number_slider_3)
subtraction_2 = Subtraction(A="500", B=pos_z)
neg_2 = Negative(Value=subtraction_2)
X_2 = UnitX(Factor=subtraction)
Z = UnitZ(Factor=neg_2)
move_2 = Move(Geometry=[brep, pt], Motion=X_2)  # -> Geometry, Transform
move_3 = Move(Geometry=move_2.Geometry, Motion=Z)  # -> Geometry, Transform
preview = CustomPreview(Geometry=move_3.Geometry, Shader=ColourSwatch(SwatchColor=RGB(99, 94, 94)))

# ----
# 1b
# SET TOOL AND ROBOT MODEL
list_3 = ValueList({"no_tool": 0, "measurement_tool": 1, "extruder_v1": 2, "alu_extruder_v2": 3}, selected="alu_extruder_v2")
tools = Tools(tool_id=list_3, get_lidar_tcp=get_scan_tcp, G=list, G_2=list_2)  # -> tool_5, lidar_tcp_2, vec_2, pt_9, pln_2
base = PythonScript(x=subtraction, z=subtraction_2)  # -> base_frame, base
# ---------- base: Python ----------
from compas.geometry import Frame

"""
origin = [0, 0, 0]
xaxis = [1, 0, 0]
yaxis = [0, 1, 0]


origin = [-313.92, -147.58, 13.79]
xaxis = [0.00000, -1.00000, 0.00000]
yaxis = [1.00000, 0.00000, 0.00000]
"""

#Copy the following into base component:
 
#origin = [0.0, 0.0, 0.0]






linear_axis_x = x
linear_axis_z = z 

#axis    Y         X                        Z
origin = [0.0, linear_axis_x, linear_axis_z]
xaxis = [0.0, -1.0, 0.0]
yaxis = [1.0, 0.0, 0.0]

base_frame = Frame(list(origin), list(xaxis), list(yaxis))

base = "base = " + str(origin) + "\n" + "change in linear_axis_x = " + str(linear_axis_x) + "\n" + "change in linear_axis_z = " + str(linear_axis_z)
# ---------- end base ----------
list_4 = ValueList({"UR5", "UR10"}, selected="UR10")
panel_8 = Panel(base.base)
robot = PythonScript(model=list_4, tool=tools.tool_5, lidar_tcp=tools.lidar_tcp_2, base_frame=base.base_frame)  # -> robot
# ---------- robot: Python ----------
from eggshell.ur_online_control.ur.ur10 import UR10
#from ur_online_control.ur.ur5 import UR5
from scriptcontext import sticky as st

if model == "UR5":
    robot = UR5()
elif model == "UR10":
    robot = UR10()

if tool:
    robot.set_tool(tool)
if base_frame:
    robot.set_base(base_frame)

st["robot"] = robot
# ---------- end robot ----------

# ---- group: Path cross-section
xz = XZPlane(Origin=Point(0, 0, 0))
rectangle = Rectangle(Plane=xz, XSize=Slider(2.5, range=0..10), YSize=Slider(1, range=0..10), Radius=Slider(0.61, range=0..1))  # -> Rectangle, Length

# ----
bang = Button()
panel_9 = Panel("Unload libraries")
unload = PythonScript(bang=bang)
# ---------- unload: Python ----------
from compas_ghpython import unload_modules

unload_modules("compas")
unload_modules("ur_online_control")
# ---------- end unload ----------

# ----
# Disconnect / recompute planes_wcs input after moving axis!
# [to make sure robot base is updated within gh]
panel_10 = Panel(linear_axis)

# ----
# Visualization
number_slider_4 = Slider(1, range=0..100)
py_3 = PythonScript()  # -> path
# ---------- py_3: Python ----------
import sys
import os

ghComp = ghenv.Component
ghDoc = ghComp.OnPingDocument()

# the full path of the gh file
path = ghDoc.FilePath
# the current directory 
path = os.path.abspath(os.path.join(path, ".."))

print path
# ---------- end py_3 ----------

# ----
# Load Slicer
panel_11 = Panel("slicer_data.json")
csloadslicer = CsLoadSlicer(recompute=Button(), json_name=panel_11, path=py_3, folder_name=data)  # -> out, mesh, paths, are_closed, all_points; inputs recompute: Boolean
# ---------- csloadslicer: Python ----------
"""
Loads a Slicer class from its json file in the 'output' folder.

"""

import compas_slicer_ghpython.visualization as gh_compas_slicer
gh_compas_slicer = reload(gh_compas_slicer)


if path and folder_name and json_name:
    mesh, paths, are_closed, all_points = gh_compas_slicer.load_slicer(path, folder_name, json_name)
    
else:
    gh_compas_slicer.missing_input()
# ---------- end csloadslicer ----------

number_slider_5 = Slider(17, range=0..50)

# ----
# Load Printpoints
panel_12 = Panel("out_printpoints.json")
csloadprintpoints = CsLoadPrintpoints(recompute=Button(), json_name=panel_12, path=py_3, folder_name=data)  # -> out, geometry, points, frames, layer_heights, up_vectors, mesh_normals, closest_support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; inputs recompute: Boolean
# ---------- csloadprintpoints: Python ----------
"""
Loads a dictionaly of Printpoints from a json file in the 'output' folder.

"""

import compas_slicer_ghpython.visualization as gh_compas_slicer
gh_compas_slicer = reload(gh_compas_slicer)


if path and folder_name and json_name:
    points, frames, layer_heights, up_vectors, mesh_normals, closest_support, velocities, wait_times, \
    blend_radiuses, extruder_toggles = \
        gh_compas_slicer.load_printpoints(path, folder_name, json_name)
    
else:
    gh_compas_slicer.missing_input()
# ---------- end csloadprintpoints ----------

panel_13 = Panel(move_3.Geometry)

# ---- group: layer height
layer_height = Slider(2, range=0..2.5)

# ---- group: print_width
number_slider_6 = Slider(3.25, range=0..4)

# ---- group: Trim_layer
number_slider_7 = Slider(0.05, range=0..0.1)

# ---- group: #Width
list_5 = ValueList({"One": 1, "Two": 2, "Three": 2² - 1, "Four": Sqrt(16)}, selected="One")

# ---- group: #Layers
list_6 = ValueList({"One": 1, "Two": 2, "Three": 2² - 1, "Four": Sqrt(16)}, selected="One")

# ----
item_2 = ListItem(List=move_3.Geometry, Index=0, Wrap=True)

# ---- group: scan position
pt_2 = Point()

# ---- group: TEST_PT
pt_3 = Point(<point referenced from the Rhino model>)

# ---- group: PRINT_PT
pt_4 = Point(<point referenced from the Rhino model>)

# ----
geo = Geometry(item_2)

points = Point(csloadprintpoints.points)
up_vectors = Vector(csloadprintpoints.up_vectors)
mesh_normals = Vector(csloadprintpoints.mesh_normals)
cpts = Point(csloadprintpoints.closest_support)
layer_heights = Number(csloadprintpoints.layer_heights)
frames = Plane(csloadprintpoints.frames)

mesh_normals_2 = Vector(mesh_normals)
points_2 = Point(points)
section = Curve(rectangle.Rectangle)

velocities = Number(csloadprintpoints.velocities)
blend_radiuses = Number(csloadprintpoints.blend_radiuses)
extruder_toggles = Number(csloadprintpoints.extruder_toggles)
wait_times = Number(csloadprintpoints.wait_times)

# ----
# Render Path Visualization
toggle = BooleanToggle(False)
extruder_toggles_2 = Number(extruder_toggles)
layer_heights_2 = Number(layer_heights)
up_vectors_2 = Vector(up_vectors)
python = CsRenderPathViz(
    points=points_2,
    mesh_normals=mesh_normals_2,
    layer_heights=layer_heights_2,
    up_vectors=up_vectors_2,
    extruder_toggles=extruder_toggles_2,
    cross_section=section,
    planar_printing=Toggle(True),
    compute=toggle)  # -> out, loft_surfaces, travel_path_lines; inputs points: list of Point3d, mesh_normals: list of Vector3d, layer_heights: list, up_vectors: list of Vector3d, extruder_toggles: list of Boolean, cross_section: Curve, planar_printing: Boolean, compute: Boolean
# ---------- python: Python ----------
"""
Creates a render visualization of the print paths with loft surfaces where extruder_toggle=True.
For large number of points, this can take a while to compute, so keep it turned off unless you need it.
Loads files from the 'output' folder.

"""

import compas_slicer_ghpython.visualization as gh_compas_slicer
gh_compas_slicer = reload(gh_compas_slicer)

pipe_resolution = 14

if points and mesh_normals and layer_heights and extruder_toggles and cross_section:
    if compute:
        loft_surfaces, travel_path_lines = \
            gh_compas_slicer.render_path_visualization(points, mesh_normals, layer_heights, up_vectors, extruder_toggles, cross_section, planar_printing)
    else:
        print('Compute is set to False')
else:
    gh_compas_slicer.missing_input()
# ---------- end python ----------

mesh = Mesh(csloadslicer.mesh)
paths = Curve(csloadslicer.paths)
all_points = Point(csloadslicer.all_points)

panel_14 = Panel(csloadprintpoints.out)
intcrv = Interpolate(Vertices=replace, Degree=3, Periodic=False, KnotStyle=1)  # -> flatten(Curve), Length, Domain
panel_15 = Panel(csloadslicer.out)

# ---- group: Color output
geo_2 = Geometry(python.travel_path_lines)
geo_3 = Geometry(python.loft_surfaces)
preview_2 = CustomPreview(Geometry=geo_3, Material=ColourSwatch(SwatchColor=RGB(222, 222, 222)))
preview_3 = CustomPreview(Geometry=geo_2, Material=ColourSwatch(SwatchColor=RGB(255, 156, 36)))

# ----
panel_16 = Panel(wait_times)
vdis = VectorDisplay(Anchor=points, Vector=expr("x*5", up_vectors))
pline = PolyLine(Vertices=points, Closed=False)

# ---- group: Select parameter to display
list_7 = ValueList({"Velocity": 0, "Wait time": 1, "Blend radius": 2, "Extruder Toggle": 3}, selected="Blend radius")

# ----
filter = StreamFilter(Gate=list_7, Stream0=velocities, Stream1=wait_times, Stream2=blend_radiuses, Stream3=extruder_toggles)
angle_of_scans = Slider(15, range=0..90)
num = Number(filter)

# ---- group: Visualize parameter with color
bnd = Bounds(Numbers=num)
avr = Average(Input=num)
dedomain = DeconstructDomain(Domain=bnd)  # -> Start, End
average = Panel(avr)
gradient = Gradient(
    LowerLimit=dedomain.Start,
    UpperLimit=dedomain.End,
    Parameter=num,
    stops=[0: RGB(0, 128, 0), 0.5: RGB(255, 255, 0), 1: RGB(255, 0, 0)])
pt_5 = Point(points)
cloud = CloudDisplay(Points=pt_5, Colours=gradient, Size=Slider(3.96, range=0..10), SpriteType=0)

# ---- group: Visualize parameter with text
tag_offset = Slider(1, range=0..100)
pdecon = Deconstruct(Point=points)  # -> XComponent, YComponent, ZComponent
addition = Addition(A=pdecon.ZComponent, B=tag_offset)
pt_6 = ConstructPoint(XCoordinate=pdecon.XComponent, YCoordinate=pdecon.YComponent, ZCoordinate=addition)
tag = TextTag(Location=pt_6, Text=num, Colour=ColourSwatch(SwatchColor=RGB(50, 130, 186)))

# ---- group: Slicer data
len = Length(Curve=flatten(paths))
lng = ListLength(List=flatten(paths))
ma = MassAddition(Input=len)  # -> Result, PartialResults
total_path_length = Panel(ma.Result)
total_number_of_paths = Panel(lng)

# ----
min = Panel(dedomain.Start)
max = Panel(dedomain.End)

# ---- group: safe_pt
pt_7 = Point(<point referenced from the Rhino model>)
xy = XYPlane(Origin=pt_7)
rotate = Rotate(Geometry=xy, Angle=degrees("5"), Plane=xy)  # -> Geometry, Transform
preview_4 = CustomPreview(Geometry=rotate.Geometry, Material=ColourSwatch(SwatchColor=RGB(159, 55, 196)))

# ---- group: parameters
move_scan_pt = BooleanToggle(False)
dfillet_mm = Slider(0, range=0..100)
move_safe_pt = BooleanToggle(True)
safe_wait_time_sec = Slider(5, range=0..80)
use_variable_fillet = BooleanToggle(False)
use_variable_speed = BooleanToggle(False)
use_wait_time = BooleanToggle(True)
speed_mm_s = Slider(13, range=0..80)
use_cooling = BooleanToggle(True)
list_8 = ValueList({"Extruder on": "extruder_on", "Extruder off": "extruder_off", "Variable extrusion": "variable_extrusion"}, selected="Variable extrusion")

# ----
# 2b
panel_17 = Panel("PRINTING PARAMETERS")
# 2c
panel_18 = Panel("SAVE JSON")
mesh_2 = Mesh()

# ---- group: Read File / Folder
panel_19 = Panel("6_15_Presentation")

# ---- group: Read File
py_4 = GhPythonScript(foldername=panel_19)  # -> json_source
# ---------- py_4: Python ----------
import os
import sys

filepath = ghenv.Component.Attributes.Owner.OnPingDocument().FilePath
path = os.path.abspath(os.path.join(filepath, "..", "..", ".."))


json_source = os.path.abspath(os.path.join(path, "four_d/data", foldername))

print(json_source)
# ---------- end py_4 ----------
panel_20 = Panel(py_4)

# ---- group: VISU Inactive
# Direct UR control
stop = Button()
get = Button()
get_2 = Button()
pose = PythonScript(get=get)  # -> pose_joints
# ---------- pose: Python ----------
from scriptcontext import sticky as st
from eggshell.ur_online_control.ur_direct import get_current_pose_joints
from eggshell.ur_online_control.ur.robot import BaseConfiguration

server_address = st["server_address"]
server_port = 30005
ur_ip = st["ur_ip"]
robot = st["robot"]
tool_angle_axis = list(robot.tool.tcp_frame.point) + robot.tool.tcp_frame.axis_angle_vector
print tool_angle_axis

guid = str(ghenv.Component.InstanceGuid)
pose_joints_key = "pose_joints" + guid


if get:
    st[pose_joints_key] = get_current_pose_joints(server_address, server_port, ur_ip, tool_angle_axis)
    
if pose_joints_key not in st:
    pose_joints = []
else:
    pose_joints = BaseConfiguration.from_joints(st[pose_joints_key])
# ---------- end pose ----------
pose_2 = PythonScript(get=get_2)  # -> pose_cartesian
# ---------- pose_2: Python ----------
from scriptcontext import sticky as st
from eggshell.ur_online_control.ur_direct import get_current_pose_cartesian

server_address = st["server_address"]
server_port = 30005
ur_ip = st["ur_ip"]
robot = st["robot"]
tool_angle_axis = list(robot.tool.tcp_frame.point) + robot.tool.tcp_frame.axis_angle_vector
print tool_angle_axis

guid = str(ghenv.Component.InstanceGuid)
pose_cartesian_key = "pose_cartesian" + guid


if get:
    st[pose_cartesian_key] = get_current_pose_cartesian(server_address, server_port, ur_ip, tool_angle_axis)

if pose_cartesian_key not in st:
    pose_cartesian = []
else:
    pose_cartesian = st[pose_cartesian_key]
# ---------- end pose_2 ----------
stop_2 = PythonScript(stop=stop)
# ---------- stop_2: Python ----------
from scriptcontext import sticky as st
from eggshell.ur_online_control.ur_direct import stop as stop_robot

ur_ip = st["ur_ip"]

if stop:
    stop_robot(ur_ip)
# ---------- end stop_2 ----------
panel_21 = Panel(pose)
panel_22 = Panel(pose_2)

# ---- group: Read File / Filename
panel_23 = Panel("13062021_0226_Prediction_Parameters__Transformed_Mesh.json")

# ----
number_slider_8 = Slider(10, range=0..10)
number_slider_9 = Slider(1, range=0..1)
number_slider_10 = Slider(2, range=0..2)

# ---- group: READ_PREDICTION_MESH
# Read JSON_0
toggle_2 = BooleanToggle(True)
read = GhPythonScript(path=panel_20, name_json=panel_23, generate_Mesh=toggle_2)  # -> out, mesh; inputs generate_Mesh: Boolean
# ---------- read: Python ----------
import os
import json
from compas.datastructures import Mesh
from compas_ghpython.artists import MeshArtist


if generate_Mesh:
    layer_number = 0
    filename = os.path.join(path, name_json)
    print filename
    c_mesh = Mesh.from_json(filename)
    
    artist = MeshArtist(c_mesh)
    mesh = artist.draw()
# ---------- end read ----------

# ---- group: VISU Inactive / Define joint positions
base_2 = Slider(0, range=-360..360)
elbow = Slider(0, range=-360..360)
wrist2 = Slider(0, range=-360..360)
shoulder = Slider(0, range=-360..360)
wrist1 = Slider(0, range=-360..360)
wrist3 = Slider(0, range=-360..360)
ur1_q1_q6 = Data([base_2, shoulder, elbow, wrist1, wrist2, wrist3])

# ---- group: VISU Inactive
# Calculate basis
# Measure basis:
# 1. Clear the recorded poses
# 2. Move robot to origin and press "get pose"
# 3. Move robot to point in positive x-axis and press "get pose"
# 4. Move robot to an other point in your basis and press "get pose"
# (The farer away these positions are, the better)
# 
# 5. Alternatively change the order in the component calc base
# 6. Copy output into base component
list_9 = ValueList({"origin, pt on positive x-axis, pt in xy plane": 0, "origin, pt on positive y-axis, pt in xy plane": 1}, selected="origin, pt on positive x-axis, pt in xy plane")
clear = Button()
rec = PythonScript(msg=pose_2, rec=get_2, clear=clear)  # -> rec; inputs msg: list
# ---------- rec: Python ----------
from scriptcontext import sticky as st

guid = str(ghenv.Component.InstanceGuid)
recorded_key =  "recorded_" + guid
just_cleared_key = "just_cleared_" + guid

if recorded_key not in st:
    st[recorded_key] = []

if just_cleared_key not in st:
    st[just_cleared_key] = False

if clear:
    st[recorded_key] = []
    st[just_cleared_key] = True
else:
    if len(msg):
        if msg != [None] and not st[just_cleared_key] and rec:
            st[recorded_key].append(msg)
    st[just_cleared_key] = False
        


rec = st[recorded_key]

print rec
# ---------- end rec ----------
calc_base = PythonScript(poses=rec, input_type=list_9)  # -> out; inputs poses: list
# ---------- calc_base: Python ----------
import Rhino.Geometry as rg
import math


if len(poses) > 2:
    
    O = poses[0]
    P1 = poses[1]
    P2 = poses[2]
    
    if input_type == 0:
        # origin, pt on positive x-axis, pt in xy plane
        origin = rg.Point3d(O[0], O[1], O[2])
        pt_on_xaxis = rg.Point3d(P1[0], P1[1], P1[2])
        pt_in_xyplane = rg.Point3d(P2[0], P2[1], P2[2])
        
        xaxis = pt_on_xaxis - origin
        xaxis.Unitize()
        
        v = pt_in_xyplane - origin
        zaxis = rg.Vector3d.CrossProduct(v, xaxis)
        zaxis.Unitize()
        
        # zaxis must look up!
        if math.acos(rg.Vector3d.ZAxis * zaxis) > math.acos(rg.Vector3d.ZAxis * -zaxis):
            zaxis = -zaxis
        
        yaxis = rg.Vector3d.CrossProduct(zaxis, xaxis)
    
    elif input_type == 1:
        # origin, pt on positive y-axis, pt in xy plane
        origin = rg.Point3d(O[0], O[1], O[2])
        pt_on_yaxis = rg.Point3d(P1[0], P1[1], P1[2])
        pt_in_xyplane = rg.Point3d(P2[0], P2[1], P2[2])
        
        yaxis = pt_on_yaxis - origin
        yaxis.Unitize()
        
        v = pt_in_xyplane - origin
        zaxis = rg.Vector3d.CrossProduct(v, yaxis)
        zaxis.Unitize()
        
        # zaxis must look up!
        if math.acos(rg.Vector3d.ZAxis * zaxis) > math.acos(rg.Vector3d.ZAxis * -zaxis):
            zaxis = -zaxis
        
        xaxis = rg.Vector3d.CrossProduct(yaxis, zaxis)
        
        
    print "Copy the following into base component:"
    print " "
    print "origin = [%.2f, %.2f, %.2f]" % tuple(list(origin))
    print "xaxis = [%.5f, %.5f, %.5f]" % tuple(list(xaxis))
    print "yaxis = [%.5f, %.5f, %.5f]" % tuple(list(yaxis))
    

#print rg.Vector3d.CrossProduct(rg.Vector3d.YAxis, rg.Vector3d.ZAxis)
#print rg.Vector3d.CrossProduct(rg.Vector3d.ZAxis, rg.Vector3d.XAxis)
# ---------- end calc_base ----------
panel_24 = Panel(rec)
panel_25 = Panel(calc_base)

# ----
value_list = ValueList({"one_pos_Scan": 0, "muti__pos_scan": 1}, selected="muti__pos_scan")
dam = DataDam(DataA=read.mesh, BufferDelay=10000000, BufferMode=0)
pt_8 = Point(Point(0, 0, 0))

# ---- group: VISU Inactive / Visualise / robot model brep
py_5 = PythonScript(model=list_4)  # -> n
# ---------- py_5: Python ----------
if model == "UR5":
    n = 0
if model == "UR10":
    n = 1

print n
# ---------- end py_5 ----------
ur10_brep = UR10Brep([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])
ur5_brep = UR5Brep([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])
show_brep = BooleanToggle(False)
filter_2 = StreamFilter(Gate=py_5, Stream0=ur5_brep, Stream1=ur10_brep)

# ---- group: Read File / Folder
panel_26 = Panel("6_15_Presentation")

# ---- group: Read File / Filename
panel_27 = Panel("23062021_1425_Prediction_Parameters__Transformed_Mesh.json")

# ---- group: Read File / Folder
panel_28 = Panel("6_15_Presentation")

# ---- group: Read File / Filename
panel_29 = Panel("23062021_1426_Remesh_Parameters__Base_Mesh.json")

# ---- group: Read File
py_6 = GhPythonScript(foldername=panel_26)  # -> json_source; same code as py_4
panel_30 = Panel(py_6)

# Base Mesh Generation
py_7 = GhPythonScript(foldername=panel_28)  # -> json_source; same code as py_4
panel_31 = Panel(py_7)

# ----
scan_result = Mesh(<mesh referenced from the Rhino model>)

# ---- group: VISU Inactive
panel_32 = Panel("set digital out")
value = BooleanToggle(False)
number = Slider(0, range=0..10)
digital_out = PythonScript(number=number, value=value)  # -> script; inputs number: Int32, value: Boolean
# ---------- digital_out: Python ----------
script = "def prog():\n"
script += "\ttextmsg(\">> program start\")\n"
script += "\tset_digital_out(%i, %s)\n" % (int(number), str(value))
script += "\ttextmsg(\"<< program end\")\n"
script += "end\n"
script += "prog()\n\n"

print script
# ---------- end digital_out ----------
send = Button()
send_2 = Send(script=digital_out, send=send)
panel_33 = Panel(send_2)

panel_34 = Panel("move vertical")
movel = PythonScript()  # -> script
# ---------- movel: Python ----------
from scriptcontext import sticky as st

robot = st["robot"]
tool_angle_axis = list(robot.tool.tcp_frame.point) + robot.tool.tcp_frame.axis_angle_vector
x, y, z, ax, ay, az = tool_angle_axis

script = "def prog():\n"
script += "\ttextmsg(\">> program start\")\n"
script += "\tset_tcp(p%s)\n" % str([x/1000., y/1000., z/1000, ax, ay, az])
script += "\tcurrent_pose = get_forward_kin()\n"
script += "\tmovel(p[current_pose[0], current_pose[1], current_pose[2], 0, 0, 0], a=0.1, v=0.1)\n"
script += "\ttextmsg(\"<< program end\")\n"
script += "end\n"
script += "prog()\n\n"

print script
# ---------- end movel ----------
send_3 = Button()
send_4 = Send(script=movel, send=send_3)
panel_35 = Panel(send_4)

# ----
pt_9 = Point(Point(0, 0, 0))

# ---- group: VISU Inactive
# move incremental in TCS
get_current_pose = Button()
list_10 = ValueList({"xaxis", "yaxis", "zaxis"}, selected="yaxis")
movel_2 = PythonScript(get=get_current_pose, step_size=Slider(5, range=-10..10), direction=list_10)  # -> script; inputs get: list
# ---------- movel_2: Python ----------
from scriptcontext import sticky as st
from compas.geometry import Frame
from compas.geometry import Point, Vector
from ur_online_control.ur_direct import get_current_pose_cartesian

server_address = st["server_address"]
server_port = 30005
ur_ip = st["ur_ip"]
robot = st["robot"]
tool_angle_axis = list(robot.tool.tcp_frame.point) + robot.tool.tcp_frame.axis_angle_vector
print tool_angle_axis

guid = str(ghenv.Component.InstanceGuid)
pose_cartesian_key = "pose_cartesian" + guid

if get:
    st[pose_cartesian_key] = get_current_pose_cartesian(server_address, server_port, ur_ip, tool_angle_axis)

if pose_cartesian_key not in st:
    pose_cartesian = []
    script = ""
else:
    pose_cartesian = st[pose_cartesian_key]

    robot = st["robot"]
    tool_angle_axis = list(robot.tool.tcp_frame.point) + robot.tool.tcp_frame.axis_angle_vector
    x, y, z, ax, ay, az = tool_angle_axis
    
    script = "def prog():\n"
    script += "\ttextmsg(\">> program start\")\n"
    script += "\tset_tcp(p%s)\n" % str([x/1000., y/1000., z/1000, ax, ay, az])
    script += "\tcurrent_pose = get_forward_kin()\n"
    
#    frame = Frame.from_pose_axis_angle_vector(pose_cartesian)
    frame = Frame.from_axis_angle_vector([ax, ay, az])
    frame.point = [x, y, z]

    if direction == "xaxis":
        next_vector = Vector(*frame.xaxis) * step_size
    elif direction == "yaxis":
        next_vector = Vector(*frame.yaxis) * step_size
    else: # direction == "zaxis":
        next_vector = Vector(*frame.zaxis) * step_size
    
    x, y, z = next_vector
    script += "\tmovel(p[current_pose[0] + %f, current_pose[1] + %f, current_pose[2] + %f, current_pose[3], current_pose[4], current_pose[5]], t=%f)\n" % (x/1000., y/1000., z/1000., step_size * 0.1)
    
    script += "\ttextmsg(\"<< program end\")\n"
    script += "end\n"
    script += "prog()\n\n"
    
    print script
# ---------- end movel_2 ----------
send_5 = Button()
send_6 = Send(script=movel_2, send=send_5)
panel_36 = Panel(send_6)

# move incremental in WCS
number_slider_11 = Slider(5, range=-10..10)
list_11 = ValueList({"xaxis", "yaxis", "zaxis"}, selected="zaxis")
movel_3 = PythonScript(step_size=number_slider_11, direction=list_11)  # -> script
# ---------- movel_3: Python ----------
from scriptcontext import sticky as st

robot = st["robot"]
tool_angle_axis = list(robot.tool.tcp_frame.point) + robot.tool.tcp_frame.axis_angle_vector
x, y, z, ax, ay, az = tool_angle_axis

script = "def prog():\n"
script += "\ttextmsg(\">> program start\")\n"
script += "\tset_tcp(p%s)\n" % str([x/1000., y/1000., z/1000, ax, ay, az])
script += "\tcurrent_pose = get_forward_kin()\n"


if direction == "xaxis":
    script += "\tmovel(p[current_pose[0] + %f, current_pose[1], current_pose[2], current_pose[3], current_pose[4], current_pose[5]], t=%f)\n" % (step_size/1000., step_size * 0.1)

elif direction == "yaxis":
    script += "\tmovel(p[current_pose[0], current_pose[1] + %f, current_pose[2], current_pose[3], current_pose[4], current_pose[5]], t=%f)\n" % (step_size/1000., step_size * 0.1)

else: # direction == "zaxis":
    script += "\tmovel(p[current_pose[0], current_pose[1], current_pose[2] + %f, current_pose[3], current_pose[4], current_pose[5]], t=%f)\n" % (step_size/1000., step_size * 0.1)

script += "\ttextmsg(\"<< program end\")\n"
script += "end\n"
script += "prog()\n\n"

print script
# ---------- end movel_3 ----------
send_7 = Button()
send_8 = Send(script=movel_3, send=send_7)
panel_37 = Panel(send_8)

# ----
mesh_3 = Mesh(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)
mesh_4 = Mesh(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)
demesh = DeconstructMesh(Mesh=mesh_3)  # -> Vertices, Faces, Colours, Normals
demesh_2 = DeconstructMesh(Mesh=mesh_4)  # -> Vertices, Faces, Colours, Normals
number_slider_12 = Slider(100, range=0..100)
number_slider_13 = Slider(0, range=0..1000)
number_slider_14 = Slider(200, range=0..1000)

# ----
# Manual Print Point Generation
# save this as a .obj for slicing
number_slider_15 = Slider(300, range=0..400)
pt_10 = Point(Point(0, 0, 0))
pdecon_2 = Deconstruct(Point=pt_10)  # -> XComponent, YComponent, ZComponent
division = Division(A=number_slider_15, B=-2)
pt_11 = ConstructPoint(XCoordinate=pdecon_2.XComponent, YCoordinate=division, ZCoordinate=pdecon_2.ZComponent)
Y = UnitY(Factor=1)
rectangle_2 = Rectangle(Plane=PlaneXY(0, 0, 0), XSize=number_slider_15, YSize=number_slider_15, Radius=0)  # -> Rectangle, Length
line = LineSDL(Start=pt_11, Direction=Y, Length=number_slider_15)
cir = Circle(Plane=PlaneXY(0, 0, 0), Radius=1)
list_12 = ValueList({"No Cap": 0, "Linear Cap": 1, "Tangent Cap": 2, "Curve Cap": 3}, selected="No Cap")
list_13 = ValueList({"Mm": 0, "Cm": 1}, selected="Mm")
both_directions = BooleanToggle(True)
explode = Explode(Curve=cir, Recursive=True)  # -> Segments, Vertices
number_slider_16 = Slider(10, range=0..10)
multiplication = Multiplication(A=list_5, B=number_slider_6)
ext = ExtendCurve(Curve=explode.Segments, Type=Slider(1, range=0..1), Start=number_slider_16, End=number_slider_16)
merge = Merge(Data1=layer_height, Data2=multiplication, Data3=number_slider_6)
area = Area(Geometry=ext)  # -> Area, Centroid
multiplication_2 = Multiplication(A=Slider(100, range=0..100), B=Slider(1, range=0..10))
division_2 = Division(A=merge, B=Slider(10, range=0..10))
filter_3 = StreamFilter(Gate=list_13, Stream0=merge, Stream1=division_2)  # -> graft(Stream)
bang_2 = ExplodeTree(Data=filter_3)  # -> Branch0, Branch1, Branch2
cluster_2 = Cluster_3(
    C=cluster,
    A=list_6,
    B=bang_2.Branch0,
    B_2=number_slider_7,
    A_2=bang_2.Branch1,
    B_3=bang_2.Branch2,
    B_4=both_directions,
    T=list_12)  # -> crv_2, M, crv_4
crv_2 = Curve(cluster_2.crv_2)
swatch = ColourSwatch(SwatchColor=RGB(255, 130, 130))
bake = ObjectBake(
    BakeToggle=Button(),
    GeometryObjects=cluster_2.M,
    Layer="Compas_slicer",
    ObjectName="3D_for_4D",
    ObjectColor=swatch,
    LayerColor=swatch)
number_slider_17 = Slider(10, range=0..10)

geo_4 = Geometry(cluster_2.M)

# ----
# Ligthweight Path Visualization
number_slider_18 = Slider(4, range=0..10)
number_slider_19 = Slider(0, range=0..100)
extruder_toggles_3 = Number(extruder_toggles)

# ---- group: Polyline toolpath
dom = ConstructDomain(DomainStart=number_slider_19, DomainEnd=Slider(204, range=0..2000))
subset = SubList(List=points, Domain=dom, Wrap=True)  # -> List, Index
pline_2 = PolyLine(Vertices=subset.List, Closed=False)

# ----
# Tool Visualization
number_slider_20 = Slider(0, range=0..2000)
tool_origin = Panel("""0
0
99.507""")

tool_mesh = Mesh(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)

# ---- group: Scan Positions
number_of_scans = Slider(4, range=0..10)
height_of_scans = Slider(800, range=0..1000)
radius_of_scans = Slider(200, range=0..1000)

# ---- group: Re-orient points
bbox = BoundingBox(Content=points, Plane=PlaneXY(0, 0, 0), UnionBox=True)  # -> Box, Box_2
debrep_2 = DeconstructBrep(Brep=bbox.Box)  # -> Faces, Edges, Vertices
item_3 = ListItem(List=debrep_2.Vertices, Index=0, Wrap=True)  # -> Item, Item1, Item2, Item3
avr_2 = Average(Input=[item_3.Item, item_3.Item1, item_3.Item2, item_3.Item3])

# ---- group: visualization
number_slider_21 = Slider(10, range=0..10)

# ----
number_slider_22 = Slider(200, range=0..1000)
list_14 = ValueList({"Mini_print": 0, "Big_print": 1}, selected="Big_print")
Z_2 = UnitZ(Factor=Slider(1, range=-20..1))

# ---- group: print_safety
cluster_3 = Cluster()

# ---- group: print_safety / safe_zone
crv_3 = Curve(cluster_3)

# ----
area_2 = Area(Geometry=crv_3)  # -> Area, Centroid
print_bed = PrintBed(F=Slider(-0.25, range=-2..100), G=area_2.Centroid, X=Slider(1200, range=0..1200))  # -> G_2, M
cluster_4 = Cluster_2(B=print_bed.G_2)

# ---- group: 4D_pp
pt_12 = Point(print_bed.G_2)

# ----
orient = Orient(Geometry=frames, Source=avr_2, Target=print_bed.G_2)  # -> Geometry, Transform
frames_2 = Plane(orient.Geometry)
flippln = FlipPlane(Plane=frames_2, FlipX=False, FlipY=False, FlipZ=True)  # -> Flipped, R

print_planes = Plane(flippln.Flipped)

cstoolviz = CsToolViz(origin_coords=tool_origin, mesh=tool_mesh, planes=print_planes, index=number_slider_20)  # -> out, mesh, passed_path; inputs origin_coords: list, mesh: Mesh, planes: list, index: Int32
# ---------- cstoolviz: Python ----------
"""
Example visualization of tool motion during the print.

"""

import compas_slicer_ghpython.visualization as gh_compas_slicer
gh_compas_slicer = reload(gh_compas_slicer)

if origin_coords and mesh and planes and (index or index==0):
    mesh, passed_path = gh_compas_slicer.tool_visualization(origin_coords, mesh, planes, index)
else:
    gh_compas_slicer.missing_input()
# ---------- end cstoolviz ----------

mesh_5 = Mesh(cstoolviz.mesh)
geo_5 = Geometry(cstoolviz.passed_path)
preview_5 = CustomPreview(Geometry=mesh_5, Material=ColourSwatch(SwatchColor=RGB(171, 171, 171)))
preview_6 = CustomPreview(Geometry=geo_5, Material=ColourSwatch(SwatchColor=RGB(255, 156, 36)))

# ---- group: Use this for closed curves, will close end points for prints
center_scale_divide = CenterScaleDivide(G=ext, C=print_bed.G_2, A=area.Centroid, F=Slider(425, range=0..1000), N=multiplication_2)  # -> G_2, pt_3

# ----
pt_13 = Point(center_scale_divide.pt_3)
geo_6 = Geometry(center_scale_divide.G_2)
move_4 = Move(Geometry=pt_13, Motion=Vector(0, 0, 10))  # -> Geometry, Transform
offset_z_height = OffsetZ_height(L=move_4.Geometry, B=Slider(20, range=0..100))  # -> pt_3, X, Y, data_2, R
center = Center(crv=crv_2, center=pt_12)
panel_38 = Panel(offset_z_height.pt_3)
crv_4 = Curve(reparameterize(center))
divide = DivideCurve(Curve=crv_4, Count=Slider(50, range=0..100), Kinks=False)  # -> Points, Tangents, Parameters
python_2 = GhPythonScript(
    input_planes=panel_38,
    x=offset_z_height.X,
    y=offset_z_height.Y,
    z=offset_z_height.R,
    extruder_toggle_list=offset_z_height.data_2)  # -> out, a, b; inputs input_planes: list, x: list, y: list, z: list, extruder_toggle_list: list
# ---------- python_2: Python ----------
__author__ = "hjame"
__version__ = "2021.03.10"

import rhinoscriptsyntax as rs
import Rhino.Geometry as rg
import Rhino.DocObjects 
import Rhino.Input


#center is the origin of the new plane
#z_height is how much you want to move it above the print
ip_new = []
etl_new = []
i=0
rs.CreatePoint(1.0,2.0,3.0)
#ip_new.append(rs.PointCoordinates(input_points[i],2.0,2.0.3.0)
for i in range(len(extruder_toggle_list)):
    if extruder_toggle_list[i] == 0:
        etl_new.append(0)
        etl_new.append(0)
        #etl_new.append(0)
        #rs.CreatePoint(input_points[i[0]])
        ip_new.append(input_planes[i])
        ip_new.append(rs.CreatePoint(x[i], y[i], z[i]))
        #ip_new.append(rs.CreatePoint(x[i+1],y[i+1],z[i]))
        
        
#        ip_new.append(rs.CreatePoint(input_planes.[i[0]],input_planes.[i[1]],input_planes.[i[2]]+10))
    else:
        etl_new.append(1)
        ip_new.append(input_planes[i])

#    
#    if extruder_toggle_list[i] == 0:
#        extruder_toggle
#            extruder_toggle_list.insert(i+1,0)
#            old_plane = input_planes[i]
#            center = old_plane.origin
#            center[2] += z_height
#            plane = rs.PlaneFromNormal(center , old_plane.Zaxis)
#            input_planes.insert(i+1,plane)
#            
#            i = i+1
#    
a = ip_new
b = etl_new
 

        
    # insert 0 in extruder_toggle_list in the next index
    #add a point in the same index position to input_planes @ "set z value above, same x,y"
    #something like list.insert(index.object)
    # do this for every 0 in extruder toggle list
    #check if extruder_toggle_list and input_planes are the same length
# ---------- end python_2 ----------
offset_z_height_2 = OffsetZ_height(L=divide.Points, B=Slider(20, range=0..100))  # -> pt_3, X, Y, data_2, R
panel_39 = Panel(offset_z_height_2.pt_3)
pt_14 = Point(python_2.a)
python_3 = GhPythonScript(
    input_planes=panel_39,
    x=offset_z_height_2.X,
    y=offset_z_height_2.Y,
    z=offset_z_height_2.R,
    extruder_toggle_list=offset_z_height_2.data_2)  # -> out, a, b; inputs input_planes: list, x: list, y: list, z: list, extruder_toggle_list: list; same code as python_2
pt_15 = Point(python_3.a)
tag_2 = TextTag3D(
    Location=python_3.a,
    Text=python_3.b,
    Size=number_slider_17,
    Colour=ColourSwatch(SwatchColor=RGB(51, 245, 238)),
    Justification=7)
points_3 = PointList(Points=pt_15, Size=number_slider_17)

# ---- group: Scan Positions (continued)
scan_positions = Scan_positions(
    P=pt_12,
    R=radius_of_scans,
    F=height_of_scans,
    N=number_of_scans,
    A=angle_of_scans,
    G=list,
    pt=tools.pt_9,
    pln=tools.pln_2,
    D=Slider(20, range=0..100))  # -> wait_times_list_2, pln_7, vec_4

# ---- group: Scan Positions / INPUT PLANES
pln = Plane(scan_positions.pln_7)

# ---- group: SCAN WAIT TIMES
wait_time_list = Data(flatten(scan_positions.wait_times_list_2))

# ---- group: Re-orient points (continued)
orient_2 = Orient(Geometry=points, Source=avr_2, Target=print_bed.G_2)  # -> Geometry, Transform
pt_16 = Point(orient_2.Geometry)

# ----
all_points_2 = Point(pt_16)
cslightpathviz = CsLightPathViz(
    points=all_points_2,
    extruder_toggles=extruder_toggles_3,
    domain_start=number_slider_19,
    domain_end=number_slider_4,
    pipe_diameter=number_slider_18)  # -> out, print_path_pipes, travel_path_lines; inputs points: list of Point3d, extruder_toggles: list of Boolean, domain_start: Int32, domain_end: Int32
# ---------- cslightpathviz: Python ----------
"""
Creates a lightweight visualization of the print paths. Segments with extruder_toggle=True are visualized as pipes, 
segments with extruder_toggle=False are visualized as lines.
Loads files from the 'output' folder.

"""

import compas_slicer_ghpython.visualization as gh_compas_slicer
gh_compas_slicer = reload(gh_compas_slicer)

pipe_resolution = 14

if points:
    
    # assign default values to parameters where possible. 
    if not extruder_toggles:
        extruder_toggles = [False for i in range(len(points))]
    if not domain_start:
        domain_start = 0
    if not domain_end:
        domain_end = len(points)
    if not pipe_diameter:
        pipe_diameter = 2.0
        
    print_path_pipes, travel_path_lines = \
        gh_compas_slicer.lightweight_path_visualization(points, extruder_toggles, domain_start, domain_end, pipe_diameter, pipe_resolution)
    
else:
    gh_compas_slicer.missing_input()
# ---------- end cslightpathviz ----------

# ---- group: Color output
geo_7 = Geometry(cslightpathviz.travel_path_lines)
geo_8 = Geometry(cslightpathviz.print_path_pipes)
preview_7 = CustomPreview(Geometry=geo_7, Material=ColourSwatch(SwatchColor=RGB(255, 156, 36)))
preview_8 = CustomPreview(Geometry=geo_8, Material=ColourSwatch(SwatchColor=RGB(199, 199, 199)))

# ----
dam_2 = DataDam(
    DataPoints=pt_16,
    DataVelocities=velocities,
    DataBlend_radiuses=blend_radiuses,
    DataExtruder_toggles=extruder_toggles,
    DataWait_time=wait_times,
    BufferDelay=10000000,
    BufferMode=0)  # -> DataPoints, DataVelocities, DataBlend_radiuses, DataExtruder_toggles, DataWait_time

# ---- group: INPUT PLANES
xy_2 = XYPlane(Origin=flatten(dam_2.DataPoints))

# ---- group: EXTRUDER TOGGLE LIST
data_2 = Data(flatten(dam_2.DataExtruder_toggles))

# ---- group: WAIT TIME LIST
data_3 = Data(flatten(dam_2.DataWait_time))

# ---- group: FILLET LIST
num_2 = Number(flatten(dam_2.DataBlend_radiuses))

# ---- group: SPEED LIST
num_3 = Number(flatten(dam_2.DataVelocities))

# ----
rotate_2 = Rotate(Geometry=xy_2, Angle=degrees("5"), Plane=xy_2)  # -> Geometry, Transform

# ---- group: RECOMPUTE
dam_3 = DataDam(
    DataInput_planes=rotate_2.Geometry,
    DataSpeed_list=num_3,
    DataFillet_list=num_2,
    DataExtruder_toggle_list=data_2,
    DataWait_time_list=data_3,
    BufferDelay=10000000,
    BufferMode=0)  # -> DataInput_planes, DataSpeed_list, DataFillet_list, DataExtruder_toggle_list, DataWait_time_list

# ---- group: visualization (continued)
points_4 = PointList(Points=pt_14, Size=number_slider_21)
tag_3 = TextTag3D(
    Location=python_2.a,
    Text=python_2.b,
    Size=number_slider_21,
    Colour=ColourSwatch(SwatchColor=RGB(51, 245, 238)),
    Justification=7)

# ----
mini_print_bounding_area = Mini_print_bounding_area(G=list_14, C=crv_3, P=pt_12, X=number_slider_22, Y=number_slider_22)  # -> _0_0_0_0_0, _0_0_0_0_1, _0_0_0_0_2, _0_0_0_0_3, G_2, crv_2
crv_5 = Curve(mini_print_bounding_area.crv_2)
boundary_2 = BoundarySurfaces(Edges=crv_5)
extr = Extrude(Base=boundary_2, Direction=Z_2)
preview_9 = CustomPreview(Geometry=extr, Material=ColourSwatch(SwatchColor=RGB(186, 186, 186)))

# ---- group: print_safety (continued)
incurve = PointInCurve(Point=move_4.Geometry, Curve=crv_3)  # -> Relationship, Point
python_4 = GhPythonScript(x=incurve.Relationship)  # -> out; inputs x: list
# ---------- python_4: Python ----------
__author__ = "hjame"
__version__ = "2021.05.10"

import rhinoscriptsyntax as rs

count = x.count(0)
if count >= 1:
    print ('Do Not Print')

else:
    print ('Safe Print')
# ---------- end python_4 ----------
txt = Text(flatten(python_4))
panel_40 = Panel(txt)

# ---- group: print_pt visualization
xy_3 = XYPlane(Origin=pt_12)
preview_10 = CustomPreview(Geometry=xy_3, Material=ColourSwatch(SwatchColor=RGB(235, 204, 30)))

# ---- group: commands
pln_2 = Plane(flatten(dam_3.DataInput_planes))
python_5 = PythonScript(
    planes_WCS=pln_2,
    use_variable_fillet=use_variable_fillet,
    dfillet=dfillet_mm,
    fillet_list=dam_3.DataFillet_list,
    use_variable_speed=use_variable_speed,
    speed=speed_mm_s,
    speed_list=dam_3.DataSpeed_list,
    safe_pt=rotate.Geometry,
    move_safe_pt=move_safe_pt)  # -> commands; inputs planes_WCS: list of Plane, fillet_list: list, speed: Int32, speed_list: list, safe_pt: Plane
# ---------- python_5: Python ----------
import Rhino.Geometry as rg
from compas.geometry import Frame
from compas.geometry import Transformation
from compas_ghpython import draw_frame
from scriptcontext import sticky as st

robot = st["robot"]
buffer = 0.6

commands = []


### SAFE PT BEGIN ###
if move_safe_pt:
    # add safe_pt as a starting point
    tcp_WCS_safe_pt = Frame(safe_pt.Origin, safe_pt.XAxis, safe_pt.YAxis)
    #print (tcp_WCS_safe_pt)
    tcp_RCS_safe_pt = robot.get_frame_in_RCS(tcp_WCS_safe_pt)
    #print(tcp_RCS_safe_pt)
    cmd_safe_pt = tcp_RCS_safe_pt.point[0:] + tcp_RCS_safe_pt.axis_angle_vector[0:]+ [speed, 0]
    commands.append(cmd_safe_pt)

### PLANES ###
for i, plane_WCS in enumerate(planes_WCS):
    tcp_WCS = Frame(plane_WCS.Origin, plane_WCS.XAxis, plane_WCS.YAxis)
    if i == 0 or i == len(planes_WCS) - 1:
        radius = 0.
        
    else:
        if use_variable_fillet:
            if len(planes_WCS) == len(fillet_list):
                dfillet = fillet_list[i]
            else:
                raise NameError("Fillet list length not matching planes_WCS")
        
        # calculate blend radius
        prev, current, next = planes_WCS[i-1].Origin, planes_WCS[i].Origin, planes_WCS[i+1].Origin
        radius = min((prev - current).Length/2 * buffer, (next - current).Length/2 * buffer, dfillet)
        radius = round(radius,2)
    
    if use_variable_speed:
        if len(planes_WCS) == len(speed_list):
            speed = speed_list[i]
        else:
            raise NameError("Speed list length not matching planes_WCS")
        
    print(radius)
    tcp_RCS = robot.get_frame_in_RCS(tcp_WCS)
    cmd = tcp_RCS.point[0:]+ tcp_RCS.axis_angle_vector[0:]+ [speed, radius]
    commands.append(cmd)
    print(cmd)

### SAFE PT END
if move_safe_pt:
    # add safe_pt as an end point
    commands.append(cmd_safe_pt)
# ---------- end python_5 ----------

# ---- group: extruder_toggle
python_6 = GhPythonScript(
    input_planes=dam_3.DataInput_planes,
    extruder_switch=list_8,
    extruder_input_list=dam_3.DataExtruder_toggle_list,
    move_safe_pt=move_safe_pt)  # -> out, extruder_toggle_list; inputs input_planes: list, extruder_input_list: list
# ---------- python_6: Python ----------
__author__ = "dfab"
__version__ = "2020.02.12"

no_of_planes = len(input_planes)
print no_of_planes
print len(extruder_input_list)
extruder_toggle_list = []



if extruder_switch == "extruder_on":
    extruder = True
    if move_safe_pt:
        extruder_toggle_list.append(True)
    # append only True to extrusion toggle list
    for i in range(no_of_planes):
        if i == no_of_planes-1:
            # APPEND FALSE FOR LAST PLANE
            extruder_toggle_list.append(False)
        else:
            extruder_toggle_list.append(True)
    if move_safe_pt:
        extruder_toggle_list.append(False)

elif extruder_switch == "extruder_off":
    extruder = False
    if move_safe_pt:
        extruder_toggle_list.append(False)
    # append only False to extrusion toggle list
    for i in range(no_of_planes):
        extruder_toggle_list.append(False)
    if move_safe_pt:
        extruder_toggle_list.append(False)

elif extruder_switch == "variable_extrusion":
    extruder = "variable_extrusion"
    if move_safe_pt:
        extruder_toggle_list.append(True)
    # use variable extrusion list
    # check if lists have same length
    if no_of_planes == len(extruder_input_list):
        print "OK"
        # use user-generated extrusion toggle list
        for i in range(no_of_planes):
            extruder_toggle_list.append(extruder_input_list[i])
        if move_safe_pt:
            extruder_toggle_list.append(False)
    else:
        raise NameError("Extrusion toggle list not matching planes_WCS")

else:
    raise NameError("Unknown error")
# ---------- end python_6 ----------

# ---- group: wait_time
python_7 = GhPythonScript(
    input_planes=dam_3.DataInput_planes,
    move_safe_pt=move_safe_pt,
    use_wait_time=use_wait_time,
    t_list=dam_3.DataWait_time_list,
    safe_wait_time=safe_wait_time_sec)  # -> wait_time_list; inputs input_planes: list, t_list: list
# ---------- python_7: Python ----------
__author__ = "dfab"
__version__ = "2020.12.21"

wait_time_list = []

if use_wait_time:
    if len(t_list) == len(input_planes):
        if move_safe_pt:
            # append a wait_time for the first point
            wait_time_list.append(safe_wait_time)
        
        for time in t_list:
            if time == None:
                wait_time_list.append(0.0)
            else:
                wait_time_list.append(time)
        
        if move_safe_pt:
            # append a wait_time for the last point
            wait_time_list.append(0.0)
    else:
        raise NameError("Wait time list not matching planes_WCS")

else:
    if move_safe_pt:
        wait_time_list.append(safe_wait_time)
    for i in range(len(input_planes)):
        wait_time_list.append(0.0)
    if move_safe_pt:
        wait_time_list.append(0.0)
# ---------- end python_7 ----------

# ----
cull_i = CullIndex(List=python_7, Indices=Slider(0, range=0..100), Wrap=True)

# ---- group: View_Wait_times
number_slider_23 = Slider(4, range=0..10)
points_5 = PointList(Points=dam_3.DataInput_planes, Size=number_slider_23)
tag_4 = TextTag3D(
    Location=dam_3.DataInput_planes,
    Text=cull_i,
    Size=number_slider_23,
    Colour=ColourSwatch(SwatchColor=RGB(51, 245, 238)),
    Justification=7)

# ----
# REMEMBER TO RECOMPUTE IF GEOMETRY CHANGED
panel_41 = Panel("commands.json")
save_json = Button()
commands = Data(python_5)
py_8 = PythonScript()  # -> path
# ---------- py_8: Python ----------
import sys
import os

ghComp = ghenv.Component
ghDoc = ghComp.OnPingDocument()

# the full path of the gh file
path = ghDoc.FilePath
# the directory of the gh file
path = os.path.dirname(path)

path = os.path.abspath(os.path.join(path, "..", "..", "eggshell", "ur_online_control"))

print path
# ---------- end py_8 ----------
send_9 = PythonScript(
    commands=commands,
    move_safe_pt=move_safe_pt,
    extruder_switch=list_8,
    extruder_toggle_list=python_6.extruder_toggle_list,
    use_variable_speed=use_variable_speed,
    use_cooling=use_cooling,
    path=py_8,
    use_variable_fillet=use_variable_fillet,
    safe_wait_time=safe_wait_time_sec,
    use_wait_time=use_wait_time,
    wait_time=python_7,
    robot=robot,
    server_address=server_address,
    server_port=server_port,
    ur_ip=ur_ip,
    save_json=save_json,
    name_json=panel_41)  # -> out; inputs commands: list, move_safe_pt: Boolean, extruder_toggle_list: list, use_cooling: Boolean, use_variable_fillet: Boolean, safe_wait_time: Int32, wait_time: list
# ---------- send_9: Python ----------
import json
import os

from eggshell.ur_online_control.communication.msg_identifiers import *
from eggshell.ur_online_control.utilities.lists import flatten_list
from time import sleep

#from scriptcontext import sticky as st

#number of values per command to be formatted 
len_command = len(commands[0])
gh_commands = flatten_list(commands)

no_of_commands = len(gh_commands)/len_command

tool_angle_axis = robot.tool.tcp_frame.point[0:] + robot.tool.tcp_frame.axis_angle_vector[0:]
#to print in gh panel
print int(no_of_commands), "commands"
print "--------------------------"

# information to print
if move_safe_pt:
    print "SAFE POINT:  None"
else:
    print "SAFE POINT:  Yes"

if extruder_switch == "extruder_on":
    print "EXTRUDER: On"
elif extruder_switch == "extruder_off":
    print "EXTRUDER:    Off"
elif extruder_switch == "variable_extrusion":
    print "EXTRUDER:    Variable extrusion"

if use_variable_speed:
    print "PRINT SPEED: Variable speed"
else:
    print "PRINT SPEED: Single value"


if use_variable_fillet:
    print "FILLET:      Variable fillet"
else:
    print "FILLET:      Single value"

if use_wait_time:
    print "WAIT TIME:   Yes"
else:
    print "WAIT TIME:   None"

if use_cooling:
    print "COOLING:     Yes"
else:
    print "COOLING:     No"

print "--------------------------"

data = {}
data['commands'] = {}

for i, cmd in enumerate(commands):
    all_cmds = {}
    single_cmd = {
        'point': [cmd[0], cmd[1], cmd[2]],
        'tcp_rcs': [cmd[3], cmd[4], cmd[5]],
        'speed': cmd[6],
        'radius': cmd[7],
        'extruder_toggle': extruder_toggle_list[i],
        'wait_time': wait_time[i]
        }
    
    data['commands'][i] = single_cmd

data['_parameters'] = {}
data['_parameters']['server_address'] = server_address
data['_parameters']['server_port'] = server_port
data['_parameters']['ur_ip'] = ur_ip
data['_parameters']['tool_angle_axis'] = tool_angle_axis
data['_parameters']['safe_wait_time'] = safe_wait_time
data['_parameters']['len_command'] = len_command
data['_parameters']['use_cooling'] = use_cooling

filename = os.path.join(path, name_json)
print(filename)
if save_json:
    with open(filename, 'w') as f:
        f.write(json.dumps(data, indent=3, sort_keys=True))
# ---------- end send_9 ----------

panel_42 = Panel(send_9)

# ---- group: VISU Inactive / First and last point
item_4 = ListItem(List=pln_2, Index=0, Wrap=True)  # -> Item1, Item
pln_3 = Plane([item_4.Item1, item_4.Item])

# ---- group: VISU Inactive
# Visualisation
planes_wcs = Plane(pln_3)
pose_joints = Data(pose)
robot_2 = Data(robot)

# ---- group: VISU Inactive / Define plane in WCS, calculate joint positions
select_configuration = Slider(0, range=0..7)
pt_17 = Point(Point(-283.8412985, -342.877576, 297.4189147))
xy_4 = XYPlane(Origin=pt_17)
plane_wcs = Plane(xy_4)
inverse = PythonScript(robot=robot_2, plane_WCS=plane_wcs, idx=select_configuration)  # -> configuration; inputs plane_WCS: Plane, idx: Int32
# ---------- inverse: Python ----------
import Rhino.Geometry as rg
from compas.geometry import Frame, Transformation
from compas_ghpython import xdraw_frame

tcp_WCS = Frame(plane_WCS.Origin, plane_WCS.XAxis, plane_WCS.YAxis)

# transform frame to robot coordinate system
tcp_RCS = robot.get_frame_in_RCS(tcp_WCS)

# get the frame of tool0
tool0_RCS = robot.get_tool0_frame_from_tcp_frame(tcp_RCS)

# calculate solutions to frame
solutions = robot.inverse_kinematics(tool0_RCS)

if not len(solutions):
    q = [0,0,0,0,0,0]
else:
    idx = min(len(solutions) - 1, idx)
    q = solutions[idx]
    
print q

configuration = q
# ---------- end inverse ----------

# ----
vec2pt = Vector2Pt(PointA=pt_8, PointB=pt_12, Unitize=False)  # -> Vector, Length
move_5 = Move(Geometry=dam, Motion=vec2pt.Vector)  # -> Geometry, Transform
color = Color(M=move_5.Geometry, P=[False, False, True, True])  # -> mesh_3, L, P_2
mesh_6 = Mesh(move_5.Geometry)
scale = Scale(Geometry=mesh_6, Center=pt_12, Factor=Slider(3.8, range=0..10))  # -> Geometry, Transform
demesh_3 = DeconstructMesh(Mesh=scale.Geometry)  # -> Vertices, Faces, Colours, Normals
pdecon_3 = Deconstruct(Point=demesh_3.Vertices)  # -> XComponent, YComponent, ZComponent
hilonums = HighestLowestNumbers(Numbers=pdecon_3.ZComponent)  # -> Highest, Lowest
avr_3 = Average(Input=demesh_3.Vertices)
pt_18 = Point(avr_3)

# ---- group: VISU Inactive / Send joint position directly to robot
panel_43 = Panel("move cartesian")
idx = Slider(0, range=0..100)
commands_2 = Data(python_5)
item_5 = ListItem(List=commands_2, Index=idx, Wrap=True)
list_15 = ValueList({"send all positions": 0, "send only one position": 1}, selected="send all positions")
filter_4 = StreamFilter(Gate=list_15, Stream0=commands_2, Stream1=item_5)
movel_4 = PythonScript(commands=filter_4, velocity=Slider(100, range=0..100))  # -> script; inputs commands: list
# ---------- movel_4: Python ----------
from scriptcontext import sticky as st

script_lines = []
for cmd in commands:
    #q, a=1.4, v=1.05, t=0, r=0
    #print(cmd)
    x, y, z, ax, ay, az, speed, radius = cmd
    script_lines.append("movel(p%s, v=%f, r=%f)" % (str([x/1000., y/1000., z/1000, ax, ay, az]), speed/1000., radius/1000.))

robot = st["robot"]
tool_angle_axis = list(robot.tool.tcp_frame.point) + robot.tool.tcp_frame.axis_angle_vector
x, y, z, ax, ay, az = tool_angle_axis

script = "def prog():\n"
script += "\ttextmsg(\">> program start\")\n"
script += "\tset_tcp(p%s)\n" % str([x/1000., y/1000., z/1000, ax, ay, az])
script += "".join(["\t%s\n" % line for line in script_lines])
script += "\ttextmsg(\"<< program end\")\n"
script += "end\n"
script += "prog()\n\n"

print script
# ---------- end movel_4 ----------
send_10 = Button()
send_11 = Send(script=movel_4, send=send_10)
panel_44 = Panel(send_11)

# ----
# Transformed Mesh
toggle_3 = BooleanToggle(True)
read_2 = GhPythonScript(path=panel_30, name_json=panel_27, generate_Mesh=toggle_3)  # -> out, mesh; inputs generate_Mesh: Boolean; same code as read
dam_4 = DataDam(DataA=read_2.mesh, BufferDelay=10000000, BufferMode=0)
mesh_7 = Mesh(dam_4)
pt_19 = Point(Point(0, 0, 0))
vec2pt_2 = Vector2Pt(PointA=pt_19, PointB=pt_12, Unitize=False)  # -> Vector, Length
move_6 = Move(Geometry=mesh_7, Motion=vec2pt_2.Vector)  # -> Geometry, Transform

# ----
# Base Mesh
toggle_4 = BooleanToggle(True)
read_3 = GhPythonScript(path=panel_31, name_json=panel_29, generate_Mesh=toggle_4)  # -> out, mesh; inputs generate_Mesh: Boolean; same code as read
dam_5 = DataDam(DataA=read_3.mesh, BufferDelay=10000000, BufferMode=0)
mesh_8 = Mesh(dam_5)
pt_20 = Point(Point(0, 0, 0))
vec2pt_3 = Vector2Pt(PointA=pt_20, PointB=pt_12, Unitize=False)  # -> Vector, Length
move_7 = Move(Geometry=mesh_8, Motion=vec2pt_3.Vector)  # -> Geometry, Transform

mesh_9 = Mesh(move_7.Geometry)

# ----
# Base Mesh
mesh_10 = Mesh(mesh_9)

mesh_11 = Mesh(move_6.Geometry)
demesh_4 = DeconstructMesh(Mesh=move_6.Geometry)  # -> Vertices, Faces, Colours, Normals
demesh_5 = DeconstructMesh(Mesh=move_7.Geometry)  # -> Vertices, Faces, Colours, Normals
vec2pt_4 = Vector2Pt(PointA=demesh_5.Vertices, PointB=demesh_4.Vertices, Unitize=False)  # -> Vector, Length
vlen = VectorLength(Vector=vec2pt_4.Vector)
line_2 = LineSDL(Start=demesh_5.Vertices, Direction=vec2pt_4.Vector, Length=vlen)

# ---- group: OLD_TEST
pr_folder_name_2 = Panel("testing")
py_9 = GhPythonScript()  # -> ply_source
# ---------- py_9: Python ----------
import os
import sys

filepath = ghenv.Component.Attributes.Owner.OnPingDocument().FilePath
path = os.path.abspath(os.path.join(filepath, "..", ".."))

ply_source = os.path.abspath(os.path.join(path, "realsense/depthscan"))

print(ply_source)
# ---------- end py_9 ----------
panel_45 = Panel(py_9)

# ---- group: OLD_TEST / Folder name
data_4 = Data(pr_folder_name_2)

# ---- group: OLD_TEST
# Input
py_10 = PythonScript(foldername=data_4)  # -> path; same code as py

# ----
# Scan, Merge, Load
list_16 = ValueList({"Forward_Run_Scan": 0, "Inverse_Run_Scan": 1}, selected="Forward_Run_Scan")
rev = Reverse(Vector=scan_positions.vec_4)
data_5 = Data(pln)
data_6 = Data(rev)
python_8 = GhPythonScript(mode=list_16, scan_pos=data_5, vector=data_6)  # -> out, planes, t_matrix, t_planes, t_matrix_depth, t_planes_depth; inputs scan_pos: list, vector: list
# ---------- python_8: Python ----------
__author__ = "hjame"
__version__ = "2021.05.31"

import rhinoscriptsyntax as rs
import compas_rhino
from compas.geometry import Frame, Vector, Point
from compas_ghpython import draw_frame
from compas.geometry import Rotation
from compas.geometry import Plane
from compas.geometry import Translation
from compas.geometry import matrix_from_frame
from compas_rhino.geometry import RhinoPlane

import Rhino.Geometry as rg
import math as m


planes = []
t_matrix = []
t_planes = []
t_matrix_depth = []
t_planes_depth = []

if mode == 0:
    
    planes = []
    t_matrix = []
    t_planes = []
    lidar_transform = []
    
    t_matrix_depth = []
    t_planes_depth = []
    



    for i in range(len(scan_pos)):
        
        lidar_transform = Translation.from_vector(vector[i])
        #print(lidar_transform)
        frame = RhinoPlane.from_geometry(scan_pos[i]).to_compas()
        lidar_pos = frame.transformed(lidar_transform)
    
        planes.append(draw_frame(lidar_pos))
    
        t_frame = Frame(frame.point, frame.xaxis, frame.yaxis)
        t_matrix.append(matrix_from_frame(t_frame))
        t_planes.append(draw_frame(t_frame))
        
        t_frame_depth = Frame(frame.point, frame.yaxis, frame.xaxis*-1)
        t_matrix_depth.append(matrix_from_frame(t_frame_depth))
        t_planes_depth.append(draw_frame(t_frame_depth))
        
#        
#        frame = Frame(frame.point, frame.yaxis*-1, frame.normal*-1)
#        planes.append(draw_frame(frame))
    print ('%d Scan pos' % len(planes))

        
        



if mode == 1:
    
    planes = []
    t_matrix = []
    t_planes = []
    
    for i in range(len(scan_pos)):
        
        lidar_transform = Translation.from_vector(vector[i])
        #print(lidar_transform)
        frame = RhinoPlane.from_geometry(scan_pos[i]).to_compas()
    
        planes.append(draw_frame(frame))
    
        t_frame = Frame(frame.point, frame.xaxis, frame.yaxis)
        t_matrix.append(matrix_from_frame(t_frame))
        t_planes.append(draw_frame(t_frame))
#        
#        frame = Frame(frame.point, frame.yaxis*-1, frame.normal*-1)
#        planes.append(draw_frame(frame))
    print ('%d Scan pos' % len(planes))
# ---------- end python_8 ----------
py_11 = GhPythonScript()  # -> ply_source
# ---------- py_11: Python ----------
import os
import sys

filepath = ghenv.Component.Attributes.Owner.OnPingDocument().FilePath
path = os.path.abspath(os.path.join(filepath, "..", ".."))
print(path)

ply_source = os.path.abspath(os.path.join(path, "realsense/depthscan"))
# ---------- end py_11 ----------
pln_4 = Plane(python_8.t_planes_depth)
pln_5 = Plane(python_8.t_planes)
pln_6 = Plane(python_8.planes)
panel_46 = Panel(py_11)
lastdex = LastIndex(List=pln_6)
value_list_2 = ValueList({"Depthscan": "RS_D455", "LiDAR": "RS_L515"}, selected="LiDAR")
value_list_3 = ValueList({"obj": 0, "ply": 1}, selected="ply")
send_to_scan_pos = Button()
start_proxy = BooleanToggle(True)
activate = BooleanToggle(True)
merge_2 = Button()
scan = Button()
export_ply = GhPythonScript(
    activate=activate,
    start_proxy=start_proxy,
    path=panel_46,
    type=value_list_3,
    camera=value_list_2,
    targets=python_8.planes,
    t_matrix=python_8.t_matrix,
    index=Slider(5, range=0..8),
    scan_pos=send_to_scan_pos,
    scan=scan,
    merge_PLY=merge_2,
    load_mesh=Toggle(False))  # -> out, mesh; inputs type: Int32, targets: list of Plane, t_matrix: list, index: Int32, load_mesh: Boolean
# ---------- export_ply: Python ----------
import os, time
import math as m
import scriptcontext as sc
import Rhino.Geometry as rg
import rhinoscriptsyntax as rs

from compas_ghpython import unload_modules
unload_modules('robotic_plaster_spraying.depthscan')
from compas.rpc import Proxy

#import comm
#import ur_standard 
#reload(comm)
#reload(ur_standard)

from compas.datastructures import Mesh
from compas_ghpython.artists import MeshArtist
from compas.geometry import Frame
from compas.files import PLY
from compas.files import PLYReader

def load_obj(path):
    file = open(path)
    lines = file.readlines()
    v_ID = 0
    Ft
    mesh = rg.Mesh()
    for line in lines:
        if line.find("v")==0 and line.find("n")==-1:
            #print line.split(' ')
            mesh.Vertices.Add(rg.Point3d(float((line.split(' '))[1]),float((line.split(' '))[2]),float((line.split(' '))[3])))
            mesh.VertexColors.SetColor(v_ID, rs.CreateColor(float((line.split(' '))[4])*255, float((line.split(' '))[5])*255, float((line.split(' '))[6])*255))
            v_ID += 1
        if line.find("vn")==0:
            mesh.Normals.Add(rg.Vector3d(float((line.split(' '))[1]),float((line.split(' '))[2]),float((line.split(' '))[3])))
        if line.find("f")==0:
            if line.split(' ').Count==4:
                mesh.Faces.AddFace(int(line.split(' ')[1].split('/')[0])-1, int(line.split(' ')[2].split('/')[0])-1, int(line.split(' ')[3].split('/')[0])-1)
            if line.split(' ').Count==5:
                mesh.Faces.AddFace(int(line.split(' ')[1].split('/')[0])-1, int(line.split(' ')[2].split('/')[0])-1, int(line.split(' ')[3].split('/')[0])-1, int(line.split(' ')[4].split('/')[0])-1)
                
    
    mesh.Faces.ExtractDuplicateFaces()
    mesh.Compact()
    return mesh

#translation_vector = sc.sticky["translation_vector_key"]
#path = os.path.join(sc.sticky["path"], 'data/ply')

### UR constant values ###
scan_sleep = 6
squeeze_valve_IO = 0
#set_tcp = ur_standard.set_tcp_by_angles(64.0, 57.8, 90.85, 
#                                        0.0, 0.0, 0.0)


#set_tcp = ur_standard.set_tcp_by_angles(64.0, 55.10, -4.15,0.0, 0.0, 0.0)

#if camera == "RS_D455":
#    #sets tcp for RealSense D455
#    set_tcp = ur_standard.set_tcp_by_angles(64.0, 55.10, -4.15, 
#                                           0.0, 0.0, 0.0)
#    set_tcp = ur_standard.set_tcp_by_angles(64.0, 59.65, -4.15, 
#                                           0.0, 0.0, 0.0)t
#if camera == "RS_L515":
#    #sets tcp for RealSense L515
#    set_tcp = ur_standard.set_tcp_by_angles(-5.83, 28.15, 110.46, 
#                                           0.0, 0.0, 0.0)


### Scan Poses ###
#pos = [ m.radians(35), 
#        m.radians(-35), 
#        m.radians(125), 
#        m.radians(90), 
#        m.radians(-90),
#        m.radians(0)]
#
#s_pos = [ m.radians(-10),
#    m.radians(-105),
#    m.radians(165),
#    m.radians(120),
#    m.radians(-80),
#    m.radians(0)]


### Initialize UR script ###
#script = ""
#script += set_tcp
#script += ur_standard.set_digital_out(squeeze_valve_IO, True)

if type == 0:
    build_mesh_bool = True
elif type == 1:
    build_mesh_bool = False

if activate:
    if start_proxy:
        depthscan = Proxy('robotic_plaster_spraying.depthscan')
    else:
        Proxy.stop_server(depthscan)
#    if scan_pos :
#        script += ur_standard.move_j(s_pos, 0.1, 0.5)
#        script = comm.concatenate_script(script)
#        comm.send_script(script, 1)
    
    if scan:
#        if type(targets[0]) == rg.Plane:
#            print("ok")
#            script += ur_standard.move_l(targets[index], 1.5, 1.5)
#        else:
#            script += ur_standard.move_j(targets[index], 1.5, 1.5)
#        script += ur_standard.move_l(targets[index], 1.5, 1.5)
#        script = comm.concatenate_script(script)
#        comm.send_script(script, 1)
#        time.sleep(3.0)
        print (camera)
        filename = os.path.join(os.path.abspath(path), 'auto_pc_%d.ply' % index)
        depthscan.export(filename, mesh=False, pc=True)
    if merge_PLY:
        depthscan.ICP_registration(path, t_matrix, build_mesh = build_mesh_bool)


if build_mesh_bool:
    if load_mesh:
        data = os.path.join(path, 'ICP_final_mesh.obj')
        mesh = load_obj(data)
else:
    if load_mesh:
        data = os.path.join(path, 'ICP_final.ply')
        print(data)
        scanned_surface = Mesh.from_ply(data)
        artist = MeshArtist(scanned_surface)
        mesh = artist.draw()
#        ply_artist = PLYReader.read_vertices(data)
#        points = ply_artist.draw()
# ---------- end export_ply ----------
item_6 = ListItem(
    List=[Plane(origin=(662.1772031, 178.3406517, -670.7217509), x=(0.9659258263, 0, -0.2588190451), y=(0, 1, 0)), Plane(origin=(509.1772036, 266.6752432, -670.7217509), x=(0.9914814567, 0.01475454993, 0.1294095213), y=(0.01475454993, 0.9744443696, -0.2241438688)), Plane(origin=(509.1772035, 90.00606027, -670.7217509), x=(0.9914814567, -0.01475454994, 0.1294095214), y=(-0.01475454994, 0.9744443696, 0.2241438687))],
    Index=Slider(0, range=0..2),
    Wrap=True)
item_7 = ListItem(List=pln_4, Index=lastdex, Wrap=True)
xy_5 = XYPlane(Origin=Point(0, 0, 0))

cluster_5 = Cluster_4(P=pln, vec=pln, P_2=pln_6, vec_4=pln_6)  # -> geo_4, geo_2
preview_11 = CustomPreview(Geometry=cluster_5.geo_4, Material=ColourSwatch(SwatchColor=RGBA(255, 0, 0, 80)))
preview_12 = CustomPreview(Geometry=cluster_5.geo_2, Material=ColourSwatch(SwatchColor=RGBA(79, 85, 255, 161)))

item_8 = ListItem(List=pln_4, Index=Slider(1, range=0..10), Wrap=True)

# ----
# Load Single File
# To start the proxy server:
# - Start Ananconda Promt (as admin)
# - Run:
# from compas.rpc import Proxy
# p = Proxy()
py_12 = GhPythonScript()  # -> ply_source; same code as py_11
panel_47 = Panel(py_12)
type = ValueList({"mesh", "point cloud": "pointcloud"}, selected="mesh")
start_proxy_2 = BooleanToggle(False)
activate_2 = BooleanToggle(False)
export = BooleanToggle(False)
crv_6 = Curve(print_bed.M)
boxrec = BoxRectangle(Rectangle=crv_6, Height=Slider(500, range=0..1000))
export_ply_2 = GhPythonScript(activate=activate_2, start_proxy=start_proxy_2, export=export, path=panel_47, type=type)
# ---------- export_ply_2: Python ----------
from compas_ghpython import unload_modules
unload_modules('robotic_plaster_spraying.depthscan')
import robotic_plaster_spraying
from compas.rpc import Proxy
import os

filename = os.path.join(os.path.abspath(path), 'scan.ply')
print filename

if activate:
    if start_proxy:
        depthscan = Proxy('robotic_plaster_spraying.depthscan')
    else:
        Proxy.stop_server(depthscan)
    if export:
        if type == "mesh":
            filename = os.path.join(os.path.abspath(path), 'scan.ply')
            depthscan.export(filename, mesh=True, pc=False)
        if type == "pointcloud":
            filename = os.path.join(os.path.abspath(path), 'pc.ply')
            depthscan.export(filename, mesh=False, pc=True)


print(filename)
# ---------- end export_ply_2 ----------
path = PythonScript(path=panel_47, filename="test_file_2.ply")  # -> data
# ---------- path: Python ----------
import os

data = os.path.join(os.path.abspath(path), filename)
print(data)
# ---------- end path ----------
run = BooleanToggle(True)
import_scan = PythonScript(run=run, data=path)  # -> out, mesh
# ---------- import_scan: Python ----------
from compas.datastructures import Mesh
from compas_ghpython.artists import MeshArtist

if run:
    scanned_surface = Mesh.from_ply(data)
    artist = MeshArtist(scanned_surface)
    
    mesh = artist.draw()
# ---------- end import_scan ----------
process_mesh = Process_mesh(pt=Point(-381, 88, 402), G=import_scan.mesh, pln=item_8, B=pt_18)  # -> M, G_4, G_2, G_3
mesh_12 = Mesh(process_mesh.G_2)

# ---- group: Send_Mesh
dam_6 = DataDam(DataA=export_ply.mesh, BufferDelay=10000000, BufferMode=0)

# ----
mesh_13 = Mesh(dam_6)
gate = StreamGate(Stream=dam_6, Gate=value_list_3)  # -> Target0, Target1
bbox_mesh = Mesh(boxrec)
process_mesh_2 = Process_mesh(pt=Point(-381, 88, 402), G=mesh_13, pln=item_7)  # -> M, G_4, G_2, G_3
scan_mesh = Mesh(gate.Target0)
mesh_14 = Mesh(process_mesh_2.M)
demesh_6 = DeconstructMesh(Mesh=mesh_14)  # -> Vertices, Faces, Colours, Normals
split_scan_mesh = Split_scan_mesh(M=scan_mesh, S=bbox_mesh)
pt_21 = Point(demesh_6.Vertices)
pdecon_4 = Deconstruct(Point=pt_21)  # -> XComponent, YComponent, ZComponent
python_9 = GhPythonScript(
    x_max=mini_print_bounding_area._0_0_0_0_0,
    y_max=mini_print_bounding_area._0_0_0_0_2,
    x_min=mini_print_bounding_area._0_0_0_0_1,
    y_min=mini_print_bounding_area._0_0_0_0_3,
    pc_x=pdecon_4.XComponent,
    pc_y=pdecon_4.YComponent)  # -> out, pc_out; inputs pc_x: list, pc_y: list
# ---------- python_9: Python ----------
__author__ = "hjame"
__version__ = "2021.06.13"

import rhinoscriptsyntax as rs
import math

pc_out = []
for i in range(len(pc_x)):
        if pc_x[i] > x_min and pc_x[i] < x_max and pc_y[i] > y_min and pc_y[i] < y_max:
            pc_out.append(True)
        else:
            pc_out.append(False)
# ---------- end python_9 ----------
cull = CullPattern(List=pt_21, CullPattern=python_9.pc_out)
del = DelaunayMesh(Points=cull, Plane=PlaneXY(0, 0, 0))
pcd_delaunay = Pcd_delaunay(L=cull, P=cull, mesh=bbox_mesh, pl=xy_5, Z=Slider(1, range=0..1))
filter_5 = StreamFilter(Gate=value_list_3, Stream0=split_scan_mesh, Stream1=pcd_delaunay)
python_10 = GhPythonScript(mesh=filter_5, x=Slider(15, range=-50..50), y=Slider(40, range=-50..50), z=Slider(0, range=-50..50))  # -> out, mesh; inputs mesh: Mesh
# ---------- python_10: Python ----------
import Rhino.Geometry as rg

mesh.Translate(rg.Vector3d(x, y, z))
# ---------- end python_10 ----------
mesh_15 = Mesh(python_10.mesh)
preview_13 = CustomPreview(Geometry=pcd_delaunay, Material=ColourSwatch(SwatchColor=RGB(255, 255, 255)))

pt_22 = Point(process_mesh.G_3)
pt_23 = Point(process_mesh.G_4)
pdecon_5 = Deconstruct(Point=pt_22)  # -> XComponent, YComponent, ZComponent
python_11 = GhPythonScript(
    x_max=mini_print_bounding_area._0_0_0_0_0,
    y_max=mini_print_bounding_area._0_0_0_0_2,
    x_min=mini_print_bounding_area._0_0_0_0_1,
    y_min=mini_print_bounding_area._0_0_0_0_3,
    pc_x=pdecon_5.XComponent,
    pc_y=pdecon_5.YComponent)  # -> out, pc_out; inputs pc_x: list, pc_y: list; same code as python_9
cull_2 = CullPattern(List=pt_22, CullPattern=python_11.pc_out)
pdecon_6 = Deconstruct(Point=cull_2)  # -> XComponent, YComponent, ZComponent
python_12 = GhPythonScript(z_max=hilonums.Highest, z_min=hilonums.Lowest, pc_z=pdecon_6.ZComponent)  # -> out, pc_out; inputs pc_z: list
# ---------- python_12: Python ----------
__author__ = "hjame"
__version__ = "2021.06.13"

import rhinoscriptsyntax as rs
import math

pc_out = []
for i in range(len(pc_z)):
        if pc_z[i] > z_min and pc_z[i] < z_max:
            pc_out.append(True)
        else:
            pc_out.append(False)
# ---------- end python_12 ----------
filter_6 = StreamFilter(Gate=value_list, Stream1=del)
cull_3 = CullPattern(List=cull_2, CullPattern=python_12.pc_out)
prox = Proximity3D(Points=cull_3, Group=Slider(4, range=0..10), MaxRadius=Slider(45, range=0..100))  # -> Links, Topology
del_2 = DelaunayMesh(Points=cull_3, Plane=PlaneXY(0, 0, 0))
flatten = FlattenTree(Tree=prox.Links, Path="{0}")
cps = ClosestPoints(Point=demesh_5.Vertices, Cloud=cull_3, Count=Slider(1, range=0..10))  # -> ClosestPoint, CPIndex, Distance
vec2pt_5 = Vector2Pt(PointA=demesh_5.Vertices, PointB=cull_3, Unitize=False)  # -> Vector, Length
vlen_2 = VectorLength(Vector=vec2pt_5.Vector)
line_3 = LineSDL(Start=demesh_5.Vertices, Direction=vec2pt_5.Vector, Length=vlen_2)
cvec = ClosestVector(Reference=vec2pt_4.Vector, Targets=vec2pt_5.Vector, KeepLength=False)  # -> Closest, Index, Angle
item_9 = ListItem(List=line_2, Index=cvec.Index, Wrap=True)
remove_duplicate_curves = RemoveDuplicateCurves(lattice=item_9)
end = EndPoints(Curve=remove_duplicate_curves)  # -> Start, End
pt_24 = Point(end.End)

# ---- group: Custom preview
pt_25 = Point(dam_3.DataInput_planes)

# ----
pline_3 = PolyLine(Vertices=pt_25, Closed=False)

# ---- group: Custom preview (continued)
preview_14 = CustomPreview(Geometry=pline_3, Material=ColourSwatch(SwatchColor=RGB(30, 128, 199)))

# ---- group: OLD_TEST
list_17 = ValueList({"Forward_Run_Scan": 0, "Inverse_Run_Scan": 1}, selected="Forward_Run_Scan")
data_7 = Data([PlaneXY(578.7534057, 222.0156347, -855.0244305), PlaneXY(466.2534061, 286.9675402, -855.0244305), PlaneXY(466.253406, 157.0637293, -855.0244305)])
data_8 = Data([Vector(56.42379737, -43.67498302, 69.55267953), Vector(56.42379737, -43.67498302, 69.55267953), Vector(56.42379737, -43.67498302, 69.55267953)])
python_13 = GhPythonScript(mode=list_17, scan_pos=data_7, vector=data_8)  # -> out, planes, t_matrix; inputs scan_pos: list, vector: list
# ---------- python_13: Python ----------
__author__ = "hjame"
__version__ = "2021.05.31"

import rhinoscriptsyntax as rs
import compas_rhino
from compas.geometry import Frame, Vector, Point
from compas_ghpython import draw_frame
from compas.geometry import Rotation
from compas.geometry import Plane
from compas.geometry import Translation
from compas.geometry import matrix_from_frame
from compas_rhino.geometry import RhinoPlane

import Rhino.Geometry as rg
import math as m


planes = []
t_matrix = []
t_planes = []

if mode == 0:
    
    planes = []
    t_matrix = []
    t_planes = []
    lidar_transform = []



    for i in range(len(scan_pos)):
        
        lidar_transform = Translation.from_vector(vector[i])
        #print(lidar_transform)
        frame = RhinoPlane.from_geometry(scan_pos[i]).to_compas()
        lidar_pos = frame.transformed(lidar_transform)
    
        planes.append(draw_frame(lidar_pos))
    
        t_frame = Frame(frame.point, frame.xaxis, frame.yaxis)
        t_matrix.append(matrix_from_frame(t_frame))
        t_planes.append(draw_frame(t_frame))
#        
#        frame = Frame(frame.point, frame.yaxis*-1, frame.normal*-1)
#        planes.append(draw_frame(frame))
    print ('%d Scan pos' % len(planes))

        
        



if mode == 1:
    
    planes = []
    t_matrix = []
    t_planes = []
    
    for i in range(len(scan_pos)):
        
        lidar_transform = Translation.from_vector(vector[i])
        #print(lidar_transform)
        frame = RhinoPlane.from_geometry(scan_pos[i]).to_compas()
    
        planes.append(draw_frame(frame))
    
        t_frame = Frame(frame.point, frame.xaxis, frame.yaxis)
        t_matrix.append(matrix_from_frame(t_frame))
        t_planes.append(draw_frame(t_frame))
#        
#        frame = Frame(frame.point, frame.yaxis*-1, frame.normal*-1)
#        planes.append(draw_frame(frame))
    print ('%d Scan pos' % len(planes))
# ---------- end python_13 ----------
pln_7 = Plane(python_13.planes)
start_proxy_3 = BooleanToggle(True)
activate_3 = BooleanToggle(True)
merge_3 = Button()
value_list_4 = ValueList({"obj": 0, "ply": 1}, selected="obj")
geo_9 = Geometry(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)
area_3 = Area(Geometry=geo_9)  # -> Area, Centroid
export_ply_3 = GhPythonScript(
    activate=activate_3,
    start_proxy=start_proxy_3,
    path=panel_45,
    type=value_list_4,
    t_matrix=python_13.t_matrix,
    merge_PLY=merge_3,
    load_mesh=Toggle(False))  # -> out, mesh; inputs type: Int32, t_matrix: list, load_mesh: Boolean
# ---------- export_ply_3: Python ----------
import os, time
import math as m
import scriptcontext as sc
import Rhino.Geometry as rg
import rhinoscriptsyntax as rs

from compas_ghpython import unload_modules
unload_modules('robotic_plaster_spraying.depthscan')
from compas.rpc import Proxy

from compas.datastructures import Mesh
from compas_ghpython.artists import MeshArtist
from compas.geometry import Frame


def load_obj(path):
    file = open(path)
    lines = file.readlines()
    v_ID = 0
    
    mesh = rg.Mesh()
    for line in lines:
        if line.find("v")==0 and line.find("n")==-1:
            #print line.split(' ')
            mesh.Vertices.Add(rg.Point3d(float((line.split(' '))[1]),float((line.split(' '))[2]),float((line.split(' '))[3])))
            mesh.VertexColors.SetColor(v_ID, rs.CreateColor(float((line.split(' '))[4])*255, float((line.split(' '))[5])*255, float((line.split(' '))[6])*255))
            v_ID += 1
        if line.find("vn")==0:
            mesh.Normals.Add(rg.Vector3d(float((line.split(' '))[1]),float((line.split(' '))[2]),float((line.split(' '))[3])))
        if line.find("f")==0:
            if line.split(' ').Count==4:
                mesh.Faces.AddFace(int(line.split(' ')[1].split('/')[0])-1, int(line.split(' ')[2].split('/')[0])-1, int(line.split(' ')[3].split('/')[0])-1)
            if line.split(' ').Count==5:
                mesh.Faces.AddFace(int(line.split(' ')[1].split('/')[0])-1, int(line.split(' ')[2].split('/')[0])-1, int(line.split(' ')[3].split('/')[0])-1, int(line.split(' ')[4].split('/')[0])-1)
                
    
    mesh.Faces.ExtractDuplicateFaces()
    mesh.Compact()
    return mesh

if type == 0:
    build_mesh_bool = True
elif type == 1:
    build_mesh_bool = False

if activate:
    if start_proxy:
        depthscan = Proxy('robotic_plaster_spraying.depthscan')
    else:
        Proxy.stop_server(depthscan)
    if merge_PLY:
        depthscan.ICP_registration(path, t_matrix, build_mesh = build_mesh_bool)


if build_mesh_bool:
    if load_mesh:
        data = os.path.join(path, 'ICP_final_mesh.obj')
        mesh = load_obj(data)
else:
    if load_mesh:
        data = os.path.join(path, 'ICP_final.ply')
        scanned_surface = Mesh.from_ply(data)
        artist = MeshArtist(scanned_surface)
        mesh = artist.draw()
# ---------- end export_ply_3 ----------
scale_nu = ScaleNU(
    Geometry=geo_9,
    Plane=area_3.Centroid,
    ScaleX=Slider(0.5, range=0..10),
    ScaleY=Slider(1.3, range=0..10),
    ScaleZ=Slider(0.8, range=0..10))  # -> Geometry, Transform
gate_2 = StreamGate(Stream=export_ply_3.mesh, Gate=value_list_4)  # -> Target0, Target1
scan_mesh_2 = Mesh(gate_2.Target0)
demesh_7 = DeconstructMesh(Mesh=scan_mesh_2)  # -> Vertices, Faces, Colours, Normals
yz = YZPlane(Origin=Point(0, 0, 0))
pt_26 = Point(demesh_7.Vertices)
pcd_delaunay_2 = Pcd_delaunay(L=pt_26, P=pt_26, mesh=scale_nu.Geometry, pl=yz, Z=Slider(1, range=0..1))
python_14 = GhPythonScript(mesh=scan_mesh_2, x=Slider(0, range=-50..50), y=Slider(40, range=-50..50), z=Slider(0, range=-50..50))  # -> out, mesh; inputs mesh: Mesh; same code as python_10
mesh_16 = Mesh(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)

panel_48 = Panel(py_10)
unweld = UnweldMesh(Mesh=scan_mesh_2, Angle=1.570796327)
mesh_17 = Mesh(python_14.mesh)

# ---- group: OLD_TEST / split_scan_mesh
clean = CombineClean(Meshes=unweld)
disjoint = DisjointMesh(Mesh=clean)
area_4 = Area(Geometry=disjoint)  # -> Area, Centroid
sort = SortList(Keys=area_4.Area, ValuesA=disjoint)  # -> reverse(Keys), reverse(ValuesA)
item_10 = ListItem(List=sort.ValuesA, Index=0, Wrap=True)

# ---- group: OLD_TEST (continued)
filter_7 = StreamFilter(Gate=value_list_4, Stream0=item_10, Stream1=pcd_delaunay_2)

# ---- group: VISU Inactive / Calculate joint positions for path
# Add init joint states
init_configuration = Slider(2, range=0..7)
joint_states = Data([-0.1728179112, -1.415058186, 1.813991282, -1.971940356, -1.571654205, -3.308720436])
py_13 = PythonScript(robot=robot_2, planes_WCS=planes_wcs, configuration_idx=init_configuration, init_configuration=joint_states)  # -> configurations; inputs planes_WCS: list, configuration_idx: Int32, init_configuration: list
# ---------- py_13: Python ----------
from compas_ghpython import unload_modules
unload_modules('ur_online_control')
import Rhino.Geometry as rg
from compas.geometry import Frame 
from compas.geometry.xforms import Transformation
from compas_ghpython import xdraw_frame
from eggshell.ur_online_control.ur.kinematics import calculate_configurations_for_path, format_joint_positions


# TODO this must be optimized! matrix multiplication!
frames_tool0_RCS = []
for plane_WCS in planes_WCS:
    tcp_WCS = Frame(plane_WCS.Origin, plane_WCS.XAxis, plane_WCS.YAxis)
    tcp_RCS = robot.get_frame_in_RCS(tcp_WCS)
    frames_tool0_RCS.append(robot.get_tool0_frame_from_tcp_frame(tcp_RCS))

#configurations = calculate_configurations_for_path(frames_tool0_RCS, robot.params, init_configuration)
configurations = calculate_configurations_for_path(frames_tool0_RCS, robot, init_configuration)
#print configurations
configurations = configurations[min([configuration_idx, len(configurations) - 1])]

def format(numbers, k=4):
    #numbers = format_joint_positions(numbers)
    return "[" + ", ".join([("%." + str(k) + "f") % n for n in numbers]) + "]"
# ---------- end py_13 ----------
start = Button()
stop_3 = Button()
step = Button()

# ---- group: VISU Inactive / Calculate joint positions for path / Shows joint positions along path
flip = BooleanToggle(True)
l2t = PythonScript(L=py_13, flip=flip)  # -> T; inputs L: list, flip: Boolean
# ---------- l2t: Python ----------
from compas_ghpython import list_to_ghtree
L = [l.joint_values for l in L]

if flip:
    L = zip(*L)
T = list_to_ghtree(L)
# ---------- end l2t ----------
graph = QuickGraph(l2t, SortOrder=0)

# ---- group: VISU Inactive
back = Button()
reset = Button()
py_14 = GhPythonScript(joint_values=ur1_q1_q6)  # -> configuration; inputs joint_values: list
# ---------- py_14: Python ----------
import math
from ur_online_control.ur.robot import BaseConfiguration

configuration = BaseConfiguration.from_joints([math.radians(d) for d in joint_values])
# ---------- end py_14 ----------

# ---- group: VISU Inactive / Calculate joint positions for path (continued)
counter = CountThroughList(L=py_13, start=start, stop=stop_3, step=step, step_back=back, reset=reset, interval=100)  # -> item; inputs L: list, start: Boolean, stop: Boolean, step_back: Boolean
# ---------- counter: Python ----------
from scriptcontext import sticky as st
from compas_ghpython import update_component


# store data in component
guid = str(ghenv.Component.InstanceGuid)
counter_key = "counter_" + guid
running_key = "running_" + guid

if counter_key not in st:
    st[counter_key] = 0

if running_key not in st:
    st[running_key] = False

if start:
    st[running_key] = True

if stop:
    st[running_key] = False

if step:
    if st[counter_key] < len(L) - 1:
        st[counter_key] += 1

if step_back:
    if st[counter_key] < len(L) - 1:
        st[counter_key] -= 1

if reset:
    st[counter_key] = 0

if len(L):
    item = L[st[counter_key]]

if st[running_key]:
    if st[counter_key] < len(L) - 1:
        st[counter_key] += 1
        update_component(ghenv, interval)
    else:
        st[counter_key] = 0
        st[running_key] = False
# ---------- end counter ----------

# ---- group: VISU Inactive / Visualise
list_18 = ValueList({"0 forward, from angles": 0, "1 inverse, from one plane": 1, "2 inverse, from multiple planes": 2, "3 forward, from robot": 3}, selected="3 forward, from robot")
filter_8 = StreamFilter(Gate=list_18, Stream0=py_14, Stream1=inverse, Stream2=counter, Stream3=pose_joints)
configuration = Panel(filter_8)
mesh_18 = Mesh(filter_2)
draw = PythonScript(robot=robot_2, configuration=filter_8, mesh=mesh_18, brep=filter_2, show_brep=show_brep)  # -> meshes, tool0_plane, tcp_plane, robot_brep; inputs mesh: list, brep: list
# ---------- draw: Python ----------
from compas_ghpython import unload_modules
unload_modules("ur_online_control")

from compas_ghpython import xdraw_frame
from compas_ghpython import mesh_draw
from compas_ghpython.geometry.xforms import xform_from_transformation
from compas.geometry import Frame
from compas.geometry.xforms import Transformation
from ur_online_control.ur.robot import BaseConfiguration

import Rhino.Geometry as rg
import Rhino

def mesh_update_vertices(mesh, vertices):
    for i in range(len(vertices)):
        mesh.vertex[i].update({'x': vertices[i][0], 'y': vertices[i][1], 'z': vertices[i][2]})

if configuration:
    #print configuration
    #q = BaseConfiguration.from_joints(configuration)
    q = configuration
    print q
    print q.joint_values
    
    print robot.get_forward_transformations(q)
    R0, R1, R2, R3, R4, R5 = robot.get_forward_transformations(q)
    
    tool0_frame2 = robot.tool0_frame.transformed(R5)
    tcp_frame2 = Frame.from_transformation(Transformation.from_frame(tool0_frame2) * robot.transformation_tool0_tcp)
    
    print robot.transformation_tool0_tcp
    print robot.transformation_tcp_tool0
    print robot.transformation_tool0_tcp * robot.transformation_tcp_tool0
    print tcp_frame2
    tcp_frame2 = Frame.from_transformation(Transformation.from_frame(tool0_frame2) * robot.transformation_tcp_tool0)
    print tcp_frame2
    
    tool0_frame, tcp_frame = robot.get_transformed_tool_frames(R5)
    
    tool0_frame = tool0_frame2
    tcp_frame = tcp_frame2
    
    m0, m1, m2, m3, m4, m5 = mesh
    for i in range(6):
        exec("R%drg = xform_from_transformation(R%d)" % (i, i))
        exec("m%d.Transform(R%drg)" % (i, i))
    meshes = [m0, m1, m2, m3, m4, m5]
    print meshes
    mt = robot.tool.get_transformed_model(Transformation.from_frame(tool0_frame))
    
    if mt:
        meshes.extend(map(mesh_draw, mt))
    
    """
    m0, m1, m2, m3, m4, m5, tool0_frame, tcp_frame = robot.get_transformed_model(q)
    mt = robot.get_transformed_tool_model(tcp_frame)
    
    meshes = []
    meshes.append(mesh_draw(m0))
    meshes.append(mesh_draw(m1))
    meshes.append(mesh_draw(m2))
    meshes.append(mesh_draw(m3))
    meshes.append(mesh_draw(m4))
    meshes.append(mesh_draw(m5))
    if mt:
        meshes.append(mesh_draw(mt))
    
    """
    
    tool0_plane = xdraw_frame(tool0_frame)
    tcp_plane = xdraw_frame(tcp_frame)
    
    if show_brep:
        
        b0, b1, b2, b3, b4, b5 = brep
        
        b0.Transform(R0rg)
        b1.Transform(R1rg)
        b2.Transform(R2rg)
        b3.Transform(R3rg)
        b4.Transform(R4rg)
        b5.Transform(R5rg)
        
        robot_brep = [b0, b1, b2, b3, b4, b5]
# ---------- end draw ----------
robot_brep = Brep(draw.robot_brep)
tool0_plane = Plane(draw.tool0_plane)
tcp_plane = Plane(draw.tcp_plane)
draw_2 = RepresentPlaneAsLines(plane=tcp_plane, size=100)  # -> G, C
# ---------- draw_2: Python ----------
import Rhino.Geometry as rg
from System.Drawing import Color

if plane:

    G = []
    G.append(rg.Line(plane.Origin, size * plane.XAxis))
    G.append(rg.Line(plane.Origin, size * plane.YAxis))
    G.append(rg.Line(plane.Origin, size * plane.ZAxis))
    
    C = []
    C.append(Color.FromArgb(255, 0, 0))
    C.append(Color.FromArgb(0, 255, 0))
    C.append(Color.FromArgb(0, 0, 255))
# ---------- end draw_2 ----------
preview_15 = CustomPreview(Geometry=draw.meshes, Shader=ColourSwatch(SwatchColor=RGBA(99, 94, 94, 96)))
preview_16 = CustomPreview(Geometry=draw_2.G, Shader=draw_2.C)

# ----
# Read JSON_0
toggle_5 = BooleanToggle(False)

# ---- group: VISU Inactive / Send joint position directly to robot
idx_2 = Slider(0, range=0..100)
panel_49 = Panel("move joints")
joint_positions = Data(py_13)
list_19 = ValueList({"send all positions": 0, "send only one position": 1}, selected="send only one position")
item_11 = ListItem(List=joint_positions, Index=idx_2, Wrap=True)
filter_9 = StreamFilter(Gate=list_19, Stream0=joint_positions, Stream1=item_11)
movej = PythonScript(joint_positions=filter_9, velocity=Slider(153, range=0..200))  # -> script; inputs joint_positions: list
# ---------- movej: Python ----------
script_lines = []

for position in joint_positions:
    script_lines.append("movej(%s, v=%f)" % (str(position), velocity/1000.))


script = "def prog():\n"
script += "\ttextmsg(\">> program start\")\n"
script += "".join(["\t%s\n" % line for line in script_lines])
script += "\ttextmsg(\"<< program end\")\n"
script += "end\n"
script += "prog()\n\n"


print script

#script = ""
# ---------- end movej ----------
send_12 = Button()

# ---- group: VISU Inactive (continued)
send_13 = Send(script=movej, send=send_12)

# ---- group: VISU Inactive / Send joint position directly to robot (continued)
panel_50 = Panel(send_13)

# ----
value_list_5 = ValueList({"Layer 0": 0, "Read base mesh from json": 1}, selected="Layer 0")
filter_10 = StreamFilter(Gate=value_list_5, Stream0=scan_result)
scanned_mesh = Mesh(filter_10)

# ----
# Project Base Mesh Vertices onto Scanned Mesh
mesh_19 = Mesh(scanned_mesh)

# ----
# Data Gathering
# Generate JSON
panel_51 = Panel("210330_HorizontalPaths_X1_Z0")
py_15 = GhPythonScript()  # -> json_source
# ---------- py_15: Python ----------
import os
import sys

filepath = ghenv.Component.Attributes.Owner.OnPingDocument().FilePath
path = os.path.abspath(os.path.join(filepath, "..", "..", ".."))
print(path)

json_source = os.path.abspath(os.path.join(path, "data/json/210330_HorizontalPaths"))
# ---------- end py_15 ----------
generate_fabrication_parameters_json = Button()
generate_mesh_json = Button()
pln_8 = Plane()
velocity = Data()
ed = Data()

panel_52 = Panel(py_15)

read_4 = GhPythonScript(path=panel_52, name_json=panel_51, generate_Mesh=toggle_5)  # -> out, mesh; inputs generate_Mesh: Boolean
# ---------- read_4: Python ----------
import os
import json
from compas.datastructures import Mesh
from compas_ghpython.artists import MeshArtist


if generate_Mesh:
    layer_number = 0
    filename = os.path.join(path, name_json+'_Base_Mesh_%d.json' % layer_number)
    print filename
    c_mesh = Mesh.from_json(filename)
    
    artist = MeshArtist(c_mesh)
    mesh = artist.draw()
# ---------- end read_4 ----------
dam_7 = DataDam(DataA=read_4.mesh, BufferDelay=10000000, BufferMode=0)
clean_2 = CombineClean(Meshes=dam_7)

filter_11 = StreamFilter(Gate=value_list_5, Stream0=mesh_10, Stream1=clean_2)
base_mesh = Mesh(filter_11)

mesh_20 = Mesh(base_mesh)
projection = GhPythonScript(base_mesh=mesh_20, scanned_mesh=mesh_19, robot_position=pt_9)  # -> out, transformed_mesh, projected_direction; inputs base_mesh: Mesh, scanned_mesh: Mesh, robot_position: Point3d
# ---------- projection: Python ----------
import Rhino.Geometry as rg
import Rhino as rc
import math as m
from robotic_plaster_spraying.utilities_fabrication import projection
reload(projection)
from robotic_plaster_spraying.utilities_fabrication.data_gathering import remapValues

def mapValueListAsColor(values):
    
    """ Make a list of HSL color where the values are mapped onto a 
    0.0 - 0.7 hue domain. Meaning that low values will be red, medium
    values green and large values blue """
    
    colors = []
    remappedValues = remapValues(values,0.0,0.7)
    for v in remappedValues:
        c = rc.Display.ColorHSL(v,1.0,0.5).ToArgbColor()
        #c = rc.Display.ColorXYZ(v,0,0)
        colors.append(c)
    
    return colors

def colorMesh(mesh,colors):
    """ Color mesh vertices by a list of colors """
    for i,c in enumerate(colors):
        mesh.VertexColors.SetColor(i,c)

points, fIDs, projected_direction = projection.RhinoMeshData(base_mesh)

c_pt = base_mesh.ClosestPoint(robot_position)
normal = rg.Vector3d(c_pt - robot_position)

angle = rg.Vector3d.VectorAngle(projected_direction,normal)

if angle<m.radians(90):
    print ("reverse")
    projected_direction.Reverse()

transformed_vertices, _ = projection.PointProjectOnMesh(points, scanned_mesh, projected_direction)

transformed_mesh = rg.Mesh()

distances = []
for i in range(len(transformed_vertices)):
    transformed_mesh.Vertices.Add(transformed_vertices[i])
    distances.append(transformed_vertices[i].DistanceTo(points[i]))

[transformed_mesh.Faces.AddFace(*fID) for fID in fIDs]

colors = mapValueListAsColor(distances)
colorMesh(transformed_mesh,colors)
transformed_mesh.Smooth(1, True, True, True, True, 0)
# ---------- end projection ----------
mesh_21 = Mesh(projection.transformed_mesh)
vec = Vector(projection.projected_direction)

# ----
# Transformed Mesh
# This goes to your data gathering component (probably you adapted it to your setup?)
mesh_22 = Mesh(mesh_21)

# ----
# WIP
mesh_23 = Mesh(mesh_22)
generate_json = GhPythonScript(
    transformed_mesh=mesh_23,
    target_points=pln_8,
    velocity=velocity,
    Ed=ed,
    file_path=panel_52,
    name_json=panel_51,
    generate_mesh_JSON=generate_mesh_json,
    generate_fabrication_parameters_JSON=generate_fabrication_parameters_json)  # -> out, mesh; inputs transformed_mesh: Mesh, target_points: tree of Plane, velocity: tree, Ed: tree, custom_layer_num: list of Int32, iteration: Int32, branch: Int32, layer_number: Int32, generate_mesh_JSON: Boolean, generate_fabrication_parameters_JSON: Boolean
# ---------- generate_json: Python ----------
import os
import json
import Rhino.Geometry as rg
from compas.datastructures import Mesh
from compas_ghpython.artists import MeshArtist
from compas_rhino.geometry import RhinoMesh
from robotic_plaster_spraying.utilities_fabrication.projection import RhinoToCompasMesh
from robotic_plaster_spraying.utilities_fabrication.data_gathering import WriteDictToJson

pump_speed = 0.3 
air_pressure = 3 #bar

plane_list = [list(b) for b in target_points.Branches]
velocity_list = [list(b) for b in velocity.Branches]
Ed_list = [list(b) for b in Ed.Branches]

fabrication_parameters = {}
for i in range(len(plane_list)):
    fabrication_parameters[i] = {} 
    for j in range(len(plane_list[i])):
        plane = plane_list[i][j]
        if i == 0 and j == 0:
            print i,j
            fabrication_parameters[i][j] = {'xyz': [plane.OriginX, plane.OriginY,plane.OriginZ],
                                            'normal': [plane.Normal.X, plane.Normal.Y, plane.Normal.Z],
                                            'velocity': velocity_list[i][j],
                                            'Ed': Ed_list[i][j],
                                            'pump_speed': pump_speed,
                                            'air_pressure': air_pressure,
                                            'custom_layer_num': custom_layer_num
                                           }
        else:
            fabrication_parameters[i][j] = {'xyz': [plane.OriginX, plane.OriginY,plane.OriginZ],
                                            'normal': [plane.Normal.X, plane.Normal.Y, plane.Normal.Z],
                                            'velocity': velocity_list[i][j],
                                            'Ed': Ed_list[i][j]
                                           }

if layer_number == 0:
    branch = 'base_mesh'

c_mesh = RhinoToCompasMesh(transformed_mesh)
c_mesh.vertex_attributes(0, ['iteration', 'branch'], [iteration, branch])

### Generate JSON ###
mesh_filename = os.path.join(file_path, name_json+'_Base_Mesh_%d.json' % layer_number)
parameters_filename = os.path.join(file_path, name_json+'_Fabrication_Parameters.json')


if generate_mesh_JSON:
    c_mesh.to_json(mesh_filename, pretty = True)

if generate_fabrication_parameters_JSON:
    WriteDictToJson(parameters_filename, fabrication_parameters)

### Rhino mesh ###
mesh = MeshArtist(c_mesh)
mesh = mesh.draw()
# ---------- end generate_json ----------
mesh_24 = Mesh(generate_json.mesh)

# ==== cluster Send
script = ClusterInput()
send = ClusterInput()
send_2 = PythonScript(script=script, send=send)  # -> out
# ---------- send_2: Python ----------
import socket
from scriptcontext import sticky as st

ur_ip = st["ur_ip"]
ur_port = 30002

if send:
    s = socket.create_connection((ur_ip, ur_port), timeout=0.5) 
    s.send(script)
    s.close()
# ---------- end send_2 ----------
out = ClusterOutput(send_2)

# ==== cluster Tools
geo = Geometry([<curve referenced from the Rhino model> x2, <brep referenced from the Rhino model> x22, <point referenced from the Rhino model> x2])
geo_2 = Geometry([<brep referenced from the Rhino model> x21, <point referenced from the Rhino model> x3])
geo_3 = Geometry([<point referenced from the Rhino model> x2, <brep referenced from the Rhino model> x21, <point referenced from the Rhino model>])
G = ClusterInput()
G_2 = ClusterInput()
pt = Point(geo_3)
clean = CleanTree(RemoveNulls=True, RemoveInvalid=True, RemoveEmpty=False, Tree=pt)

# ---- group: lidar_tcp
geo_4 = Geometry([<point referenced from the Rhino model> x2, <brep referenced from the Rhino model> x15, <curve referenced from the Rhino model>, <point referenced from the Rhino model>, <curve referenced from the Rhino model> x2, <brep referenced from the Rhino model>, <curve referenced from the Rhino model>, <brep referenced from the Rhino model>, <curve referenced from the Rhino model> x6, <brep referenced from the Rhino model> x4, <curve referenced from the Rhino model>, <brep referenced from the Rhino model> x9, <curve referenced from the Rhino model>, <brep referenced from the Rhino model>])
pt_2 = Point(geo_4)
clean_2 = CleanTree(RemoveNulls=True, RemoveInvalid=True, RemoveEmpty=False, Tree=pt_2)
pt_3 = Point(clean_2)
partition = PartitionList(List=pt_3, Size=Slider(1, range=0..1))
bang = ExplodeTree(Data=partition)  # -> Branch0, Branch1, Branch2
vec2pt = Vector2Pt(PointA=bang.Branch2, PointB=bang.Branch0, Unitize=False)  # -> Vector, Length

# ----
number_slider = Slider(0, range=0..1)
pt_4 = Point(clean)
brep = Brep([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])
get_lidar_tcp = ClusterInput()
tool_id = ClusterInput()
item = ListItem(List=pt_4, Index=Slider(2, range=0..10), Wrap=True)
pt_5 = Point()

# ---- group: measurement tool
measurement_tool_geo = Geometry([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])
mesh = Mesh(measurement_tool_geo)
mjoin = MeshJoin(Meshes=mesh)
tool = PythonScript(meshes=mjoin, brep=measurement_tool_geo)  # -> tool; inputs meshes: list, brep: list
# ---------- tool: Python ----------
from ur_online_control.ur.tools import MeasurementTool
from compas.datastructures import Mesh
from compas_rhino.helpers import mesh_from_guid


tool = MeasurementTool()
tool.model = [mesh_from_guid(Mesh, mesh) for mesh in meshes]
#tool.model_xyz = tool.model.xyz

tool.brep = brep
# ---------- end tool ----------

# ---- group: extruder
test_geometry = Geometry(brep)
xaxis_line = Curve(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)
yaxis_line = Curve(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)
brep_2 = Brep(test_geometry)
mesh_2 = Mesh(test_geometry)
tool_2 = Tool(meshes=mesh_2, breps=brep_2, xline=xaxis_line, yline=yaxis_line)  # -> tool_2, tcp_lidar_2

# ----
get_lidar_tcp_2 = Data(get_lidar_tcp)
tool_id_2 = Integer(tool_id)
end = EndPoints(Curve=xaxis_line)  # -> Start, End
filter = StreamFilter(Gate=G_2, Stream0=bang.Branch2, Stream1=item)
pt_6 = Point(end.Start)
python = GhPythonScript(guid=mjoin)  # -> out, a
# ---------- python: Python ----------
__author__ = "hjame"
__version__ = "2021.05.27"

import rhinoscriptsyntax as rs
import compas_rhino
from compas_rhino.geometry import RhinoMesh
from eggshell.ur_online_control.ur.
guid = compas_rhino.select_mesh()
mesh = RhinoMesh.from_guid(guid).to_compas()
# ---------- end python ----------
pt_7 = Point(bang.Branch2)
vec2pt_2 = Vector2Pt(PointA=pt_7, PointB=filter, Unitize=False)  # -> Vector, Length
line = LineSDL(Start=pt_7, Direction=vec2pt_2.Vector, Length=vec2pt_2.Length)
number_slider_2 = Slider(0, range=0..360)
line_2 = LineSDL(Start=bang.Branch2, Direction=vec2pt.Vector, Length=vec2pt.Length)
number_slider_3 = Slider(270, range=0..360)
test_geometry_2 = Geometry([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])
filter_2 = StreamFilter(Gate=G_2, Stream0=vec2pt.Vector, Stream1=vec2pt_2.Vector)
filter_3 = StreamFilter(Gate=G_2, Stream0=bang.Branch0, Stream1=item)

# ---- group: inverse_kinematic_lidar
xy = XYPlane(Origin=filter_3)
inverse_kinematic_plane = Plane(xy)
inverse_kinematic_point = Point(bang.Branch2)

# ---- group: forward_kinematic_lidar
xy_2 = XYPlane(Origin=bang.Branch2)
forward_kinematic_point = Point(filter_3)
forward_kinematic_plane = Plane(xy_2)

# ----
panel = Panel(pt_6)
merge = Merge(Data1=inverse_kinematic_point, Data2=inverse_kinematic_plane)  # -> flatten(Result)
merge_2 = Merge(Data1=forward_kinematic_point, Data2=forward_kinematic_plane)  # -> flatten(Result)
shift = ShiftList(List=merge, Shift=1, Wrap=True)  # -> flatten(List)
filter_4 = StreamFilter(Gate=G, Stream0=merge_2, Stream1=shift)
split = SplitList(List=filter_4, Index=Slider(1, range=0..1))  # -> ListA, ListB
pln = Plane(split.ListB)
pt_8 = Point(split.ListA)
vec = Vector(filter_2)
pln_2 = ClusterOutput(pln)
vec_2 = ClusterOutput(vec)
pt_9 = ClusterOutput(pt_8)

# ---- group: alu extruder v2
xaxis_line_2 = Curve(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)
yaxis_line_2 = Curve(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)
rotate = Rotate(Geometry=yaxis_line_2, Angle=degrees(number_slider_3), Plane=PlaneXY(0, 0, 0))  # -> Geometry, Transform
rotate_2 = Rotate(Geometry=xaxis_line_2, Angle=degrees(number_slider_3), Plane=PlaneXY(0, 0, 0))  # -> Geometry, Transform
rotate_3 = Rotate(Geometry=test_geometry_2, Angle=degrees(number_slider_3), Plane=PlaneXY(0, 0, 0))  # -> Geometry, Transform
mesh_3 = Mesh(rotate_3.Geometry)

# ----
end_2 = EndPoints(Curve=rotate.Geometry)  # -> Start, End
brep_3 = Brep(rotate_3.Geometry)
pt_10 = Point(end_2.Start)
rotate_4 = Rotate(Geometry=rotate_2.Geometry, Angle=degrees(number_slider_2), Plane=pt_10)  # -> Geometry, Transform
rotate_5 = Rotate(Geometry=rotate.Geometry, Angle=degrees(number_slider_2), Plane=pt_10)  # -> Geometry, Transform

# ---- group: alu extruder v2 (continued)
tool_3 = Tool(vector=filter_2, meshes=mesh_3, breps=brep_3, xline=rotate_4.Geometry, yline=rotate_5.Geometry)  # -> tool_2, tcp_lidar_2

# ----
subtraction = Subtraction(A=pt_10, B=pt_6)
panel_2 = Panel(pt_10)
pt_11 = Point(subtraction)
filter_5 = StreamFilter(Gate=tool_id_2, Stream1=tool, Stream2=tool_2.tool_2, Stream3=tool_3.tool_2)
python_2 = GhPythonScript(x=tool_2.tool_2, y=tool_3.tool_2)  # -> out, a
# ---------- python_2: Python ----------
print(x)
print(y)

#print y.breps
print x.tcp_frame
print y.tcp_frame
# ---------- end python_2 ----------
panel_3 = Panel(pt_11)
filter_6 = StreamFilter(Gate=get_lidar_tcp_2, Stream0="no_tcp", Stream1=tool_3.tcp_lidar_2)
tool_4 = Data(filter_5)
tool_5 = ClusterOutput(tool_4)
lidar_tcp = Data(filter_6)
lidar_tcp_2 = ClusterOutput(lidar_tcp)
py = PythonScript(tool=filter_5)  # -> tcp_frame, model
# ---------- py: Python ----------
from compas_ghpython import mesh_draw 

tcp_frame = tool.tcp_frame
model = map(mesh_draw, tool.model)
# ---------- end py ----------
draw = PythonScript(frame=py.tcp_frame)  # -> G, C
# ---------- draw: Python ----------
import Rhino.Geometry as rg
from System.Drawing import Color

if not size:
    size = 100

if frame:
    plane = rg.Plane(rg.Point3d(*list(frame.point)), rg.Vector3d(*list(frame.xaxis)), rg.Vector3d(*list(frame.yaxis)))

    G = []
    G.append(rg.Line(plane.Origin, size * plane.XAxis))
    G.append(rg.Line(plane.Origin, size * plane.YAxis))
    G.append(rg.Line(plane.Origin, size * plane.ZAxis))
    
    C = []
    C.append(Color.FromArgb(255, 0, 0))
    C.append(Color.FromArgb(0, 255, 0))
    C.append(Color.FromArgb(0, 0, 255))
# ---------- end draw ----------
preview = CustomPreview(Geometry=draw.G, Shader=draw.C)
preview_2 = CustomPreview(Geometry=py.model, Shader=ColourSwatch(SwatchColor=RGB(141, 170, 178)))

# ==== cluster CenterScaleDivide
number_slider = Slider(5, range=0..10)
number_slider_2 = Slider(64, range=0..100)
C = ClusterInput()
G = ClusterInput()
A = ClusterInput()
ln = Line(StartPoint=A, EndPoint=C)
vec = Vector(ln)
F = ClusterInput()
N = ClusterInput()
move = Move(Geometry=G, Motion=vec)  # -> Geometry, Transform
scale = Scale(Geometry=move.Geometry, Center=C, Factor=F)  # -> Geometry, Transform
divide = DivideCurve(Curve=scale.Geometry, Count=N, Kinks=False)  # -> Points, Tangents, Parameters
pt = Point(divide.Points)
G_2 = ClusterOutput(scale.Geometry)
lastdex = LastIndex(List=divide.Points)
item = ListItem(List=divide.Points, Index=lastdex, Wrap=True)
ins = InsertItems(List=divide.Points, Item=item, Indices=Slider(0, range=0..100), Wrap=True)
pt_2 = Point(ins)
pt_3 = ClusterOutput(pt_2)

# ==== cluster OffsetZ_height
L = ClusterInput()
lng = ListLength(List=L)
lastdex = LastIndex(List=L)
dup = DuplicateData(Data=Slider(1, range=0..1), Number=lng, Order=True)
number_slider = Slider(0, range=0..100)
replace = ReplaceItems(List=dup, Item=Slider(0, range=0..100), Indices=lastdex, Wrap=False)
pt = Point(L)
pt_2 = Point(flatten(L))
data = Data(flatten(replace))
bang = ExplodeTree(Data=pt)  # -> _00000, Branch1, Branch2
data_2 = ClusterOutput(data)
pdecon = Deconstruct(Point=pt_2)  # -> XComponent, YComponent, ZComponent
pt_3 = ClusterOutput(pt_2)
X = ClusterOutput(pdecon.XComponent)
Y = ClusterOutput(pdecon.YComponent)
B = ClusterInput()
addition = Addition(A=pdecon.ZComponent, B=B)
R = ClusterOutput(addition)

# ==== cluster PrintBed
F = ClusterInput()
G = ClusterInput()
X = ClusterInput()

# ---- group: Print Bed Rectangle
Z = UnitZ(Factor=F)
move = Move(Geometry=G, Motion=Z)  # -> Geometry, Transform
pl = PlaneNormal(Origin=move.Geometry, ZAxis=Vector(0, 0, 1))
rectangle = Rectangle(Plane=pl, XSize=X, YSize=X, Radius=0)  # -> Rectangle, Length
area = Area(Geometry=rectangle.Rectangle)  # -> Area, Centroid
move2pt = MoveToPoint(Geometry=rectangle.Rectangle, PointA=area.Centroid, PointB=pl)  # -> Moved, Vector, Transform

# ----
G_2 = ClusterOutput(move.Geometry)
M = ClusterOutput(move2pt.Moved)

# ==== cluster Cluster
crv = Curve(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)
crv_2 = Curve(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)
crv_3 = Curve(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)
end = EndPoints(Curve=crv_3)  # -> Start, End
end_2 = EndPoints(Curve=crv_2)  # -> Start, End
end_3 = EndPoints(Curve=crv)  # -> Start, End
ln = Line(StartPoint=end.Start, EndPoint=end_3.End)
ln_2 = Line(StartPoint=end_2.End, EndPoint=end_3.Start)
join = JoinCurves(Curves=[ln, ln_2, crv_3, crv_2, crv], Preserve=False)
C = ClusterOutput(join)

# ==== cluster Cluster_2
B = ClusterInput()
geo = Geometry([<point referenced from the Rhino model> x2, <brep referenced from the Rhino model> x15, <curve referenced from the Rhino model>, <point referenced from the Rhino model>, <curve referenced from the Rhino model> x2, <brep referenced from the Rhino model>, <curve referenced from the Rhino model>, <brep referenced from the Rhino model>, <curve referenced from the Rhino model>, <point referenced from the Rhino model> x2, <curve referenced from the Rhino model> x5, <brep referenced from the Rhino model> x4, <curve referenced from the Rhino model>, <brep referenced from the Rhino model> x9, <curve referenced from the Rhino model>, <brep referenced from the Rhino model>])
item = ListItem(List=geo, Index=Slider(18, range=0..50), Wrap=True)
item_2 = ListItem(List=geo, Index=0, Wrap=True)
pt = Point(item_2)
vec2pt = Vector2Pt(PointA=item, PointB=pt, Unitize=False)  # -> Vector, Length
vec2pt_2 = Vector2Pt(PointA=item, PointB=B, Unitize=False)  # -> Vector, Length
move = Move(Geometry=geo, Motion=vec2pt_2.Vector)  # -> Geometry, Transform
panel = Panel(geo)
pln = Plane(item)
vec = Vector(vec2pt.Vector)
vec_2 = ClusterOutput(vec)

# ==== cluster Process_mesh
pt = ClusterInput()
xy = XYPlane(Origin=Point(0, 0, 0))
pt_2 = Point(pt)
yz = YZPlane(Origin=pt_2)
rad = Radians(Degrees=-90)
deplane = DeconstructPlane(Plane=xy)  # -> Origin, XAxis, YAxis, ZAxis
pt_3 = ClusterInput()
G = ClusterInput()
demesh = DeconstructMesh(Mesh=G)  # -> Vertices, Faces, Colours, Normals
scale = Scale(Geometry=G, Center=Point(0, 0, 0), Factor=1000)  # -> Geometry, Transform
rot3d = Rotate3D(Geometry=xy, Angle=rad, Center=Point(0, 0, 0), Axis=deplane.ZAxis)  # -> Geometry, Transform
pt_4 = Point()
xy_2 = XYPlane(Origin=Point(0, 0, 0))
orient = Orient(Geometry=rot3d.Geometry, Source=rot3d.Geometry, Target=yz)  # -> Geometry, Transform
pln = ClusterInput()
B = ClusterInput()
scale_2 = Scale(Geometry=demesh.Vertices, Center=Point(0, 0, 0), Factor=Slider(1000, range=0..1000))  # -> Geometry, Transform
transform = Transform(Geometry=scale.Geometry, Transform=orient.Transform)
rad_2 = Radians(Degrees=Slider(0, range=-180..180))
deplane_2 = DeconstructPlane(Plane=xy_2)  # -> Origin, XAxis, YAxis, ZAxis
xy_3 = XYPlane(Origin=Point(0, 0, 0))
pln_2 = Plane(pln)
xy_4 = XYPlane(Origin=Point(0, 0, 0))
rot3d_2 = Rotate3D(Geometry=xy_3, Angle=rad_2, Center=Point(0, 0, 0), Axis=deplane_2.ZAxis)  # -> Geometry, Transform
vec2pt = Vector2Pt(PointA=deplane_2.Origin, PointB=pt_4, Unitize=False)  # -> Vector, Length
orient_2 = Orient(Geometry=scale_2.Geometry, Source=xy_4, Target=pln_2)  # -> Geometry, Transform
move = Move(Geometry=rot3d_2.Geometry, Motion=vec2pt.Vector)  # -> Geometry, Transform
orient_3 = Orient(Geometry=rot3d_2.Geometry, Source=xy_3, Target=move.Geometry)  # -> Geometry, Transform
pt_5 = Point(orient_2.Geometry)
transform_2 = Transform(Geometry=scale_2.Geometry, Transform=orient_3.Transform)
xz = XZPlane(Origin=Point(0, 0, 0))
G_2 = ClusterOutput(orient_2.Geometry)
mesh = Mesh(transform_2)
box = Box()
msplit = MeshSplit(Mesh=mesh, Splitters=box)
rotate = Rotate(Geometry=pt_5, Angle=degrees(Slider(7, range=0..10)), Plane=xz)  # -> Geometry, Transform
volume = Volume(Geometry=box)  # -> Volume, Centroid
area = Area(Geometry=msplit)  # -> Area, Centroid
avr = Average(Input=rotate.Geometry)
G_3 = ClusterOutput(rotate.Geometry)
dist = Distance(PointA=graft(area.Centroid), PointB=volume.Centroid)  # -> flatten(Distance)
vec2pt_2 = Vector2Pt(PointA=avr, PointB=B, Unitize=False)  # -> Vector, Length
sort = SortList(Keys=dist, ValuesA=msplit)  # -> Keys, ValuesA
python = GhPythonScript()  # -> Out, A
item = ListItem(List=sort.ValuesA, Index=0, Wrap=True)
devec = DeconstructVector(Vector=vec2pt_2.Vector)  # -> XComponent, YComponent, ZComponent
clean = CombineClean(Meshes=item)
mesh_2 = Mesh(clean)
vec = VectorXYZ(XComponent=devec.XComponent, YComponent=devec.YComponent, ZComponent=0)  # -> Vector, Length
demesh_2 = DeconstructMesh(Mesh=mesh_2)  # -> Vertices, Faces, Colours, Normals
move_2 = Move(Geometry=rotate.Geometry, Motion=vec.Vector)  # -> Geometry, Transform
lng = ListLength(List=demesh_2.Vertices)
pdecon = Deconstruct(Point=demesh_2.Vertices)  # -> XComponent, YComponent, ZComponent
series = Series(Start=0, Step=1, Count=lng)
G_4 = ClusterOutput(move_2.Geometry)
far = ColourSwatch(SwatchColor=RGB(255, 0, 0))
close = ColourSwatch(SwatchColor=RGB(13, 0, 255))
mid = ColourSwatch(SwatchColor=RGB(255, 247, 0))
sort_2 = SortList(Keys=pdecon.XComponent, ValuesA=series)  # -> Keys, ValuesA
range = Range(Domain=Domain(0, 1), Steps=lng)
cull_i = CullIndex(List=range, Indices=0, Wrap=True)
col = Colour([far, mid, close])
interp = InterpolateData(Data=col, Parameter=cull_i, Interpolation=2)
sort_3 = SortList(Keys=sort_2.ValuesA, ValuesA=interp)  # -> Keys, ValuesA
mcol = MeshColours(Mesh=mesh_2, Colours=sort_3.ValuesA)
M = ClusterOutput(mcol)

# ==== cluster Pcd_delaunay
mesh = ClusterInput()
Z = ClusterInput()
mesh_2 = Mesh(mesh)
P = ClusterInput()
scale_nu = ScaleNU(Geometry=mesh_2, Plane=PlaneXY(0, 0, 0), ScaleX=1, ScaleY=1, ScaleZ=Z)  # -> Geometry, Transform
L = ClusterInput()
minc = MeshInclusion(Mesh=scale_nu.Geometry, Point=P, Strict=False)
iterations = Slider(5, range=0..100)
strength = Slider(0.25, range=0..1)
limit = Slider(84, range=0..100)
pl = ClusterInput()
cull = CullPattern(List=L, CullPattern=minc)
del = DelaunayMesh(Points=cull, Plane=pl)
smooth_mesh = SmoothMesh(Mesh=del, Strength=strength, SkipNaked=Toggle(True), Iterations=iterations, Limit=limit)
mesh_3 = Mesh(smooth_mesh)
mesh_4 = ClusterOutput(mesh_3)

# ==== cluster Split_scan_mesh
M = ClusterInput()
S = ClusterInput()
msplit = MeshSplit(Mesh=M, Splitters=S)
area = Area(Geometry=msplit)  # -> Area, Centroid
sort = SortList(Keys=area.Area, ValuesA=msplit)  # -> reverse(Keys), reverse(ValuesA)
item = ListItem(List=sort.ValuesA, Index=0, Wrap=True)
i = ClusterOutput(item)

# ==== cluster Scan_positions
F = ClusterInput()
R = ClusterInput()
P = ClusterInput()
N = ClusterInput()
A = ClusterInput()
G = ClusterInput()
pt = ClusterInput()
pln = ClusterInput()
pln_2 = Plane(pln)
pt_2 = Point(pt)
cir = Circle(Plane=P, Radius=R)
Z = UnitZ(Factor=F)
merge = Merge(Data1=pt_2, Data2=pln_2)
D = ClusterInput()
move = Move(Geometry=cir, Motion=Z)  # -> Geometry, Transform
toggle = BooleanToggle(False)
divide = DivideCurve(Curve=move.Geometry, Count=N, Kinks=False)  # -> Points, Tangents, Parameters
gate = StreamGate(Stream=merge, Gate=G)  # -> Target0, Target1
merge_2 = Merge(Data2=divide.Points)  # -> flatten(Result)
split = SplitList(List=gate.Target0, Index=Slider(1, range=0..1))  # -> ListA, ListB
split_2 = SplitList(List=gate.Target1, Index=Slider(1, range=0..1))  # -> ListA, ListB
pframes = PerpFrames(Curve=move.Geometry, Count=N, Align=True)  # -> Frames, Parameters

# ---- group: inverse_points
merge_3 = Merge(Data2=divide.Points)
xy = XYPlane(Origin=merge_3)
rotate = Rotate(Geometry=xy, Angle=degrees(A), Plane=pframes.Frames)  # -> Geometry, Transform

# ----
xy_2 = XYPlane(Origin=merge_2)
orient = Orient(Geometry=split_2.ListA, Source=split_2.ListB, Target=xy_2)  # -> Geometry, Transform
orient_2 = Orient(Geometry=split.ListA, Source=split.ListB, Target=xy_2)  # -> Geometry, Transform
rotate_2 = Rotate(Geometry=orient.Geometry, Angle=degrees(A), Plane=pframes.Frames)  # -> Geometry, Transform
rotate_3 = Rotate(Geometry=xy_2, Angle=degrees(A), Plane=pframes.Frames)  # -> Geometry, Transform
rotate_4 = Rotate(Geometry=orient_2.Geometry, Angle=degrees(A), Plane=pframes.Frames)  # -> Geometry, Transform
vec2pt = Vector2Pt(PointA=rotate.Geometry, PointB=rotate_2.Geometry, Unitize=False)  # -> Vector, Length
move_2 = Move(Geometry=rotate.Geometry, Motion=vec2pt.Vector)  # -> Geometry, Transform
vec = Vector(vec2pt.Vector)
pln_3 = Plane(rotate.Geometry)
pln_4 = Plane(move_2.Geometry)
vec2pt_2 = Vector2Pt(PointA=rotate_3.Geometry, PointB=rotate_4.Geometry, Unitize=False)  # -> Vector, Length
pln_5 = Plane(rotate_3.Geometry)
line = LineSDL(Start=rotate.Geometry, Direction=vec2pt.Vector, Length=vec2pt.Length)
vec_2 = Vector(vec2pt_2.Vector)
merge_4 = Merge(Data1=pln_4, Data2=vec)
repeat = RepeatData(Data=D, Length=N)
wait_times_list = Data(repeat)
merge_5 = Merge(Data1=pln_5, Data2=vec_2)
filter = StreamFilter(Gate=G, Stream0=merge_5, Stream1=merge_4)
lng = ListLength(List=pln_4)
wait_times_list_2 = ClusterOutput(wait_times_list)
split_3 = SplitList(List=filter, Index=lng)  # -> ListA, ListB
pln_6 = Plane(split_3.ListA)
vec_3 = Vector(split_3.ListB)
pln_7 = ClusterOutput(pln_6)
vec_4 = ClusterOutput(vec_3)

# ==== cluster Cluster_3
A = ClusterInput()
B = ClusterInput()
C = ClusterInput()
multiplication = Multiplication(A=A, B=B)
B_2 = ClusterInput()
subtraction = Subtraction(A=multiplication, B=B_2)
A_2 = ClusterInput()
B_3 = ClusterInput()
T = ClusterInput()
B_4 = ClusterInput()
division = Division(A=A_2, B=B_3)
dom = ConstructDomain(DomainStart=0, DomainEnd=A_2)
range = Range(Domain=dom, Steps=division)
offcrv = OffsetCurve(Curve=C, Plane=PlaneXY(0, 0, 0), Distance=range, BothSides=B_4, Kinks=0, CapType=T)  # -> flatten(Offset)
geo = Geometry(flatten(C))
Z = UnitZ(Factor=subtraction)
extr = Extrude(Base=geo, Direction=Z)
mesh = MeshBrep(
    Brep=extr,
    Settings={GridMaxCount=0, GridMinCount=16, JaggedSeams=False, MaxEdgeLength=0, MinEdgeLength=0.0001, MinTolerance=0, Refine=True, RefineAngle=0, RelativeTolerance=0.65, SimplePlanes=True, Tolerance=0})
crv = Curve(geo)
tri = Triangulate(Mesh=mesh)  # -> Mesh, Count
crv_2 = ClusterOutput(crv)
medges = MeshEdges(Mesh=tri.Mesh)  # -> NakedEdges, InteriorEdges, NonManifoldEdges
M = ClusterOutput(tri.Mesh)
crv_3 = Curve([medges.InteriorEdges, medges.NakedEdges])
crv_4 = ClusterOutput(crv_3)

# ==== cluster Center
crv = ClusterInput()
crv_2 = Curve(crv)
cpoly = ControlPolygon(Curve=crv_2)  # -> Polygon, Points
pcen = PolygonCenter(Polyline=cpoly.Polygon)  # -> CenterV, CenterE, CenterA
ma = MassAddition(Input=pcen.CenterV)  # -> Result, PartialResults
lng = ListLength(List=pcen.CenterV)
division = Division(A=ma.Result, B=lng)
center = ClusterInput()
pt = Point(division)
center_2 = Point(center)
vec2pt = Vector2Pt(PointA=pt, PointB=center_2, Unitize=False)  # -> Vector, Length
move = Move(Geometry=crv_2, Motion=vec2pt.Vector)  # -> Geometry, Transform
C = ClusterOutput(move.Geometry)

# ==== cluster Mini_print_bounding_area
P = ClusterInput()
X = ClusterInput()
Y = ClusterInput()
C = ClusterInput()

# ---- group: mini_prints_scan_bounding_box
rectangle = Rectangle(Plane=P, XSize=X, YSize=Y, Radius=0)  # -> Rectangle, Length
area = Area(Geometry=rectangle.Rectangle)  # -> Area, Centroid
vec2pt = Vector2Pt(PointA=area.Centroid, PointB=P, Unitize=False)  # -> Vector, Length
move = Move(Geometry=rectangle.Rectangle, Motion=vec2pt.Vector)  # -> Geometry, Transform

# ----
G = ClusterInput()
explode = Explode(Curve=C, Recursive=True)  # -> Segments, Vertices
pdecon = Deconstruct(Point=explode.Vertices)  # -> XComponent, YComponent, ZComponent
explode_2 = Explode(Curve=move.Geometry, Recursive=True)  # -> Segments, Vertices
crv = Curve(C)
pdecon_2 = Deconstruct(Point=explode_2.Vertices)  # -> XComponent, YComponent, ZComponent
hilonums = HighestLowestNumbers(Numbers=pdecon.XComponent)  # -> Highest, Lowest
hilonums_2 = HighestLowestNumbers(Numbers=pdecon.YComponent)  # -> Highest, Lowest
hilonums_3 = HighestLowestNumbers(Numbers=pdecon_2.YComponent)  # -> Highest, Lowest
hilonums_4 = HighestLowestNumbers(Numbers=pdecon_2.XComponent)  # -> Highest, Lowest
G_2 = ClusterOutput(move.Geometry)
crv_2 = ClusterOutput(crv)
merge = Merge(Data1=hilonums.Highest, Data2=hilonums.Lowest, Data3=hilonums_2.Highest, Data4=hilonums_2.Lowest)
merge_2 = Merge(Data1=hilonums_4.Highest, Data2=hilonums_4.Lowest, Data3=hilonums_3.Highest, Data4=hilonums_3.Lowest)
filter = StreamFilter(Gate=G, Stream0=merge_2, Stream1=merge)  # -> graft(Stream)
bang = ExplodeTree(Data=filter)  # -> _00000, _00001, _00002, _00003
_0_0_0_0_1 = ClusterOutput(bang._00001)
_0_0_0_0_0 = ClusterOutput(bang._00000)
_0_0_0_0_2 = ClusterOutput(bang._00002)
_0_0_0_0_3 = ClusterOutput(bang._00003)

# ==== cluster Color
M = ClusterInput()
clean = CombineClean(Meshes=M)
mesh = Mesh(M)
demesh = DeconstructMesh(Mesh=mesh)  # -> Vertices, Faces, Colours, Normals
lng = ListLength(List=demesh.Vertices)
pdecon = Deconstruct(Point=demesh.Vertices)  # -> XComponent, YComponent, ZComponent
series = Series(Start=0, Step=1, Count=lng)
P = ClusterInput()
far = ColourSwatch(SwatchColor=RGB(255, 0, 0))
close = ColourSwatch(SwatchColor=RGB(13, 0, 255))
mid = ColourSwatch(SwatchColor=RGB(255, 247, 0))
sort = SortList(Keys=pdecon.XComponent, ValuesA=series)  # -> Keys, ValuesA
range = Range(Domain=Domain(0, 1), Steps=lng)
cull_i = CullIndex(List=range, Indices=0, Wrap=True)
wbedges = WeaverbirdsMeshEdges(MeshOrPolylines=mesh)
col = Colour([far, mid, close])
interp = InterpolateData(Data=col, Parameter=cull_i, Interpolation=2)
sort_2 = SortList(Keys=sort.ValuesA, ValuesA=interp)  # -> Keys, ValuesA
cull = CullPattern(List=wbedges, CullPattern=P)
pdecon_2 = Deconstruct(Point=demesh.Vertices)  # -> XComponent, YComponent, ZComponent
mcol = MeshColours(Mesh=mesh, Colours=sort_2.ValuesA)
L = ClusterOutput(cull)
mesh_2 = Mesh(mcol)
smaller = SmallerThan(FirstNumber=pdecon_2.ZComponent, SecondNumber=Slider(0, range=0..1))  # -> SmallerThan, OrEqualTo
mesh_3 = ClusterOutput(mesh_2)
cull_2 = CullPattern(List=demesh.Vertices, CullPattern=smaller.SmallerThan)
cullpt = CullDuplicates(Points=cull_2, Tolerance=0.1, CullMode=3)  # -> Points, Indices, Valence
P_2 = ClusterOutput(cullpt.Points)

# ==== cluster Cluster_4
vec = ClusterInput()
P = ClusterInput()

# ---- group: Scan_visu
planesrf = PlaneSurface(Plane=P, XSize=Domain(-10, 10), YSize=Domain(-10, 10))
vec_2 = Vector(vec)
multiplication = Multiplication(A=vec_2, B=Slider(10, range=0..10))
extr = Extrude(Base=planesrf, Direction=multiplication)
flippln = FlipPlane(Plane=P, FlipX=False, FlipY=False, FlipZ=True)  # -> Flipped, R
vec_3 = Vector(flippln.Flipped)
number_slider = Slider(25, range=0..100)
line = LineSDL(Start=flippln.Flipped, Direction=vec_3, Length=number_slider)
cone = Cone(Base=flippln.Flipped, Radius=Slider(9, range=0..100), Length=number_slider)  # -> Cone, Tip

# ----
vec_4 = ClusterInput()
P_2 = ClusterInput()

# ---- group: scan_visu
planesrf_2 = PlaneSurface(Plane=P_2, XSize=Domain(-10, 10), YSize=Domain(-10, 10))
vec_5 = Vector(vec_4)
multiplication_2 = Multiplication(A=vec_5, B=Slider(5, range=0..10))
extr_2 = Extrude(Base=planesrf_2, Direction=multiplication_2)
flippln_2 = FlipPlane(Plane=P_2, FlipX=False, FlipY=False, FlipZ=True)  # -> Flipped, R
number_slider_2 = Slider(15, range=0..100)
vec_6 = Vector(flippln_2.Flipped)
line_2 = LineSDL(Start=flippln_2.Flipped, Direction=vec_6, Length=number_slider_2)
cone_2 = Cone(Base=flippln_2.Flipped, Radius=Slider(10, range=0..100), Length=number_slider_2)  # -> Cone, Tip

# ----
merge = Merge(Data1=cone_2.Cone, Data2=extr_2)
geo = Geometry(merge)
merge_2 = Merge(Data1=cone.Cone, Data2=extr)
geo_2 = ClusterOutput(geo)
geo_3 = Geometry(merge_2)
geo_4 = ClusterOutput(geo_3)

# ==== cluster RemoveDuplicateCurves: Remove curves that share the same midpoint

lattice = ClusterInput()  # Lattice curves to filter
crv = Curve(lattice)
curvepoint = PointOnCurve(crv, parameter=0.5)
# CRYSTALLON V1.0 -- Lattice structure tools for Grasshopper3D
# 
# Copyright (C) 2018  Aaron Porterfield
# 
# www.studiofathom.com
# www.fequalsf.com
# 
#     This program is free software: you can redistribute it and/or modify
#     it under the terms of the GNU General Public License as published by
#     the Free Software Foundation, either version 3 of the License, or any later version.
# 
#     This program is distributed in the hope that it will be useful,
#     but WITHOUT ANY WARRANTY; without even the implied warranty of
#     MERCHANTABILITY or FITNESS FOR A PARTICULAR PURPOSE.  See the
#     GNU General Public License for more details.
# 
#     You should have received a copy of the GNU General Public License
#     along with this program.  If not, see <http://www.gnu.org/licenses/>.
panel = Panel("REMOVE DUPLICATE CURVES")
cullpt = CullDuplicates(Points=curvepoint, Tolerance=".001", CullMode=1)  # -> Points, Indices, Valence
item = ListItem(List=crv, Index=cullpt.Indices, Wrap=True)
lattice_2 = ClusterOutput(item)  # Filtered lattice

# ==== cluster Cluster_5
X = ClusterInput()
Y = ClusterInput()
rectangle = Rectangle(Plane=PlaneXY(0, 0, 0), XSize=X, YSize=Y, Radius=0)  # -> Rectangle, Length
explode = Explode(Curve=rectangle.Rectangle, Recursive=True)  # -> Segments, Vertices
N = ClusterInput()
item = ListItem(List=explode.Segments, Index=0, Wrap=True)  # -> Item2, Item1, Item
divide = DivideCurve(Curve=item.Item, Count=N, Kinks=False)  # -> reverse(flatten(Points)), Tangents, Parameters
divide_2 = DivideCurve(Curve=item.Item2, Count=N, Kinks=False)  # -> flatten(Points), Tangents, Parameters
F = ClusterInput()
ln = Line(StartPoint=divide_2.Points, EndPoint=divide.Points)
curvepoint = PointOnCurve(ln, parameter=0.5)
X_2 = UnitX(Factor=F)
move = Move(Geometry=flatten(curvepoint), Motion=X_2)  # -> Geometry, Transform
merge = Merge(Data1=graft(divide_2.Points), Data2=graft(move.Geometry), Data3=graft(divide.Points))
intcrv = Interpolate(Vertices=merge, Degree=3, Periodic=False, KnotStyle=1)  # -> flatten(Curve), Length, Domain
item_2 = ListItem(List=intcrv.Curve, Index=0, Wrap=True)  # -> flatten(Item1), flatten(Item)
geo = Geometry(item_2.Item)
join = JoinCurves(Curves=flatten([item.Item2, item_2.Item1, item.Item, item_2.Item]), Preserve=False)
panel = Panel("""0
-1""")
D = ClusterInput()
offcrv = OffsetCurve(Curve=join, Plane=PlaneXY(0, 0, 0), Distance=D, BothSides=True, Kinks=0, CapType=1)
cull_i = CullIndex(List=intcrv.Curve, Indices=panel, Wrap=True)
merge_2 = Merge(Data1=flatten(join), Data2=flatten(offcrv))
L = ClusterOutput(cull_i)
geo_2 = Geometry(merge_2)
geo_3 = Geometry(cull_i)

# ==== cluster Tool
breps = ClusterInput()
meshes = ClusterInput()
vector = ClusterInput()
yline = ClusterInput()
meshes_2 = Mesh(meshes)
vector_2 = Data(vector)
mjoin = MeshJoin(Meshes=meshes_2)
xline = ClusterInput()
item = ListItem(List=breps, Index=Slider(0, range=0..100), Wrap=True)

# ---- group: old
tool = PythonScript(meshes=mjoin, breps=breps, xline=xline, yline=yline)  # -> tool; inputs meshes: list of Mesh, breps: list of Brep
# ---------- tool: Python ----------
import Rhino.Geometry as rg
from compas.geometry import Frame
from eggshell.ur_online_control.ur.tool import Tool
from compas.datastructures import Mesh
from compas_rhino.helpers import mesh_from_guid


xaxis = rg.Line(xline.PointAtStart, xline.PointAtEnd)
yaxis = rg.Line(yline.PointAtStart, yline.PointAtEnd)

if xaxis.From.DistanceTo(yaxis.From) < 0.01:
    origin = xaxis.From
    xaxis = xaxis.Direction
    yaxis = yaxis.Direction
elif xaxis.To.DistanceTo(yaxis.To) < 0.01:
    origin = xaxis.To
    xaxis = -xaxis.Direction
    yaxis = -yaxis.Direction
elif xaxis.From.DistanceTo(yaxis.To) < 0.01:
    origin = xaxis.From
    xaxis = xaxis.Direction
    yaxis = -yaxis.Direction
elif xaxis.To.DistanceTo(yaxis.From) < 0.01:
    origin = xaxis.To
    xaxis = -xaxis.Direction
    yaxis = yaxis.Direction

xaxis.Unitize()
yaxis.Unitize()

print origin
print xaxis
print yaxis

tcp_frame = Frame(origin, xaxis, yaxis)

tool = Tool(tcp_frame)
tool.model = [mesh_from_guid(Mesh, mesh) for mesh in meshes]
#tool.model_xyz = tool.model.xyz
tool.breps = breps
# ---------- end tool ----------

# ----
python = GhPythonScript(guid=mjoin, breps=item, vector=vector_2, xline=xline, yline=yline)  # -> out, tool, tcp_frame, tcp_lidar, T
# ---------- python: Python ----------
__author__ = "hjame"
__version__ = "2021.05.27"

import rhinoscriptsyntax as rs
import Rhino.Geometry as rg
from compas.geometry import Frame
from compas.geometry import Vector
from compas.geometry import Plane
from compas.geometry import Translation
import compas_rhino
from compas_rhino.geometry import RhinoMesh
from compas_rhino.geometry import RhinoPlane
from eggshell.ur_online_control.ur.tool import Tool

xaxis = rg.Line(rs.CurveStartPoint(xline), rs.CurveEndPoint(xline))
yaxis = rg.Line(rs.CurveStartPoint(yline), rs.CurveEndPoint(yline))

if xaxis.From.DistanceTo(yaxis.From) < 0.01:
    origin = xaxis.From
    xaxis = xaxis.Direction
    yaxis = yaxis.Direction
elif xaxis.To.DistanceTo(yaxis.To) < 0.01:
    origin = xaxis.To
    xaxis = -xaxis.Direction
    yaxis = -yaxis.Direction
elif xaxis.From.DistanceTo(yaxis.To) < 0.01:
    origin = xaxis.From
    xaxis = xaxis.Direction
    yaxis = -yaxis.Direction
elif xaxis.To.DistanceTo(yaxis.From) < 0.01:
    origin = xaxis.To
    xaxis = -xaxis.Direction
    yaxis = yaxis.Direction

xaxis.Unitize()
yaxis.Unitize()

print origin
print xaxis
print yaxis

T = Translation.from_vector(vector)

tcp_frame = Frame(origin, xaxis, yaxis)
tcp_plane = Plane.from_frame(tcp_frame)
tcp_plane_rhino = RhinoPlane.from_geometry(tcp_frame)

tcp_lidar = Frame.from_transformation(T)

print(tcp_plane_rhino)
print(tcp_plane)
print(tcp_frame)
tool = Tool(tcp_frame)






#guid = compas_rhino.select_mesh()
#tool.model = RhinoMesh.from_guid(guid).to_compas()
tool.breps = breps
# ---------- end python ----------
tcp_lidar = Data(python.T)
tool_2 = ClusterOutput(python.tool)
tcp_lidar_2 = ClusterOutput(tcp_lidar)
