# Grasshopper definition Geometries.ghx (Grasshopper 1.0.7)
# plug-ins: LunchBox

number_slider = Slider(400, range=0..1000)
rectangle = Rectangle(Plane=PlaneXY(0, 0, 0), XSize=number_slider, YSize=number_slider, Radius=0)  # -> Rectangle, Length
number_slider_2 = Slider(2, range=0..10)
diamond = DiamondPanels(Surface=rectangle.Rectangle, UDivisions=Slider(5, range=0..10), VDivisions=Slider(8, range=0..10))  # -> DiamondPanels, TriPanels
neg = Negative(Value=Slider(1.5, range=0..10))
fillet = Fillet(Curve=diamond.DiamondPanels, Radius=number_slider_2)
fillet_2 = Fillet(Curve=diamond.TriPanels, Radius=number_slider_2)
merge = Merge(Data1=fillet, Data2=fillet_2)
offset = OffsetCurve(Curve=merge, Distance=neg, Plane=PlaneXY(0, 0, 0), Corners=1)
