# Grasshopper definition 6.15_ur_printing_script_r7_gj.gh (Grasshopper 1.0.7)
# plug-ins: Pufferfish, LunchBox

pr_folder_name = Panel("data")
eggshell_setup = Geometry([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])

# ---- group: Folder name
data = Data(pr_folder_name)

# ----
# Input
py = PythonScript(foldername=data)  # -> path
# ---------- py: Python ----------
import sys
import os

ghComp = ghenv.Component
ghDoc = ghComp.OnPingDocument()

# the full path of the gh file
path = ghDoc.FilePath
# the current directory 
path = os.path.abspath(os.path.join(path, "..." , "..." , "data" ,foldername))

print path
# ---------- end py ----------

crv = Curve([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])
panel = Panel(py)
item = ListItem(List=crv, Index=0, Wrap=True)  # -> Item, Item1
geo = Geometry([Point(500, 53.6, 0), Point(437.5, -53.6, 0), Point(375, 53.6, 0), Point(312.5, -53.6, 0), Point(250, 53.6, 0), Point(187.5, -53.6, 0)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])
geo_2 = Geometry([Point(500, 54.9, 0), Point(437.5, -54.9, 0), Point(375, 54.9, 0), Point(312.5, -54.9, 0), Point(250, 54.9, 0), Point(187.5, -54.9, 0)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])
geo_3 = Geometry(item.Item)
crv_2 = Curve([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])
geo_4 = Geometry([Point(500, 59, 0), Point(437.5, -59, 0), Point(375, 59, 0), Point(312.5, -59, 0), Point(250, 59, 0), Point(187.5, -59, 0)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])
cp = ControlPoints(Curve=geo_3)  # -> flatten(Points), Weights, Knots

server_address = ValueList({"Joris IP .11": "192.168.10.11", "Hamilton IP .45": "192.168.10.45", "Guillaume IP .27": "192.168.10.27", "Wei IP .26": "192.168.10.27"}, selected="Guillaume IP .27")
ur_ip = ValueList({"192.168.10.13"}, selected="192.168.10.13")
# Settings
server_port = Integer(30003)
globals = PythonScript(server_address=server_address, server_port=server_port, ur_ip=ur_ip)  # inputs server_port: Int32
# ---------- globals: Python ----------
from scriptcontext import sticky as st

st["server_address"] = server_address
st["server_port"] = server_port

st["ur_ip"] = ur_ip
# ---------- end globals ----------

geo_5 = Geometry(Tree({0}: [{Plane=PlaneXY(0, 0, 0), Size=Domain2(u=0..600, v=0..600)}], {0;0;0}: [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], {0;0;1}: [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], {0;0;2}: [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], {0;0;3}: [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], {0;0;4}: [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], {0;0;5}: [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], {0;0;6}: [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], {0;0;7}: [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], {0;0;8}: [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]))

move_to_pos = Button()
get_pos = Button()
close = Button()
number_slider = Slider(1000, range=0..1000)
pos_z = Slider(150, range=0..1500)
linear_axis = GhPythonScript(move_to_pos=move_to_pos, pos_x=number_slider, pos_z=pos_z, get_pos=get_pos, close=close)  # -> out
# ---------- linear_axis: Python ----------
__author__ = "joburger"
__version__ = "2018.09.20"

from eggshell.linear_axis import siemens as s

if move_to_pos:
    p = s.SiemensPortal(2)
    
    try:
         p.set_x(pos_x)
         p.set_z(pos_z)
         # p.wait_ext_axis()
    
    finally:
         p.close()

if close:
    try:
        p.close()
        p = s.SiemensPortal(2)
    finally:
        p.close()

#position_data = None

position_data = "NO DATA"
if get_pos:
    try:
        p = s.SiemensPortal(2)
        position_data = "NO DATA"
        position_data = "AXIS POSITION \nX:" + str(p.get_x()) + " Z:" + str(p.get_z())
        print "hmm"
    finally:
        p.close()

try:
    print position_data
except RuntimeError:
    print "Something did not work"
# ---------- end linear_axis ----------

panel_2 = Panel("""ORIGIN
LINEAR 
AXIS""")

# ----
# Check if UR is available
ping = Button()
py_2 = PythonScript(ip=ur_ip, ping=ping)  # -> out
# ---------- py_2: Python ----------
from scriptcontext import sticky as st
import platform    # For getting the operating system name
import subprocess  # For executing a shell command

def ping(host):
    """
    Returns True if host (str) responds to a ping request.
    Remember that a host may not respond to a ping (ICMP) request even if the host name is valid.
    """

    # Option for the number of packets as a function of
    param = '-n' if platform.system().lower()=='windows' else '-c'

    # Building the command. Ex: "ping -c 1 google.com"
    command = ['ping', param, '1', host]

    return subprocess.call(command) == 0

guid = str(ghenv.Component.InstanceGuid)
txt_key = "txt_" + guid
if txt_key not in st:
    st[txt_key] = ""
ur_ip = st["ur_ip"]

if ping:
    
    available = ping(ur_ip)
    
    if available:
        st[txt_key] = "%s is up!" % ur_ip
    else:
        st[txt_key] = "%s is down!" % ur_ip

print st[txt_key]
# ---------- end py_2 ----------
panel_3 = Panel(py_2)

# ---- group: Path cross-section
xz = XZPlane(Origin=Point(0, 0, 0))
rectangle = Rectangle(Plane=xz, XSize=Slider(2.5, range=0..10), YSize=Slider(1, range=0..10), Radius=Slider(0.61, range=0..1))  # -> Rectangle, Length

# ----
bang = Button()
panel_4 = Panel("Unload libraries")
unload = PythonScript(bang=bang)
# ---------- unload: Python ----------
from compas_ghpython import unload_modules

unload_modules("compas")
unload_modules("ur_online_control")
# ---------- end unload ----------

# ----
# Disconnect / recompute planes_wcs input after moving axis!
# [to make sure robot base is updated within gh]
panel_5 = Panel(linear_axis)

number_slider_2 = Slider(20.75, range=0..50)
number_slider_3 = Slider(30, range=0..100)
addition = Addition(A=Slider(1, range=0..1), B=number_slider_2)
geo_6 = Geometry(cp.Points)
lng = ListLength(List=geo_6)
repeat = RepeatData(Data=Slider(0.3, range=0..1), Length=lng)
repeat_2 = RepeatData(Data=Slider(25, range=0..100), Length=lng)
repeat_3 = RepeatData(Data=Slider(1, range=0..1), Length=lng)
repeat_4 = RepeatData(Data=Slider(1, range=0..1), Length=lng)

velocities = Number(repeat_2)
blend_radiuses = Number(repeat_4)
extruder_toggles = Number(repeat_3)
wait_times = Number(repeat)

# ---- group: Select parameter to display
list = ValueList({"Velocity": 0, "Wait time": 1, "Blend radius": 2, "Extruder Toggle": 3}, selected="Blend radius")

# ---- group: parameters
safe_wait_time_sec = Slider(5, range=0..80)
move_scan_pt = BooleanToggle(True)
move_safe_pt = BooleanToggle(True)
use_variable_speed = BooleanToggle(False)
use_wait_time = BooleanToggle(True)
use_variable_fillet = BooleanToggle(False)
use_cooling = BooleanToggle(True)
list_2 = ValueList({"Extruder on": "extruder_on", "Extruder off": "extruder_off", "Variable extrusion": "variable_extrusion"}, selected="Extruder on")
dfillet_mm = Slider(0, range=0..100)
speed_mm_s = Slider(25, range=0..80)

# ----
print_speed_mm_s = Slider(14, range=0..80)
jog_speed_mm_s = Slider(45, range=0..80)

number_slider_4 = Slider(10, range=0..10)
# Manual Print Point Generation
cir = Circle(Plane=PlaneXY(0, 0, 0), Radius=1)
explode = Explode(Curve=cir, Recursive=True)  # -> Segments, Vertices
ext = ExtendCurve(Curve=explode.Segments, Type=Slider(1, range=0..1), Start=number_slider_4, End=number_slider_4)
area = Area(Geometry=ext)  # -> Area, Centroid
multiplication = Multiplication(A=Slider(100, range=0..100), B=Slider(1, range=0..10))

# ----
# save this as a .obj for slicing
test_rectangle_200mm = Geometry({Plane=PlaneXY(0, 0, 0), Size=Domain2(u=0..300, v=0..300)})
list_3 = ValueList({"Mm": 0, "Cm": 1}, selected="Mm")
list_4 = ValueList({"One": 1, "Two": 2, "Three": 2² - 1, "Four": Sqrt(16)}, selected="Two")
list_5 = ValueList({"One": 1, "Two": 2, "Three": 2² - 1, "Four": Sqrt(16)}, selected="Three")
both_directions = BooleanToggle(False)
list_6 = ValueList({"No Cap": 0, "Linear Cap": 1, "Tangent Cap": 2, "Curve Cap": 3}, selected="No Cap")
number_slider_5 = Slider(3.25, range=0..4)
layer_height = Slider(2, range=0..2.5)
multiplication_2 = Multiplication(A=list_5, B=number_slider_5)
merge = Merge(Data1=layer_height, Data2=multiplication_2, Data3=number_slider_5)
division = Division(A=merge, B=Slider(10, range=0..10))
filter = StreamFilter(Gate=list_3, Stream0=merge, Stream1=division)  # -> graft(Stream)
bang_2 = ExplodeTree(Data=filter)  # -> Branch0, Branch1, Branch2
cluster = Cluster_3(
    C=test_rectangle_200mm,
    A=list_4,
    B=bang_2.Branch0,
    B_2=Slider(0.05, range=0..0.1),
    A_2=bang_2.Branch1,
    B_3=bang_2.Branch2,
    B_4=both_directions,
    T=list_6)  # -> crv_2, M, crv_4
geo_7 = Geometry(cluster.M)
panel_6 = Panel("Compas_slicer")  # disabled
panel_7 = Panel("3D_for_4D")  # disabled
button = Button()  # disabled
swatch = ColourSwatch(SwatchColor=RGB(255, 130, 130))  # disabled
bake = ObjectBake(BakeToggle=button, GeometryObjects=cluster.M, Layer=panel_6, ObjectName=panel_7, ObjectColor=swatch, LayerColor=swatch)  # disabled
number_slider_6 = Slider(10, range=0..10)

mjoin = MeshJoin(Meshes=geo_7)

list_7 = ValueList({"no_tool": 0, "measurement_tool": 1, "extruder_v1": 2, "alu_extruder_v2": 3}, selected="alu_extruder_v2")
list_8 = ValueList({"UR5", "UR10"}, selected="UR10")

# ----
# SET YOUR IP AND ROBOT IP
# 1a
# SET TOOL AND ROBOT MODEL
# 1b
# 1c
list_9 = ValueList({"LiDAR": 0, "Depthscan": 1}, selected="Depthscan")
get_scan_tcp = BooleanToggle(True)
list_10 = ValueList({"Lidar Forward Kinematic": 0, "Lidar Inverse Kinematic": 1}, selected="Lidar Inverse Kinematic")
panel_8 = Panel("LINEAR AXIS PARAMETERS")
pt = ConstructPoint(XCoordinate=0, YCoordinate=0, ZCoordinate=0)

# ---- group: Linear axis geometry
subtraction = Subtraction(A="1000", B=number_slider)
brep = Brep(<brep referenced from the Rhino model>)
subtraction_2 = Subtraction(A="500", B=pos_z)
neg = Negative(Value=subtraction_2)
X = UnitX(Factor=subtraction)
Z = UnitZ(Factor=neg)
move = Move(Geometry=[brep, pt], Motion=X)  # -> Geometry, Transform
move_2 = Move(Geometry=move.Geometry, Motion=Z)  # -> Geometry, Transform
preview = CustomPreview(Geometry=move_2.Geometry, Shader=ColourSwatch(SwatchColor=RGB(99, 94, 94)))

# ----
tools = Tools(tool_id=list_7, get_lidar_tcp=get_scan_tcp, G=list_10, G_2=list_9)  # -> tool_5, lidar_tcp_2, vec_2, pt_9, pln_2
base = PythonScript(x=subtraction, z=subtraction_2)  # -> base_frame, base
# ---------- base: Python ----------
from compas.geometry import Frame

"""
origin = [0, 0, 0]
xaxis = [1, 0, 0]
yaxis = [0, 1, 0]


origin = [-313.92, -147.58, 13.79]
xaxis = [0.00000, -1.00000, 0.00000]
yaxis = [1.00000, 0.00000, 0.00000]
"""

#Copy the following into base component:
 
#origin = [0.0, 0.0, 0.0]






linear_axis_x = x
linear_axis_z = z 

#axis    Y         X                        Z
origin = [0.0, linear_axis_x, linear_axis_z]
xaxis = [0.0, -1.0, 0.0]
yaxis = [1.0, 0.0, 0.0]

base_frame = Frame(list(origin), list(xaxis), list(yaxis))

base = "base = " + str(origin) + "\n" + "change in linear_axis_x = " + str(linear_axis_x) + "\n" + "change in linear_axis_z = " + str(linear_axis_z)
# ---------- end base ----------
panel_9 = Panel(base.base)
robot = PythonScript(model=list_8, tool=tools.tool_5, lidar_tcp=tools.lidar_tcp_2, base_frame=base.base_frame)  # -> robot
# ---------- robot: Python ----------
from eggshell.ur_online_control.ur.ur10 import UR10
#from ur_online_control.ur.ur5 import UR5
from scriptcontext import sticky as st

if model == "UR5":
    robot = UR5()
elif model == "UR10":
    robot = UR10()

if tool:
    robot.set_tool(tool)
if base_frame:
    robot.set_base(base_frame)

st["robot"] = robot
# ---------- end robot ----------

panel_10 = Panel(move_2.Geometry)

list_11 = ValueList({"Forward_Run_Scan": 0, "Inverse_Run_Scan": 1}, selected="Forward_Run_Scan")
py_3 = GhPythonScript()  # -> ply_source
# ---------- py_3: Python ----------
import os
import sys

filepath = ghenv.Component.Attributes.Owner.OnPingDocument().FilePath
path = os.path.abspath(os.path.join(filepath, "..", "..","data"))
print(path)

ply_source = os.path.abspath(os.path.join(path, "realsense/depthscan"))
# ---------- end py_3 ----------
# Scan, Merge, Load
panel_11 = Panel(py_3)
send_to_scan_pos = Button()
value_list = ValueList({"Depthscan": "RS_D455", "LiDAR": "RS_L515"}, selected="LiDAR")
start_proxy = BooleanToggle(True)
activate = BooleanToggle(True)
merge_2 = Button()
scan = Button()
value_list_2 = ValueList({"obj": 0, "ply": 1}, selected="ply")

# ----
# 2a
# In order for the components in this file to work, you need to add the correct folder to your paths in Rhino.
# In Rhino, type "EditPythonScript", go to Tools > Options > Add to search path and add the following folder:
# <path>/compas_slicer/src/grasshopper_visualization'
# Output
panel_12 = Panel("Load Print Points")
# Visualization
number_slider_7 = Slider(1, range=0..100)
py_4 = PythonScript()  # -> path
# ---------- py_4: Python ----------
import sys
import os

ghComp = ghenv.Component
ghDoc = ghComp.OnPingDocument()

# the full path of the gh file
path = ghDoc.FilePath
# the current directory 
path = os.path.abspath(os.path.join(path, ".."))

print path
# ---------- end py_4 ----------
panel_13 = Panel(wait_times)
filter_2 = StreamFilter(Gate=list, Stream0=velocities, Stream1=wait_times, Stream2=blend_radiuses, Stream3=extruder_toggles)
num = Number(filter_2)

# ----
# Load Slicer
panel_14 = Panel("slicer_data.json")
csloadslicer = CsLoadSlicer(recompute=Button(), json_name=panel_14, path=py_4, folder_name=data)  # -> out, mesh, paths, are_closed, all_points; inputs recompute: Boolean
# ---------- csloadslicer: Python ----------
"""
Loads a Slicer class from its json file in the 'output' folder.

"""

import compas_slicer_ghpython.visualization as gh_compas_slicer
gh_compas_slicer = reload(gh_compas_slicer)


if path and folder_name and json_name:
    mesh, paths, are_closed, all_points = gh_compas_slicer.load_slicer(path, folder_name, json_name)
    
else:
    gh_compas_slicer.missing_input()
# ---------- end csloadslicer ----------

# ----
# Load Printpoints
panel_15 = Panel("out_printpoints.json")
csloadprintpoints = CsLoadPrintpoints(recompute=Button(), json_name=panel_15, path=py_4, folder_name=data)  # -> out, geometry, points, frames, layer_heights, up_vectors, mesh_normals, closest_support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; inputs recompute: Boolean
# ---------- csloadprintpoints: Python ----------
"""
Loads a dictionaly of Printpoints from a json file in the 'output' folder.

"""

import compas_slicer_ghpython.visualization as gh_compas_slicer
gh_compas_slicer = reload(gh_compas_slicer)


if path and folder_name and json_name:
    points, frames, layer_heights, up_vectors, mesh_normals, closest_support, velocities, wait_times, \
    blend_radiuses, extruder_toggles = \
        gh_compas_slicer.load_printpoints(path, folder_name, json_name)
    
else:
    gh_compas_slicer.missing_input()
# ---------- end csloadprintpoints ----------

points = Point(geo_6)
layer_heights = Number(csloadprintpoints.layer_heights)
up_vectors = Vector(csloadprintpoints.up_vectors)
mesh_normals = Vector(csloadprintpoints.mesh_normals)
cpts = Point(csloadprintpoints.closest_support)
frames = Plane(csloadprintpoints.frames)

mesh_normals_2 = Vector(mesh_normals)
points_2 = Point(points)
section = Curve(rectangle.Rectangle)

# ----
# Render Path Visualization
toggle = BooleanToggle(False)
extruder_toggles_2 = Number(extruder_toggles)
layer_heights_2 = Number(layer_heights)
up_vectors_2 = Vector(up_vectors)
python = CsRenderPathViz(
    points=points_2,
    mesh_normals=mesh_normals_2,
    layer_heights=layer_heights_2,
    up_vectors=up_vectors_2,
    extruder_toggles=extruder_toggles_2,
    cross_section=section,
    planar_printing=Toggle(True),
    compute=toggle)  # -> out, loft_surfaces, travel_path_lines; inputs points: list of Point3d, mesh_normals: list of Vector3d, layer_heights: list, up_vectors: list of Vector3d, extruder_toggles: list of Boolean, cross_section: Curve, planar_printing: Boolean, compute: Boolean
# ---------- python: Python ----------
"""
Creates a render visualization of the print paths with loft surfaces where extruder_toggle=True.
For large number of points, this can take a while to compute, so keep it turned off unless you need it.
Loads files from the 'output' folder.

"""

import compas_slicer_ghpython.visualization as gh_compas_slicer
gh_compas_slicer = reload(gh_compas_slicer)

pipe_resolution = 14

if points and mesh_normals and layer_heights and extruder_toggles and cross_section:
    if compute:
        loft_surfaces, travel_path_lines = \
            gh_compas_slicer.render_path_visualization(points, mesh_normals, layer_heights, up_vectors, extruder_toggles, cross_section, planar_printing)
    else:
        print('Compute is set to False')
else:
    gh_compas_slicer.missing_input()
# ---------- end python ----------

mesh = Mesh(csloadslicer.mesh)
all_points = Point(csloadslicer.all_points)
paths = Curve(csloadslicer.paths)

# ---- group: Color output
geo_8 = Geometry(python.travel_path_lines)
geo_9 = Geometry(python.loft_surfaces)
preview_2 = CustomPreview(Geometry=geo_9, Material=ColourSwatch(SwatchColor=RGB(222, 222, 222)))
preview_3 = CustomPreview(Geometry=geo_8, Material=ColourSwatch(SwatchColor=RGB(255, 156, 36)))

# ---- group: Visualize parameter with color
bnd = Bounds(Numbers=num)
avr = Average(Input=num)
dedomain = DeconstructDomain(Domain=bnd)  # -> Start, End
average = Panel(avr)
gradient = Gradient(
    LowerLimit=dedomain.Start,
    UpperLimit=dedomain.End,
    Parameter=num,
    stops=[0: RGB(0, 128, 0), 0.5: RGB(255, 255, 0), 1: RGB(255, 0, 0)])
pt_2 = Point(points)
cloud = CloudDisplay(Points=pt_2, Colours=gradient, Size=Slider(3.96, range=0..10), SpriteType=0)

# ---- group: Visualize parameter with text
tag_offset = Slider(1, range=0..100)
pdecon = Deconstruct(Point=points)  # -> XComponent, YComponent, ZComponent
addition_2 = Addition(A=pdecon.ZComponent, B=tag_offset)
pt_3 = ConstructPoint(XCoordinate=pdecon.XComponent, YCoordinate=pdecon.YComponent, ZCoordinate=addition_2)
tag = TextTag(Location=pt_3, Text=num, Colour=ColourSwatch(SwatchColor=RGB(50, 130, 186)))

# ---- group: Slicer data
len = Length(Curve=flatten(paths))
lng_2 = ListLength(List=flatten(paths))
ma = MassAddition(Input=len)  # -> Result, PartialResults
total_path_length = Panel(ma.Result)
total_number_of_paths = Panel(lng_2)

# ----
# Load Single File
# To start the proxy server:
# - Start Ananconda Promt (as admin)
# - Run:
# from compas.rpc import Proxy
# p = Proxy()
py_5 = GhPythonScript()  # -> ply_source
# ---------- py_5: Python ----------
import os
import sys

filepath = ghenv.Component.Attributes.Owner.OnPingDocument().FilePath
path = os.path.abspath(os.path.join(filepath, "..", "..", "data"))
print(path)

ply_source = os.path.abspath(os.path.join(path, "realsense/depthscan"))
# ---------- end py_5 ----------
panel_16 = Panel(py_5)
type = ValueList({"mesh", "point cloud": "pointcloud"}, selected="mesh")
start_proxy_2 = BooleanToggle(False)
activate_2 = BooleanToggle(False)
export = BooleanToggle(False)
path = PythonScript(path=panel_16, filename="test_file_2.ply")  # -> data
# ---------- path: Python ----------
import os

data = os.path.join(os.path.abspath(path), filename)
print(data)
# ---------- end path ----------
export_ply = GhPythonScript(activate=activate_2, start_proxy=start_proxy_2, export=export, path=panel_16, type=type)
# ---------- export_ply: Python ----------
from compas_ghpython import unload_modules
unload_modules('robotic_plaster_spraying.depthscan')
import robotic_plaster_spraying
from compas.rpc import Proxy
import os

filename = os.path.join(os.path.abspath(path), 'scan.ply')
print filename

if activate:
    if start_proxy:
        depthscan = Proxy('robotic_plaster_spraying.depthscan')
    else:
        Proxy.stop_server(depthscan)
    if export:
        if type == "mesh":
            filename = os.path.join(os.path.abspath(path), 'scan.ply')
            depthscan.export(filename, mesh=True, pc=False)
        if type == "pointcloud":
            filename = os.path.join(os.path.abspath(path), 'pc.ply')
            depthscan.export(filename, mesh=False, pc=True)


print(filename)
# ---------- end export_ply ----------

# ----
# Ligthweight Path Visualization
number_slider_8 = Slider(4, range=0..10)
number_slider_9 = Slider(0, range=0..100)
extruder_toggles_3 = Number(extruder_toggles)

# ---- group: Polyline toolpath
dom = ConstructDomain(DomainStart=number_slider_9, DomainEnd=Slider(204, range=0..2000))
subset = SubList(List=points, Domain=dom, Wrap=True)  # -> List, Index
pline = PolyLine(Vertices=subset.List, Closed=False)

# ----
number_slider_10 = Slider(17.5, range=0..50)
number_slider_11 = Slider(-0.25, range=-2..100)

# ----
# Tool Visualization
number_slider_12 = Slider(7, range=0..2000)
tool_origin = Panel("""0
0
99.507""")

tool_mesh = Mesh(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)

number_of_scans = Slider(4, range=0..10)
height_of_scans = Slider(800, range=0..1000)
radius_of_scans = Slider(200, range=0..1000)
angle_of_scans = Slider(15, range=0..90)

pt_4 = Point()
pt_5 = Point(<point referenced from the Rhino model>)
pt_6 = Point(<point referenced from the Rhino model>)

panel_17 = Panel(csloadprintpoints.out)
panel_18 = Panel(csloadslicer.out)
vdis = VectorDisplay(Anchor=points, Vector=expr("x*5", up_vectors))
pline_2 = PolyLine(Vertices=points, Closed=False)
min = Panel(dedomain.Start)
max = Panel(dedomain.End)

export_obj = GhPythonScript(export=Button(), mesh=mjoin, ObjName="20210706_test.obj")  # -> out, a; inputs mesh: Mesh
# ---------- export_obj: Python ----------
import os
import sys
import compas_rhino
from compas_rhino.geometry import RhinoMesh
import Rhino.Geometry as rg 


filepath = ghenv.Component.Attributes.Owner.OnPingDocument().FilePath

#path is the main stream save .obj in the "data" folder for slicing

path = os.path.abspath(os.path.join(filepath, "..","data","3D_for_4D.obj"))

#path_storage is the main second saver to .obj in the "obj" folder for documentation
#change ObjName in the panel to not overwrite your archives .obj

path_storage = os.path.abspath(os.path.join(filepath, "..", "..","data","obj",ObjName))


print (path_storage)
HERE = os.path.join(os.path.abspath(path)) 
HERE_storage = os.path.join(os.path.abspath(path_storage))

#######


if export:
    print(HERE)
    c_mesh = RhinoMesh.from_geometry(mesh).to_compas()
    c_mesh.to_obj(HERE, None, True)
    c_mesh.to_obj(HERE_storage, None, True)
# ---------- end export_obj ----------

# ---- group: Re-orient points
bbox = BoundingBox(Content=points, Plane=PlaneXY(0, 0, 0), UnionBox=True)  # -> Box, Box_2
debrep = DeconstructBrep(Brep=bbox.Box)  # -> Faces, Edges, Vertices
item_2 = ListItem(List=debrep.Vertices, Index=0, Wrap=True)  # -> Item, Item1, Item2, Item3
avr_2 = Average(Input=[item_2.Item, item_2.Item1, item_2.Item2, item_2.Item3])

# ---- group: safe_pt
pt_7 = Point(<point referenced from the Rhino model>)
xy = XYPlane(Origin=pt_7)
rotate = Rotate(Geometry=xy, Angle=degrees("5"), Plane=xy)  # -> Geometry, Transform
preview_4 = CustomPreview(Geometry=rotate.Geometry, Material=ColourSwatch(SwatchColor=RGB(159, 55, 196)))

# ----
number_slider_13 = Slider(200, range=0..1000)
list_12 = ValueList({"Mini_print": 0, "Big_print": 1}, selected="Big_print")
Z_2 = UnitZ(Factor=Slider(1, range=-20..1))

# ---- group: print_safety
cluster_2 = Cluster()

# ---- group: print_safety / safe_zone
crv_3 = Curve(cluster_2)

# ----
area_2 = Area(Geometry=crv_3)  # -> Area, Centroid
print_bed = PrintBed(F=number_slider_2, G=area_2.Centroid, X=Slider(1200, range=0..1200))  # -> G_2, M
cluster_3 = Cluster_2(B=print_bed.G_2)

# ---- group: Use this for closed curves, will close end points for prints
center_scale_divide = CenterScaleDivide(G=ext, C=print_bed.G_2, A=area.Centroid, F=Slider(425, range=0..1000), N=multiplication)  # -> G_2, pt_3

# ----
pt_8 = Point(center_scale_divide.pt_3)
geo_10 = Geometry(center_scale_divide.G_2)
move_3 = Move(Geometry=pt_8, Motion=Vector(0, 0, 10))  # -> Geometry, Transform

pt_9 = Point(print_bed.G_2)

scan_positions = Scan_positions(
    P=pt_9,
    R=radius_of_scans,
    F=height_of_scans,
    N=number_of_scans,
    A=angle_of_scans,
    G=list_10,
    pt=tools.pt_9,
    pln=tools.pln_2,
    D=Slider(20, range=0..100))  # -> wait_times_list_2, pln_7, vec_4

crv_4 = Curve(print_bed.M)
boxrec = BoxRectangle(Rectangle=crv_4, Height=Slider(500, range=0..1000))

# ---- group: SCAN WAIT TIMES
wait_time_list = Data(flatten(scan_positions.wait_times_list_2))

# ---- group: INPUT PLANES
pln = Plane(scan_positions.pln_7)

# ----
center = Center(crv=cluster.crv_2, center=pt_9)
crv_5 = Curve(reparameterize(center))
divide = DivideCurve(Curve=crv_5, Count=Slider(50, range=0..100), Kinks=False)  # -> Points, Tangents, Parameters
offset_z_height = OffsetZ_height(L=divide.Points, B=Slider(20, range=0..100))  # -> pt_3, X, Y, data_2, R
panel_19 = Panel(offset_z_height.pt_3)
python_2 = GhPythonScript(
    input_planes=panel_19,
    x=offset_z_height.X,
    y=offset_z_height.Y,
    z=offset_z_height.R,
    extruder_toggle_list=offset_z_height.data_2)  # -> out, a, b; inputs input_planes: list, x: list, y: list, z: list, extruder_toggle_list: list
# ---------- python_2: Python ----------
__author__ = "hjame"
__version__ = "2021.03.10"

import rhinoscriptsyntax as rs
import Rhino.Geometry as rg
import Rhino.DocObjects 
import Rhino.Input


#center is the origin of the new plane
#z_height is how much you want to move it above the print
ip_new = []
etl_new = []
i=0
rs.CreatePoint(1.0,2.0,3.0)
#ip_new.append(rs.PointCoordinates(input_points[i],2.0,2.0.3.0)
for i in range(len(extruder_toggle_list)):
    if extruder_toggle_list[i] == 0:
        etl_new.append(0)
        etl_new.append(0)
        #etl_new.append(0)
        #rs.CreatePoint(input_points[i[0]])
        ip_new.append(input_planes[i])
        ip_new.append(rs.CreatePoint(x[i], y[i], z[i]))
        #ip_new.append(rs.CreatePoint(x[i+1],y[i+1],z[i]))
        
        
#        ip_new.append(rs.CreatePoint(input_planes.[i[0]],input_planes.[i[1]],input_planes.[i[2]]+10))
    else:
        etl_new.append(1)
        ip_new.append(input_planes[i])

#    
#    if extruder_toggle_list[i] == 0:
#        extruder_toggle
#            extruder_toggle_list.insert(i+1,0)
#            old_plane = input_planes[i]
#            center = old_plane.origin
#            center[2] += z_height
#            plane = rs.PlaneFromNormal(center , old_plane.Zaxis)
#            input_planes.insert(i+1,plane)
#            
#            i = i+1
#    
a = ip_new
b = etl_new
 

        
    # insert 0 in extruder_toggle_list in the next index
    #add a point in the same index position to input_planes @ "set z value above, same x,y"
    #something like list.insert(index.object)
    # do this for every 0 in extruder toggle list
    #check if extruder_toggle_list and input_planes are the same length
# ---------- end python_2 ----------
pt_10 = Point(python_2.a)
tag_2 = TextTag3D(
    Location=python_2.a,
    Text=python_2.b,
    Size=number_slider_6,
    Colour=ColourSwatch(SwatchColor=RGB(51, 245, 238)),
    Justification=7)
points_3 = PointList(Points=pt_10, Size=number_slider_6)

orient = Orient(Geometry=points, Source=avr_2, Target=print_bed.G_2)  # -> Geometry, Transform
frames_2 = Plane(orient.Geometry)
flippln = FlipPlane(Plane=frames_2, FlipX=False, FlipY=False, FlipZ=True)  # -> Flipped, R

print_planes = Plane(flippln.Flipped)

cstoolviz = CsToolViz(origin_coords=tool_origin, mesh=tool_mesh, planes=print_planes, index=number_slider_12)  # -> out, mesh, passed_path; inputs origin_coords: list, mesh: Mesh, planes: list, index: Int32
# ---------- cstoolviz: Python ----------
"""
Example visualization of tool motion during the print.

"""

import compas_slicer_ghpython.visualization as gh_compas_slicer
gh_compas_slicer = reload(gh_compas_slicer)

if origin_coords and mesh and planes and (index or index==0):
    mesh, passed_path = gh_compas_slicer.tool_visualization(origin_coords, mesh, planes, index)
else:
    gh_compas_slicer.missing_input()
# ---------- end cstoolviz ----------

mesh_2 = Mesh(cstoolviz.mesh)
geo_11 = Geometry(cstoolviz.passed_path)
preview_5 = CustomPreview(Geometry=mesh_2, Material=ColourSwatch(SwatchColor=RGB(171, 171, 171)))
preview_6 = CustomPreview(Geometry=geo_11, Material=ColourSwatch(SwatchColor=RGB(255, 156, 36)))

# ---- group: Re-orient points (continued)
orient_2 = Orient(Geometry=points, Source=avr_2, Target=print_bed.G_2)  # -> Geometry, Transform
pt_11 = Point(orient_2.Geometry)

# ----
all_points_2 = Point(pt_11)
cslightpathviz = CsLightPathViz(
    points=all_points_2,
    extruder_toggles=extruder_toggles_3,
    domain_start=number_slider_9,
    domain_end=number_slider_7,
    pipe_diameter=number_slider_8)  # -> out, print_path_pipes, travel_path_lines; inputs points: list of Point3d, extruder_toggles: list of Boolean, domain_start: Int32, domain_end: Int32
# ---------- cslightpathviz: Python ----------
"""
Creates a lightweight visualization of the print paths. Segments with extruder_toggle=True are visualized as pipes, 
segments with extruder_toggle=False are visualized as lines.
Loads files from the 'output' folder.

"""

import compas_slicer_ghpython.visualization as gh_compas_slicer
gh_compas_slicer = reload(gh_compas_slicer)

pipe_resolution = 14

if points:
    
    # assign default values to parameters where possible. 
    if not extruder_toggles:
        extruder_toggles = [False for i in range(len(points))]
    if not domain_start:
        domain_start = 0
    if not domain_end:
        domain_end = len(points)
    if not pipe_diameter:
        pipe_diameter = 2.0
        
    print_path_pipes, travel_path_lines = \
        gh_compas_slicer.lightweight_path_visualization(points, extruder_toggles, domain_start, domain_end, pipe_diameter, pipe_resolution)
    
else:
    gh_compas_slicer.missing_input()
# ---------- end cslightpathviz ----------

# ---- group: Color output
geo_12 = Geometry(cslightpathviz.travel_path_lines)
geo_13 = Geometry(cslightpathviz.print_path_pipes)
preview_7 = CustomPreview(Geometry=geo_12, Material=ColourSwatch(SwatchColor=RGB(255, 156, 36)))
preview_8 = CustomPreview(Geometry=geo_13, Material=ColourSwatch(SwatchColor=RGB(199, 199, 199)))

# ----
mini_print_bounding_area = Mini_print_bounding_area(G=list_12, C=crv_3, P=pt_9, X=number_slider_13, Y=number_slider_13)  # -> _0_0_0_0_0, _0_0_0_0_1, _0_0_0_0_2, _0_0_0_0_3, G_2, crv_2
crv_6 = Curve(mini_print_bounding_area.crv_2)
boundary = BoundarySurfaces(Edges=crv_6)
extr = Extrude(Base=boundary, Direction=Z_2)
preview_9 = CustomPreview(Geometry=extr, Material=ColourSwatch(SwatchColor=RGB(186, 186, 186)))

# ---- group: print_safety (continued)
incurve = PointInCurve(Point=move_3.Geometry, Curve=crv_3)  # -> Relationship, Point
python_3 = GhPythonScript(x=incurve.Relationship)  # -> out; inputs x: list
# ---------- python_3: Python ----------
__author__ = "hjame"
__version__ = "2021.05.10"

import rhinoscriptsyntax as rs

count = x.count(0)
if count >= 1:
    print ('Do Not Print')

else:
    print ('Safe Print')
# ---------- end python_3 ----------
txt = Text(flatten(python_3))
panel_20 = Panel(txt)

# ---- group: print_pt visualization
xy_2 = XYPlane(Origin=pt_9)
preview_10 = CustomPreview(Geometry=xy_2, Material=ColourSwatch(SwatchColor=RGB(235, 204, 30)))

# ----
rev = Reverse(Vector=scan_positions.vec_4)
data_2 = Data(pln)
data_3 = Data(rev)
python_4 = GhPythonScript(mode=list_11, scan_pos=data_2, vector=data_3)  # -> out, planes, t_matrix, t_planes, t_matrix_depth, t_planes_depth; inputs scan_pos: list, vector: list
# ---------- python_4: Python ----------
__author__ = "hjame"
__version__ = "2021.05.31"

import rhinoscriptsyntax as rs
import compas_rhino
from compas.geometry import Frame, Vector, Point
from compas_ghpython import draw_frame
from compas.geometry import Rotation
from compas.geometry import Plane
from compas.geometry import Translation
from compas.geometry import matrix_from_frame
from compas_rhino.geometry import RhinoPlane

import Rhino.Geometry as rg
import math as m


planes = []
t_matrix = []
t_planes = []
t_matrix_depth = []
t_planes_depth = []

if mode == 0:
    
    planes = []
    t_matrix = []
    t_planes = []
    lidar_transform = []
    
    t_matrix_depth = []
    t_planes_depth = []
    



    for i in range(len(scan_pos)):
        
        lidar_transform = Translation.from_vector(vector[i])
        #print(lidar_transform)
        frame = RhinoPlane.from_geometry(scan_pos[i]).to_compas()
        lidar_pos = frame.transformed(lidar_transform)
    
        planes.append(draw_frame(lidar_pos))
    
        t_frame = Frame(frame.point, frame.xaxis, frame.yaxis)
        t_matrix.append(matrix_from_frame(t_frame))
        t_planes.append(draw_frame(t_frame))
        
        t_frame_depth = Frame(frame.point, frame.yaxis, frame.xaxis*-1)
        t_matrix_depth.append(matrix_from_frame(t_frame_depth))
        t_planes_depth.append(draw_frame(t_frame_depth))
        
#        
#        frame = Frame(frame.point, frame.yaxis*-1, frame.normal*-1)
#        planes.append(draw_frame(frame))
    print ('%d Scan pos' % len(planes))

        
        



if mode == 1:
    
    planes = []
    t_matrix = []
    t_planes = []
    
    for i in range(len(scan_pos)):
        
        lidar_transform = Translation.from_vector(vector[i])
        #print(lidar_transform)
        frame = RhinoPlane.from_geometry(scan_pos[i]).to_compas()
    
        planes.append(draw_frame(frame))
    
        t_frame = Frame(frame.point, frame.xaxis, frame.yaxis)
        t_matrix.append(matrix_from_frame(t_frame))
        t_planes.append(draw_frame(t_frame))
#        
#        frame = Frame(frame.point, frame.yaxis*-1, frame.normal*-1)
#        planes.append(draw_frame(frame))
    print ('%d Scan pos' % len(planes))
# ---------- end python_4 ----------
pln_2 = Plane(python_4.planes)
pln_3 = Plane(python_4.t_planes_depth)
pln_4 = Plane(python_4.t_planes)
lastdex = LastIndex(List=pln_2)
export_ply_2 = GhPythonScript(
    activate=activate,
    start_proxy=start_proxy,
    path=panel_11,
    type=value_list_2,
    camera=value_list,
    targets=python_4.planes,
    t_matrix=python_4.t_matrix,
    index=Slider(3, range=0..8),
    scan_pos=send_to_scan_pos,
    scan=scan,
    merge_PLY=merge_2,
    load_mesh=Toggle(False))  # -> out, mesh; inputs type: Int32, targets: list of Plane, t_matrix: list, index: Int32, load_mesh: Boolean
# ---------- export_ply_2: Python ----------
import os, time
import math as m
import scriptcontext as sc
import Rhino.Geometry as rg
import rhinoscriptsyntax as rs

from compas_ghpython import unload_modules
unload_modules('robotic_plaster_spraying.depthscan')
from compas.rpc import Proxy

#import comm
#import ur_standard 
#reload(comm)
#reload(ur_standard)

from compas.datastructures import Mesh
from compas_ghpython.artists import MeshArtist
from compas.geometry import Frame
from compas.files import PLY
from compas.files import PLYReader

def load_obj(path):
    file = open(path)
    lines = file.readlines()
    v_ID = 0
    Ft
    mesh = rg.Mesh()
    for line in lines:
        if line.find("v")==0 and line.find("n")==-1:
            #print line.split(' ')
            mesh.Vertices.Add(rg.Point3d(float((line.split(' '))[1]),float((line.split(' '))[2]),float((line.split(' '))[3])))
            mesh.VertexColors.SetColor(v_ID, rs.CreateColor(float((line.split(' '))[4])*255, float((line.split(' '))[5])*255, float((line.split(' '))[6])*255))
            v_ID += 1
        if line.find("vn")==0:
            mesh.Normals.Add(rg.Vector3d(float((line.split(' '))[1]),float((line.split(' '))[2]),float((line.split(' '))[3])))
        if line.find("f")==0:
            if line.split(' ').Count==4:
                mesh.Faces.AddFace(int(line.split(' ')[1].split('/')[0])-1, int(line.split(' ')[2].split('/')[0])-1, int(line.split(' ')[3].split('/')[0])-1)
            if line.split(' ').Count==5:
                mesh.Faces.AddFace(int(line.split(' ')[1].split('/')[0])-1, int(line.split(' ')[2].split('/')[0])-1, int(line.split(' ')[3].split('/')[0])-1, int(line.split(' ')[4].split('/')[0])-1)
                
    
    mesh.Faces.ExtractDuplicateFaces()
    mesh.Compact()
    return mesh

#translation_vector = sc.sticky["translation_vector_key"]
#path = os.path.join(sc.sticky["path"], 'data/ply')

### UR constant values ###
scan_sleep = 6
squeeze_valve_IO = 0
#set_tcp = ur_standard.set_tcp_by_angles(64.0, 57.8, 90.85, 
#                                        0.0, 0.0, 0.0)


#set_tcp = ur_standard.set_tcp_by_angles(64.0, 55.10, -4.15,0.0, 0.0, 0.0)

#if camera == "RS_D455":
#    #sets tcp for RealSense D455
#    set_tcp = ur_standard.set_tcp_by_angles(64.0, 55.10, -4.15, 
#                                           0.0, 0.0, 0.0)
#    set_tcp = ur_standard.set_tcp_by_angles(64.0, 59.65, -4.15, 
#                                           0.0, 0.0, 0.0)t
#if camera == "RS_L515":
#    #sets tcp for RealSense L515
#    set_tcp = ur_standard.set_tcp_by_angles(-5.83, 28.15, 110.46, 
#                                           0.0, 0.0, 0.0)


### Scan Poses ###
#pos = [ m.radians(35), 
#        m.radians(-35), 
#        m.radians(125), 
#        m.radians(90), 
#        m.radians(-90),
#        m.radians(0)]
#
#s_pos = [ m.radians(-10),
#    m.radians(-105),
#    m.radians(165),
#    m.radians(120),
#    m.radians(-80),
#    m.radians(0)]


### Initialize UR script ###
#script = ""
#script += set_tcp
#script += ur_standard.set_digital_out(squeeze_valve_IO, True)

if type == 0:
    build_mesh_bool = True
elif type == 1:
    build_mesh_bool = False

if activate:
    if start_proxy:
        depthscan = Proxy('robotic_plaster_spraying.depthscan')
    else:
        Proxy.stop_server(depthscan)
#    if scan_pos :
#        script += ur_standard.move_j(s_pos, 0.1, 0.5)
#        script = comm.concatenate_script(script)
#        comm.send_script(script, 1)
    
    if scan:
#        if type(targets[0]) == rg.Plane:
#            print("ok")
#            script += ur_standard.move_l(targets[index], 1.5, 1.5)
#        else:
#            script += ur_standard.move_j(targets[index], 1.5, 1.5)
#        script += ur_standard.move_l(targets[index], 1.5, 1.5)
#        script = comm.concatenate_script(script)
#        comm.send_script(script, 1)
#        time.sleep(3.0)
        print (camera)
        filename = os.path.join(os.path.abspath(path), 'auto_pc_%d.ply' % index)
        depthscan.export(filename, mesh=False, pc=True)
    if merge_PLY:
        depthscan.ICP_registration(path, t_matrix, build_mesh = build_mesh_bool)


if build_mesh_bool:
    if load_mesh:
        data = os.path.join(path, 'ICP_final_mesh.obj')
        mesh = load_obj(data)
else:
    if load_mesh:
        data = os.path.join(path, 'ICP_final.ply')
        print(data)
        scanned_surface = Mesh.from_ply(data)
        artist = MeshArtist(scanned_surface)
        mesh = artist.draw()
#        ply_artist = PLYReader.read_vertices(data)
#        points = ply_artist.draw()
# ---------- end export_ply_2 ----------
item_3 = ListItem(List=pln_3, Index=lastdex, Wrap=True)
bbox_mesh = Mesh(boxrec)

# ---- group: Send_Mesh
dam = DataDam(DataA=export_ply_2.mesh, BufferDelay=10000000, BufferMode=0)

# ----
mesh_3 = Mesh(dam)
process_mesh = Process_mesh(pt=Point(-381, 88, 402), G=mesh_3, pln=item_3)  # -> M, G_4, G_2, G_3
gate = StreamGate(Stream=dam, Gate=value_list_2)  # -> Target0, Target1

cluster_4 = Cluster_4(P=pln, vec=pln, P_2=pln_2, vec_4=pln_2)  # -> geo_4, geo_2
preview_11 = CustomPreview(Geometry=cluster_4.geo_4, Material=ColourSwatch(SwatchColor=RGBA(255, 0, 0, 80)))
preview_12 = CustomPreview(Geometry=cluster_4.geo_2, Material=ColourSwatch(SwatchColor=RGBA(79, 85, 255, 161)))

dam_2 = DataDam(
    DataPoints=pt_11,
    DataVelocities=velocities,
    DataBlend_radiuses=blend_radiuses,
    DataExtruder_toggles=extruder_toggles,
    DataWait_time=wait_times,
    BufferDelay=10000000,
    BufferMode=0)  # -> DataPoints, DataVelocities, DataBlend_radiuses, DataExtruder_toggles, DataWait_time

# ---- group: INPUT PLANES
xy_3 = XYPlane(Origin=flatten(dam_2.DataPoints))

# ---- group: FILLET LIST
num_2 = Number(flatten(dam_2.DataBlend_radiuses))

# ---- group: WAIT TIME LIST
data_4 = Data(flatten(dam_2.DataWait_time))

# ---- group: EXTRUDER TOGGLE LIST
data_5 = Data(flatten(dam_2.DataExtruder_toggles))

# ---- group: SPEED LIST
num_3 = Number(flatten(dam_2.DataVelocities))

# ----
rotate_2 = Rotate(Geometry=xy_3, Angle=degrees("5"), Plane=xy_3)  # -> Geometry, Transform
dam_3 = DataDam(
    DataInput_planes=rotate_2.Geometry,
    DataSpeed_list=num_3,
    DataFillet_list=num_2,
    DataExtruder_toggle_list=data_5,
    DataWait_time_list=data_4,
    BufferDelay=10000000,
    BufferMode=0)  # -> DataInput_planes, DataSpeed_list, DataFillet_list, DataExtruder_toggle_list, DataWait_time_list

partition = PartitionList(List=dam_3.DataExtruder_toggle_list, Size=Slider(8, range=0..10))
panel_21 = Panel(partition)
deplane = DeconstructPlane(Plane=dam_3.DataInput_planes)  # -> Origin, XAxis, YAxis, ZAxis
vdis_2 = VectorDisplay(Anchor=deplane.Origin, Vector=deplane.ZAxis)

# ---- group: extruder_toggle
python_5 = GhPythonScript(
    input_planes=dam_3.DataInput_planes,
    extruder_switch=list_2,
    extruder_input_list=dam_3.DataExtruder_toggle_list,
    move_safe_pt=move_safe_pt)  # -> out, extruder_toggle_list; inputs input_planes: list, extruder_input_list: list
# ---------- python_5: Python ----------
__author__ = "dfab"
__version__ = "2020.02.12"

no_of_planes = len(input_planes)
print no_of_planes
print len(extruder_input_list)
extruder_toggle_list = []



if extruder_switch == "extruder_on":
    extruder = True
    if move_safe_pt:
        extruder_toggle_list.append(True)
    # append only True to extrusion toggle list
    for i in range(no_of_planes):
        if i == no_of_planes-1:
            # APPEND FALSE FOR LAST PLANE
            extruder_toggle_list.append(False)
        else:
            extruder_toggle_list.append(True)
    if move_safe_pt:
        extruder_toggle_list.append(False)

elif extruder_switch == "extruder_off":
    extruder = False
    if move_safe_pt:
        extruder_toggle_list.append(False)
    # append only False to extrusion toggle list
    for i in range(no_of_planes):
        extruder_toggle_list.append(False)
    if move_safe_pt:
        extruder_toggle_list.append(False)

elif extruder_switch == "variable_extrusion":
    extruder = "variable_extrusion"
    if move_safe_pt:
        extruder_toggle_list.append(True)
    # use variable extrusion list
    # check if lists have same length
    if no_of_planes == len(extruder_input_list):
        print "OK"
        # use user-generated extrusion toggle list
        for i in range(no_of_planes):
            extruder_toggle_list.append(extruder_input_list[i])
        if move_safe_pt:
            extruder_toggle_list.append(False)
    else:
        raise NameError("Extrusion toggle list not matching planes_WCS")

else:
    raise NameError("Unknown error")
# ---------- end python_5 ----------

# ---- group: wait_time
python_6 = GhPythonScript(
    input_planes=dam_3.DataInput_planes,
    move_safe_pt=move_safe_pt,
    use_wait_time=use_wait_time,
    t_list=dam_3.DataWait_time_list,
    safe_wait_time=safe_wait_time_sec)  # -> wait_time_list; inputs input_planes: list, t_list: list
# ---------- python_6: Python ----------
__author__ = "dfab"
__version__ = "2020.12.21"

wait_time_list = []

if use_wait_time:
    if len(t_list) == len(input_planes):
        if move_safe_pt:
            # append a wait_time for the first point
            wait_time_list.append(safe_wait_time)
        
        for time in t_list:
            if time == None:
                wait_time_list.append(0.0)
            else:
                wait_time_list.append(time)
        
        if move_safe_pt:
            # append a wait_time for the last point
            wait_time_list.append(0.0)
    else:
        raise NameError("Wait time list not matching planes_WCS")

else:
    if move_safe_pt:
        wait_time_list.append(safe_wait_time)
    for i in range(len(input_planes)):
        wait_time_list.append(0.0)
    if move_safe_pt:
        wait_time_list.append(0.0)
# ---------- end python_6 ----------

# ----
cull_i = CullIndex(List=python_6, Indices=Slider(0, range=0..100), Wrap=True)

# ---- group: View_Wait_times
number_slider_14 = Slider(4, range=0..10)
points_4 = PointList(Points=dam_3.DataInput_planes, Size=number_slider_14)
tag_3 = TextTag3D(
    Location=dam_3.DataInput_planes,
    Text=cull_i,
    Size=number_slider_14,
    Colour=ColourSwatch(SwatchColor=RGB(51, 245, 238)),
    Justification=7)

# ---- group: Custom preview
pt_12 = Point(dam_3.DataInput_planes)

# ----
# 2b
panel_22 = Panel("PRINTING PARAMETERS")
pline_3 = PolyLine(Vertices=pt_12, Closed=False)

# ---- group: Custom preview (continued)
preview_13 = CustomPreview(Geometry=pline_3, Material=ColourSwatch(SwatchColor=RGB(30, 128, 199)))

# ----
pdecon_2 = Deconstruct(Point=pt_12)  # -> XComponent, YComponent, ZComponent
python_7 = GhPythonScript(jog_speed=jog_speed_mm_s, print_speed=speed_mm_s, height_list=pdecon_2.ZComponent, jog_height=Slider(9.9, range=0..9.9))  # -> out, speed_list; inputs height_list: list
# ---------- python_7: Python ----------
__author__ = "hjame"
__version__ = "2021.07.11"

import rhinoscriptsyntax as rs

speed_list = []

print(min(height_list)+jog_height)

for i in range(len(height_list)):
    if height_list[i] > (min(height_list)+jog_height):
        speed_list.append(jog_speed)
    else:
        speed_list.append(print_speed)
# ---------- end python_7 ----------

# ---- group: commands
pln_5 = Plane(flatten(dam_3.DataInput_planes))
python_8 = PythonScript(
    planes_WCS=pln_5,
    use_variable_fillet=use_variable_fillet,
    dfillet=dfillet_mm,
    fillet_list=dam_3.DataFillet_list,
    use_variable_speed=use_variable_speed,
    speed=speed_mm_s,
    speed_list=python_7.speed_list,
    safe_pt=rotate.Geometry,
    move_safe_pt=move_safe_pt)  # -> commands; inputs planes_WCS: list of Plane, fillet_list: list, speed: Int32, speed_list: list, safe_pt: Plane
# ---------- python_8: Python ----------
import Rhino.Geometry as rg
from compas.geometry import Frame
from compas.geometry import Transformation
from compas_ghpython import draw_frame
from scriptcontext import sticky as st

robot = st["robot"]
buffer = 0.6

commands = []


### SAFE PT BEGIN ###
if move_safe_pt:
    # add safe_pt as a starting point
    tcp_WCS_safe_pt = Frame(safe_pt.Origin, safe_pt.XAxis, safe_pt.YAxis)
    #print (tcp_WCS_safe_pt)
    tcp_RCS_safe_pt = robot.get_frame_in_RCS(tcp_WCS_safe_pt)
    #print(tcp_RCS_safe_pt)
    cmd_safe_pt = tcp_RCS_safe_pt.point[0:] + tcp_RCS_safe_pt.axis_angle_vector[0:]+ [speed, 0]
    commands.append(cmd_safe_pt)

### PLANES ###
for i, plane_WCS in enumerate(planes_WCS):
    tcp_WCS = Frame(plane_WCS.Origin, plane_WCS.XAxis, plane_WCS.YAxis)
    if i == 0 or i == len(planes_WCS) - 1:
        radius = 0.
        
    else:
        if use_variable_fillet:
            if len(planes_WCS) == len(fillet_list):
                dfillet = fillet_list[i]
            else:
                raise NameError("Fillet list length not matching planes_WCS")
        
        # calculate blend radius
        prev, current, next = planes_WCS[i-1].Origin, planes_WCS[i].Origin, planes_WCS[i+1].Origin
        radius = min((prev - current).Length/2 * buffer, (next - current).Length/2 * buffer, dfillet)
        radius = round(radius,2)
    
    if use_variable_speed:
        if len(planes_WCS) == len(speed_list):
            speed = speed_list[i]
        else:
            raise NameError("Speed list length not matching planes_WCS")
        
    print(radius)
    tcp_RCS = robot.get_frame_in_RCS(tcp_WCS)
    cmd = tcp_RCS.point[0:]+ tcp_RCS.axis_angle_vector[0:]+ [speed, radius]
    commands.append(cmd)
    print(cmd)

### SAFE PT END
if move_safe_pt:
    # add safe_pt as an end point
    commands.append(cmd_safe_pt)
# ---------- end python_8 ----------

# ----
# 2c
# REMEMBER TO RECOMPUTE IF GEOMETRY CHANGED
panel_23 = Panel("commands.json")
panel_24 = Panel("SAVE JSON")
py_6 = PythonScript()  # -> path
# ---------- py_6: Python ----------
import sys
import os

ghComp = ghenv.Component
ghDoc = ghComp.OnPingDocument()

# the full path of the gh file
path = ghDoc.FilePath
# the directory of the gh file
path = os.path.dirname(path)

path = os.path.abspath(os.path.join(path, "..", "..", "..", "eggshell", "ur_online_control"))

print path
# ---------- end py_6 ----------
save_json = Button()
commands = Data(python_8)
send = PythonScript(
    commands=commands,
    move_safe_pt=move_safe_pt,
    extruder_switch=list_2,
    extruder_toggle_list=python_5.extruder_toggle_list,
    use_variable_speed=use_variable_speed,
    use_cooling=use_cooling,
    path=py_6,
    use_variable_fillet=use_variable_fillet,
    safe_wait_time=safe_wait_time_sec,
    use_wait_time=use_wait_time,
    wait_time=python_6,
    robot=robot,
    server_address=server_address,
    server_port=server_port,
    ur_ip=ur_ip,
    save_json=save_json,
    name_json=panel_23,
    saver_json="20210724_test.json")  # -> out; inputs commands: list, move_safe_pt: Boolean, extruder_toggle_list: list, use_cooling: Boolean, use_variable_fillet: Boolean, safe_wait_time: Int32, wait_time: list
# ---------- send: Python ----------
import json
import os
import sys

from eggshell.ur_online_control.communication.msg_identifiers import *
from eggshell.ur_online_control.utilities.lists import flatten_list
from time import sleep

#from scriptcontext import sticky as st

#number of values per command to be formatted 
len_command = len(commands[0])
gh_commands = flatten_list(commands)

no_of_commands = len(gh_commands)/len_command

tool_angle_axis = robot.tool.tcp_frame.point[0:] + robot.tool.tcp_frame.axis_angle_vector[0:]
#to print in gh panel
print int(no_of_commands), "commands"
print "--------------------------"

# information to print
if move_safe_pt:
    print "SAFE POINT:  None"
else:
    print "SAFE POINT:  Yes"

if extruder_switch == "extruder_on":
    print "EXTRUDER: On"
elif extruder_switch == "extruder_off":
    print "EXTRUDER:    Off"
elif extruder_switch == "variable_extrusion":
    print "EXTRUDER:    Variable extrusion"

if use_variable_speed:
    print "PRINT SPEED: Variable speed"
else:
    print "PRINT SPEED: Single value"


if use_variable_fillet:
    print "FILLET:      Variable fillet"
else:
    print "FILLET:      Single value"

if use_wait_time:
    print "WAIT TIME:   Yes"
else:
    print "WAIT TIME:   None"

if use_cooling:
    print "COOLING:     Yes"
else:
    print "COOLING:     No"

print "--------------------------"

data = {}
data['commands'] = {}

for i, cmd in enumerate(commands):
    all_cmds = {}
    single_cmd = {
        'point': [cmd[0], cmd[1], cmd[2]],
        'tcp_rcs': [cmd[3], cmd[4], cmd[5]],
        'speed': cmd[6],
        'radius': cmd[7],
        'extruder_toggle': extruder_toggle_list[i],
        'wait_time': wait_time[i]
        }
    
    data['commands'][i] = single_cmd

data['_parameters'] = {}
data['_parameters']['server_address'] = server_address
data['_parameters']['server_port'] = server_port
data['_parameters']['ur_ip'] = ur_ip
data['_parameters']['tool_angle_axis'] = tool_angle_axis
data['_parameters']['safe_wait_time'] = safe_wait_time
data['_parameters']['len_command'] = len_command
data['_parameters']['use_cooling'] = use_cooling

filepath = ghenv.Component.Attributes.Owner.OnPingDocument().FilePath
path_storage = os.path.abspath(os.path.join(filepath, "..", "..","data","json_print",saver_json))


filename = os.path.join(path, name_json)

filename_storage = os.path.join(os.path.abspath(path_storage))



print(filename)
print(filename_storage)

if save_json:
    with open(filename, 'w') as f:
        f.write(json.dumps(data, indent=3, sort_keys=True))

if save_json:
    with open(filename_storage, 'w') as f:
        f.write(json.dumps(data, indent=3, sort_keys=True))
# ---------- end send ----------
panel_25 = Panel(send)

# ==== cluster Tools
geo = Geometry([<curve referenced from the Rhino model> x2, <brep referenced from the Rhino model> x22, <point referenced from the Rhino model> x2])
geo_2 = Geometry(<point referenced from the Rhino model>)
geo_3 = Geometry([<brep referenced from the Rhino model> x21, <point referenced from the Rhino model> x3])
geo_4 = Geometry(geo_2)
G = ClusterInput()
G_2 = ClusterInput()
pt = Point(geo_4)
clean = CleanTree(RemoveNulls=True, RemoveInvalid=True, RemoveEmpty=False, Tree=pt)
geo_5 = Geometry(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)
number_slider = Slider(0, range=0..1)
pt_2 = Point(clean)
divide = DivideCurve(Curve=geo_5, Count=Slider(3, range=0..10), Kinks=False)  # -> Points, Tangents, Parameters

# ---- group: lidar_tcp
geo_6 = Geometry(divide.Points)
pt_3 = Point(geo_6)
clean_2 = CleanTree(RemoveNulls=True, RemoveInvalid=True, RemoveEmpty=False, Tree=pt_3)
pt_4 = Point(clean_2)
partition = PartitionList(List=pt_4, Size=Slider(1, range=0..1))
bang = ExplodeTree(Data=partition)  # -> Branch0, Branch1, Branch2
vec2pt = Vector2Pt(PointA=bang.Branch2, PointB=bang.Branch0, Unitize=False)  # -> Vector, Length

# ----
brep = Brep([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])
get_lidar_tcp = ClusterInput()
tool_id = ClusterInput()
item = ListItem(List=pt_2, Index=Slider(2, range=0..10), Wrap=True)
pt_5 = Point()

# ---- group: measurement tool
measurement_tool_geo = Geometry([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])
mesh = Mesh(measurement_tool_geo)
mjoin = MeshJoin(Meshes=mesh)
tool = PythonScript(meshes=mjoin, brep=measurement_tool_geo)  # -> tool; inputs meshes: list, brep: list
# ---------- tool: Python ----------
from ur_online_control.ur.tools import MeasurementTool
from compas.datastructures import Mesh
from compas_rhino.helpers import mesh_from_guid


tool = MeasurementTool()
tool.model = [mesh_from_guid(Mesh, mesh) for mesh in meshes]
#tool.model_xyz = tool.model.xyz

tool.brep = brep
# ---------- end tool ----------

# ---- group: extruder
test_geometry = Geometry(brep)
xaxis_line = Curve(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)
yaxis_line = Curve(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)
brep_2 = Brep(test_geometry)
mesh_2 = Mesh(test_geometry)
tool_2 = Tool(meshes=mesh_2, breps=brep_2, xline=xaxis_line, yline=yaxis_line)  # -> tool_2, tcp_lidar_2

# ----
get_lidar_tcp_2 = Data(get_lidar_tcp)
tool_id_2 = Integer(tool_id)
end = EndPoints(Curve=xaxis_line)  # -> Start, End
filter = StreamFilter(Gate=G_2, Stream0=bang.Branch2, Stream1=item)
pt_6 = Point(end.Start)
python = GhPythonScript(guid=mjoin)  # -> out, a
# ---------- python: Python ----------
__author__ = "hjame"
__version__ = "2021.05.27"

import rhinoscriptsyntax as rs
import compas_rhino
from compas_rhino.geometry import RhinoMesh
from eggshell.ur_online_control.ur.
guid = compas_rhino.select_mesh()
mesh = RhinoMesh.from_guid(guid).to_compas()
# ---------- end python ----------
pt_7 = Point(bang.Branch2)
vec2pt_2 = Vector2Pt(PointA=pt_7, PointB=filter, Unitize=False)  # -> Vector, Length
line = LineSDL(Start=pt_7, Direction=vec2pt_2.Vector, Length=vec2pt_2.Length)
number_slider_2 = Slider(0, range=0..360)
line_2 = LineSDL(Start=bang.Branch2, Direction=vec2pt.Vector, Length=vec2pt.Length)
number_slider_3 = Slider(270, range=0..360)
test_geometry_2 = Geometry([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])
filter_2 = StreamFilter(Gate=G_2, Stream0=vec2pt.Vector, Stream1=vec2pt_2.Vector)
filter_3 = StreamFilter(Gate=G_2, Stream0=bang.Branch0, Stream1=item)

# ---- group: inverse_kinematic_lidar
xy = XYPlane(Origin=filter_3)
inverse_kinematic_plane = Plane(xy)
inverse_kinematic_point = Point(bang.Branch2)

# ---- group: forward_kinematic_lidar
xy_2 = XYPlane(Origin=bang.Branch2)
forward_kinematic_point = Point(filter_3)
forward_kinematic_plane = Plane(xy_2)

# ----
panel = Panel(pt_6)
merge = Merge(Data1=inverse_kinematic_point, Data2=inverse_kinematic_plane)  # -> flatten(Result)
merge_2 = Merge(Data1=forward_kinematic_point, Data2=forward_kinematic_plane)  # -> flatten(Result)
shift = ShiftList(List=merge, Shift=1, Wrap=True)  # -> flatten(List)
filter_4 = StreamFilter(Gate=G, Stream0=merge_2, Stream1=shift)
split = SplitList(List=filter_4, Index=Slider(1, range=0..1))  # -> ListA, ListB
pln = Plane(split.ListB)
pt_8 = Point(split.ListA)
vec = Vector(filter_2)
pln_2 = ClusterOutput(pln)
vec_2 = ClusterOutput(vec)
pt_9 = ClusterOutput(pt_8)

# ---- group: alu extruder v2
xaxis_line_2 = Curve(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)
yaxis_line_2 = Curve(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)
rotate = Rotate(Geometry=yaxis_line_2, Angle=degrees(number_slider_3), Plane=PlaneXY(0, 0, 0))  # -> Geometry, Transform
rotate_2 = Rotate(Geometry=xaxis_line_2, Angle=degrees(number_slider_3), Plane=PlaneXY(0, 0, 0))  # -> Geometry, Transform
rotate_3 = Rotate(Geometry=test_geometry_2, Angle=degrees(number_slider_3), Plane=PlaneXY(0, 0, 0))  # -> Geometry, Transform
mesh_3 = Mesh(rotate_3.Geometry)

# ----
end_2 = EndPoints(Curve=rotate.Geometry)  # -> Start, End
brep_3 = Brep(rotate_3.Geometry)
pt_10 = Point(end_2.Start)
rotate_4 = Rotate(Geometry=rotate_2.Geometry, Angle=degrees(number_slider_2), Plane=pt_10)  # -> Geometry, Transform
rotate_5 = Rotate(Geometry=rotate.Geometry, Angle=degrees(number_slider_2), Plane=pt_10)  # -> Geometry, Transform

# ---- group: alu extruder v2 (continued)
tool_3 = Tool(vector=filter_2, meshes=mesh_3, breps=brep_3, xline=rotate_4.Geometry, yline=rotate_5.Geometry)  # -> tool_2, tcp_lidar_2

# ----
subtraction = Subtraction(A=pt_10, B=pt_6)
panel_2 = Panel(pt_10)
pt_11 = Point(subtraction)
filter_5 = StreamFilter(Gate=tool_id_2, Stream1=tool, Stream2=tool_2.tool_2, Stream3=tool_3.tool_2)
python_2 = GhPythonScript(x=tool_2.tool_2, y=tool_3.tool_2)  # -> out, a
# ---------- python_2: Python ----------
print(x)
print(y)

#print y.breps
print x.tcp_frame
print y.tcp_frame
# ---------- end python_2 ----------
panel_3 = Panel(pt_11)
filter_6 = StreamFilter(Gate=get_lidar_tcp_2, Stream0="no_tcp", Stream1=tool_3.tcp_lidar_2)
tool_4 = Data(filter_5)
tool_5 = ClusterOutput(tool_4)
lidar_tcp = Data(filter_6)
lidar_tcp_2 = ClusterOutput(lidar_tcp)
py = PythonScript(tool=filter_5)  # -> tcp_frame, model
# ---------- py: Python ----------
from compas_ghpython import mesh_draw 

tcp_frame = tool.tcp_frame
model = map(mesh_draw, tool.model)
# ---------- end py ----------
draw = PythonScript(frame=py.tcp_frame)  # -> G, C
# ---------- draw: Python ----------
import Rhino.Geometry as rg
from System.Drawing import Color

if not size:
    size = 100

if frame:
    plane = rg.Plane(rg.Point3d(*list(frame.point)), rg.Vector3d(*list(frame.xaxis)), rg.Vector3d(*list(frame.yaxis)))

    G = []
    G.append(rg.Line(plane.Origin, size * plane.XAxis))
    G.append(rg.Line(plane.Origin, size * plane.YAxis))
    G.append(rg.Line(plane.Origin, size * plane.ZAxis))
    
    C = []
    C.append(Color.FromArgb(255, 0, 0))
    C.append(Color.FromArgb(0, 255, 0))
    C.append(Color.FromArgb(0, 0, 255))
# ---------- end draw ----------
preview = CustomPreview(Geometry=draw.G, Shader=draw.C)
preview_2 = CustomPreview(Geometry=py.model, Shader=ColourSwatch(SwatchColor=RGB(141, 170, 178)))

# ==== cluster CenterScaleDivide
number_slider = Slider(5, range=0..10)
number_slider_2 = Slider(64, range=0..100)
C = ClusterInput()
G = ClusterInput()
A = ClusterInput()
ln = Line(StartPoint=A, EndPoint=C)
vec = Vector(ln)
F = ClusterInput()
N = ClusterInput()
move = Move(Geometry=G, Motion=vec)  # -> Geometry, Transform
scale = Scale(Geometry=move.Geometry, Center=C, Factor=F)  # -> Geometry, Transform
divide = DivideCurve(Curve=scale.Geometry, Count=N, Kinks=False)  # -> Points, Tangents, Parameters
pt = Point(divide.Points)
G_2 = ClusterOutput(scale.Geometry)
lastdex = LastIndex(List=divide.Points)
item = ListItem(List=divide.Points, Index=lastdex, Wrap=True)
ins = InsertItems(List=divide.Points, Item=item, Indices=Slider(0, range=0..100), Wrap=True)
pt_2 = Point(ins)
pt_3 = ClusterOutput(pt_2)

# ==== cluster PrintBed
F = ClusterInput()
G = ClusterInput()
X = ClusterInput()

# ---- group: Print Bed Rectangle
Z = UnitZ(Factor=F)
move = Move(Geometry=G, Motion=Z)  # -> Geometry, Transform
pl = PlaneNormal(Origin=move.Geometry, ZAxis=Vector(0, 0, 1))
rectangle = Rectangle(Plane=pl, XSize=X, YSize=X, Radius=0)  # -> Rectangle, Length
area = Area(Geometry=rectangle.Rectangle)  # -> Area, Centroid
move2pt = MoveToPoint(Geometry=rectangle.Rectangle, PointA=area.Centroid, PointB=pl)  # -> Moved, Vector, Transform

# ----
G_2 = ClusterOutput(move.Geometry)
M = ClusterOutput(move2pt.Moved)

# ==== cluster Cluster
crv = Curve(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)
crv_2 = Curve(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)
crv_3 = Curve(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)
end = EndPoints(Curve=crv_3)  # -> Start, End
end_2 = EndPoints(Curve=crv_2)  # -> Start, End
end_3 = EndPoints(Curve=crv)  # -> Start, End
ln = Line(StartPoint=end.Start, EndPoint=end_3.End)
ln_2 = Line(StartPoint=end_2.End, EndPoint=end_3.Start)
join = JoinCurves(Curves=[ln, ln_2, crv_3, crv_2, crv], Preserve=False)
C = ClusterOutput(join)

# ==== cluster Cluster_2
B = ClusterInput()
geo = Geometry([<point referenced from the Rhino model> x2, <brep referenced from the Rhino model> x15, <curve referenced from the Rhino model>, <point referenced from the Rhino model>, <curve referenced from the Rhino model> x2, <brep referenced from the Rhino model>, <curve referenced from the Rhino model>, <brep referenced from the Rhino model>, <curve referenced from the Rhino model>, <point referenced from the Rhino model> x2, <curve referenced from the Rhino model> x5, <brep referenced from the Rhino model> x4, <curve referenced from the Rhino model>, <brep referenced from the Rhino model> x9, <curve referenced from the Rhino model>, <brep referenced from the Rhino model>])
item = ListItem(List=geo, Index=Slider(18, range=0..50), Wrap=True)
item_2 = ListItem(List=geo, Index=0, Wrap=True)
pt = Point(item_2)
vec2pt = Vector2Pt(PointA=item, PointB=pt, Unitize=False)  # -> Vector, Length
vec2pt_2 = Vector2Pt(PointA=item, PointB=B, Unitize=False)  # -> Vector, Length
move = Move(Geometry=geo, Motion=vec2pt_2.Vector)  # -> Geometry, Transform
panel = Panel(geo)
pln = Plane(item)
vec = Vector(vec2pt.Vector)
vec_2 = ClusterOutput(vec)

# ==== cluster Scan_positions
F = ClusterInput()
R = ClusterInput()
P = ClusterInput()
N = ClusterInput()
A = ClusterInput()
G = ClusterInput()
pt = ClusterInput()
pln = ClusterInput()
pln_2 = Plane(pln)
pt_2 = Point(pt)
cir = Circle(Plane=P, Radius=R)
Z = UnitZ(Factor=F)
merge = Merge(Data1=pt_2, Data2=pln_2)
D = ClusterInput()
move = Move(Geometry=cir, Motion=Z)  # -> Geometry, Transform
toggle = BooleanToggle(False)
divide = DivideCurve(Curve=move.Geometry, Count=N, Kinks=False)  # -> Points, Tangents, Parameters
gate = StreamGate(Stream=merge, Gate=G)  # -> Target0, Target1
merge_2 = Merge(Data2=divide.Points)  # -> flatten(Result)
split = SplitList(List=gate.Target0, Index=Slider(1, range=0..1))  # -> ListA, ListB
split_2 = SplitList(List=gate.Target1, Index=Slider(1, range=0..1))  # -> ListA, ListB
pframes = PerpFrames(Curve=move.Geometry, Count=N, Align=True)  # -> Frames, Parameters

# ---- group: inverse_points
merge_3 = Merge(Data2=divide.Points)
xy = XYPlane(Origin=merge_3)
rotate = Rotate(Geometry=xy, Angle=degrees(A), Plane=pframes.Frames)  # -> Geometry, Transform

# ----
xy_2 = XYPlane(Origin=merge_2)
orient = Orient(Geometry=split_2.ListA, Source=split_2.ListB, Target=xy_2)  # -> Geometry, Transform
orient_2 = Orient(Geometry=split.ListA, Source=split.ListB, Target=xy_2)  # -> Geometry, Transform
rotate_2 = Rotate(Geometry=orient.Geometry, Angle=degrees(A), Plane=pframes.Frames)  # -> Geometry, Transform
rotate_3 = Rotate(Geometry=xy_2, Angle=degrees(A), Plane=pframes.Frames)  # -> Geometry, Transform
rotate_4 = Rotate(Geometry=orient_2.Geometry, Angle=degrees(A), Plane=pframes.Frames)  # -> Geometry, Transform
vec2pt = Vector2Pt(PointA=rotate.Geometry, PointB=rotate_2.Geometry, Unitize=False)  # -> Vector, Length
move_2 = Move(Geometry=rotate.Geometry, Motion=vec2pt.Vector)  # -> Geometry, Transform
vec = Vector(vec2pt.Vector)
pln_3 = Plane(rotate.Geometry)
pln_4 = Plane(move_2.Geometry)
vec2pt_2 = Vector2Pt(PointA=rotate_3.Geometry, PointB=rotate_4.Geometry, Unitize=False)  # -> Vector, Length
pln_5 = Plane(rotate_3.Geometry)
line = LineSDL(Start=rotate.Geometry, Direction=vec2pt.Vector, Length=vec2pt.Length)
vec_2 = Vector(vec2pt_2.Vector)
merge_4 = Merge(Data1=pln_4, Data2=vec)
repeat = RepeatData(Data=D, Length=N)
wait_times_list = Data(repeat)
merge_5 = Merge(Data1=pln_5, Data2=vec_2)
filter = StreamFilter(Gate=G, Stream0=merge_5, Stream1=merge_4)
lng = ListLength(List=pln_4)
wait_times_list_2 = ClusterOutput(wait_times_list)
split_3 = SplitList(List=filter, Index=lng)  # -> ListA, ListB
pln_6 = Plane(split_3.ListA)
vec_3 = Vector(split_3.ListB)
pln_7 = ClusterOutput(pln_6)
vec_4 = ClusterOutput(vec_3)

# ==== cluster Cluster_3
A = ClusterInput()
B = ClusterInput()
C = ClusterInput()
multiplication = Multiplication(A=A, B=B)
B_2 = ClusterInput()
subtraction = Subtraction(A=multiplication, B=B_2)
A_2 = ClusterInput()
B_3 = ClusterInput()
T = ClusterInput()
B_4 = ClusterInput()
division = Division(A=A_2, B=B_3)
dom = ConstructDomain(DomainStart=0, DomainEnd=A_2)
range = Range(Domain=dom, Steps=division)
offcrv = OffsetCurve(Curve=C, Plane=PlaneXY(0, 0, 0), Distance=range, BothSides=B_4, Kinks=0, CapType=T)  # -> flatten(Offset)
Z = UnitZ(Factor=subtraction)
geo = Geometry(flatten(offcrv))
extr = Extrude(Base=geo, Direction=Z)
mesh = MeshBrep(
    Brep=extr,
    Settings={GridMaxCount=0, GridMinCount=16, JaggedSeams=False, MaxEdgeLength=0, MinEdgeLength=0.0001, MinTolerance=0, Refine=True, RefineAngle=0, RelativeTolerance=0.65, SimplePlanes=True, Tolerance=0})
crv = Curve(geo)
tri = Triangulate(Mesh=mesh)  # -> Mesh, Count
crv_2 = ClusterOutput(crv)
medges = MeshEdges(Mesh=tri.Mesh)  # -> NakedEdges, InteriorEdges, NonManifoldEdges
M = ClusterOutput(tri.Mesh)
crv_3 = Curve([medges.InteriorEdges, medges.NakedEdges])
crv_4 = ClusterOutput(crv_3)

# ==== cluster OffsetZ_height
L = ClusterInput()
lng = ListLength(List=L)
lastdex = LastIndex(List=L)
dup = DuplicateData(Data=Slider(1, range=0..1), Number=lng, Order=True)
number_slider = Slider(0, range=0..100)
replace = ReplaceItems(List=dup, Item=Slider(0, range=0..100), Indices=lastdex, Wrap=False)
pt = Point(L)
pt_2 = Point(flatten(L))
data = Data(flatten(replace))
bang = ExplodeTree(Data=pt)  # -> _0000, _0001, _0002
data_2 = ClusterOutput(data)
pdecon = Deconstruct(Point=pt_2)  # -> XComponent, YComponent, ZComponent
pt_3 = ClusterOutput(pt_2)
X = ClusterOutput(pdecon.XComponent)
Y = ClusterOutput(pdecon.YComponent)
B = ClusterInput()
addition = Addition(A=pdecon.ZComponent, B=B)
R = ClusterOutput(addition)

# ==== cluster Center
crv = ClusterInput()
crv_2 = Curve(crv)
cpoly = ControlPolygon(Curve=crv_2)  # -> Polygon, Points
pcen = PolygonCenter(Polyline=cpoly.Polygon)  # -> CenterV, CenterE, CenterA
ma = MassAddition(Input=pcen.CenterV)  # -> Result, PartialResults
lng = ListLength(List=pcen.CenterV)
division = Division(A=ma.Result, B=lng)
center = ClusterInput()
pt = Point(division)
center_2 = Point(center)
vec2pt = Vector2Pt(PointA=pt, PointB=center_2, Unitize=False)  # -> Vector, Length
move = Move(Geometry=crv_2, Motion=vec2pt.Vector)  # -> Geometry, Transform
C = ClusterOutput(move.Geometry)

# ==== cluster Process_mesh
pt = ClusterInput()
xy = XYPlane(Origin=Point(0, 0, 0))
pt_2 = Point(pt)
yz = YZPlane(Origin=pt_2)
rad = Radians(Degrees=-90)
deplane = DeconstructPlane(Plane=xy)  # -> Origin, XAxis, YAxis, ZAxis
pt_3 = ClusterInput()
G = ClusterInput()
demesh = DeconstructMesh(Mesh=G)  # -> Vertices, Faces, Colours, Normals
scale = Scale(Geometry=G, Center=Point(0, 0, 0), Factor=1000)  # -> Geometry, Transform
rot3d = Rotate3D(Geometry=xy, Angle=rad, Center=Point(0, 0, 0), Axis=deplane.ZAxis)  # -> Geometry, Transform
pt_4 = Point()
xy_2 = XYPlane(Origin=Point(0, 0, 0))
orient = Orient(Geometry=rot3d.Geometry, Source=rot3d.Geometry, Target=yz)  # -> Geometry, Transform
pln = ClusterInput()
B = ClusterInput()
scale_2 = Scale(Geometry=demesh.Vertices, Center=Point(0, 0, 0), Factor=Slider(1000, range=0..1000))  # -> Geometry, Transform
transform = Transform(Geometry=scale.Geometry, Transform=orient.Transform)
rad_2 = Radians(Degrees=Slider(0, range=-180..180))
deplane_2 = DeconstructPlane(Plane=xy_2)  # -> Origin, XAxis, YAxis, ZAxis
xy_3 = XYPlane(Origin=Point(0, 0, 0))
pln_2 = Plane(pln)
xy_4 = XYPlane(Origin=Point(0, 0, 0))
rot3d_2 = Rotate3D(Geometry=xy_3, Angle=rad_2, Center=Point(0, 0, 0), Axis=deplane_2.ZAxis)  # -> Geometry, Transform
vec2pt = Vector2Pt(PointA=deplane_2.Origin, PointB=pt_4, Unitize=False)  # -> Vector, Length
orient_2 = Orient(Geometry=scale_2.Geometry, Source=xy_4, Target=pln_2)  # -> Geometry, Transform
move = Move(Geometry=rot3d_2.Geometry, Motion=vec2pt.Vector)  # -> Geometry, Transform
orient_3 = Orient(Geometry=rot3d_2.Geometry, Source=xy_3, Target=move.Geometry)  # -> Geometry, Transform
pt_5 = Point(orient_2.Geometry)
transform_2 = Transform(Geometry=scale_2.Geometry, Transform=orient_3.Transform)
xz = XZPlane(Origin=Point(0, 0, 0))
G_2 = ClusterOutput(orient_2.Geometry)
mesh = Mesh(transform_2)
box = Box()
msplit = MeshSplit(Mesh=mesh, Splitters=box)
rotate = Rotate(Geometry=pt_5, Angle=degrees(Slider(7, range=0..10)), Plane=xz)  # -> Geometry, Transform
volume = Volume(Geometry=box)  # -> Volume, Centroid
area = Area(Geometry=msplit)  # -> Area, Centroid
avr = Average(Input=rotate.Geometry)
G_3 = ClusterOutput(rotate.Geometry)
dist = Distance(PointA=graft(area.Centroid), PointB=volume.Centroid)  # -> flatten(Distance)
vec2pt_2 = Vector2Pt(PointA=avr, PointB=B, Unitize=False)  # -> Vector, Length
sort = SortList(Keys=dist, ValuesA=msplit)  # -> Keys, ValuesA
python = GhPythonScript()  # -> Out, A
item = ListItem(List=sort.ValuesA, Index=0, Wrap=True)
devec = DeconstructVector(Vector=vec2pt_2.Vector)  # -> XComponent, YComponent, ZComponent
clean = CombineClean(Meshes=item)
mesh_2 = Mesh(clean)
vec = VectorXYZ(XComponent=devec.XComponent, YComponent=devec.YComponent, ZComponent=0)  # -> Vector, Length
demesh_2 = DeconstructMesh(Mesh=mesh_2)  # -> Vertices, Faces, Colours, Normals
move_2 = Move(Geometry=rotate.Geometry, Motion=vec.Vector)  # -> Geometry, Transform
lng = ListLength(List=demesh_2.Vertices)
pdecon = Deconstruct(Point=demesh_2.Vertices)  # -> XComponent, YComponent, ZComponent
series = Series(Start=0, Step=1, Count=lng)
G_4 = ClusterOutput(move_2.Geometry)
far = ColourSwatch(SwatchColor=RGB(255, 0, 0))
close = ColourSwatch(SwatchColor=RGB(13, 0, 255))
mid = ColourSwatch(SwatchColor=RGB(255, 247, 0))
sort_2 = SortList(Keys=pdecon.XComponent, ValuesA=series)  # -> Keys, ValuesA
range = Range(Domain=Domain(0, 1), Steps=lng)
cull_i = CullIndex(List=range, Indices=0, Wrap=True)
col = Colour([far, mid, close])
interp = InterpolateData(Data=col, Parameter=cull_i, Interpolation=2)
sort_3 = SortList(Keys=sort_2.ValuesA, ValuesA=interp)  # -> Keys, ValuesA
mcol = MeshColours(Mesh=mesh_2, Colours=sort_3.ValuesA)
M = ClusterOutput(mcol)

# ==== cluster Mini_print_bounding_area
P = ClusterInput()
X = ClusterInput()
Y = ClusterInput()
C = ClusterInput()

# ---- group: mini_prints_scan_bounding_box
rectangle = Rectangle(Plane=P, XSize=X, YSize=Y, Radius=0)  # -> Rectangle, Length
area = Area(Geometry=rectangle.Rectangle)  # -> Area, Centroid
vec2pt = Vector2Pt(PointA=area.Centroid, PointB=P, Unitize=False)  # -> Vector, Length
move = Move(Geometry=rectangle.Rectangle, Motion=vec2pt.Vector)  # -> Geometry, Transform

# ----
G = ClusterInput()
explode = Explode(Curve=C, Recursive=True)  # -> Segments, Vertices
pdecon = Deconstruct(Point=explode.Vertices)  # -> XComponent, YComponent, ZComponent
explode_2 = Explode(Curve=move.Geometry, Recursive=True)  # -> Segments, Vertices
crv = Curve(C)
pdecon_2 = Deconstruct(Point=explode_2.Vertices)  # -> XComponent, YComponent, ZComponent
hilonums = HighestLowestNumbers(Numbers=pdecon.XComponent)  # -> Highest, Lowest
hilonums_2 = HighestLowestNumbers(Numbers=pdecon.YComponent)  # -> Highest, Lowest
hilonums_3 = HighestLowestNumbers(Numbers=pdecon_2.YComponent)  # -> Highest, Lowest
hilonums_4 = HighestLowestNumbers(Numbers=pdecon_2.XComponent)  # -> Highest, Lowest
G_2 = ClusterOutput(move.Geometry)
crv_2 = ClusterOutput(crv)
merge = Merge(Data1=hilonums.Highest, Data2=hilonums.Lowest, Data3=hilonums_2.Highest, Data4=hilonums_2.Lowest)
merge_2 = Merge(Data1=hilonums_4.Highest, Data2=hilonums_4.Lowest, Data3=hilonums_3.Highest, Data4=hilonums_3.Lowest)
filter = StreamFilter(Gate=G, Stream0=merge_2, Stream1=merge)  # -> graft(Stream)
bang = ExplodeTree(Data=filter)  # -> _00000, _00001, _00002, _00003
_0_0_0_0_1 = ClusterOutput(bang._00001)
_0_0_0_0_0 = ClusterOutput(bang._00000)
_0_0_0_0_2 = ClusterOutput(bang._00002)
_0_0_0_0_3 = ClusterOutput(bang._00003)

# ==== cluster Cluster_4
vec = ClusterInput()
P = ClusterInput()

# ---- group: Scan_visu
planesrf = PlaneSurface(Plane=P, XSize=Domain(-10, 10), YSize=Domain(-10, 10))
vec_2 = Vector(vec)
multiplication = Multiplication(A=vec_2, B=Slider(10, range=0..10))
extr = Extrude(Base=planesrf, Direction=multiplication)
flippln = FlipPlane(Plane=P, FlipX=False, FlipY=False, FlipZ=True)  # -> Flipped, R
vec_3 = Vector(flippln.Flipped)
number_slider = Slider(25, range=0..100)
line = LineSDL(Start=flippln.Flipped, Direction=vec_3, Length=number_slider)
cone = Cone(Base=flippln.Flipped, Radius=Slider(9, range=0..100), Length=number_slider)  # -> Cone, Tip

# ----
vec_4 = ClusterInput()
P_2 = ClusterInput()

# ---- group: scan_visu
planesrf_2 = PlaneSurface(Plane=P_2, XSize=Domain(-10, 10), YSize=Domain(-10, 10))
vec_5 = Vector(vec_4)
multiplication_2 = Multiplication(A=vec_5, B=Slider(5, range=0..10))
extr_2 = Extrude(Base=planesrf_2, Direction=multiplication_2)
flippln_2 = FlipPlane(Plane=P_2, FlipX=False, FlipY=False, FlipZ=True)  # -> Flipped, R
number_slider_2 = Slider(15, range=0..100)
vec_6 = Vector(flippln_2.Flipped)
line_2 = LineSDL(Start=flippln_2.Flipped, Direction=vec_6, Length=number_slider_2)
cone_2 = Cone(Base=flippln_2.Flipped, Radius=Slider(10, range=0..100), Length=number_slider_2)  # -> Cone, Tip

# ----
merge = Merge(Data1=cone_2.Cone, Data2=extr_2)
geo = Geometry(merge)
merge_2 = Merge(Data1=cone.Cone, Data2=extr)
geo_2 = ClusterOutput(geo)
geo_3 = Geometry(merge_2)
geo_4 = ClusterOutput(geo_3)

# ==== cluster Tool
breps = ClusterInput()
meshes = ClusterInput()
vector = ClusterInput()
yline = ClusterInput()
meshes_2 = Mesh(meshes)
vector_2 = Data(vector)
mjoin = MeshJoin(Meshes=meshes_2)
xline = ClusterInput()
item = ListItem(List=breps, Index=Slider(0, range=0..100), Wrap=True)

# ---- group: old
tool = PythonScript(meshes=mjoin, breps=breps, xline=xline, yline=yline)  # -> tool; inputs meshes: list of Mesh, breps: list of Brep
# ---------- tool: Python ----------
import Rhino.Geometry as rg
from compas.geometry import Frame
from eggshell.ur_online_control.ur.tool import Tool
from compas.datastructures import Mesh
from compas_rhino.helpers import mesh_from_guid


xaxis = rg.Line(xline.PointAtStart, xline.PointAtEnd)
yaxis = rg.Line(yline.PointAtStart, yline.PointAtEnd)

if xaxis.From.DistanceTo(yaxis.From) < 0.01:
    origin = xaxis.From
    xaxis = xaxis.Direction
    yaxis = yaxis.Direction
elif xaxis.To.DistanceTo(yaxis.To) < 0.01:
    origin = xaxis.To
    xaxis = -xaxis.Direction
    yaxis = -yaxis.Direction
elif xaxis.From.DistanceTo(yaxis.To) < 0.01:
    origin = xaxis.From
    xaxis = xaxis.Direction
    yaxis = -yaxis.Direction
elif xaxis.To.DistanceTo(yaxis.From) < 0.01:
    origin = xaxis.To
    xaxis = -xaxis.Direction
    yaxis = yaxis.Direction

xaxis.Unitize()
yaxis.Unitize()

print origin
print xaxis
print yaxis

tcp_frame = Frame(origin, xaxis, yaxis)

tool = Tool(tcp_frame)
tool.model = [mesh_from_guid(Mesh, mesh) for mesh in meshes]
#tool.model_xyz = tool.model.xyz
tool.breps = breps
# ---------- end tool ----------

# ----
python = GhPythonScript(guid=mjoin, breps=item, vector=vector_2, xline=xline, yline=yline)  # -> out, tool, tcp_frame, tcp_lidar, T
# ---------- python: Python ----------
__author__ = "hjame"
__version__ = "2021.05.27"

import rhinoscriptsyntax as rs
import Rhino.Geometry as rg
from compas.geometry import Frame
from compas.geometry import Vector
from compas.geometry import Plane
from compas.geometry import Translation
import compas_rhino
from compas_rhino.geometry import RhinoMesh
from compas_rhino.geometry import RhinoPlane
from eggshell.ur_online_control.ur.tool import Tool

xaxis = rg.Line(rs.CurveStartPoint(xline), rs.CurveEndPoint(xline))
yaxis = rg.Line(rs.CurveStartPoint(yline), rs.CurveEndPoint(yline))

if xaxis.From.DistanceTo(yaxis.From) < 0.01:
    origin = xaxis.From
    xaxis = xaxis.Direction
    yaxis = yaxis.Direction
elif xaxis.To.DistanceTo(yaxis.To) < 0.01:
    origin = xaxis.To
    xaxis = -xaxis.Direction
    yaxis = -yaxis.Direction
elif xaxis.From.DistanceTo(yaxis.To) < 0.01:
    origin = xaxis.From
    xaxis = xaxis.Direction
    yaxis = -yaxis.Direction
elif xaxis.To.DistanceTo(yaxis.From) < 0.01:
    origin = xaxis.To
    xaxis = -xaxis.Direction
    yaxis = yaxis.Direction

xaxis.Unitize()
yaxis.Unitize()

print origin
print xaxis
print yaxis

T = Translation.from_vector(vector)

tcp_frame = Frame(origin, xaxis, yaxis)
tcp_plane = Plane.from_frame(tcp_frame)
tcp_plane_rhino = RhinoPlane.from_geometry(tcp_frame)

tcp_lidar = Frame.from_transformation(T)

print(tcp_plane_rhino)
print(tcp_plane)
print(tcp_frame)
tool = Tool(tcp_frame)






#guid = compas_rhino.select_mesh()
#tool.model = RhinoMesh.from_guid(guid).to_compas()
tool.breps = breps
# ---------- end python ----------
tcp_lidar = Data(python.T)
tool_2 = ClusterOutput(python.tool)
tcp_lidar_2 = ClusterOutput(tcp_lidar)
