# Grasshopper definition Geometries.ghx (Grasshopper 1.0.7)
# plug-ins: LunchBox

rectangle = Rectangle(Plane=PlaneXY(0, 0, 0), XSize=Slider(500, range=0..1000), YSize=Slider(800, range=0..1000), Radius=0)  # -> Rectangle, Length
diamond = DiamondPanels(Surface=rectangle.Rectangle, UDivisions=Slider(9, range=0..10), VDivisions=Slider(7, range=0..10))  # -> DiamondPanels, TriPanels
offset = OffsetCurve(Curve=rectangle.Rectangle, Distance=1, Plane=PlaneXY(0, 0, 0), Corners=1)

number_slider = Slider(200, range=0..1000)
srf = Surface(reparameterize(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))

number_slider_2 = Slider(200, range=0..1000)
wip_geo = GhPythonScript(x=number_slider_2, y=number_slider_2)  # -> out, a
# ---------- wip_geo: Python ----------
import rhinoscriptsyntax as rs
import Rhino.Geometry as rg 
import ghpythonlib.components as gh

#define base rectangle 


origin = rg.Plane( rg.Point3d(0,0,0), rg.Vector3d.ZAxis)
rectangle = rg.Rectangle3d(origin, 200, 200)

edges = gh.Explode(rectangle, True)[0]

s_edges = gh.ListItem(edges,[1,3], False)

divided_edges = gh.DivideCurve(s_edges, 10, True)[0]

L = int(gh.ListLength(divided_edges)/2)

print (L)


split_list1 = gh.SplitList(divided_edges, L)[0]
split_list2 = gh.ReverseList(gh.SplitList(divided_edges, L)[1])

new_lines = gh.Line(split_list1,split_list2)  

new_points = gh.DivideCurve(new_lines, 10, True)[0]

mp1 = gh.Move((gh.Dispatch(new_points, [True, False])[0]), rg.Vector3d(0,20,0))[0]
mp2 = gh.Move((gh.Dispatch(new_points, [True, False])[1]), rg.Vector3d(0,20,0))[0]

##a = gh.Weave(mp1,mp2)

#a = gh.PolyLine(pts, False)

list0= mp1
list1= mp2

zipped=zip(list0,list1)
result0=[item for sublist in zipped for item in sublist]

result1=[]
for sublist in zipped:
    for item in sublist:
        result1.append(item)
print result0
print result1
# ---------- end wip_geo ----------
geo = Geometry(wip_geo.a)

srf_2 = Surface(reparameterize(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))
number_slider_3 = Slider(175, range=0..1000)
srf_3 = Surface(reparameterize(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))

number_slider_4 = Slider(600, range=0..1000)
number_slider_5 = Slider(2, range=0..10)
rectangle_2 = Rectangle(Plane=PlaneXY(0, 0, 0), XSize=number_slider_4, YSize=number_slider_4, Radius=0)  # -> Rectangle, Length
number_slider_6 = Slider(2, range=0..10)
diamond_2 = DiamondPanels(Surface=rectangle_2.Rectangle, UDivisions=Slider(1, range=0..10), VDivisions=Slider(0, range=0..10))  # -> DiamondPanels, TriPanels
neg = Negative(Value=number_slider_5)
fillet = Fillet(Curve=diamond_2.DiamondPanels, Radius=number_slider_6)
fillet_2 = Fillet(Curve=diamond_2.TriPanels, Radius=number_slider_6)
merge = Merge(Data1=fillet, Data2=fillet_2)
offset_2 = OffsetCurve(Curve=merge, Distance=neg, Plane=PlaneXY(0, 0, 0), Corners=1)

geo_2 = Geometry(<brep referenced from the Rhino model>)

line_overlap = Slider(0.5, range=0..1)
bump_height = Slider(0, range=0..10)
x_row = Slider(5, range=0..10)
y_row = Slider(7, range=0..10)
list = ValueList({"double lines": 0, "simple lines": 1}, selected="simple lines")
print_bed_ur5 = Geometry(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)
geo_input = Geometry(srf_2)
geo_set = Geo_set(G=geo_input, x=bump_height)
print_param = Print_param(
    G=list,
    C=geo_set,
    A=line_overlap,
    relay=y_row,
    relay_2=x_row,
    X=Slider(200, range=0..1000),
    Y=Slider(200, range=0..1000))  # -> s_1, R
panel = Panel(print_param.R)

project = Project(Geometry=geo_2, Plane=PlaneXY(0, 0, 0))  # -> Geometry, Transform
number_slider_7 = Slider(3, range=0..10)
number_slider_8 = Slider(3, range=0..10)
geo_set_2 = Geo_set(G=srf_3, x=bump_height)
rectangle_3 = Rectangle(Plane=PlaneXY(0, 0, 0), XSize=number_slider_3, YSize=Slider(700, range=0..1000), Radius=0)  # -> Rectangle, Length
rectangle_4 = Rectangle(Plane=PlaneXY(0, 0, 0), XSize=Slider(1200, range=0..10000), YSize=Slider(10000, range=0..10000), Radius=0)  # -> Rectangle, Length
debrep = DeconstructBrep(Brep=project.Geometry)  # -> Faces, Edges, Vertices
number_slider_9 = Slider(1, range=0..1)
explode = Explode(Curve=rectangle_4.Rectangle, Recursive=True)  # -> Segments, Vertices
attract = Attractor(AttractorDomain=Domain(0, 1))  # -> Values, Vectors, Distances
number_slider_10 = Slider(100, range=0..100)
scale_nu = ScaleNU(Plane=PlaneXY(0, 0, 0), ScaleX=1, ScaleY=1, ScaleZ=1)  # -> Geometry, Transform
item = ListItem(List=debrep.Edges, Index=0, Wrap=True)  # -> Item, Item1, Item2, Item3
squads = SkewedQuads(Surface=rectangle_3.Rectangle, UDivisions=Slider(1, range=0..10), VDivisions=Slider(3, range=0..10), TParameter=0)  # -> FullPanels, EdgePanels
number_slider_11 = Slider(3, range=0..10)
quads = QuadPanels(Surface=rectangle_2.Rectangle, UDivisions=number_slider_8, VDivisions=number_slider_8)
item_2 = ListItem(List=explode.Segments, Index=0, Wrap=True)  # -> Item, Item1, Item2, Item3
geo_3 = Geometry(geo_set_2)
explode_2 = Explode(Curve=geo_set_2, Recursive=True)  # -> Segments, Vertices
area = Area(Geometry=project.Geometry)  # -> Area, Centroid
divide = DivideCurve(Curve=item.Item2, Count=10, Kinks=False)  # -> Points, Tangents, Parameters
divide_2 = DivideCurve(Curve=item.Item, Count=10, Kinks=False)  # -> reverse(Points), Tangents, Parameters

geo_4 = Geometry(item_2.Item)
geo_5 = Geometry(item_2.Item2)

X = UnitX(Factor=expr("x*2", number_slider_3))
merge_2 = Merge(Data1=squads.FullPanels, Data2=squads.EdgePanels)
item_3 = ListItem(List=explode_2.Segments, Index=0, Wrap=True)  # -> Item, Item1, Item2, Item3
tria = TriangularPanelsA(Surface=rectangle_2.Rectangle, UDivisions=Slider(2, range=0..10), VDivisions=Slider(3, range=0..10))
tric = TrianglePanelsC(Surface=rectangle_2.Rectangle, UDivisions=number_slider_11, VDivisions=number_slider_11)
ln = Line(StartPoint=divide_2.Points, EndPoint=divide.Points)
divlength = DivideLength(Curve=geo_4, Length=number_slider_10)  # -> reverse(Points), Tangents, Parameters
divlength_2 = DivideLength(Curve=geo_5, Length=number_slider_10)  # -> Points, Tangents, Parameters

# ----
# Export obj. to data
layer_height = Slider(2, range=0..10)
layer_number = Slider(1, range=0..10)
layering = Layering(A=layer_height, B=layer_number)
# Shape Prediction
# 
# >>>>
export_obj = GhPythonScript(export=Button(), mesh=layering, ObjName="20210722_diamond_large_in.obj")  # -> out, a; inputs mesh: Mesh
# ---------- export_obj: Python ----------
import os
import sys
import compas_rhino
from compas_rhino.geometry import RhinoMesh
import Rhino.Geometry as rg 


filepath = ghenv.Component.Attributes.Owner.OnPingDocument().FilePath
path = os.path.abspath(os.path.join(filepath, "..","data","3D_for_4D.obj"))
path_storage = os.path.abspath(os.path.join(filepath, "..", "..","obj",ObjName))

print (path_storage)
HERE = os.path.join(os.path.abspath(path)) 
HERE_storage = os.path.join(os.path.abspath(path_storage))

#######


if export:
    print(HERE)
    print(HERE_storage)
    c_mesh = RhinoMesh.from_geometry(mesh).to_compas()
    c_mesh.to_obj(HERE, None, True)
    c_mesh.to_obj(HERE_storage, None, True)
# ---------- end export_obj ----------

series = Series(Start=0, Step=1, Count=10)
divide_3 = DivideCurve(Curve=item_3.Item3, Count=10, Kinks=False)  # -> reverse(Points), Tangents, Parameters
divide_4 = DivideCurve(Curve=item_3.Item1, Count=10, Kinks=False)  # -> Points, Tangents, Parameters
mirror = Mirror(Geometry=merge_2, Plane=PlaneYZ(0, 0, 0))  # -> Geometry, Transform
offset_3 = OffsetCurve(Curve=rectangle_2.Rectangle, Distance=number_slider_5, Plane=PlaneXY(0, 0, 0), Corners=1)
divide_5 = DivideCurve(Curve=ln, Count=10, Kinks=False)  # -> Points, Tangents, Parameters
ln_2 = Line(StartPoint=divlength.Points, EndPoint=divlength_2.Points)
panel_2 = Panel("""2.2
4.4""")
ln_3 = Line(StartPoint=divide_4.Points, EndPoint=divide_3.Points)
end = EndPoints(Curve=ln)  # -> Start, End
dispatch = Dispatch(List=ln, DispatchPattern=[True, False])  # -> ListA, ListB
divlength_3 = DivideLength(Curve=ln_2, Length=Slider(800, range=0..1000))  # -> Points, Tangents, Parameters
merge_3 = Merge(Data1=merge_2, Data2=mirror.Geometry)
project_2 = Project(Curve=ln, Brep=geo_2, Direction=Vector(0, 0, 1))
end_2 = EndPoints(Curve=ln_3)  # -> Start, End
Z = UnitZ(Factor=Slider(10, range=0..10))
flip = FlipCurve(Curve=dispatch.ListA)  # -> Curve, Flag
offset_4 = OffsetCurve(Curve=tric, Distance=neg, Plane=PlaneXY(0, 0, 0), Corners=1)
merge_4 = Merge(Data1=offset_2, Data2=offset_3)  # -> flatten(Result)
offset_5 = OffsetCurve(Curve=rectangle_2.Rectangle, Distance=panel_2, Plane=PlaneXY(0, 0, 0), Corners=1)
shatter = Shatter(Curve=ln_2, Parameters=divlength_3.Parameters)
merge_5 = Merge(Data1=end_2.Start, Data2=end_2.End)
move = Move(Geometry=end_2.Start, Motion=Z)  # -> Geometry, Transform
move_2 = Move(Geometry=end_2.End, Motion=Z)  # -> Geometry, Transform
cluster = Cluster(data=end.End)
cluster_2 = Cluster_2(data=end.Start)
weave = Weave(Pattern=[0, 1], Stream0=flip.Curve, Stream1=dispatch.ListB, NullGaps=False)
dispatch_2 = Dispatch(List=shatter, DispatchPattern=[True, False])  # -> ListA, ListB
fillet_3 = Fillet(Curve=offset_4, Radius=Slider(3, range=0..10))
panel_3 = Panel("""3
3
3
3
-3
-3
-3
-3""")
merge_6 = Merge(Data1=graft(move.Geometry), Data2=graft(end_2.Start), Data3=graft(end_2.End), Data4=graft(move_2.Geometry))
Z_2 = UnitZ(Factor=Slider(1, range=0..1))
geo_6 = Geometry(dispatch_2.ListA)
merge_7 = Merge(Data1=cluster, Data2=graft(ln), Data3=cluster_2)
offset_6 = OffsetCurve(Curve=merge_3, Distance=expr("-x", panel_3), Plane=PlaneXY(0, 0, 0), Corners=1)
arrlinear = LinearArray(Geometry=offset_6, Direction=X, Count=Slider(2, range=0..10))  # -> flatten(Geometry), Transform
area_2 = Area(Geometry=arrlinear.Geometry)  # -> Area, Centroid
pdecon = Deconstruct(Point=area_2.Centroid)  # -> XComponent, YComponent, ZComponent
sort = SortList(Keys=pdecon.XComponent, ValuesA=arrlinear.Geometry)  # -> Keys, ValuesA
move_3 = Move(Geometry=geo_6, Motion=Z_2)  # -> Geometry, Transform
pline = PolyLine(Vertices=merge_6, Closed=False)  # -> flatten(Polyline)
merge_8 = Merge(Data1=flatten(offset_5), Data2=flatten(fillet_3))  # -> flatten(Result)
join = JoinCurves(Curves=merge_7, Preserve=False)
Z_3 = UnitZ(Factor=Slider(2, range=0..10))
geo_7 = Geometry(sort.ValuesA)
bbox = BoundingBox(Content=geo_7, Plane=PlaneXY(0, 0, 0), UnionBox=True)  # -> Box, Box_2
panel_4 = Panel("""0
1
1
0""")
move_4 = Move(Geometry=join, Motion=Z_3)  # -> Geometry, Transform
simplify = SimplifyTree(Tree=join, Front=False)
dispatch_3 = Dispatch(List=pline, DispatchPattern=[True, False])  # -> ListA, ListB
debrep_2 = DeconstructBrep(Brep=bbox.Box)  # -> Faces, Edges, Vertices
geo_8 = Geometry(merge_8)
flip_2 = FlipCurve(Curve=move_4.Geometry)  # -> Curve, Flag
flip_3 = FlipCurve(Curve=dispatch_3.ListA)  # -> Curve, Flag
item_4 = ListItem(List=debrep_2.Faces, Index=0, Wrap=True)
simplify_2 = SimplifyTree(Tree=flip_2.Curve, Front=False)
debrep_3 = DeconstructBrep(Brep=item_4)  # -> Faces, Edges, Vertices
cp = ControlPoints(Curve=join)  # -> Points, Weights, Knots
intcrv = Interpolate(Degree=3, Periodic=False, KnotStyle=1)  # -> Curve, Length, Domain
cp_2 = ControlPoints(Curve=flip_2.Curve)  # -> Points, Weights, Knots
weave_2 = Weave(Pattern=[0, 1], Stream0=flip_3.Curve, Stream1=dispatch_3.ListB, NullGaps=False)
repeat = RepeatData(Data=panel_4, Length=Slider(44, range=0..100))
data = Data(flatten([Point(-1217.462134, 24.43165261, 0), Point(-1217.462134, 1024.431653, 0), Point(-1217.462134, 1024.431653, 10), Point(-1217.462134, 24.43165261, 10), Point(-1242.46167, 24.27715847, 0), Point(-1242.461662, 1024.586147, 0)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]))
join_2 = JoinCurves(Curves=debrep_3.Edges, Preserve=False)
merge_9 = Merge(Data1=cp.Points, Data2=cp_2.Points)
cp_3 = ControlPoints(Curve=weave_2)  # -> flatten(Points), Weights, Knots
Z_4 = UnitZ(Factor=Slider(10, range=0..10))
data_2 = Data(["0", "1", "1", "0", "0", "1", "1", "0", "0", "1", "1", "0", "0", "1", "1", "0", "0", "1", "1", "0", "0", "1", "1", "0", "0", "1", "1", "0", "0", "1", "1", "0", "0", "1", "1", "0", "0", "1", "1", "0", "0", "1", "1", "0"])
item_5 = ListItem(List=merge_9, Index=0, Wrap=True)  # -> Item1, Item
offset_7 = OffsetCurve(Curve=join_2, Distance=Slider(6, range=0..10), Plane=PlaneXY(0, 0, 0), Corners=1)
data_3 = Data([Point(-1217.462134, 24.43165261, 10), Point(-1217.462134, 24.43165261, 0), Point(-1217.462134, 1024.431653, 0), Point(-1217.462134, 1024.431653, 10), Point(-1242.461662, 1024.586147, 10), Point(-1242.461662, 1024.586147, 0)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])
pline_2 = PolyLine(Vertices=cp_3.Points, Closed=False)
move_5 = Move(Geometry=item_5.Item1, Motion=Z_4)  # -> Geometry, Transform
geo_9 = Geometry(item_5.Item1)

horizontal_count = Slider(1, range=0..10)
list_2 = ValueList({"One": 1, "Two": 2, "Three": 2² - 1, "Four": Sqrt(16)}, selected="One")
data_4 = Data(geo_7)
crv = Curve(data_4)

horizontal_count_2 = Slider(1, range=0..10)
list_3 = ValueList({"One": 1, "Two": 2, "Three": 2² - 1, "Four": Sqrt(16)}, selected="One")
data_5 = Data({Plane=PlaneXY(560.1772031, 178.3406517, -1070.221751), Size=Domain2(u=0..200, v=0..200)})
crv_2 = Curve(data_5)

panel_5 = Panel(join)
ins = InsertItems(List=merge_9, Item=move_5.Geometry, Indices="-1", Wrap=True)  # -> flatten(List)

layer_height_2 = Slider(2, range=0..10)
line_space = Slider(1.5, range=0..10)

pline_3 = PolyLine(Vertices=ins, Closed=False)

parameters_for_mesh = ParametersForMesh(
    data=line_space,
    data_2=layer_height_2,
    crv=crv_2,
    C_2=horizontal_count_2,
    A_2=list_3,
    crv_3=crv,
    C=horizontal_count,
    A=list_2)  # -> M_2, M
mesh = Mesh(parameters_for_mesh.M_2)
mesh_2 = Mesh(parameters_for_mesh.M)
merge_10 = Merge(Data1=mesh, Data2=mesh_2)  # -> flatten(Result)
geo_10 = Geometry(merge_10)
mjoin = MeshJoin(Meshes=geo_10)
export_obj_2 = GhPythonScript(export=Button(), mesh=mjoin, ObjName="20210712_arrow_2.obj")  # -> out, a; inputs mesh: Mesh
# ---------- export_obj_2: Python ----------
import os
import sys
import compas_rhino
from compas_rhino.geometry import RhinoMesh
import Rhino.Geometry as rg 


filepath = ghenv.Component.Attributes.Owner.OnPingDocument().FilePath

#path is the main stream save .obj in the "data" folder for slicing

path = os.path.abspath(os.path.join(filepath, "..","data","3D_for_4D.obj"))

#path_storage is the main second saver to .obj in the "obj" folder for documentation
#change ObjName in the panel to not overwrite your archives .obj

path_storage = os.path.abspath(os.path.join(filepath, "..", "..","obj",ObjName))


print (path_storage)
HERE = os.path.join(os.path.abspath(path)) 
HERE_storage = os.path.join(os.path.abspath(path_storage))

#######


if export:
    print(HERE)
    c_mesh = RhinoMesh.from_geometry(mesh).to_compas()
    c_mesh.to_obj(HERE, None, True)
    c_mesh.to_obj(HERE_storage, None, True)
# ---------- end export_obj_2 ----------

# ----
# Export obj. to data
layer_height_3 = Slider(2, range=0..10)
layer_number_2 = Slider(1, range=0..10)
layering_2 = Layering(A=layer_height_3, B=layer_number_2)
export_obj_3 = GhPythonScript(export=Button(), mesh=layering_2, ObjName="20210722_diamond_large_in.obj")  # -> out, a; inputs mesh: Mesh; same code as export_obj

# ----
# Tool Visualization
number_slider_12 = Slider(0, range=0..100)
print_frame = Print_frame(C=print_param.s_1)
tool_origin = Panel("""0
0
99.507""")

print_planes = Plane(print_frame)
tool_mesh = Mesh(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)

cstoolviz = CsToolViz(origin_coords=tool_origin, mesh=tool_mesh, planes=print_planes, index=number_slider_12)  # -> out, mesh, passed_path; inputs origin_coords: list, mesh: Mesh, planes: list, index: Int32
# ---------- cstoolviz: Python ----------
"""
Example visualization of tool motion during the print.

"""

import compas_slicer_ghpython.visualization as gh_compas_slicer
gh_compas_slicer = reload(gh_compas_slicer)

if origin_coords and mesh and planes and (index or index==0):
    mesh, passed_path = gh_compas_slicer.tool_visualization(origin_coords, mesh, planes, index)
else:
    gh_compas_slicer.missing_input()
# ---------- end cstoolviz ----------
preview = CustomPreview(Geometry=cstoolviz.mesh, Material=ColourSwatch(SwatchColor=RGB(171, 171, 171)))
preview_2 = CustomPreview(Geometry=cstoolviz.passed_path, Material=ColourSwatch(SwatchColor=RGB(255, 156, 36)))

# ==== cluster Layering
A = ClusterInput()
B = ClusterInput()
multiplication = Multiplication(A=A, B=B)
B_2 = ClusterInput()
Z = UnitZ(Factor=expr("x-0.05", multiplication))
extr = Extrude(Base=B_2, Direction=Z)
rebsrf = RebuildSurface(Surface=extr, CountU=Slider(3, range=0..10), CountV=Slider(300, range=0..1000))
mjoin = MeshJoin(Meshes=rebsrf)
tri = Triangulate(Mesh=mjoin)  # -> Mesh, Count
mjoin_2 = MeshJoin(Meshes=tri.Mesh)
M = ClusterOutput(mjoin_2)

# ==== cluster ParametersForMesh
C = ClusterInput()
C_2 = ClusterInput()
data = ClusterInput()
data_2 = ClusterInput()
data_3 = Data(data)
data_4 = Data(data_2)
A = ClusterInput()
A_2 = ClusterInput()
crv = ClusterInput()

# ---- group: Edge Curves
multiplication = Multiplication(A=data_3, B=Slider(2, range=0..10))
multiplication_2 = Multiplication(A=A_2, B=data_4)
series = Series(Start=data_3, Step=multiplication, Count=C_2)
subtraction = Subtraction(A=multiplication_2, B=Slider(0.05, range=0..0.1))
crv_2 = Curve(crv)
Z = UnitZ(Factor=subtraction)
extr = Extrude(Base=crv_2, Direction=Z)
mesh = MeshBrep(
    Brep=extr,
    Settings={GridMaxCount=0, GridMinCount=16, JaggedSeams=False, MaxEdgeLength=0, MinEdgeLength=0.0001, MinTolerance=0, Refine=True, RefineAngle=0, RelativeTolerance=0.65, SimplePlanes=True, Tolerance=0})
tri = Triangulate(Mesh=mesh)  # -> Mesh, Count

# ----
crv_3 = ClusterInput()

# ---- group: Filler_Curves
multiplication_3 = Multiplication(A=data_3, B=Slider(2, range=0..10))
multiplication_4 = Multiplication(A=A, B=data_4)
series_2 = Series(Start=data_3, Step=multiplication_3, Count=C)
subtraction_2 = Subtraction(A=multiplication_4, B=Slider(0.05, range=0..0.1))
neg = Negative(Value=series_2)
crv_4 = Curve(crv_3)
Z_2 = UnitZ(Factor=subtraction_2)
extr_2 = Extrude(Base=crv_4, Direction=Z_2)
mesh_2 = MeshBrep(
    Brep=extr_2,
    Settings={GridMaxCount=0, GridMinCount=16, JaggedSeams=False, MaxEdgeLength=0, MinEdgeLength=0.0001, MinTolerance=0, Refine=True, RefineAngle=0, RelativeTolerance=0.65, SimplePlanes=True, Tolerance=0})
tri_2 = Triangulate(Mesh=mesh_2)  # -> Mesh, Count

# ----
M = ClusterOutput(tri_2.Mesh)
M_2 = ClusterOutput(tri.Mesh)

# ==== cluster Print_param
X = ClusterInput()
Y = ClusterInput()
C = ClusterInput()
relay = ClusterInput()
rectangle = Rectangle(Plane=PlaneXY(0, 0, 0), XSize=X, YSize=Y, Radius=0)  # -> Rectangle, Length
relay_2 = ClusterInput()
explode = Explode(Curve=C, Recursive=True)  # -> Segments, Vertices
item = ListItem(List=explode.Segments, Index=0, Wrap=True)  # -> Item, Item1, Item2, Item3
diamond = DiamondPanels(Surface=C, UDivisions=relay, VDivisions=relay_2)  # -> DiamondPanels, TriPanels
divide = DivideCurve(Curve=item.Item3, Count=relay, Kinks=False)  # -> reverse(Points), Tangents, Parameters
divide_2 = DivideCurve(Curve=item.Item1, Count=relay, Kinks=False)  # -> Points, Tangents, Parameters
neg = Negative(Value=Slider(1.5, range=0..10))
ln = Line(StartPoint=divide_2.Points, EndPoint=divide.Points)
item_2 = ListItem(List=divide_2.Points, Index=0, Wrap=True)  # -> Item, Item1
A = ClusterInput()
dispatch = Dispatch(List=ln, DispatchPattern=[True, False])  # -> ListA, ListB
offset = OffsetCurve(Curve=diamond.TriPanels, Distance=neg, Plane=PlaneXY(0, 0, 0), Corners=1)
offset_2 = OffsetCurve(Curve=diamond.DiamondPanels, Distance=neg, Plane=PlaneXY(0, 0, 0), Corners=1)
dist = Distance(PointA=item_2.Item, PointB=item_2.Item1)  # -> expr("x/2", Distance)
divide_3 = DivideCurve(Curve=dispatch.ListA, Count=relay_2, Kinks=False)  # -> Points, Tangents, Parameters
divide_4 = DivideCurve(Curve=dispatch.ListB, Count=relay_2, Kinks=False)  # -> Points, Tangents, Parameters
merge = Merge(Data1=offset_2, Data2=offset, Data3=C)  # -> flatten(Result)
addition = Addition(A=A, B=dist)
dispatch_2 = Dispatch(List=divide_3.Points, DispatchPattern=[True, False])  # -> ListA, ListB
dispatch_3 = Dispatch(List=divide_4.Points, DispatchPattern=[True, False])  # -> ListA, ListB
Y_2 = UnitY(Factor=addition)
rev = Reverse(Vector=Y_2)
rev_2 = Reverse(Vector=Y_2)
move = Move(Geometry=dispatch_2.ListA, Motion=Y_2)  # -> Geometry, Transform
move_2 = Move(Geometry=dispatch_2.ListB, Motion=rev)  # -> Geometry, Transform
move_3 = Move(Geometry=dispatch_3.ListA, Motion=rev_2)  # -> Geometry, Transform
move_4 = Move(Geometry=dispatch_3.ListB, Motion=Y_2)  # -> Geometry, Transform
weave = Weave(Pattern=[0, 1], Stream0=move.Geometry, Stream1=move_2.Geometry, NullGaps=False)
weave_2 = Weave(Pattern=[0, 1], Stream0=move_3.Geometry, Stream1=move_4.Geometry, NullGaps=False)
pline = PolyLine(Vertices=weave, Closed=False)
pline_2 = PolyLine(Vertices=weave_2, Closed=False)
divide_5 = DivideCurve(Curve=pline_2, Count=10, Kinks=False)  # -> reverse(Points), Tangents, Parameters
divide_6 = DivideCurve(Curve=pline, Count=10, Kinks=False)  # -> Points, Tangents, Parameters
cp = ControlPoints(Curve=pline)  # -> Points, Weights, Knots
cp_2 = ControlPoints(Curve=pline_2)  # -> reverse(Points), Weights, Knots
intcrv = Interpolate(Vertices=divide_6.Points, Degree=3, Periodic=False, KnotStyle=1)  # -> Curve, Length, Domain
intcrv_2 = Interpolate(Vertices=divide_5.Points, Degree=3, Periodic=False, KnotStyle=1)  # -> Curve, Length, Domain
merge_2 = Merge(Data1=cp.Points, Data2=cp_2.Points)  # -> flatten(Result)
Z = UnitZ(Factor=Slider(1, range=0..1))
move_5 = Move(Geometry=merge_2, Motion=Z)  # -> reverse(Geometry), Transform
G = ClusterInput()
number_slider = Slider(13, range=0..100)
merge_3 = Merge(Data1=merge_2)
number_slider_2 = Slider(13, range=0..100)
pline_3 = PolyLine(Vertices=merge_3, Closed=False)
bbox = BoundingBox(Content=pline_3, Plane=PlaneXY(0, 0, 0))  # -> Box, Box_2
edges = BrepEdges(Brep=bbox.Box)  # -> Naked, Interior, NonManifold
concat = Concatenate(FragmentA=number_slider_2, FragmentB=" mm/s")
join = JoinCurves(Curves=edges.Naked, Preserve=False)
boundary = BoundarySurfaces(Edges=join)
geo = Geometry(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)
offset_3 = OffsetCurve(Curve=join, Distance=Slider(1.5, range=0..10), Plane=PlaneXY(0, 0, 0), Corners=1)
merge_4 = Merge(Data1=pline_3, Data2=offset_3)  # -> flatten(Result)
filter = StreamFilter(Gate=G, Stream0=merge, Stream1=merge_4)
len = Length(Curve=flatten(filter))
ma = MassAddition(Input=len)  # -> Result, PartialResults
expression = Expression(x=ma.Result, y=number_slider_2, Expression="(x/y)/60")
concat_2 = Concatenate(FragmentA=expression, FragmentB=" min")
concat_3 = Concatenate(FragmentA=ma.Result, FragmentB=" mm filament")
merge_5 = Merge(Data1=concat_2, Data2=concat, Data3=concat_3)
s_1 = ClusterOutput(filter)
R = ClusterOutput(merge_5)

# ==== cluster Geo_set
G = ClusterInput()
x = ClusterInput()
project = Project(Geometry=G, Plane=PlaneXY(0, 0, 0))  # -> Geometry, Transform
height_function = GhPythonScript(x=x)  # -> y
# ---------- height_function: Python ----------
__author__ = "guillaumejami"
__version__ = "2021.08.10"

import rhinoscriptsyntax as rs

if x <= 0:
    y= "x need to be poitive value"

if x >= 0 and x <= 1:
    y= 1

if x >= 1 and x <= 2:
    y= 1.2


if x >= 2 and x <= 3:
    y= 1.4


if x >= 3 and x <= 4:
    y= 1.4


if x >= 4 and x <= 5:
    y= 1.6
# ---------- end height_function ----------
area = Area(Geometry=project.Geometry)  # -> Area, Centroid
scale = Scale(Geometry=project.Geometry, Center=area.Centroid, Factor=height_function)  # -> Geometry, Transform
debrep = DeconstructBrep(Brep=scale.Geometry)  # -> Faces, Edges, Vertices
join = JoinCurves(Curves=debrep.Edges, Preserve=False)
C = ClusterOutput(join)

# ==== cluster Print_frame
C = ClusterInput()
cp = ControlPoints(Curve=C)  # -> flatten(Points), Weights, Knots
pl = ConstructPlane(Origin=cp.Points, XAxis=Vector(1, 0, 0), YAxis=Vector(0, 1, 0))
Z = UnitZ(Factor=1)
pl_2 = PlaneNormal(Origin=cp.Points, ZAxis=Z)
pln = Plane(pl_2)
pln_2 = ClusterOutput(pln)

# ==== cluster Cluster
data = ClusterInput()
number_slider = Slider(15, range=0..100)
data_2 = Data(data)
X = UnitX(Factor=number_slider)
X_2 = UnitX(Factor=expr("x*2", number_slider))
move = Move(Geometry=data_2, Motion=X)  # -> Geometry, Transform
move_2 = Move(Geometry=data_2, Motion=X)  # -> Geometry, Transform
neg = Negative(Value=X_2)
Y = UnitY(Factor=Slider(2, range=0..10))
move_3 = Move(Geometry=move_2.Geometry, Motion=Y)  # -> Geometry, Transform
move_4 = Move(Geometry=move_3.Geometry, Motion=neg)  # -> Geometry, Transform
merge = Merge(Data1=graft(data_2), Data2=graft(move.Geometry), Data3=graft(move_3.Geometry), Data4=graft(move_4.Geometry))
pline = PolyLine(Vertices=merge, Closed=False)
pl = ClusterOutput(pline)

# ==== cluster Cluster_2
data = ClusterInput()
number_slider = Slider(15, range=0..100)
data_2 = Data(data)
X = UnitX(Factor=number_slider)
X_2 = UnitX(Factor=expr("x*2", number_slider))
move = Move(Geometry=data_2, Motion=X)  # -> Geometry, Transform
move_2 = Move(Geometry=data_2, Motion=X)  # -> Geometry, Transform
neg = Negative(Value=X_2)
Y = UnitY(Factor=Slider(2, range=0..10))
neg_2 = Negative(Value=Y)
move_3 = Move(Geometry=move_2.Geometry, Motion=neg_2)  # -> Geometry, Transform
move_4 = Move(Geometry=move_3.Geometry, Motion=neg)  # -> Geometry, Transform
merge = Merge(Data1=graft(data_2), Data2=graft(move.Geometry), Data3=graft(move_3.Geometry), Data4=graft(move_4.Geometry))
pline = PolyLine(Vertices=merge, Closed=False)
pl = ClusterOutput(pline)
