# Grasshopper definition 6.15.prediction_script_r7.gh (Grasshopper 1.0.7)
# plug-ins: Human UI, Anemone, Kangaroo2 Components, karambaGH, Human, sof_gh_sofistik_rhino, Pufferfish, sof_gh_axis_modeling_rhino, LunchBox

# ---- group: UI / Show UI
toggle = BooleanToggle(True)

# ---- group: UI
getscreen = GetScreenDimensions()  # -> Width, Height
expression = Expression(x=Toggle(False), y=getscreen.Width, Expression="If( x, y, 152)")
swatch = Red(SwatchColor=RGB(150, 150, 150))
swatch_2 = Red(SwatchColor=RGB(255, 255, 255))
accent = ValueList({"Amber", "Blue", "Brown", "Cobalt", "Crimson", "Cyan", "Emerald", "Green", "Indigo", "Lime", "Magenta", "Mauve", "Olive", "Orange", "Pink", "Purple", "Red", "Sienna", "Steel", "Taupe", "Teal", "Violet", "Yellow"}, selected="Steel")
launchwin = LaunchWindow(
    Show=toggle,
    Name="4D Printing Simulation",
    Width=expression,
    Height=getscreen.Height,
    FontFamily="Minion Pro",
    ChildStatus=0,
    EnableHorizScroll=False)
radiobtn = CreateRadioButton(RadioButtonName="Less", RadioButtonGroup="Resolution", InitiallySelected=False)
colorpicker = CreateColorPicker(DefaultColor=swatch_2)
colorpicker_2 = CreateColorPicker(DefaultColor=swatch)
checkbox = CreateCheckbox(Label="3D View", StartingValue=True)
checkbox_2 = CreateCheckbox(Label="Export", StartingValue=False)
textbox = CreateTextBox(DefaultText="Input Layer", UpdateButton=False, showLabel=True)
radiobtn_2 = CreateRadioButton(RadioButtonName="Circle", RadioButtonGroup="Use Examples", InitiallySelected=True)
radiobtn_3 = CreateRadioButton(RadioButtonName="Rectangle", RadioButtonGroup="Use Examples", InitiallySelected=False)
radiobtn_4 = CreateRadioButton(RadioButtonName="Star", RadioButtonGroup="Use Examples", InitiallySelected=False)
radiobtn_5 = CreateRadioButton(RadioButtonName="Pattern", RadioButtonGroup="Use Examples", InitiallySelected=False)
radiobtn_6 = CreateRadioButton(RadioButtonName="Origami", RadioButtonGroup="Use Examples", InitiallySelected=False)
tb = CreateTextBlock(Text="Colour", TextSize=12, Justification=0)
radiobtn_7 = CreateRadioButton(RadioButtonName="Even Less", RadioButtonGroup="Resolution", InitiallySelected=False)
checkbox_3 = CreateCheckbox(Label="Rendering", StartingValue=False)
checkbox_4 = CreateCheckbox(Label="Stepper", StartingValue=True)
checkbox_5 = CreateCheckbox(Label="Pipes", StartingValue=True)
tb_2 = CreateTextBlock(Text="Resolution", TextSize=12, Justification=0)
radiobtn_8 = CreateRadioButton(RadioButtonName="Max", RadioButtonGroup="Resolution", InitiallySelected=False)
radiobtn_9 = CreateRadioButton(RadioButtonName="High", RadioButtonGroup="Resolution", InitiallySelected=False)
radiobtn_10 = CreateRadioButton(RadioButtonName="Medium", RadioButtonGroup="Resolution", InitiallySelected=True)
radiobtn_11 = CreateRadioButton(RadioButtonName="Low", RadioButtonGroup="Resolution", InitiallySelected=False)
radiobtn_12 = CreateRadioButton(RadioButtonName="Min", RadioButtonGroup="Resolution", InitiallySelected=False)
checkbox_6 = CreateCheckbox(Label="Use Examples", StartingValue=True)
swatch_3 = White(SwatchColor=RGB(212, 212, 212))
pt = Point(Point(0, 0, 0))
winprops = SetWindowProperties(
    Window=launchwin,
    StartingLocation=pt,
    Theme=Toggle(True),
    AccentColor=accent,
    ShowTitleBar=Toggle(True),
    BackgroundColor=swatch_3,
    ScaleFactor=1)
adjustpos = AdjustElementPositioning(
    ElementsToAdjust=[colorpicker_2, checkbox_5, colorpicker, textbox, checkbox_4, tb, checkbox, checkbox_3, checkbox_2],
    Margin="0,0,0,10",
    AbsolutePositioning=False)
adjustpos_2 = AdjustElementPositioning(ElementsToAdjust=textbox, Margin="0,5,0,5", AbsolutePositioning=False)
adjustpos_3 = AdjustElementPositioning(ElementsToAdjust=checkbox_6, Margin="0,5,0,10", AbsolutePositioning=False)
adjustpos_4 = AdjustElementPositioning(ElementsToAdjust=tb, Margin="0,0,0,5", AbsolutePositioning=False)
adjustpos_5 = AdjustElementPositioning(ElementsToAdjust=tb_2, Margin="0,0,0,5", AbsolutePositioning=False)
merge = Merge(
    Data1=textbox,
    Data2=checkbox_6,
    Data3=radiobtn_2,
    Data4=radiobtn_3,
    Data5=radiobtn_4,
    Data6=radiobtn_5,
    Data7=radiobtn_6)
merge_2 = Merge(Data1=radiobtn_2, Data2=radiobtn_3, Data3=radiobtn_4, Data4=radiobtn_5, Data5=radiobtn_6)
merge_3 = Merge(
    Data1=tb,
    Data2=textbox,
    Data3=colorpicker,
    Data4=colorpicker_2,
    Data5=checkbox,
    Data6=checkbox_3,
    Data7=checkbox_2,
    Data8=checkbox_4,
    Data9=checkbox_5,
    Data10=tb_2,
    Data11=radiobtn_8,
    Data12=radiobtn_9,
    Data13=radiobtn_10,
    Data14=radiobtn_11,
    Data15=radiobtn_12,
    Data16=radiobtn,
    Data17=radiobtn_7)
merge_4 = Merge(
    Data1=radiobtn_8,
    Data2=radiobtn_9,
    Data3=radiobtn_10,
    Data4=radiobtn_11,
    Data5=radiobtn_12,
    Data6=radiobtn,
    Data7=radiobtn_7)
msphere = MeshSphereEx(Base=PlaneXY(0, 0, 0), Radius=1e-06, Count=1)
stack = CreateStack(UIElements=merge, Horizontal=False)
stack_2 = CreateStack(UIElements=merge_3, Horizontal=False)
toggle_2 = CreateToggle(Default=False, OnLabel="Start", OffLabel="Stop")
_3dview = Create3DView(MeshToDisplay=msphere, MeshColors=swatch_3, ViewWidth=getscreen.Width, ViewHeight=getscreen.Height)
button = CreateButton(ButtonName="Reset", ButtonStyle=0)
button_2 = CreateButton(ButtonName="Start / Stop", ButtonStyle=0)
button_3 = CreateButton(ButtonName="Bake", ButtonStyle=0)
expander = CreateExpander(UIElements=stack, Header="  Input", Open=False)
expander_2 = CreateExpander(UIElements=stack_2, Header="  Settings", Open=False)
adjustpos_6 = AdjustElementPositioning(ElementsToAdjust=stack, AbsolutePositioning=False, Width=100, HorizontalAlignment=3, VerticalAlignment=3)
adjustpos_7 = AdjustElementPositioning(ElementsToAdjust=stack_2, AbsolutePositioning=False, Width=100, HorizontalAlignment=3, VerticalAlignment=3)
tooltip = AttachTooltipToElement(ElementsToAttachTo=button, TooltipContent="Reset the Simulation", ShowDelay=500, Duration=2000)
tooltip_2 = AttachTooltipToElement(ElementsToAttachTo=button_2, TooltipContent="Hold to Start the Simulation", ShowDelay=500, Duration=2000)
tooltip_3 = AttachTooltipToElement(ElementsToAttachTo=expander, TooltipContent="What to Simulate?", ShowDelay=500, Duration=2000)
adjustpos_8 = AdjustElementPositioning(ElementsToAdjust=[expander_2, expander], Margin="0,10,0,0", AbsolutePositioning=False)
merge_5 = Merge(Data1=button, Data2=toggle_2, Data3=button_2, Data4=button_3, Data5=expander, Data6=expander_2)
merge_6 = Merge(Data1=toggle_2, Data2=button, Data3=button_2, Data4=button_3, Data5=expander, Data6=expander_2)
adjustpos_9 = AdjustElementPositioning(
    ElementsToAdjust=merge_5,
    Margin="0,5,0,5",
    AbsolutePositioning=False,
    Width=120,
    HorizontalAlignment=3,
    VerticalAlignment=2)
stack_3 = CreateStack(UIElements=merge_5, Horizontal=False)
adjustelem = AdjustElementAppearance(ElementsToAdjust=merge_6, Foreground=RGB(255, 255, 255), FontSize=14)
merge_7 = Merge(Data1=stack_3, Data2=_3dview)
adjustpos_10 = AdjustElementPositioning(ElementsToAdjust=stack_3, Margin="0", AbsolutePositioning=False, Width=150, HorizontalAlignment=3, VerticalAlignment=2)
stack_4 = CreateStack(UIElements=merge_7, Horizontal=True)
val = ValueListener(Elements=toggle_2, SomeProperty=True)  # -> StartToogle, Indices
val_2 = ValueListener(Elements=button, SomeProperty=True)  # -> Values, Indices
val_3 = ValueListener(Elements=button_2, SomeProperty=True)  # -> StartStop, Indices
val_4 = ValueListener(Elements=button_3, SomeProperty=True)  # -> Values, Indices
val_5 = ValueListener(Elements=textbox, SomeProperty=True)  # -> Values, Indices
val_6 = ValueListener(Elements=checkbox_6, SomeProperty=True)  # -> flatten(Example), Indices
val_7 = ValueListener(Elements=merge_2, SomeProperty=True)  # -> flatten(Values), Indices
val_8 = ValueListener(Elements=colorpicker, SomeProperty=True)  # -> Color1, Indices
val_9 = ValueListener(Elements=colorpicker_2, SomeProperty=True)  # -> Color2, Indices
val_10 = ValueListener(Elements=checkbox, SomeProperty=True)  # -> _3DView, Indices
val_11 = ValueListener(Elements=checkbox_2, SomeProperty=True)  # -> Values, Indices
val_12 = ValueListener(Elements=checkbox_3, SomeProperty=True)  # -> Rendering, Indices
val_13 = ValueListener(Elements=checkbox_4, SomeProperty=True)  # -> Stepper, Indices
val_14 = ValueListener(Elements=checkbox_5, SomeProperty=True)  # -> Values, Indices
val_15 = ValueListener(Elements=merge_4, SomeProperty=True)  # -> flatten(Values), Indices
viewbox = CreateViewBox(UIElements=stack_4, Width=expr("x-50", getscreen.Width), Height=expr("x-50", getscreen.Height))
addelems = AddElements(Window=launchwin, Elements=viewbox, DoVLChecking=True)  # -> AddedElements, ElementNames
select = Select(layer=val_5.Values, example=val_6.Example, nr=val_7.Values)
merge_8 = Merge(Data1=val_8.Color1, Data2=val_9.Color2)
or = GateOr(A=val.StartToogle, B=val_3.StartStop)
and = GateAnd(A=or, B=val_12.Rendering)

# ----
io = IO(
    SofistikDocumentProperties_VersionMajor="2020",
    SofistikDocumentProperties_VersionMinor="9",
    SofistikDocumentProperties_VersionName="Rhino-Interface")
io_2 = IO(
    SofistikDocumentProperties_VersionMajor="2020",
    SofistikDocumentProperties_VersionMinor="9",
    SofistikDocumentProperties_VersionName="Rhino-Interface")
io_3 = IO(
    SofistikDocumentProperties_VersionMajor="2020",
    SofistikDocumentProperties_VersionMinor="9",
    SofistikDocumentProperties_VersionName="Rhino-Interface")
data_folder_name = Panel("data")

# ---- group: Folder name
data = Data(data_folder_name)

# ----
# Input
py = PythonScript(foldername=data)  # -> path
# ---------- py: Python ----------
import sys
import os

ghComp = ghenv.Component
ghDoc = ghComp.OnPingDocument()

# the full path of the gh file
path = ghDoc.FilePath
# the current directory 
path = os.path.abspath(os.path.join(path, "..." , foldername))

print path
# ---------- end py ----------

py_2 = PythonScript()  # -> path
# ---------- py_2: Python ----------
import sys
import os

ghComp = ghenv.Component
ghDoc = ghComp.OnPingDocument()

# the full path of the gh file
path = ghDoc.FilePath
# the current directory 
path = os.path.abspath(os.path.join(path, ".."))

print path
# ---------- end py_2 ----------
panel = Panel(py_2)
# Output
panel_2 = Panel(py)
# Visualization
number_slider = Slider(22, range=0..35)

# ---- group: Path cross-section
xz = XZPlane(Origin=Point(0, 0, 0))
rectangle = Rectangle(Plane=xz, XSize=Slider(2.5, range=0..10), YSize=Slider(1.89, range=0..10), Radius=Slider(0.89, range=0..1))  # -> Rectangle, Length

# ----
# In order for the components in this file to work, you need to add the correct folder to your paths in Rhino.
# In Rhino, type "EditPythonScript", go to Tools > Options > Add to search path and add the following folder:
# <path>/compas_slicer/src/grasshopper_visualization'
# Load Slicer
panel_3 = Panel("slicer_data.json")
csloadslicer = CsLoadSlicer(recompute=Button(), json_name=panel_3, path=py_2, folder_name=data)  # -> out, mesh, paths, are_closed, all_points; inputs recompute: Boolean
# ---------- csloadslicer: Python ----------
"""
Loads a Slicer class from its json file in the 'output' folder.

"""

import compas_slicer_ghpython.visualization as gh_compas_slicer
gh_compas_slicer = reload(gh_compas_slicer)


if path and folder_name and json_name:
    mesh, paths, are_closed, all_points = gh_compas_slicer.load_slicer(path, folder_name, json_name)
    
else:
    gh_compas_slicer.missing_input()
# ---------- end csloadslicer ----------

# ----
# Load Printpoints
panel_4 = Panel("out_printpoints.json")
csloadprintpoints = CsLoadPrintpoints(recompute=Button(), json_name=panel_4, path=py_2, folder_name=data)  # -> out, geometry, points, frames, layer_heights, up_vectors, mesh_normals, closest_support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; inputs recompute: Boolean
# ---------- csloadprintpoints: Python ----------
"""
Loads a dictionaly of Printpoints from a json file in the 'output' folder.

"""

import compas_slicer_ghpython.visualization as gh_compas_slicer
gh_compas_slicer = reload(gh_compas_slicer)


if path and folder_name and json_name:
    points, frames, layer_heights, up_vectors, mesh_normals, closest_support, velocities, wait_times, \
    blend_radiuses, extruder_toggles = \
        gh_compas_slicer.load_printpoints(path, folder_name, json_name)
    
else:
    gh_compas_slicer.missing_input()
# ---------- end csloadprintpoints ----------

number_slider_2 = Slider(0, range=0..35)
addition = Addition(A=number_slider, B=1)
number_slider_3 = Slider(10, range=0..10)

frames = Plane(csloadprintpoints.frames)
up_vectors = Vector(csloadprintpoints.up_vectors)
mesh_normals = Vector(csloadprintpoints.mesh_normals)
cpts = Point(csloadprintpoints.closest_support)
points = Point(csloadprintpoints.points)
layer_heights = Number(csloadprintpoints.layer_heights)

frames_2 = Plane(frames)
flippln = FlipPlane(Plane=frames_2, FlipX=False, FlipY=False, FlipZ=True)  # -> Flipped, R

mesh_normals_2 = Vector(mesh_normals)
points_2 = Point(points)
section = Curve(rectangle.Rectangle)

print_planes = Plane(flippln.Flipped)
tool_mesh = Mesh(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)

# ----
# Tool Visualization
number_slider_4 = Slider(0, range=0..2000)
tool_origin = Panel("""0
0
99.507""")
cstoolviz = CsToolViz(origin_coords=tool_origin, mesh=tool_mesh, planes=print_planes, index=number_slider)  # -> out, mesh, passed_path; inputs origin_coords: list, mesh: Mesh, planes: list, index: Int32
# ---------- cstoolviz: Python ----------
"""
Example visualization of tool motion during the print.

"""

import compas_slicer_ghpython.visualization as gh_compas_slicer
gh_compas_slicer = reload(gh_compas_slicer)

if origin_coords and mesh and planes and (index or index==0):
    mesh, passed_path = gh_compas_slicer.tool_visualization(origin_coords, mesh, planes, index)
else:
    gh_compas_slicer.missing_input()
# ---------- end cstoolviz ----------

velocities = Number(csloadprintpoints.velocities)
wait_times = Number(csloadprintpoints.wait_times)
blend_radiuses = Number(csloadprintpoints.blend_radiuses)
extruder_toggles = Number(csloadprintpoints.extruder_toggles)

# ----
# Ligthweight Path Visualization
number_slider_5 = Slider(4, range=0..10)
extruder_toggles_2 = Number(extruder_toggles)
all_points = Point(points)
cslightpathviz = CsLightPathViz(
    points=all_points,
    extruder_toggles=extruder_toggles_2,
    domain_start=Slider(0, range=0..35),
    domain_end=addition,
    pipe_diameter=number_slider_5)  # -> out, print_path_pipes, travel_path_lines; inputs points: list of Point3d, extruder_toggles: list of Boolean, domain_start: Int32, domain_end: Int32
# ---------- cslightpathviz: Python ----------
"""
Creates a lightweight visualization of the print paths. Segments with extruder_toggle=True are visualized as pipes, 
segments with extruder_toggle=False are visualized as lines.
Loads files from the 'output' folder.

"""

import compas_slicer_ghpython.visualization as gh_compas_slicer
gh_compas_slicer = reload(gh_compas_slicer)

pipe_resolution = 14

if points:
    
    # assign default values to parameters where possible. 
    if not extruder_toggles:
        extruder_toggles = [False for i in range(len(points))]
    if not domain_start:
        domain_start = 0
    if not domain_end:
        domain_end = len(points)
    if not pipe_diameter:
        pipe_diameter = 2.0
        
    print_path_pipes, travel_path_lines = \
        gh_compas_slicer.lightweight_path_visualization(points, extruder_toggles, domain_start, domain_end, pipe_diameter, pipe_resolution)
    
else:
    gh_compas_slicer.missing_input()
# ---------- end cslightpathviz ----------

# ----
# Render Path Visualization
extruder_toggles_3 = Number(extruder_toggles)
layer_heights_2 = Number(layer_heights)
up_vectors_2 = Vector(up_vectors)
python = CsRenderPathViz(
    points=points_2,
    mesh_normals=mesh_normals_2,
    layer_heights=layer_heights_2,
    up_vectors=up_vectors_2,
    extruder_toggles=extruder_toggles_3,
    cross_section=section,
    planar_printing=Toggle(True),
    compute=Toggle(False))  # -> out, loft_surfaces, travel_path_lines; inputs points: list of Point3d, mesh_normals: list of Vector3d, layer_heights: list, up_vectors: list of Vector3d, extruder_toggles: list of Boolean, cross_section: Curve, planar_printing: Boolean, compute: Boolean
# ---------- python: Python ----------
"""
Creates a render visualization of the print paths with loft surfaces where extruder_toggle=True.
For large number of points, this can take a while to compute, so keep it turned off unless you need it.
Loads files from the 'output' folder.

"""

import compas_slicer_ghpython.visualization as gh_compas_slicer
gh_compas_slicer = reload(gh_compas_slicer)

pipe_resolution = 14

if points and mesh_normals and layer_heights and extruder_toggles and cross_section:
    if compute:
        loft_surfaces, travel_path_lines = \
            gh_compas_slicer.render_path_visualization(points, mesh_normals, layer_heights, up_vectors, extruder_toggles, cross_section, planar_printing)
    else:
        print('Compute is set to False')
else:
    gh_compas_slicer.missing_input()
# ---------- end python ----------

mesh = Mesh(csloadslicer.mesh)
all_points_2 = Point(csloadslicer.all_points)
paths = Curve(csloadslicer.paths)

panel_5 = Panel(csloadprintpoints.out)
hexgrid = Hexagonal(
    Plane=PlaneXY(0, 0, 0),
    Size=Slider(40, range=0..100),
    ExtentX=Slider(15, range=0..100),
    ExtentY=Slider(12, range=0..100))  # -> Cells, Points
panel_6 = Panel(csloadslicer.out)
number_slider_6 = Slider(200, range=0..1000)

# ---- group: Color output
geo = Geometry(cslightpathviz.travel_path_lines)
geo_2 = Geometry(cslightpathviz.print_path_pipes)
preview = CustomPreview(Geometry=geo, Material=ColourSwatch(SwatchColor=RGB(255, 156, 36)))
preview_2 = CustomPreview(Geometry=geo_2, Material=ColourSwatch(SwatchColor=RGB(199, 199, 199)))

# ---- group: Polyline toolpath
dom = ConstructDomain(DomainStart=Slider(0, range=0..100), DomainEnd=number_slider)
subset = SubList(List=points, Domain=dom, Wrap=True)  # -> List, Index
pline = PolyLine(Vertices=subset.List, Closed=False)

# ---- group: Color output
geo_3 = Geometry(python.travel_path_lines)
geo_4 = Geometry(python.loft_surfaces)
preview_3 = CustomPreview(Geometry=geo_4, Material=ColourSwatch(SwatchColor=RGB(222, 222, 222)))
preview_4 = CustomPreview(Geometry=geo_3, Material=ColourSwatch(SwatchColor=RGB(255, 156, 36)))

# ----
geo_5 = Geometry(cstoolviz.passed_path)
mesh_2 = Mesh(cstoolviz.mesh)
preview_5 = CustomPreview(Geometry=mesh_2, Material=ColourSwatch(SwatchColor=RGB(171, 171, 171)))
preview_6 = CustomPreview(Geometry=geo_5, Material=ColourSwatch(SwatchColor=RGB(255, 156, 36)))

pline_2 = PolyLine(Vertices=points, Closed=False)
vdis = VectorDisplay(Anchor=points, Vector=expr("x*5", up_vectors))
crv = Curve(<curve referenced from the Rhino model>)
flip = FlipMatrix(Data=hexgrid.Points)  # -> simplify(Data)
crv_2 = Curve(<curve referenced from the Rhino model>)

# ---- group: Select parameter to display
list = ValueList({"Velocity": 0, "Wait time": 1, "Blend radius": 2, "Extruder Toggle": 3}, selected="Blend radius")

# ----
crv_3 = Curve(<curve referenced from the Rhino model>)
multiplication = Multiplication(A=Slider(80, range=0..80), B=10)
dom_2 = ConstructDomain(DomainStart=0, DomainEnd=1)
filter = StreamFilter(Gate=list, Stream0=velocities, Stream1=wait_times, Stream2=blend_radiuses, Stream3=extruder_toggles)
range = Range(Domain=dom_2, Steps=Slider(3, range=0..10))
rectangle_2 = Rectangle(Plane=PlaneXY(0, 0, 0), XSize=multiplication, YSize=multiplication, Radius=0)  # -> Rectangle, Length
eval = EvaluateCurve(Curve=reparameterize([crv, crv_3, crv_2]), Parameter=Slider(0.4, range=0..1))  # -> Point, Tangent, Angle
num = Number(filter)
number_slider_7 = Slider(100, range=0..100)
merge_9 = Merge(Data2=flip)

# ---- group: Visualize parameter with text
tag_offset = Slider(1, range=0..100)
pdecon = Deconstruct(Point=points)  # -> XComponent, YComponent, ZComponent
addition_2 = Addition(A=pdecon.ZComponent, B=tag_offset)
pt_2 = ConstructPoint(XCoordinate=pdecon.XComponent, YCoordinate=pdecon.YComponent, ZCoordinate=addition_2)
tag = TextTag(Location=pt_2, Text=num, Colour=ColourSwatch(SwatchColor=RGB(50, 130, 186)))

# ---- group: Visualize parameter with color
bnd = Bounds(Numbers=num)
avr = Average(Input=num)
dedomain = DeconstructDomain(Domain=bnd)  # -> Start, End
average = Panel(avr)
gradient = Gradient(
    LowerLimit=dedomain.Start,
    UpperLimit=dedomain.End,
    Parameter=num,
    stops=[0: RGB(0, 128, 0), 0.5: RGB(255, 255, 0), 1: RGB(255, 0, 0)])
pt_3 = Point(points)
cloud = CloudDisplay(Points=pt_3, Colours=gradient, Size=Slider(3.96, range=0..10), SpriteType=0)

# ----
explode = Explode(Curve=rectangle_2.Rectangle, Recursive=True)  # -> Segments, Vertices

# ---- group: Slicer data
len = Length(Curve=flatten(paths))
lng = ListLength(List=flatten(paths))
ma = MassAddition(Input=len)  # -> Result, PartialResults
total_path_length = Panel(ma.Result)
total_number_of_paths = Panel(lng)

# ----
# Draw Curves
crv_4 = Curve([<curve referenced from the Rhino model> x3])
min = Panel(dedomain.Start)
max = Panel(dedomain.End)
midpt = CurveMiddle(Curve=explode.Segments)
area = Area(Geometry=crv_4)  # -> Area, Centroid
item = ListItem(List=midpt, Index=Slider(2, range=0..10), Wrap=True)
item_2 = ListItem(List=midpt, Index=0, Wrap=True)
merge_10 = Merge(Data1=area.Centroid)  # -> flatten(Result)
cp = ClosestPoint(Point=merge_9, Cloud=merge_10)  # -> ClosestPoint, CPIndex, Distance
smaller = SmallerThan(FirstNumber=cp.Distance, SecondNumber=Slider(160, range=0..1000))  # -> SmallerThan, OrEqualTo
p_n_c = PickNChoose(Pattern=smaller.SmallerThan, Stream0=merge_9, Stream1=cp.ClosestPoint)
dcon = DeleteConsecutive(Set=p_n_c, Wrap=False)  # -> Set, Count
ln = Line(StartPoint=item_2, EndPoint=item)
crv_5 = Geometry(rectangle_2.Rectangle)
pline_3 = PolyLine(Vertices=dcon.Set, Closed=False)
divide = DivideCurve(Curve=pline_3, Count=Slider(6, range=0..20), Kinks=False)  # -> Points, Tangents, Parameters
nurbs = NurbsCurve(Vertices=divide.Points, Degree=Slider(3, range=0..10), Periodic=False)  # -> Curve, Length, Domain
join = JoinCurves(Curves=nurbs.Curve, Preserve=False)  # -> flatten(Curves)
lng_2 = ListLength(List=join)
subtraction = Subtraction(A=lng_2, B=1)
item_3 = ListItem(List=join, Index=subtraction, Wrap=True)
item_4 = ListItem(List=join, Index=Slider(0, range=0..100), Wrap=True)

# ---- group: Tri Settings
toggle_3 = BooleanToggle(True)
number_slider_8 = Slider(50, range=0..50)
number_slider_9 = Slider(0.01, range=0..0.01)

# ---- group: Offset?
# Remesh Settings
list_2 = ValueList({"No Offset": 0, "Offset": 1}, selected="Offset")

# ---- group: Trim_layer
number_slider_10 = Slider(0.05, range=0..0.1)

# ----
list_3 = ValueList({"Remesh(Discretation)": 0, "Remesh(Tri-Remesh)": 1, "Remesh(Tri-Remesh+Imperfection)": 2}, selected="Remesh(Discretation)")

# ---- group: layer height
layer_height = Slider(1.75, range=0..2.5)

# ----
list_4 = ValueList({"No Cap": 0, "Linear Cap": 1, "Tangent Cap": 2, "Curve Cap": 3}, selected="No Cap")

# ---- group: print_width
number_slider_11 = Slider(3.2, range=0..4)

# ---- group: #Width
list_5 = ValueList({"One": 1, "Two": 2, "Three": 2² - 1, "Four": Sqrt(16)}, selected="One")

# ---- group: #Layers
list_6 = ValueList({"One": 1, "Two": 2, "Three": 2² - 1, "Four": Sqrt(16)}, selected="Three")

# ----
both_directions = BooleanToggle(True)
list_7 = ValueList({"Mm": 0, "Cm": 1}, selected="Mm")
end = EndPoints(Curve=item_3)  # -> Start, End
end_2 = EndPoints(Curve=item_4)  # -> Start, End

# ---- group: Offset Factor?
list_8 = ValueList({"Zero": 0, "One": 1, "Two": 2, "Three": 2² - 1, "Four": Sqrt(16)}, selected="Two")

# ----
multiplication_2 = Multiplication(A=list_5, B=number_slider_11)
rec_2pt = Rectangle2Pt(Plane=PlaneXY(0, 0, 0), PointA=end_2.Start, PointB=end.End, Radius=0)  # -> Rectangle, Length
merge_11 = Merge(Data1=layer_height, Data2=multiplication_2, Data3=number_slider_11)
join_2 = JoinCurves(Curves=[join, rec_2pt.Rectangle], Preserve=False)
division = Division(A=merge_11, B=Slider(10, range=0..10))
filter_2 = StreamFilter(Gate=list_7, Stream0=merge_11, Stream1=division)  # -> graft(Stream)
pan = Panel("""1
2
4
10
15
20
25""")
bang = ExplodeTree(Data=filter_2)  # -> Branch0, Branch1, Branch2
cull = CullPattern(List=pan, CullPattern=val_15.Values)

# ---- group: Tolerance
number_slider_12 = Slider(1, range=0..10)

# ----
# save this as a .obj for slicing
panel_7 = Panel("Compas_slicer")
swatch_4 = ColourSwatch(SwatchColor=RGB(255, 130, 130))
list_9 = ValueList({"K2": 0, "Kangaroo": 1}, selected="Kangaroo")

# ---- group: textile settings / length strength
number_slider_13 = Slider(0.5, range=0..1)

# ---- group: Line intersection settings / angle strength
number_slider_14 = Slider(100, range=0..100)

# ---- group: 3D print goals / angle strength
number_slider_15 = Slider(100, range=0..100)

# ---- group: textile settings
stretching = ValueList({"120%": 0.83, "130%": 0.77, "150%": 0.66}, selected="130%")

# ---- group: 3D print goals / length strength
number_slider_16 = Slider(100, range=0..100)

# ---- group: Line intersection settings
length_strength = Slider(100, range=0..100)

# ----
# Kangaroo Goals
number_slider_17 = Slider(10, range=0..10)
floor = Floor(Strength=number_slider_17)
value_list = ValueList({"one_pos_Scan": 0, "muti__pos_scan": 1}, selected="one_pos_Scan")

# ----
# Read JSON_0
toggle_4 = BooleanToggle(True)
read = GhPythonScript(generate_Mesh=toggle_4)  # -> out, mesh; inputs generate_Mesh: Boolean
# ---------- read: Python ----------
import os
import json
from compas.datastructures import Mesh
from compas_ghpython.artists import MeshArtist


if generate_Mesh:
    layer_number = 0
    filename = os.path.join(path, name_json+'_Base_Mesh_%d.json' % layer_number)
    print filename
    c_mesh = Mesh.from_json(filename)
    
    artist = MeshArtist(c_mesh)
    mesh = artist.draw()
# ---------- end read ----------
dam = DataDam(DataA=read.mesh, BufferDelay=10000000, BufferMode=0)
clean = CombineClean(Meshes=dam)

# ----
# Load .ply
# To start the proxy server:
# - Start Ananconda Promt (as admin)
# - Run:
# from compas.rpc import Proxy
# p = Proxy()
py_3 = GhPythonScript()  # -> ply_source
# ---------- py_3: Python ----------
import os
import sys

filepath = ghenv.Component.Attributes.Owner.OnPingDocument().FilePath
path = os.path.abspath(os.path.join(filepath, "..", "..", ".."))
print(path)

ply_source = os.path.abspath(os.path.join(path, "GitHub/four_d/data"))
# ---------- end py_3 ----------
py_4 = GhPythonScript()  # -> ply_source
# ---------- py_4: Python ----------
import os
import sys

filepath = ghenv.Component.Attributes.Owner.OnPingDocument().FilePath
path = os.path.abspath(os.path.join(filepath, "..", "..", ".."))
print(path)

ply_source = os.path.abspath(os.path.join(path, "data/ply"))
# ---------- end py_4 ----------
panel_8 = Panel(py_3)
camera_position = Panel("-280, 0, 350")
type = ValueList({"mesh", "point cloud": "pointcloud"}, selected="mesh")
panel_9 = Panel()
start_proxy = BooleanToggle(True)
activate = BooleanToggle(True)
export = BooleanToggle(False)
crv_6 = Curve(<curve referenced from the Rhino model>)
boxrec = BoxRectangle(Rectangle=crv_6, Height=Slider(500, range=0..1000))
export_ply = GhPythonScript(activate=activate, start_proxy=start_proxy, export=export, path=panel_8, type=type)
# ---------- export_ply: Python ----------
from compas_ghpython import unload_modules
unload_modules('robotic_plaster_spraying.depthscan')
from compas.rpc import Proxy
import os

filename = os.path.join(os.path.abspath(path), 'scan.ply')
print filename

if activate:
    if start_proxy:
        depthscan = Proxy('robotic_plaster_spraying.depthscan')
    else:
        Proxy.stop_server(depthscan)
    if export:
        if type == "mesh":
            filename = os.path.join(os.path.abspath(path), 'scan.ply')
            depthscan.export(filename, mesh=True, pc=False)
        if type == "pointcloud":
            filename = os.path.join(os.path.abspath(path), 'pc.ply')
            depthscan.export(filename, mesh=False, pc=True)
# ---------- end export_ply ----------
path = PythonScript(path=panel_8, filename=panel_9)  # -> data
# ---------- path: Python ----------
import os

data = os.path.join(os.path.abspath(path), 'scan.ply')
# ---------- end path ----------
run = BooleanToggle(False)
import_scan = PythonScript(run=run, data=path)  # -> out, mesh
# ---------- import_scan: Python ----------
from compas.datastructures import Mesh
from compas_ghpython.artists import MeshArtist

if run:
    scanned_surface = Mesh.from_ply(data)
    artist = MeshArtist(scanned_surface)
    
    mesh = artist.draw()
# ---------- end import_scan ----------
process_mesh = Process_mesh(box=boxrec, G=import_scan.mesh, pt=camera_position)
mesh_3 = Mesh(process_mesh)

filter_3 = StreamFilter(Gate=value_list, Stream0=mesh_3)

# ----
# Build Base Mesh
offset = Slider(125, range=0..200)
resolution = Slider(25, range=0..100)
build = GhPythonScript(mesh=filter_3, offset=offset, resolution=resolution)  # -> out, mesh; inputs mesh: Mesh, resolution: Int32
# ---------- build: Python ----------
import Rhino.Geometry as rg
from robotic_plaster_spraying.utilities_fabrication.projection import RhinoMeshData

if mesh:
    mesh.Normals.ComputeNormals()
    points, fIDs, average_normal = RhinoMeshData(mesh)
    x_vec = rg.Vector3d.CrossProduct(average_normal, rg.Vector3d.ZAxis)
    x_vec.Unitize()
    
    b_box = rg.BoundingBox(points)
    box = rg.Box(b_box)
    
    x_length = box.X[1]-box.X[0]
    y_length = box.Y[1]-box.Y[0]
    height = box.Z[1]-box.Z[0]
    
    if x_length - y_length> 0:
        width = x_length
    else:
        width = y_length
    
    pt = box.Center - (width-offset)/2*x_vec - (height-offset)/2*rg.Vector3d.ZAxis
    plane = rg.Plane(pt, x_vec, rg.Vector3d.ZAxis)
    
    interval = rg.Interval(0,resolution+1)
    
    mesh = rg.Mesh.CreateFromPlane(plane, rg.Interval(0,width-offset), rg.Interval(0,height-offset), int(width/resolution), int(height/resolution))
# ---------- end build ----------
mesh_4 = Mesh(build.mesh)

# ----
# No Scan
number_slider_18 = Slider(6, range=0..10)
mesh_5 = Mesh()
build_2 = GhPythonScript(mesh=mesh_5, level=number_slider_18)  # -> out, mesh; inputs mesh: Mesh, level: Int32
# ---------- build_2: Python ----------
from robotic_plaster_spraying.utilities_fabrication.projection import RhinoToCompasMesh
from compas.datastructures import mesh_subdivide_quad
from compas_ghpython.artists import MeshArtist

c_mesh = RhinoToCompasMesh(mesh)
subd_mesh = mesh_subdivide_quad(c_mesh, k = level)

### Rhino mesh ###
mesh = MeshArtist(subd_mesh)
mesh = mesh.draw()
# ---------- end build_2 ----------
clean_2 = CombineClean(Meshes=build_2.mesh)
area_2 = Area(Geometry=clean_2)  # -> Area, Centroid
scale = Scale(Geometry=clean_2, Center=area_2.Centroid, Factor=Slider(1.1, range=0..10))  # -> Geometry, Transform

# ---- group: Trigger
trigger = Boolean(or)
loop_start = LoopStart(Repeat=20, Trigger=trigger, Data=1)  # -> port, Counter, Data
not = GateNot(A=trigger)
multiplication_3 = Multiplication(A=loop_start.Data, B=1.1)
loop_end = LoopEnd(port=loop_start.port, Exit=not, Data=multiplication_3, TimeOutVal=0, pausedState=False, state="Constant output")
steps = Steps(num=loop_end, stepper=val_13.Stepper)

# ----
# Process Control
value_list_2 = ValueList({"No Scan": 0, "Layer 0": 1, "Read base mesh from json": 2}, selected="No Scan")
filter_4 = StreamFilter(Gate=value_list_2, Stream0=clean_2, Stream1=mesh_4, Stream2=clean)
filter_5 = StreamFilter(Gate=value_list_2, Stream0=scale.Geometry, Stream1=filter_3, Stream2=filter_3)
scanned_mesh = Mesh(filter_5)
base_mesh = Mesh(filter_4)

# ----
# Project Base Mesh Vertices onto Scanned Mesh
mesh_6 = Mesh(scanned_mesh)
mesh_7 = Mesh(base_mesh)
projection = GhPythonScript(base_mesh=mesh_7, scanned_mesh=mesh_6)  # -> out, transformed_mesh, projected_direction; inputs base_mesh: Mesh, scanned_mesh: Mesh, robot_position: Point3d
# ---------- projection: Python ----------
import Rhino.Geometry as rg
import Rhino as rc
import math as m
from robotic_plaster_spraying.utilities_fabrication import projection
reload(projection)
from robotic_plaster_spraying.utilities_fabrication.data_gathering import remapValues

def mapValueListAsColor(values):
    
    """ Make a list of HSL color where the values are mapped onto a 
    0.0 - 0.7 hue domain. Meaning that low values will be red, medium
    values green and large values blue """
    
    colors = []
    remappedValues = remapValues(values,0.0,0.7)
    for v in remappedValues:
        c = rc.Display.ColorHSL(v,1.0,0.5).ToArgbColor()
        #c = rc.Display.ColorXYZ(v,0,0)
        colors.append(c)
    
    return colors

def colorMesh(mesh,colors):
    """ Color mesh vertices by a list of colors """
    for i,c in enumerate(colors):
        mesh.VertexColors.SetColor(i,c)

points, fIDs, projected_direction = projection.RhinoMeshData(base_mesh)

c_pt = base_mesh.ClosestPoint(robot_position)
normal = rg.Vector3d(c_pt - robot_position)

angle = rg.Vector3d.VectorAngle(projected_direction,normal)

if angle<m.radians(90):
    print ("reverse")
    projected_direction.Reverse()

transformed_vertices, _ = projection.PointProjectOnMesh(points, scanned_mesh, projected_direction)

transformed_mesh = rg.Mesh()

distances = []
for i in range(len(transformed_vertices)):
    transformed_mesh.Vertices.Add(transformed_vertices[i])
    distances.append(transformed_vertices[i].DistanceTo(points[i]))

[transformed_mesh.Faces.AddFace(*fID) for fID in fIDs]

colors = mapValueListAsColor(distances)
colorMesh(transformed_mesh,colors)
transformed_mesh.Smooth(1, True, True, True, True, 0)
# ---------- end projection ----------
mesh_8 = Mesh(projection.transformed_mesh)
vec = Vector(projection.projected_direction)

# ---- group: Input Curve from 3D curve
crv_7 = Curve()

# ---- group: Copy and Paste Mesh Filepath
panel_10 = Panel("10062021_235928_Prediction_Parameters__Transformed_Mesh.json")

# ---- group: WIP:Kangaroo_ENG_2_Goals / curve intersection
number_slider_19 = Slider(1, range=0..1)
distance_from_center = Slider(1, range=0..1)
radius = Slider(4, range=0..4)
elastic_modulus = Slider(3500, range=0..3500)

# ---- group: WIP:Kangaroo_ENG_2_Goals / Textile Settings
number_slider_20 = Slider(373, range=0..1000)
stretching_2 = ValueList({"120%": 0.83, "130%": 0.77, "150%": 0.66}, selected="150%")
textile_radius = Slider(1, range=0..1)
max_pretension = Slider(10, range=0..25)
strength = Slider(2, range=0..15)

# ---- group: WIP:Kangaroo_ENG_2_Goals / 3D printed Settings
number_slider_21 = Slider(1, range=0..1)
radius_2 = Slider(4, range=0..4)
elastic_modulus_2 = Slider(3500, range=0..3500)
z_height = Slider(2, range=0..2)

# ---- group: OLD / 3D printed material
matprops = MaterialPropertiesKaramba3D(
    FamilyOfMaterial="Plastic",
    Name="PLA",
    YoungsModulus_kN_cm2=Slider(300, range=0..1000),
    InPlaneShearModulus_kN_cm2=Slider(90, range=0..100),
    TransverseShearModulus_kN_cm2=Slider(90, range=0..100),
    SpecificWeight_kN_m3=Slider(12.4, range=0..100),
    CoefficientOfThermalExpansion_1_C=1e-05,
    YieldStrength_kN_cm2=Slider(4.5, range=0..10),
    mode="Isotrop")
matselect = MaterialSelectionKaramba3D(Materials=matprops, menu=[dropdown(1), dropdown(1)])
panel_11 = Panel(matselect)
division_2 = Division(A=Slider(7, range=0..10), B=Slider(2.1, range=0..10))
cross_section = CrossSectionKaramba3D(
    FamilyNameOfCrossSection="DefaultCroSec",
    Material=matselect,
    Diameter_cm=division_2,
    WallThickness_cm=division_2,
    mode="Circular Hollow")
panel_12 = Panel(cross_section)

# ---- group: OLD
# Karamba Material Properties
number_slider_22 = Slider(0.01, range=0..0.01)
panel_13 = Panel("membrane")

# ---- group: OLD / Textile material
number_slider_23 = Slider(1000, range=1..1000)
multiplication_4 = Multiplication(A=number_slider_23, B="0.5")
matprops_2 = MaterialPropertiesKaramba3D(
    FamilyOfMaterial="Steel",
    Name="S235",
    ElementIdentifier=panel_13,
    YoungsModulus_kN_cm2=number_slider_23,
    InPlaneShearModulus_kN_cm2=multiplication_4,
    TransverseShearModulus_kN_cm2=multiplication_4,
    SpecificWeight_kN_m3=78.5,
    CoefficientOfThermalExpansion_1_C=1e-05,
    YieldStrength_kN_cm2=23.5,
    mode="Isotrop")
number_slider_24 = Slider(1, range=0.1..1)
cross_section_2 = CrossSectionKaramba3D(FamilyNameOfCrossSection="DefaultCroSec", Material=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, Height_cm=1, mode="Shell - Const")

# ---- group: Dead_sofistik
py_5 = GhPythonScript(foldername="elastic_interface_regions.cdb")  # -> json_source
# ---------- py_5: Python ----------
import os
import sys

filepath = ghenv.Component.Attributes.Owner.OnPingDocument().FilePath
path = os.path.abspath(os.path.join(filepath, "..", ".."))


json_source = os.path.abspath(os.path.join(path, "sofistik", foldername))

print(json_source)
# ---------- end py_5 ----------
brep = Brep(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)
readsection = ReadSectionCdb(CdbFile=py_5, SectionId=Slider(1, range=0..10))  # -> Section, Variables
modify_section = ModifySection(Section=readsection.Section, SOF_SECTION_OUTPUTNONPARAMETRIC=False)
secattr = SectionAttributes(SectionId="1", SectionName="Test Membrane Sample", Material="1")
panel_14 = Panel("""NORM 'NS' 'en1992-2004' COUN 44
MAT 1 E 400E3/0.8 EY 300E3/0.8 MUE 0.25 G 10E3/0.8 $ OAL 0 $ t = 0.8 mm
NMAT 1 MEMB $ defines material as membrane
END
       """)
ase = AdvancedSolutionEngine(NumberOfThreads=-1)
modify_section_2 = ModifySection(Section=readsection.Section, SectionAttributes=secattr, SOF_SECTION_OUTPUTNONPARAMETRIC=False)
structural_area = StructuralArea(
    Brep=brep,
    Number=0,
    Group=0,
    Thickness=Slider(1, range=0..1),
    Material=0,
    ReinforcementMaterial=0,
    DirX=Vector(0, 0, 0),
    FlipZ=False,
    Alignment="Centered",
    MeshOptions="Automatic",
    ElementSize=0)
area_3 = Area(Geometry=brep)  # -> Area, Centroid
Z = UnitZ(Factor=Slider(-5, range=-10..10))
merge_12 = Merge(Data1=structural_area)
toggle_5 = BooleanToggle(False)
lpattr = LoopAttributes()
point_load = PointLoad(
    LoadCase=1,
    Force=Z,
    Moment=Vector(0, 0, 0),
    Displacement=Vector(0, 0, 0),
    RotationalDisplacement=Vector(0, 0, 0),
    HostLocal=False)
aqua = Aqua(ControlValues=panel_14)
sofiload = SOFiLOAD(Ld=point_load)
sofimshc = SOFiMSHC(
    StructuralElements=flatten(brep),
    InitSystem=True,
    CreateMesh=Toggle(True),
    MeshDensity=0,
    IntersectionTolerance=0.01,
    StartIndex=1000,
    GroupDivisor=-1000)
ase_2 = AdvancedSolutionEngine(LoadCaseIDs=Slider(1, range=0..1), NumberOfThreads=-1)
py_6 = PythonScript(filename="membrane_compression")  # -> path
# ---------- py_6: Python ----------
import sys
import os

ghComp = ghenv.Component
ghDoc = ghComp.OnPingDocument()

# the full path of the gh file
path = ghDoc.FilePath
# the current directory 
path = os.path.abspath(os.path.join(path, "..", "..", "sofistik", "test_files", filename))

print path
# ---------- end py_6 ----------
py_7 = PythonScript()  # -> path
# ---------- py_7: Python ----------
import sys
import os

ghComp = ghenv.Component
ghDoc = ghComp.OnPingDocument()

# the full path of the gh file
path = ghDoc.FilePath
# the current directory 
path = os.path.abspath(os.path.join(path, "..", "..", "sofistik", "test_files"))

print path
# ---------- end py_7 ----------
merge_13 = Merge(Data1=aqua, Data2=sofimshc, Data3=sofiload, Data4=ase_2)
panel_15 = Panel(py_6)
project = SOFiSTiKProject(
    SOFiSTiKData=merge_13,
    ProjectName="sofi_test_3",
    ProjectFolder=py_7,
    SOF_AUTO_MODE=False,
    SOF_SILENT_CALC=False,
    SOF_STREAM_CONTENT=False)
readsection_2 = ReadSectionCdb(CdbFile=panel_15)  # -> Section, Variables
readsection_3 = ReadSectionJson()

# ---- group: Set Curve
join_3 = JoinCurves(Curves=crv_5, Preserve=False)

# ----
center_print = CenterPrint(crv=join_3)

# ---- group: Set Curve (continued)
divide_curves = DivideCurves(I=center_print)  # -> crv_2, pt_2, valancy_2

# ----
check_print_safety = Check_Print_safety(C=center_print)  # -> R, G
crv_8 = Curve(check_print_safety.G)
preview_7 = CustomPreview(Geometry=crv_8, Material=ColourSwatch(SwatchColor=RGB(255, 0, 0)))
python_2 = GhPythonScript(x=check_print_safety.R)  # -> out; inputs x: list
# ---------- python_2: Python ----------
__author__ = "hjame"
__version__ = "2021.05.10"

import rhinoscriptsyntax as rs

count = x.count(0)
if count >= 1:
    print ('Do Not Print')

else:
    print ('Safe Print')
# ---------- end python_2 ----------
txt = Text(flatten(python_2))
panel_16 = Panel(txt)

# ----
# Remesh, Seperate Curves
offest_and_resemash = OffestAndResemash(
    P=divide_curves.crv_2,
    G=list_2,
    D=list_8,
    sharp=toggle_3,
    length=number_slider_8,
    F=number_slider_9,
    G_2=list_3,
    L=pan,
    mesh_size=val_15.Values)  # -> crv_2, L_3, M, L_2, s_0
find_2d_curves = Find2DCurves(B=number_slider_12, C=offest_and_resemash.L_2, T=offest_and_resemash.crv_2)  # -> similarity, crv_2, L

# ----
# Triangle Mesh Required for Compas Slicer
cluster = Cluster_3(
    C=center_print,
    A=list_6,
    B=bang.Branch0,
    B_2=number_slider_10,
    A_2=bang.Branch1,
    B_3=bang.Branch2,
    B_4=both_directions,
    T=list_4)  # -> crv_2, M, crv_4
crv_9 = Curve(cluster.crv_4)
bake = ObjectBake(
    BakeToggle=Button(),
    GeometryObjects=cluster.M,
    Layer=panel_7,
    ObjectName="3D_for_4D",
    ObjectColor=swatch_4,
    LayerColor=swatch_4)

# ---- group: Check Lines
line = Line(find_2d_curves.L)

# ---- group: Check Curve
crv_10 = Curve(find_2d_curves.crv_2)

# ----
dam_2 = DataDam(
    DataA=offest_and_resemash.L_2,
    DataB=divide_curves.pt_2,
    DataC=divide_curves.valancy_2,
    DataD=find_2d_curves.similarity,
    DataF=offest_and_resemash.s_0,
    DataG=find_2d_curves.similarity,
    BufferDelay=10000000,
    BufferMode=0)  # -> DataA, DataB, DataC, DataD, DataF, DataG
dam_3 = DataDam(
    DataA=dam_2.DataA,
    DataB=dam_2.DataB,
    DataC=dam_2.DataC,
    DataD=dam_2.DataD,
    DataE=dam_2.DataF,
    DataF=dam_2.DataG,
    BufferDelay=10000000,
    BufferMode=0)  # -> DataA, DataB, DataC, DataD, DataE, DataF
cluster_2 = Cluster(wbedges=dam_3.DataA, pt=dam_3.DataB, int=dam_3.DataC, printlines=dam_3.DataD)  # -> S, C, view_edges, printlines_2, i

# ---- group: show
mesh_9 = Mesh(dam_3.DataE)
smooth = Smooth(M=mesh_9, Strength=Slider(2, range=0..10))
show = Show(G=mesh_9)

# ----
textile = Textile(L=cluster_2.view_edges, D=cluster_2.printlines_2, B=stretching, strength=number_slider_13)
line_intersections = LineIntersections(line=cluster_2.i, strength_2=length_strength, strength=number_slider_14)  # -> L, A
_3d_printed_lines = _3DPrintedLines(line=cluster_2.S, C=cluster_2.C, strength=number_slider_16, strength_2=number_slider_15)  # -> L, A
entwine = Entwine(
    Branch00=floor,
    Branch01=_3d_printed_lines.L,
    Branch02=_3d_printed_lines.A,
    Branch03=textile,
    Branch04=line_intersections.L,
    Branch05=line_intersections.A,
    Branch06=show,
    Branch07=smooth,
    FlattenInputs=True)

# ---- group: Kangaroo Goals
clean_3 = CleanTree(RemoveNulls=True, RemoveInvalid=True, RemoveEmpty=False, Tree=entwine)

# ----
filter_6 = StreamFilter(Gate=list_9, Stream1=clean_3)
data_2 = Data(find_2d_curves.similarity)

# ----
# Generate Prediction Parameters
# 1.
# 2.
# Generate Remesh Parameters
# 1.
# 2.
gener_predict_params = Button()
generate_remesh_file = Button()
update_t_mesh = Button()
update_b_mesh = Button()
date_time = GetCurrentDatetime(Update=update_t_mesh, Format="%d%m%Y_%H%M")  # -> Exp
# ---------- date_time: Python ----------
import time
import scriptcontext as sc

if Format:
    sc.sticky["Format"] = Format
else: sc.sticky["Format"] = "%A, %B %d %Y (%H:%M:%S)"

if Update:
    Exp = sc.sticky["Time"] = time.strftime(sc.sticky["Format"])

#Check for Key and create 
if sc.sticky.has_key("Time"):Exp = sc.sticky["Time"]
else:Exp = sc.sticky["Time"] ="Unsaved"
# ---------- end date_time ----------
date_time_2 = GetCurrentDatetime(Update=update_b_mesh, Format="%d%m%Y_%H%M")  # -> Exp; same code as date_time
panel_17 = Panel(date_time)
panel_18 = Panel(date_time_2)
py_8 = GhPythonScript(foldername="6_15_Presentation")  # -> json_source
# ---------- py_8: Python ----------
import os
import sys

filepath = ghenv.Component.Attributes.Owner.OnPingDocument().FilePath
path = os.path.abspath(os.path.join(filepath, "..", "..", ".."))


json_source = os.path.abspath(os.path.join(path, "four_d/data", foldername))

print(json_source)
# ---------- end py_8 ----------
panel_19 = Panel(py_8)
panel_20 = Panel(py_8)
collect_remesh_params = GhPythonScript(
    remesh_type=list_3,
    offset=list_2,
    offset_distance=list_8,
    sharp=toggle_3,
    length=number_slider_8,
    wrap_factor=number_slider_9,
    resolution=cull,
    base_mesh=offest_and_resemash.s_0,
    bot=find_2d_curves.similarity,
    file_path=panel_19,
    name_json="Remesh_Parameters_",
    gener_remesh_params=generate_remesh_file,
    save_mesh=Toggle(False),
    add_date=Toggle(False),
    date_time=panel_18)  # -> out, R_param_list; inputs remesh_type: Int32, bot: list
# ---------- collect_remesh_params: Python ----------
__author__ = "hjame"
__version__ = "2021.04.23"

import rhinoscriptsyntax as rs
import os
import json
from compas.datastructures import Mesh
from compas_ghpython.artists import MeshArtist
from compas_rhino.geometry import RhinoMesh
from robotic_plaster_spraying.utilities_fabrication.projection import RhinoToCompasMesh
from robotic_plaster_spraying.utilities_fabrication.data_gathering import WriteDictToJson

#master_list = []

#constants
if remesh_type == 1 or 2:
    remesh_params = { "Type": [remesh_type],
                    'Offset': [offset],
                    "Offset_Distance": [offset_distance],
                    "Sharp": [sharp],
                    "line_length": [length],
                    "wrap_offset": [wrap_factor],
                    "beams_or_textile": [bot]
                    }

if remesh_type == 0:
    remesh_params = { "Type": [remesh_type],
                    'Offset': [offset],
                    "Offset_Distance": [offset_distance],
                    "Mesh_resolution": [resolution],
                    "beams_or_textile": [bot]
                    }

b_mesh = RhinoToCompasMesh(base_mesh)

if add_date == True:
    parameters_filename = os.path.join(file_path, date_time+"_"+name_json+"_Remesh_parameters.json")
    mesh_filename = os.path.join(file_path, date_time+"_"+name_json+'_Base_Mesh.json')
else:
    mesh_filename = os.path.join(file_path, name_json+'_Base_Mesh.json')
    parameters_filename = os.path.join(file_path, name_json+"_Remesh_parameters.json")
    


#save the mesh
if save_mesh == True:
    b_mesh.to_json(mesh_filename, pretty = True)
    remesh_params['mesh_file'] = [date_time+"_"+name_json+'_Base_Mesh.json']

#save the params
if gener_remesh_params:
    WriteDictToJson(parameters_filename, remesh_params)
#





#
#commit to master list
#master_list = []
#if commit_data:
#    master_list.append(remesh_params)
#    master_filename = os.path.join(file_path, name_master+"_master_list.json")
#    json.dumps(master_filename, master_list)
#
#print(master_list)



#############################
# ---------- end collect_remesh_params ----------
panel_21 = Panel(py_8)

# ----
# Read JSON
toggle_6 = BooleanToggle(True)
read_2 = GhPythonScript(
    mesh_filepath=panel_21,
    mesh_filename=panel_10,
    load_base_mesh=Toggle(True),
    load_bot=toggle_6,
    reverse_vol=Toggle(False))  # -> out, mesh, close_mesh, target_pts_out; inputs load_base_mesh: Boolean
# ---------- read_2: Python ----------
import os
import json
import Rhino.Geometry as rg
import ghpythonlib.treehelpers as th
from compas.geometry import Vector
from compas.datastructures import Mesh
from compas_ghpython.artists import MeshArtist
from robotic_plaster_spraying.utilities_fabrication import data_gathering
reload(data_gathering)
from robotic_plaster_spraying.utilities_fabrication import projection
reload(projection)

if load_base_mesh:
    c_mesh = Mesh.from_json(os.path.join(mesh_filepath, mesh_filename))
    
    artist = MeshArtist(c_mesh)
    mesh = artist.draw()
    
    close_mesh = projection.CapMesh(c_mesh, reverse = reverse_vol)
    
    artist = MeshArtist(close_mesh)
    close_mesh = artist.draw()
    
#if load_bot:
#    bot = beam_index
#    bot = bot.split(",")
#    print bot


#if load_remesh_parameters:
#    fabrication_parameters = data_gathering.ReadDictFromJson(os.path(parameters_filepath))
#    
#    path = []
#    velocity_list = []
#    Ed_list = []
#    normal_list = []
#    overall_setting = []
#    
#    for i in range(len(fabrication_parameters)):
#        branch = []
#        Ed = []
#        velocity = []
#        normal = []
#        for j in range(len(fabrication_parameters['%d' % i])):
#            if i == 0 and j == 0:
#                overall_setting.extend([fabrication_parameters['%d' % i]['%d' % j]['pump_speed'],
#                                        fabrication_parameters['%d' % i]['%d' % j]['air_pressure'],
#                                        fabrication_parameters['%d' % i]['%d' % j]['custom_layer_num']
#                                       ])
#                branch.append(rg.Point3d(*fabrication_parameters['%d' % i]['%d' % j]['xyz']))
#                Ed.append(fabrication_parameters['%d' % i]['%d' % j]['Ed'])
#                velocity.append(fabrication_parameters['%d' % i]['%d' % j]['velocity'])
#                normal.append(Vector(*fabrication_parameters['%d' % i]['%d' % j]['normal']))
#            else:
#                
#                branch.append(rg.Point3d(*fabrication_parameters['%d' % i]['%d' % j]['xyz']))
#                Ed.append(fabrication_parameters['%d' % i]['%d' % j]['Ed'])
#                velocity.append(fabrication_parameters['%d' % i]['%d' % j]['velocity'])
#                normal.append(Vector(*fabrication_parameters['%d' % i]['%d' % j]['normal']))
#        
#        path.append(branch)
#        Ed_list.append(Ed)
#        velocity_list.append(velocity)
#        normal_list.append(normal)
#        
#    target_pts_out = th.list_to_tree(path)
#    velocity_list_out = th.list_to_tree(velocity_list)
#    Ed_list_out = th.list_to_tree(Ed_list)
#    overall_setting_out = th.list_to_tree(overall_setting)
# ---------- end read_2 ----------
color = Color(M=read_2.mesh, P=find_2d_curves.similarity)  # -> mesh_3, L, P_2
mesh_10 = Mesh(read_2.close_mesh)
pt_4 = Point(read_2.target_pts_out)

# ---- group: Solve and Show
bouncysolver = BouncySolver(GoalObjects=filter_6, Reset=val_2.Values, Threshold=1e-08, Tolerance=0.0001, Damping=0.99, Iterations=steps, On=or)  # -> I, V, O
# Solve and Show 4D print
iterations = Panel(bouncysolver.I)
ende = Panel("1000")

# ---- group: WIP:Kangaroo_ENG_2_Goals
# K2 Engineering Goals
dam_4 = DataDam(BufferDelay=10000000, BufferMode=0)  # -> DataA, DataB, DataC, DataD, DataE, DataF
cluster_3 = Cluster(wbedges=dam_4.DataA, pt=dam_4.DataB, int=dam_4.DataC, printlines=dam_4.DataD)  # -> S, C, view_edges, printlines_2, i
number_slider_25 = Slider(2, range=0..10)
k2_3d_printed_lines = K23DPrintedLines(line=cluster_3.S, C=cluster_3.C, relay=elastic_modulus_2, z=radius_2, opt=number_slider_21, x=z_height)  # -> beam_2, bar_2, rod_2
k2_line_intersections = K2LineIntersections(line=cluster_3.i, relay=elastic_modulus, x=radius, z=distance_from_center, opt=number_slider_19)  # -> bar_2, rod_2
k2_textile = K2Textile(
    L=cluster_3.view_edges,
    D=cluster_3.printlines_2,
    s0=strength,
    ptmax=max_pretension,
    x=textile_radius,
    B=stretching_2,
    E=number_slider_20)

# ----
filter_7 = StreamFilter(Gate=list_9, Stream0=dam_4.DataF, Stream1=dam_3.DataF)
show_4d_result = Show4DResult(P=filter_7, print=filter_7, T=bouncysolver.O, x=val_14.Values)  # -> O, T_2, P_2, mesh_2
find_3d_curves = Find3DCurves(brep=show_4d_result.P_2, mesh=show_4d_result.mesh_2, P=data_2)  # -> brep_4, L_2, mesh_3, L_3, L

# ---- group: Input Mesh from 3D curve
mesh_11 = Mesh(find_3d_curves.mesh_3)

# ----
# Data Collection
collect_predict_params = GhPythonScript(
    rod_radius=radius_2,
    z_height=z_height,
    strength=strength,
    max_pretension=max_pretension,
    textile_radius=textile_radius,
    transformed_mesh=mesh_11,
    file_path=panel_20,
    name_json="Prediction_Parameters_",
    gener_predict_params=gener_predict_params,
    save_mesh=Toggle(False),
    add_date=Toggle(False),
    date_time=panel_17)  # -> out, prediction_parameters
# ---------- collect_predict_params: Python ----------
__author__ = "hjame"
__version__ = "2021.04.22"

import rhinoscriptsyntax as rs
import os
import json
from compas.datastructures import Mesh
from compas_ghpython.artists import MeshArtist
from compas_rhino.geometry import RhinoMesh
from robotic_plaster_spraying.utilities_fabrication.projection import RhinoToCompasMesh
from robotic_plaster_spraying.utilities_fabrication.data_gathering import WriteDictToJson

#constants
##rods
Rod_EM = 2241 # MPA 
Rest_Angle = 1 

##Textile
Textile_EM = 373 # MPA
Stretch = .66

#mesh_list =  [list[(b) for b in mesh


predict_params = {'rod_radius': rod_radius,
                            'z_height': z_height,
                            'tension_strength': strength,
                            'max_pretension': max_pretension,
                            'textile_thickness': textile_radius,
                            'Rod_EM': Rod_EM,
                            'Rest_Angle': Rest_Angle,
                            'Textile_EM': Textile_EM,
                            'Stretch': Stretch
                            }


t_mesh = RhinoToCompasMesh(transformed_mesh)
#mesh_filename = os.path.join(file_path, name_json+'_Base_Mesh_%d.json')
#parameters_filename = os.path.join(file_path, name_json+"_Remesh_parameters.json")

if add_date == True:
    parameters_filename = os.path.join(file_path, date_time+"_"+name_json+"_Prediction_parameters.json")
    mesh_filename = os.path.join(file_path, date_time+"_"+name_json+'_Transformed_Mesh.json')
else:
    mesh_filename = os.path.join(file_path, name_json+'_Transformed_Mesh.json')
    parameters_filename = os.path.join(file_path, name_json+"_Prediciton_parameters.json")
    


#save the mesh
if save_mesh == True:
    t_mesh.to_json(mesh_filename, pretty = True)
    predict_params['mesh_file'] = mesh_filename

#save the params
if gener_predict_params:
    WriteDictToJson(parameters_filename, predict_params)



##Generate JSON
#t_mesh = RhinoToCompasMesh(transformed_mesh)
#mesh_filename = os.path.join(file_path, name_json+'_Tansformed_Mesh_%d.json')
#parameters_filename = os.path.join(file_path, name_json+"_Prediction_parameters.json")
#save the params
#if gener_predict_params:
#    WriteDictToJson(parameters_filename, prediction_params)
#save the mesh
#if save_mesh:
#    t_mesh.to_json(mesh_filename, pretty = True)
#
# ---------- end collect_predict_params ----------

merge_14 = Merge(Data1=show_4d_result.O, Data2=show_4d_result.T_2)
result = Mesh(merge_14)

# ---- group: Solve and Show (continued)
output = Output(in_run=val_11.Values, O=result, B=val_4.Values, N=bouncysolver.I)
render = Render(result=result, iteration=bouncysolver.I, ende=ende, render=and)

# ----
preview_8 = CustomPreview(Geometry=find_3d_curves.brep_4, Material=ColourSwatch(SwatchColor=RGB(64, 64, 64)))
preview_9 = CustomPreview(Geometry=find_3d_curves.mesh_3, Material=ColourSwatch(SwatchColor=RGB(227, 227, 227)))

# ---- group: WIP:Kangaroo_ENG_2_Goals / show
mesh_12 = Mesh(dam_4.DataE)
show_2 = Show(G=mesh_12)
smooth_2 = Smooth(M=mesh_12, Strength=number_slider_25)

# ---- group: WIP:Kangaroo_ENG_2_Goals (continued)
entwine_2 = Entwine(
    Branch02=k2_3d_printed_lines.beam_2,
    Branch03=k2_textile,
    Branch04=k2_line_intersections.bar_2,
    Branch05=k2_line_intersections.rod_2,
    Branch06=show_2,
    Branch07=smooth_2,
    FlattenInputs=True)

# ---- group: WIP:Kangaroo_ENG_2_Goals / K2 Goals
clean_4 = CleanTree(RemoveNulls=True, RemoveInvalid=True, RemoveEmpty=False, Tree=entwine_2)

# ---- group: analysis
linetobeam = LineToBeamKaramba3D(CrossSection=cross_section, New=True, Remove=True, LimitDistance_m=0.005)  # -> Element, Points, Info
meshtoshell = MeshToShellKaramba3D(Identifier="membrane", CrossSection=cross_section_2, LimitDistance_m=0.005)  # -> Element, Points, Info
medges = MeshEdges()  # -> NakedEdges, InteriorEdges, NonManifoldEdges
end_3 = EndPoints(Curve=medges.NakedEdges)  # -> Start, End
rdpoints = RemoveDuplicatePointsKaramba3D(Point=end_3.Start, LimitDistance=0.005)  # -> OutPoint, Info, Indexes
pt_5 = Point(rdpoints.OutPoint)
supp = SupportKaramba3D(PosInd=pt_5, menu=[buttons(on, on, on, off, off, off)])
Z_2 = UnitZ(Factor=Slider(-0.649, range=-10..10))
loads = LoadsKaramba3D(Vector=Z_2, LCase=0, mode="Gravity")
merge_15 = Merge(Data1=linetobeam.Element, Data2=meshtoshell.Element)

# ----
# Build and Analyse - Karamba
# Visualization
number_slider_26 = Slider(0, range=0..100)
pt_6 = Point(linetobeam.Points)
merge_16 = Merge(Data1=linetobeam.Points, Data2=meshtoshell.Points)
pdecon_2 = Deconstruct(Point=linetobeam.Points)  # -> XComponent, YComponent, ZComponent
larger = LargerThan(FirstNumber=pdecon_2.ZComponent, SecondNumber=number_slider_26)  # -> LargerThan, OrEqualTo
cull_2 = CullPattern(List=pt_6, CullPattern=larger.LargerThan)
loads_2 = LoadsKaramba3D(Vector=Z_2, LCase=0, mode="Uniform Line", menu=[buttons(off, on, off)])
loads_3 = LoadsKaramba3D(Vector=Z_2, LCase=0, mode="MeshLoad -Const.", menu=[buttons(off, on, off), buttons(on, on)])
load = LoadKaramba3D(flatten([loads_2, loads_3]))

# ---- group: analysis (continued)
supp_2 = SupportKaramba3D(PosInd=pt_6, menu=[buttons(on, on, on, on, on, on)])
assemble = AssembleModelKaramba3D(Elem=merge_15, Support=supp_2, Load=loads, LimitDistance_m=0.005)  # -> Model, Info, Mass_kg, CenterOfGravity
analyze = AnalyzeKaramba3D(Model=assemble.Model)  # -> CalculatedModel, MaximumDisplacement_cm, ResultingForceOfGravity_kN, ElasticEnergy_kNm

# ---- group: Shell and beam view
modelview = ModelViewKaramba3D(Model=analyze.CalculatedModel, ResultFactors=1, ResultCase=-1)  # -> Model, DeformedMesh, DeformedAxes, DeformedModel
shellview = ShellViewKaramba3D(Model=modelview.Model, IndexOfLayer=0)  # -> Model, MeshesOfRenderedShells, LegendColors, LegendTags
legend = Legend(Colour=shellview.LegendColors, Tags=shellview.LegendTags, LegendType=1)
beamview = BeamViewKaramba3D(Model=shellview.Model)  # -> Model, MeshesOfRenderedBeams, DeformedBeamAxes, LegendColors, LegendTags
mesh_13 = Mesh(beamview.MeshesOfRenderedBeams)
legend_2 = Legend(Colour=beamview.LegendColors, Tags=beamview.LegendTags, LegendType=1)

# ----
dam_5 = DataDam(
    DataA=shellview.Model,
    DataB=shellview.MeshesOfRenderedShells,
    DataC=shellview.MeshesOfRenderedShells,
    BufferDelay=10000000,
    BufferMode=0)  # -> DataA, DataB, DataC

# ---- group: Visualise Principal Stress Lines
popgeo = PopulateGeometry(Geometry=dam_5.DataB, Count=Slider(100, range=20..200), Seed=1)
medges_2 = MeshEdges(Mesh=dam_5.DataC)  # -> NakedEdges, InteriorEdges, NonManifoldEdges
shelllineresults = LineResultsOnShellsKaramba3D(
    AnalyzedModel=dam_5.DataA,
    LayerPosition=Slider(0, range=-1..1),
    ListOfSourcesOfPrincipalStressLinesLinesPoints=flatten(popgeo),
    SegmentLength_m=0.5,
    DA_deg=5,
    mode="PrincStress")  # -> AnalyzedModel, Lines1, Lines2
previewlw = CustomPreviewLineweights(Geometry=medges_2.NakedEdges, Shader=ColourSwatch(SwatchColor=RGB(0, 0, 0)), Thickness="2")
join_4 = JoinCurves(Curves=shelllineresults.Lines1, Preserve=False)
join_5 = JoinCurves(Curves=shelllineresults.Lines2, Preserve=False)
subcrv = SubCurve(BaseCurve=join_4, Domain="0 to 20")
subcrv_2 = SubCurve(BaseCurve=join_5, Domain="0 to 20")
preview_10 = CustomPreview(Geometry=subcrv_2, Shader=ColourSwatch(SwatchColor=RGB(255, 0, 0)))
preview_11 = CustomPreview(Geometry=subcrv, Shader=ColourSwatch(SwatchColor=RGB(0, 0, 255)))

# ==== cluster Render
iteration = ClusterInput()
result = ClusterInput()
ende = ClusterInput()
result_2 = Mesh(flatten(result))
iteration_2 = Number(iteration)
ende_2 = Number(ende)
colour = ColourPicker(PickedColour=RGB(255, 255, 255))
colour_2 = ColourPicker(PickedColour=RGB(255, 255, 255))
colour_3 = ColourPicker(PickedColour=RGB(255, 255, 255))
colour_4 = ColourPicker(PickedColour=RGB(255, 255, 255))
division = Division(A=1, B=ende_2)
path = Panel("C:\Users\ronny\Desktop\render\")
multiplication = Multiplication(A=division, B=iteration_2)
expression = Expression(x=iteration_2, y=ende_2, Expression="If( x < y, true, false)")
material = CreateMaterial(
    Diffuse=colour,
    Specular=colour_3,
    Emission=RGB(0, 0, 0),
    Transparency=Slider(0, range=0..1),
    Shine=Slider(0, range=0..100))
multiplication_2 = Multiplication(A=multiplication, B=1.570796327)
material_2 = CreateMaterial(
    Diffuse=colour_2,
    Specular=colour_4,
    Emission=RGB(0, 0, 0),
    Transparency=Slider(0.1, range=0..1),
    Shine=Slider(0, range=0..100))
rotate = Rotate(Geometry=result_2, Angle=multiplication_2, Plane=PlaneXY(0, 0, 0))  # -> Geometry, Transform
render = ClusterInput()
merge = Merge(Data1=material, Data2=material_2)
and = GateAnd(A=expression, Render=render)
c_render_loop = CSharpScript(geometry=result_2, material=merge, activate=and, current=iteration_2, filePath=path)  # -> out; inputs geometry: list of GeometryBase, material: list, layers: list of String, activate: Boolean, current: Int32, filePath: String
# ---------- c_render_loop: C# ----------
    if(!activate) return;

    List<Guid> guids = new List<Guid>();

    for(int i = 0; i < geometry.Count; i++){

      Rhino.DocObjects.ObjectAttributes att = new Rhino.DocObjects.ObjectAttributes();

      Rhino.Display.DisplayMaterial shader = new Rhino.Display.DisplayMaterial();

      if(material.Count == geometry.Count){
        shader = (Rhino.Display.DisplayMaterial) material[i];
      }else if(material.Count > 0){
        shader = (Rhino.Display.DisplayMaterial) material[0];
      }

      Rhino.DocObjects.Material mat = new Rhino.DocObjects.Material();

      mat.AmbientColor = shader.Ambient;
      mat.DiffuseColor = shader.Diffuse;
      mat.EmissionColor = shader.Emission;
      mat.Shine = shader.Shine;
      mat.SpecularColor = shader.Specular;
      mat.Transparency = shader.Transparency;

      string shaderName = string.Format("D{0}-E{1}-S{2}-Sp{3}-T{4}",
        shader.Diffuse.Name,
        shader.Emission.Name,
        shader.Shine,
        shader.Specular,
        shader.Transparency
        );

      mat.Name = shaderName;

      int nwMat = doc.Materials.Find(shaderName, true);
      if(nwMat < 0) nwMat = doc.Materials.Add(mat);

      Print(nwMat.ToString());

      string layer = "";

      if(layers.Count == geometry.Count){
        layer = layers[i];
      }else if(layers.Count > 0){
        layer = layers[0];
      }

      if(layer.Length == 0){
        att.MaterialSource = Rhino.DocObjects.ObjectMaterialSource.MaterialFromObject;
        att.MaterialIndex = nwMat;
        att.LayerIndex = doc.Layers.Find(doc.Layers.CurrentLayer.Id, true);
      }else{
        att.MaterialSource = Rhino.DocObjects.ObjectMaterialSource.MaterialFromLayer;
        int layInd = doc.Layers.Find(layer, true);
        if(layInd < 0){
          Rhino.DocObjects.Layer l = new Rhino.DocObjects.Layer();
          l.Color = mat.DiffuseColor;
          l.Name = layer;
          l.RenderMaterialIndex = nwMat;
          layInd = doc.Layers.Add(l);
        }
        att.LayerIndex = layInd;
      }

      Guid id = Guid.Empty;

      if(geometry[i].ObjectType == Rhino.DocObjects.ObjectType.Brep) id = doc.Objects.AddBrep((Brep) geometry[i], att);
      if(geometry[i].ObjectType == Rhino.DocObjects.ObjectType.Surface) id = doc.Objects.AddSurface((Surface) geometry[i], att);
      if(geometry[i].ObjectType == Rhino.DocObjects.ObjectType.Mesh) id = doc.Objects.AddMesh((Mesh) geometry[i], att);

      if(id.ToString().Length > 0) guids.Add(id);

    }


    string savedLocation = filePath + "\\r" + current.ToString("") + ".png";

    Rhino.RhinoApp.RunScript("_-Render", false);
    Rhino.RhinoApp.RunScript("_-SaveRenderWindowAs \n\"" + savedLocation + "\"\n", false);
    Rhino.RhinoApp.RunScript("_-CloseRenderWindow", false);
    Rhino.RhinoApp.RunScript("_-ClearUndo", false);

    for(int i = 0; i < guids.Count; i++) doc.Objects.Delete(guids[i], true);
# ---------- end c_render_loop ----------

# ==== cluster Output
O = ClusterInput()
layer = Panel("C:\Users\ronny\Desktop\Rhino\output\")
group = Group(Objects=O)
layer_2 = Panel("Simulation")
N = ClusterInput()
layer_3 = DefineLayer(Name=N)
join = TextJoin(Text=[layer_2, layer_3], Join="::")
in_run = ClusterInput()
attributes = DefineObjectAttributes(Layer=join)
layer_4 = Panel("Mesh")
B = ClusterInput()
panel = Panel(O)
bake = BakeObjects(Geometry=group, Attributes=attributes, Bake=B)
c_script = CSharpScript(in_run=in_run, in_mesh=O, in_name=N, in_path=layer)  # -> out, A; inputs in_run: Boolean, in_mesh: list of Mesh, in_name: String, in_path: String
# ---------- c_script: C# ----------
    
    /* gefunden unter: https://discourse.mcneel.com/t/how-to-write-selected-mesh-to-an-obj-file/47365/6 */
  
  if(in_run) {
      path = System.IO.Path.GetDirectoryName(in_path) + "\\" + in_name + ".obj";
      int faceCount = 0;
      using(StreamWriter writer = new StreamWriter(path)) {
        for(int n = 0; n < in_mesh.Count; n++) {
          List<String> vert = new List<String>();
          List<String> face = new List<String>();

          in_mesh[n].Faces.ConvertQuadsToTriangles();
          BoundingBox bbox = in_mesh[n].GetBoundingBox(true);

          for(int i = 0; i < in_mesh[n].Vertices.Count; i++) {
            vert.Add(String.Format("v {0} {1} {2}", -in_mesh[n].Vertices[i].X, in_mesh[n].Vertices[i].Z, in_mesh[n].Vertices[i].Y));
          }

          for(int i = 0; i < in_mesh[n].TextureCoordinates.Count; i++) {
            double tx = in_mesh[n].TextureCoordinates[i].X;
            double ty = in_mesh[n].TextureCoordinates[i].Y;
            vert.Add(String.Format("vt " + tx.ToString("F6") + " " + ty.ToString("F6")));
          }

          for(int i = 0; i < in_mesh[n].Normals.Count; i++) {
            vert.Add(String.Format("vn {0} {1} {2}", -in_mesh[n].Normals[i].X, in_mesh[n].Normals[i].Z, in_mesh[n].Normals[i].Y));
          }

          for(int i = 0; i < in_mesh[n].Faces.Count; i++) {
            MeshFace f = in_mesh[n].Faces.GetFace(i);
            int fa = f.A + 1 + faceCount;
            int fb = f.B + 1 + faceCount;
            int fc = f.C + 1 + faceCount;
            string fas = fa.ToString();
            string fbs = fb.ToString();
            string fcs = fc.ToString();
            face.Add(String.Format("f " + fas + "/" + fas + "/" + fas + " " + fbs + "/" + fbs + "/" + fbs + " " + fcs + "/" + fcs + "/" + fcs));
          }

          for(int i = 0; i < vert.Count; i++) {
            writer.WriteLine(vert[i]);
          }

          writer.WriteLine("");
          writer.WriteLine("g " + in_name + n.ToString());

          for(int i = 0; i < face.Count; i++) {
            writer.WriteLine(face[i]);
          }
          faceCount += in_mesh[n].Vertices.Count;
        }
      }
    }
    A = path;
# ---------- c_script: C# additional code ----------
  String path;
# ---------- end c_script ----------
save = ObjectSave(
    BakeToggle=in_run,
    FileDirectory=layer,
    FileName=N,
    GeometryObjects=O,
    Layer=layer_2,
    ObjectName=layer_4,
    ObjectColor=RGB(255, 255, 255),
    LayerColor=RGB(255, 255, 255))  # disabled

# ==== cluster Select
number_slider = Slider(7, range=0..10)
multiplication = Multiplication(A=number_slider, B=2)
Z = UnitZ(Factor=1)
vec = VectorXYZ(XComponent=multiplication, YComponent=multiplication, ZComponent=0)  # -> Vector, Length
circle = CircleCNR(Center=Z, Normal=Z, Radius=number_slider)
Z_2 = UnitZ(Factor=0)
rec_2pt = Rectangle2Pt(Plane=PlaneXY(0, 0, 0), PointA=Point(0, 0, 0), PointB=vec.Vector, Radius=0)  # -> Rectangle, Length
ln = Line(StartPoint=Z_2, EndPoint=vec.Vector)
multiplication_2 = Multiplication(A=Slider(3, range=0..10), B=2)
arrpolar = PolarArray(Geometry=ln, Plane=PlaneXY(0, 0, 0), Count=multiplication_2, Angle=6.283185307)  # -> Geometry, Transform
arrrec = RectangularArray(Geometry=circle, Cell=rec_2pt.Rectangle, XCount=3, YCount=3)  # -> Geometry, Transform
end = EndPoints(Curve=arrpolar.Geometry)  # -> Start, End
shift = ShiftList(List=flatten(end.End), Shift=1, Wrap=True)
ln_2 = Line(StartPoint=end.End, EndPoint=shift)
layer = ClusterInput()
example = ClusterInput()
nr = ClusterInput()
join = JoinCurves(Curves=[arrpolar.Geometry, ln_2], Preserve=False)
layer_2 = DefineLayer(Layer=layer)
expression = Expression(Nr=nr, Example=example, Expression="If(Example, Nr, false)")
expression_2 = Expression(Layer=layer_2, Example=example, Expression="If(Example, 0, Layer)")
origami = Curve([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])
pattern = Curve([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])
circle_2 = Curve(circle)
rectangle = Curve(rec_2pt.Rectangle)
star = Curve(join)
grp = Group(Objects=rectangle)
grp_2 = Group(Objects=star)
grp_3 = Group(Objects=pattern)
grp_4 = Group(Objects=origami)
grp_5 = Group(Objects=circle_2)
merge = Merge(Data1=flatten(grp_5), Data2=flatten(grp), Data3=flatten(grp_2), Data4=flatten(grp_3), Data5=flatten(grp_4))
reflay = ReferenceByLayer(LayerName=expression_2)
dispatch = Dispatch(List=merge, DispatchPattern=expression)  # -> Example, ListB
filtertype = FilterByType(Geometry=reflay, ObjectType="Curve")
clean = CleanTree(RemoveNulls=True, RemoveInvalid=True, RemoveEmpty=False, Tree=filtertype)
ungroup = Ungroup(Group=dispatch.Example)
crv = Curve(flatten([clean, ungroup]))
crv_2 = ClusterOutput(crv)

# ==== cluster Steps
num = ClusterInput()
num_2 = Number(num)
expression = Expression(x=num_2, Expression="If(x>20, 20, x)")
stepper = ClusterInput()
expression_2 = Expression(x=expression, Stepper=stepper, Expression="If(Stepper, x, 1000)")
iterations = ClusterOutput(expression_2)

# ==== cluster DivideCurves
I = ClusterInput()
io = IO(
    SofistikDocumentProperties_VersionMajor="2020",
    SofistikDocumentProperties_VersionMinor="9",
    SofistikDocumentProperties_VersionName="Rhino-Interface")
null = NullItem(Item=I)  # -> NullFlags, InvalidFlags, Description
dispatch = Dispatch(List=I, DispatchPattern=null.NullFlags)  # -> ListA, ListB
geo = Geometry(dispatch.ListB)

# ---- group: handles curves with no intersections
lng = ListLength(List=geo)
series = Series(Start=0, Step=1, Count=lng)
round = Round(Number=series)  # -> Nearest, Floor, Ceiling

# ---- group: solve intersections
mcx = MultipleCurves(Curves=geo)  # -> Points, IndexA, IndexB, ParamA, ParamB
equals = Equality(FirstNumber=mcx.IndexA, SecondNumber=graft(series))  # -> Equality, Inequality
equals_2 = Equality(FirstNumber=mcx.IndexB, SecondNumber=graft(series))  # -> Equality, Inequality
dispatch_2 = Dispatch(List=mcx.ParamB, DispatchPattern=equals_2.Equality)  # -> ListA, ListB
dispatch_3 = Dispatch(List=mcx.ParamA, DispatchPattern=equals.Equality)  # -> ListA, ListB
merge = Merge(Data1=dispatch_3.ListA, Data2=dispatch_2.ListA)
shatter = Shatter(Curve=graft(geo), Parameters=merge)  # -> simplify(Segments)

# ---- group: handles curves with no intersections (continued)
sunion = SetUnion(SetA=mcx.IndexA, SetB=mcx.IndexB)
exdiff = SetDifferenceS(SetA=round.Nearest, SetB=sunion)
item = ListItem(List=geo, Index=exdiff, Wrap=True)  # -> graft(Item)
branch = TreeBranch(Tree=shatter, Path=graft(exdiff), MaintainPaths=True)
match = MatchTree(Tree=item, Guide=branch)

# ----
merge_2 = Merge(Data1=match, Data2=shatter)  # -> flatten(Result)

# ---- group: intersection points & valency
end = EndPoints(Curve=merge_2)  # -> Start, End
cullpt = CullDuplicates(Points=flatten([end.Start, end.End]), Tolerance=0.1, CullMode=3)  # -> Points, Indices, Valence
smaller = SmallerThan(FirstNumber=cullpt.Valence, SecondNumber=3)  # -> SmallerThan, OrEqualTo
dispatch_4 = Dispatch(List=cullpt.Valence, DispatchPattern=smaller.SmallerThan)  # -> ListA, ListB
dispatch_5 = Dispatch(List=cullpt.Points, DispatchPattern=smaller.SmallerThan)  # -> ListA, ListB

# ----
pt = Point(simplify(flatten(dispatch_5.ListB)))
valancy = Integer(flatten(dispatch_4.ListB))
crv = Curve(merge_2)
crv_2 = ClusterOutput(crv)
valancy_2 = ClusterOutput(valancy)
pt_2 = ClusterOutput(pt)

# ==== cluster Find2DCurves
io = IO(
    SofistikDocumentProperties_VersionMajor="2020",
    SofistikDocumentProperties_VersionMinor="9",
    SofistikDocumentProperties_VersionName="Rhino-Interface")
C = ClusterInput()
T = ClusterInput()
B = ClusterInput()
number_slider = Slider(0, range=0..1236)
number_slider_2 = Slider(1236, range=0..10000)

# ---- group: separate print and textile
end = EndPoints(Curve=C)  # -> Start, End
pdecon = Deconstruct(Point=end.End)  # -> XComponent, YComponent, ZComponent
pdecon_2 = Deconstruct(Point=end.Start)  # -> XComponent, YComponent, ZComponent
pt = ConstructPoint(XCoordinate=pdecon_2.XComponent, YCoordinate=pdecon_2.YComponent, ZCoordinate=pdecon_2.ZComponent)
pt_2 = ConstructPoint(XCoordinate=pdecon.XComponent, YCoordinate=pdecon.YComponent, ZCoordinate=pdecon.ZComponent)
ln = Line(StartPoint=pt, EndPoint=pt_2)
flatten = FlattenTree(Tree=T, Path="{0}")  # -> simplify(graft(Tree))
curvepoint = PointOnCurve(ln, parameter=0.5)
crv_cp = CurveClosestPoint(Point=curvepoint, Curve=flatten)  # -> Point, Parameter, simplify(Distance)
sort = SortList(Keys=crv_cp.Distance)  # -> Keys, ValuesA
item = ListItem(List=sort.Keys, Index=0, Wrap=True)
number_slider_3 = Slider(120, range=0..2000)
eval = Evaluate(F="If(x<0.05, 0.05, x)", x=item)
addition = Addition(A=crv_cp.Distance, B=B)

# ----
sort_2 = SortList(Keys=ln, ValuesA=ln)  # -> Keys, ValuesA
item_2 = ListItem(List=sort_2.ValuesA, Index=number_slider, Wrap=True)
item_3 = ListItem(List=sort_2.Keys, Index=number_slider, Wrap=True)
multiplication = Multiplication(A=eval, B=number_slider_3)  # -> simplify(Result)
pt_3 = Point(item_2)

# ---- group: separate print and textile (continued)
similar = Similarity(FirstNumber=simplify(addition), SecondNumber=B, Threshold=simplify(multiplication))  # -> Similarity, AbsoluteDifference

# ----
sort_3 = SortList(Keys=similar.Similarity, ValuesA=ln)  # -> Keys, ValuesA
similarity = ClusterOutput(similar.Similarity)
cull = CullPattern(List=ln, CullPattern=similar.Similarity)
item_4 = ListItem(List=sort_3.ValuesA, Index=number_slider_2, Wrap=True)
item_5 = ListItem(List=sort_3.Keys, Index=number_slider_2, Wrap=True)
crv = Curve(cull)
cull_i = CullIndex(List=similar.Similarity, Indices="False", Wrap=True)
crv_2 = ClusterOutput(crv)
L = ClusterOutput(ln)

# ==== cluster Find3DCurves
io = IO(
    SofistikDocumentProperties_VersionMajor="2020",
    SofistikDocumentProperties_VersionMinor="9",
    SofistikDocumentProperties_VersionName="Rhino-Interface")
brep = ClusterInput()

# ---- group: Centerline / Resolution
number_slider = Slider(100, range=0..100)

# ---- group: Centerline
brep_2 = Brep(brep)
brep_3 = Brep(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)
range = Range(Domain=Domain(0, 1), Steps=number_slider)
preview = CustomPreview(Geometry=brep_2, Shader=ColourSwatch(SwatchColor=RGBA(191, 191, 191, 45)))
debrep = DeconstructBrep(Brep=brep_2)  # -> Faces, Edges, Vertices
pt = ConstructPoint(XCoordinate=range, YCoordinate=0, ZCoordinate=0)
iso = IsoCurve(Surface=reparameterize(graft(debrep.Faces)), UVPoint=pt)  # -> UIsocurve, flatten(VIsocurve)
crv = Curve(iso.VIsocurve)
cp = ControlPoints(Curve=crv)  # -> Points, Weights, Knots
avr = Average(Input=cp.Points)
flip = FlipMatrix(Data=avr)
cullpt = CullDuplicates(Points=flip, Tolerance=0.1, CullMode=1)  # -> Points, Indices, Valence
intcrv = Interpolate(Vertices=cullpt.Points, Degree=3, Periodic=False, KnotStyle=1)  # -> Curve, Length, Domain
previewlw = CustomPreviewLineweights(Geometry=intcrv.Curve, Shader=ColourSwatch(SwatchColor=RGB(255, 0, 0)), Thickness=3, Absolute=False)

# ----
P = ClusterInput()
mesh = ClusterInput()
mesh_2 = Mesh(mesh)
wbedges = WeaverbirdsMeshEdges(MeshOrPolylines=mesh_2)
cull = CullPattern(List=wbedges, CullPattern=P)
L = ClusterOutput(cull)
wbedges_2 = WeaverbirdsMeshEdges(MeshOrPolylines=mesh_2)
brep_4 = ClusterOutput(brep_2)
L_2 = ClusterOutput(cull)
L_3 = ClusterOutput(wbedges_2)
mesh_3 = ClusterOutput(mesh_2)

# ==== cluster Show4DResult
io = IO(
    SofistikDocumentProperties_VersionMajor="2020",
    SofistikDocumentProperties_VersionMinor="9",
    SofistikDocumentProperties_VersionName="Rhino-Interface")
T = ClusterInput()
clean = CleanTree(RemoveNulls=True, RemoveInvalid=Toggle(False), RemoveEmpty=False, Tree=T)
lastdex = LastIndex(List=clean)
item = ListItem(List=clean, Index=lastdex, Wrap=True)
mesh = Mesh(item)
clean_2 = CleanTree(RemoveNulls=True, RemoveInvalid=True, RemoveEmpty=False, Tree=mesh)
wbedges = WeaverbirdsMeshEdges(MeshOrPolylines=clean_2)
radius = Slider(1, range=0..1)
P = ClusterInput()
cull = CullPattern(List=wbedges, CullPattern=P)
print = ClusterInput()
crv = Curve(cull)
x = ClusterInput()
dispatch = Dispatch(List=wbedges, DispatchPattern=print)  # -> ListA, flatten(ListB)
expression = Expression(x=x, y=Slider(1, range=0..15), Expression="If(x, y, 0)")
mesh_2 = ClusterOutput(mesh)
wbloop = WeaverbirdsLoopSubdivision(MeshCurves=clean_2, Level=2, SmoothNakedEdges=0)  # -> flatten(OutputMeshCurves)
lng = ListLength(List=dispatch.ListA)
join = JoinCurves(Curves=dispatch.ListA, Preserve=False)
O = ClusterOutput(wbloop)
addition = Addition(A=lng, B=1)
reb = RebuildCurve(Curve=simplify(flatten(join)), Degree=3, Count=simplify(flatten(addition)), Tangents=True)
pipe = Pipe(Curve=reb, Radius=expression, Caps=2)  # -> flatten(Pipe)
mjoin = MeshJoin(Meshes=pipe)
P_2 = ClusterOutput(pipe)
clean_3 = CleanTree(RemoveNulls=True, RemoveInvalid=True, RemoveEmpty=False, Tree=mjoin)
T_2 = ClusterOutput(clean_3)

# ==== cluster OffestAndResemash
io = IO(
    SofistikDocumentProperties_VersionMajor="2020",
    SofistikDocumentProperties_VersionMinor="9",
    SofistikDocumentProperties_VersionName="Rhino-Interface")
D = ClusterInput()
P = ClusterInput()
polyoffset = PolylineOffset(
    Polylines=P,
    Distance=D,
    Plane=Plane(origin=(0, 0, 0), x=(0, 0, 0), y=(0, 0, 0)),
    Tolerance=0.001,
    ClosedFillet=1,
    OpenFillet=1,
    Miter=2)  # -> Contour, Holes
crv = Curve(P)
G = ClusterInput()
crv_2 = ClusterOutput(crv)
filter = StreamFilter(Gate=G, Stream0=crv, Stream1=polyoffset.Contour)
G_2 = ClusterInput()
gate = StreamGate(Stream=filter, Gate=G_2)  # -> Target0, Target1, Target2
boundary = BoundarySurfaces(Edges=gate.Target2)
mesh_size = ClusterInput()
L = ClusterInput()
F = ClusterInput()
boundary_2 = BoundarySurfaces(Edges=gate.Target1)
Z = UnitZ(Factor=Slider(0, range=0..100))
brep = Brep(boundary)
brep_2 = Brep(crv)
mesh = MeshBrep(
    Brep=brep_2,
    Settings={GridMaxCount=0, GridMinCount=16, JaggedSeams=False, MaxEdgeLength=0, MinEdgeLength=0.0001, MinTolerance=0, Refine=True, RefineAngle=0, RelativeTolerance=0.65, SimplePlanes=True, Tolerance=0})
split = SplitBrep(Brep=brep, Cutter=crv)
discrete_remesh = DiscreteRemesh(geo_5=gate.Target0, geo_2=crv, L=L, mesh_size=mesh_size)
brep_3 = Brep(boundary_2)
Z_2 = UnitZ(Factor=F)
brep_4 = Brep(crv)
move = Move(Geometry=mesh, Motion=Z)  # -> Geometry, Transform
mesh_2 = MeshBrep(
    Brep=brep_4,
    Settings={GridMaxCount=0, GridMinCount=16, JaggedSeams=False, MaxEdgeLength=0, MinEdgeLength=0.0001, MinTolerance=0, Refine=True, RefineAngle=0, RelativeTolerance=0.65, SimplePlanes=True, Tolerance=0})
split_2 = SplitBrep(Brep=brep_3, Cutter=crv)
join = BrepJoin(Breps=split)  # -> Breps, Closed
move_2 = Move(Geometry=mesh_2, Motion=Z_2)  # -> Geometry, Transform
join_2 = BrepJoin(Breps=split_2)  # -> Breps, Closed
geo = ClusterInput()
length = ClusterInput()
sharp = ClusterInput()
triremesh = TriRemesh(Geometry=join.Breps, Target=move.Geometry, Sharp=sharp, Features=crv, Length=length, Iterations=25)  # -> Triangulation, Dual, Creases
geo_2 = Geometry(geo)
triremesh_2 = TriRemesh(Geometry=join_2.Breps, Target=move_2.Geometry, Sharp=sharp, Features=crv, Length=length, Iterations=25)  # -> Triangulation, Dual, Creases
mesh_3 = Mesh(discrete_remesh)
null = NullItem(Item=geo_2)  # -> NullFlags, InvalidFlags, Description
circle = CircleCNR(Center=Point(1547, 1475, 0), Normal=Vector(0, 0, 1), Radius=0.01)
item = ListItem(List=null.InvalidFlags, Index=0, Wrap=True)
filter_2 = StreamFilter(Gate=item, Stream0=geo_2, Stream1=circle)
demesh = DeconstructMesh(Mesh=triremesh.Triangulation)  # -> Vertices, Faces, Colours, Normals
incurves = PointInCurves(Point=demesh.Vertices, Curves=filter_2)  # -> Relationship, Index, Point
larger = LargerThan(FirstNumber=incurves.Relationship, SecondNumber=1)  # -> LargerThan, OrEqualTo
cullv = CullVertices(Mesh=triremesh.Triangulation, Pattern=larger.LargerThan, Shrink=True)
add_imperfection = AddImperfection(M=cullv)
filter_3 = StreamFilter(Gate=G_2, Stream0=mesh_3, Stream1=triremesh_2.Triangulation, Stream2=add_imperfection)
filter_4 = StreamFilter(Gate=G_2, Stream0=mesh_3, Stream1=triremesh_2.Triangulation, Stream2=add_imperfection)
clean = CombineClean(Meshes=filter_3)
wbedges = WeaverbirdsMeshEdges(MeshOrPolylines=filter_3)
s_0 = ClusterOutput(filter_4)
wbedges_2 = WeaverbirdsMeshEdges(MeshOrPolylines=clean)
L_2 = ClusterOutput(wbedges)
M = ClusterOutput(clean)
L_3 = ClusterOutput(wbedges_2)

# ==== cluster Cluster
printlines = ClusterInput()
wbedges = ClusterInput()
gate = StreamGate(Printlines=printlines, Gate=0)  # -> Target0, Target1
wbedges_2 = Line(wbedges)
view_edges = ClusterOutput(wbedges_2)
printlines_2 = ClusterOutput(gate.Target0)
dispatch = Dispatch(List=wbedges_2, DispatchPattern=gate.Target0)  # -> ListA, ListB
join = JoinCurves(Curves=simplify(dispatch.ListA), Preserve=False)
explode = Explode(Curve=join, Recursive=True)  # -> Segments, Vertices
S = ClusterOutput(explode.Segments)
C = ClusterOutput(join)
int = ClusterInput()
pt = ClusterInput()
int_2 = Integer(int)
pt_2 = Point(pt)
flatten = FlattenTree(Tree=explode.Segments, Path="{0}")
curvepoint = PointOnCurve(flatten, parameter=0.5)
cps = ClosestPoints(Point=pt_2, Cloud=curvepoint, Count=int_2)  # -> ClosestPoint, CPIndex, Distance
item = ListItem(List=flatten, Index=cps.CPIndex, Wrap=True)
i = ClusterOutput(item)

# ==== cluster Textile
D = ClusterInput()
L = ClusterInput()
B = ClusterInput()
strength = ClusterInput()

# ---- group: Textile
flip = FlipMatrix(Data=D)
cset = CreateSet(List=flip)  # -> Set, Map
lng = ListLength(List=cset.Set)
larger = LargerThan(FirstNumber=lng, SecondNumber=1)  # -> flatten(LargerThan), OrEqualTo
dispatch = Dispatch(List=L, DispatchPattern=larger.LargerThan)  # -> ListA, flatten(ListB)
line = Line(dispatch.ListB)
len = Length(Curve=line)

# ----
multiplication = Multiplication(A=len, B=B)

# ---- group: Textile (continued)
length_line = LengthLine(Line=line, Length=multiplication, Strength=strength)

# ----
L_2 = ClusterOutput(length_line)

# ==== cluster LineIntersections
line = ClusterInput()
strength = ClusterInput()
strength_2 = ClusterInput()

line_2 = Line(line)
lng = ListLength(List=line_2)
series = Series(Start=0, Step=1, Count=expr("x-1", lng))
line_3 = Line(line_2)
shift = ShiftList(List=line_2, Shift=series, Wrap=True)
angle = Angle(LineA=line_3, LineB=shift, Strength=strength)
length_line = LengthLine(Line=line_3, Strength=strength_2)

L = ClusterOutput(length_line)
A = ClusterOutput(angle)

# ==== cluster _3DPrintedLines
C = ClusterInput()
line = ClusterInput()
strength = ClusterInput()
strength_2 = ClusterInput()

cls = Closed(Curve=C)  # -> Closed, Periodic
line_2 = Line(line)
shift = ShiftList(List=simplify(line_2), Shift=1, Wrap=simplify(cls.Closed))
line_3 = Line(line_2)
short = ShortestList(ListA=line_3, ListB=shift, TrimMode=2)  # -> ListA, ListB
angle = Angle(LineA=short.ListA, LineB=short.ListB, Strength=strength_2)
length_line = LengthLine(Line=line_3, Strength=strength)

L = ClusterOutput(length_line)
A = ClusterOutput(angle)

# ==== cluster K2Textile
D = ClusterInput()
L = ClusterInput()
B = ClusterInput()
s0 = ClusterInput()
ptmax = ClusterInput()
x = ClusterInput()
E = ClusterInput()

flip = FlipMatrix(Data=D)
cset = CreateSet(List=flip)  # -> Set, Map
lng = ListLength(List=cset.Set)
larger = LargerThan(FirstNumber=lng, SecondNumber=1)  # -> flatten(LargerThan), OrEqualTo
dispatch = Dispatch(List=L, DispatchPattern=larger.LargerThan)  # -> ListA, flatten(ListB)
line = Line(dispatch.ListB)
len = Length(Curve=line)
multiplication = Multiplication(A=len, B=B)
pt = Pretension(RestLength=line, Strength=s0, FFLength=multiplication, MaxPretension=ptmax)
sqr = Square(Value=x)
pi = Pi(Factor=sqr)
cable = Cable(Line=line, EModulus=E, Area=pi, PreTension=pt)

cable_2 = ClusterOutput(cable)

# ==== cluster K2LineIntersections
line = ClusterInput()
line_2 = Line(line)
lng = ListLength(List=line_2)
series = Series(Start=0, Step=1, Count=expr("x-1", lng))
shift = ShiftList(List=line_2, Shift=series, Wrap=True)
relay = ClusterInput()
x = ClusterInput()

# ---- group: Area
sqr = Square(Value=x)
pi = Pi(Factor=sqr)

# ---- group: Inertia
sqr_2 = Square(Value=pi)

# ----
z = ClusterInput()
opt = ClusterInput()
bar = Bar(Line=line_2, EModulus=relay, Area=pi)
rod = Rod(LineA=line_2, LineB=shift, EModulus=relay, Inertia=sqr_2, ZDistance=z, RestAngleOption=opt)
bar_2 = ClusterOutput(bar)
rod_2 = ClusterOutput(rod)

# ==== cluster K23DPrintedLines
io = IO(
    SofistikDocumentProperties_VersionMajor="2020",
    SofistikDocumentProperties_VersionMinor="9",
    SofistikDocumentProperties_VersionName="Rhino-Interface")
relay = ClusterInput()
line = ClusterInput()
C = ClusterInput()
cls = Closed(Curve=C)  # -> Closed, Periodic
line_2 = Line(line)
shift = ShiftList(List=simplify(line_2), Shift=1, Wrap=simplify(cls.Closed))
line_3 = Line(line_2)
short = ShortestList(ListA=line_3, ListB=shift, TrimMode=2)  # -> ListA, ListB
x = ClusterInput()
pframe = PerpFrame(Curve=reparameterize(short.ListA), Parameter=Slider(0, range=0..100))
shift_2 = ShiftList(List=pframe, Shift=1, Wrap=True)

# ---- group: area
sqr = Square(Value=x)
pi = Pi(Factor=sqr)

# ----
number_slider = Slider(10.77, range=0..100)
number_slider_2 = Slider(2.666, range=0..10)
addition = Addition(A=number_slider_2, B=number_slider)

# ---- group: Inertia
sqr_2 = Square(Value=pi)

# ----
sqr_3 = Square(Value=x)
sqr_4 = Square(Value=sqr_3)
beam = Beam(
    StartPlane=pframe,
    EndPlane=shift_2,
    EModulus=Slider(3500, range=0..10000),
    GModulus=Slider(2400, range=0..10000),
    A=pi,
    Iy=number_slider_2,
    Iz=number_slider,
    It=addition)
pi_2 = Pi(Factor=sqr_4)
division = Division(A=pi_2, B=Slider(4, range=0..10))
z = ClusterInput()
opt = ClusterInput()
beam_2 = ClusterOutput(beam)
rod = Rod(LineA=short.ListA, LineB=short.ListB, EModulus=relay, Inertia=division, ZDistance=z, RestAngleOption=opt)
bar = Bar(Line=short.ListA, EModulus=relay, Area=pi)
bar_2 = ClusterOutput(bar)
rod_2 = ClusterOutput(rod)

# ==== cluster Color
io = IO(
    SofistikDocumentProperties_VersionMajor="2020",
    SofistikDocumentProperties_VersionMinor="9",
    SofistikDocumentProperties_VersionName="Rhino-Interface")
M = ClusterInput()
clean = CombineClean(Meshes=M)
mesh = Mesh(M)
demesh = DeconstructMesh(Mesh=mesh)  # -> Vertices, Faces, Colours, Normals
lng = ListLength(List=demesh.Vertices)
pdecon = Deconstruct(Point=demesh.Vertices)  # -> XComponent, YComponent, ZComponent
series = Series(Start=0, Step=1, Count=lng)
P = ClusterInput()
far = ColourSwatch(SwatchColor=RGB(255, 0, 0))
close = ColourSwatch(SwatchColor=RGB(13, 0, 255))
mid = ColourSwatch(SwatchColor=RGB(255, 247, 0))
sort = SortList(Keys=pdecon.XComponent, ValuesA=series)  # -> Keys, ValuesA
range = Range(Domain=Domain(0, 1), Steps=lng)
cull_i = CullIndex(List=range, Indices=0, Wrap=True)
wbedges = WeaverbirdsMeshEdges(MeshOrPolylines=mesh)
col = Colour([far, mid, close])
interp = InterpolateData(Data=col, Parameter=cull_i, Interpolation=2)
sort_2 = SortList(Keys=sort.ValuesA, ValuesA=interp)  # -> Keys, ValuesA
cull = CullPattern(List=wbedges, CullPattern=P)
pdecon_2 = Deconstruct(Point=demesh.Vertices)  # -> XComponent, YComponent, ZComponent
mcol = MeshColours(Mesh=mesh, Colours=sort_2.ValuesA)
L = ClusterOutput(cull)
mesh_2 = Mesh(mcol)
smaller = SmallerThan(FirstNumber=pdecon_2.ZComponent, SecondNumber=Slider(0, range=0..1))  # -> SmallerThan, OrEqualTo
mesh_3 = ClusterOutput(mesh_2)
cull_2 = CullPattern(List=demesh.Vertices, CullPattern=smaller.SmallerThan)
cullpt = CullDuplicates(Points=cull_2, Tolerance=0.1, CullMode=3)  # -> Points, Indices, Valence
P_2 = ClusterOutput(cullpt.Points)

# ==== cluster Process_mesh
pt = ClusterInput()
G = ClusterInput()
pt_2 = Point(pt)
xy = XYPlane(Origin=Point(0, 0, 0))
yz = YZPlane(Origin=pt_2)
scale = Scale(Geometry=G, Center=Point(0, 0, 0), Factor=1000)  # -> Geometry, Transform
rad = Radians(Degrees=-90)
deplane = DeconstructPlane(Plane=xy)  # -> Origin, XAxis, YAxis, ZAxis
box = ClusterInput()
rot3d = Rotate3D(Geometry=xy, Angle=rad, Center=Point(0, 0, 0), Axis=deplane.ZAxis)  # -> Geometry, Transform
orient = Orient(Geometry=rot3d.Geometry, Source=rot3d.Geometry, Target=yz)  # -> Geometry, Transform
box_2 = Box(box)
transform = Transform(Geometry=scale.Geometry, Transform=orient.Transform)
mesh = Mesh(transform)
msplit = MeshSplit(Mesh=mesh, Splitters=box_2)
area = Area(Geometry=msplit)  # -> Area, Centroid
volume = Volume(Geometry=box_2)  # -> Volume, Centroid
dist = Distance(PointA=graft(area.Centroid), PointB=volume.Centroid)  # -> flatten(Distance)
sort = SortList(Keys=dist, ValuesA=msplit)  # -> Keys, ValuesA
item = ListItem(List=sort.ValuesA, Index=0, Wrap=True)
clean = CombineClean(Meshes=item)
mesh_2 = Mesh(clean)
demesh = DeconstructMesh(Mesh=mesh_2)  # -> Vertices, Faces, Colours, Normals
lng = ListLength(List=demesh.Vertices)
pdecon = Deconstruct(Point=demesh.Vertices)  # -> XComponent, YComponent, ZComponent
series = Series(Start=0, Step=1, Count=lng)
far = ColourSwatch(SwatchColor=RGB(255, 0, 0))
close = ColourSwatch(SwatchColor=RGB(13, 0, 255))
mid = ColourSwatch(SwatchColor=RGB(255, 247, 0))
sort_2 = SortList(Keys=pdecon.XComponent, ValuesA=series)  # -> Keys, ValuesA
range = Range(Domain=Domain(0, 1), Steps=lng)
cull_i = CullIndex(List=range, Indices=0, Wrap=True)
col = Colour([far, mid, close])
interp = InterpolateData(Data=col, Parameter=cull_i, Interpolation=2)
sort_3 = SortList(Keys=sort_2.ValuesA, ValuesA=interp)  # -> Keys, ValuesA
mcol = MeshColours(Mesh=mesh_2, Colours=sort_3.ValuesA)
M = ClusterOutput(mcol)

# ==== cluster Check_Print_safety
io = IO(
    SofistikDocumentProperties_VersionMajor="2020",
    SofistikDocumentProperties_VersionMinor="9",
    SofistikDocumentProperties_VersionName="Rhino-Interface")
cluster = Cluster_2()
area = Area(Geometry=cluster)  # -> Area, Centroid
xy = XYPlane(Origin=Point(0, 0, 0))
vec2pt = Vector2Pt(PointA=area.Centroid, PointB=xy, Unitize=False)  # -> Vector, Length
move = Move(Geometry=cluster, Motion=vec2pt.Vector)  # -> Geometry, Transform
C = ClusterInput()
divide = DivideCurve(Curve=C, Count=Slider(40, range=0..100), Kinks=False)  # -> Points, Tangents, Parameters
incurve = PointInCurve(Point=divide.Points, Curve=move.Geometry)  # -> Relationship, Point
R = ClusterOutput(incurve.Relationship)
G = ClusterOutput(move.Geometry)

# ==== cluster Cluster_3
io = IO(
    SofistikDocumentProperties_VersionMajor="2020",
    SofistikDocumentProperties_VersionMinor="9",
    SofistikDocumentProperties_VersionName="Rhino-Interface")
A = ClusterInput()
B = ClusterInput()
C = ClusterInput()
multiplication = Multiplication(A=A, B=B)
B_2 = ClusterInput()
subtraction = Subtraction(A=multiplication, B=B_2)
A_2 = ClusterInput()
B_3 = ClusterInput()
T = ClusterInput()
B_4 = ClusterInput()
division = Division(A=A_2, B=B_3)
dom = ConstructDomain(DomainStart=0, DomainEnd=A_2)
range = Range(Domain=dom, Steps=division)
offcrv = OffsetCurve(Curve=C, Plane=PlaneXY(0, 0, 0), Distance=range, BothSides=B_4, Kinks=0, CapType=T)  # -> flatten(Offset)
Z = UnitZ(Factor=subtraction)
extr = Extrude(Base=offcrv, Direction=Z)
mesh = MeshBrep(
    Brep=extr,
    Settings={GridMaxCount=0, GridMinCount=16, JaggedSeams=False, MaxEdgeLength=0, MinEdgeLength=0.0001, MinTolerance=0, Refine=True, RefineAngle=0, RelativeTolerance=0.65, SimplePlanes=True, Tolerance=0})
crv = Curve(offcrv)
tri = Triangulate(Mesh=mesh)  # -> Mesh, Count
crv_2 = ClusterOutput(crv)
medges = MeshEdges(Mesh=tri.Mesh)  # -> NakedEdges, InteriorEdges, NonManifoldEdges
M = ClusterOutput(tri.Mesh)
crv_3 = Curve([medges.InteriorEdges, medges.NakedEdges])
crv_4 = ClusterOutput(crv_3)

# ==== cluster CenterPrint
crv = ClusterInput()
crv_2 = Curve(crv)
cpoly = ControlPolygon(Curve=crv_2)  # -> Polygon, Points
pcen = PolygonCenter(Polyline=cpoly.Polygon)  # -> CenterV, CenterE, CenterA
ma = MassAddition(Input=pcen.CenterV)  # -> Result, PartialResults
lng = ListLength(List=pcen.CenterV)
division = Division(A=ma.Result, B=lng)
pt = Point(division)
center = Point(Point(0, 0, 0))
vec2pt = Vector2Pt(PointA=pt, PointB=center, Unitize=False)  # -> Vector, Length
move = Move(Geometry=crv_2, Motion=vec2pt.Vector)  # -> Geometry, Transform
C = ClusterOutput(move.Geometry)

# ==== cluster DiscreteRemesh
L = ClusterInput()
mesh_size = ClusterInput()
dispatch = Dispatch(List=L, DispatchPattern=mesh_size)  # -> ListA, ListB
geo = ClusterInput()
geo_2 = ClusterInput()
geo_3 = Geometry(geo_2)
geo_4 = Geometry(geo)
null = NullItem(Item=geo_3)  # -> NullFlags, InvalidFlags, Description
null_2 = NullItem(Item=geo_4)  # -> NullFlags, InvalidFlags, Description
circle = CircleCNR(Center=Point(1283, 814, 0), Normal=Vector(0, 0, 1), Radius=0.01)
item = ListItem(List=null.InvalidFlags, Index=0, Wrap=True)
geo_5 = ClusterInput()
circle_2 = CircleCNR(Center=Point(1547, 1475, 0), Normal=Vector(0, 0, 1), Radius=0.01)
item_2 = ListItem(List=null_2.InvalidFlags, Index=0, Wrap=True)
geo_6 = Geometry(geo_5)
filter = StreamFilter(Gate=item, Stream0=geo_3, Stream1=circle)
filter_2 = StreamFilter(Gate=item_2, Stream0=geo_4, Stream1=circle_2)
brep = Brep(geo_6)
lng = ListLength(List=filter)
ins = InsertItems(List=filter, Item=filter_2, Indices=lng, Wrap=True)
explode = Explode(Curve=ins, Recursive=True)  # -> flatten(Segments), Vertices
discretization = Discretization(
    Breps=brep,
    Curves=explode.Segments,
    Tolerance=0.001,
    MeshSize=dispatch.ListA,
    Iterations=Slider(500, range=0..10000),
    Beta=Slider(0.7, range=0.1..3))  # -> Meshes, Curves
demesh = DeconstructMesh(Mesh=discretization.Meshes)  # -> Vertices, Faces, Colours, Normals
incurves = PointInCurves(Point=demesh.Vertices, Curves=filter_2)  # -> Relationship, Index, Point
larger = LargerThan(FirstNumber=incurves.Relationship, SecondNumber=1)  # -> LargerThan, OrEqualTo
cullv = CullVertices(Mesh=discretization.Meshes, Pattern=larger.LargerThan, Shrink=True)
add_imperfection = AddImperfection(M=cullv)
M = ClusterOutput(add_imperfection)

# ==== cluster Cluster_2
io = IO(
    SofistikDocumentProperties_VersionMajor="2020",
    SofistikDocumentProperties_VersionMinor="9",
    SofistikDocumentProperties_VersionName="Rhino-Interface")
crv = Curve(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)
crv_2 = Curve(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)
crv_3 = Curve(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)
end = EndPoints(Curve=crv)  # -> Start, End
end_2 = EndPoints(Curve=crv_2)  # -> Start, End
end_3 = EndPoints(Curve=crv_3)  # -> Start, End
ln = Line(StartPoint=end.Start, EndPoint=end_3.End)
ln_2 = Line(StartPoint=end_2.End, EndPoint=end_3.Start)
join = JoinCurves(Curves=[ln, ln_2, crv, crv_2, crv_3], Preserve=False)
area = Area(Geometry=join)  # -> Area, Centroid
C = ClusterOutput(join)
move = Move(Geometry=join, Motion=Vector(0, 0, 10))  # -> Geometry, Transform

# ==== cluster AddImperfection
M = ClusterInput()
cullvertices = MeshCullUnusedVertices(Mesh=M)
demesh = DeconstructMesh(Mesh=cullvertices)  # -> Vertices, Faces, Colours, Normals
null = NullItem(Item=demesh.Vertices)  # -> NullFlags, InvalidFlags, Description
not = GateNot(A=null.InvalidFlags)
cull = CullPattern(List=demesh.Vertices, CullPattern=not)
pdecon = Deconstruct(Point=cull)  # -> XComponent, YComponent, ZComponent
lng = ListLength(List=pdecon.ZComponent)
random = Random(Range=Domain(0, 0.001), Number=lng, Seed=2)
pt = ConstructPoint(XCoordinate=pdecon.XComponent, YCoordinate=pdecon.YComponent, ZCoordinate=random)
conmesh = ConstructMesh(Vertices=pt, Faces=demesh.Faces)
M_2 = ClusterOutput(conmesh)
