# Grasshopper definition simple_lines.ghx (Grasshopper 1.0.7)
# plug-ins: LunchBox

number_slider = Slider(10, range=0..10)
number_slider_2 = Slider(200, range=0..1000)
number_slider_3 = Slider(30, range=0..100)
print_bed_ur5 = Geometry(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)
rectangle = Rectangle(Plane=PlaneXY(0, 0, 0), XSize=number_slider_2, YSize=Slider(400, range=0..1000), Radius=0)  # -> Rectangle, Length
rectangle_2 = Rectangle(Plane=PlaneXY(0, 0, 0), XSize=Slider(500, range=0..1000), YSize=Slider(800, range=0..1000), Radius=0)  # -> Rectangle, Length
rectangle_3 = Rectangle(Plane=PlaneXY(0, 0, 0), XSize=Slider(500, range=0..1000), YSize=Slider(750, range=0..1000), Radius=0)  # -> Rectangle, Length
explode = Explode(Curve=rectangle.Rectangle, Recursive=True)  # -> Segments, Vertices
explode_2 = Explode(Curve=rectangle_3.Rectangle, Recursive=True)  # -> Segments, Vertices
offset = OffsetCurve(Curve=rectangle_2.Rectangle, Distance=1, Plane=PlaneXY(0, 0, 0), Corners=1)
number_slider_4 = Slider(8, range=0..10)
number_slider_5 = Slider(7, range=0..10)
crv = Curve(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)
diamond = DiamondPanels(Surface=rectangle_2.Rectangle, UDivisions=Slider(9, range=0..10), VDivisions=Slider(7, range=0..10))  # -> DiamondPanels, TriPanels
item = ListItem(List=explode.Segments, Index=0, Wrap=True)  # -> Item, Item1, Item2, Item3
item_2 = ListItem(List=explode_2.Segments, Index=0, Wrap=True)  # -> Item, Item1, Item2, Item3
series = Series(Start=0, Step=0.1, Count=10)
geo = Geometry(item.Item1)
geo_2 = Geometry(item.Item3)
geo_3 = Geometry(item_2.Item1)
geo_4 = Geometry(item_2.Item3)
series_2 = Series(Start=1, Step=0.2, Count=10)
graph = GraphMapper(series, x0=0, x1=1, y0=0, y1=1, Ox=0, Oy=0, Px=0.776023984, Py=0.404256165, container_name="Parabola")
flip = FlipCurve(Curve=geo_2)  # -> Curve, Flag
divide = DivideCurve(Curve=item_2.Item1, Count=number_slider_5, Kinks=False)  # -> Points, Tangents, Parameters
divide_2 = DivideCurve(Curve=item_2.Item3, Count=number_slider_5, Kinks=False)  # -> reverse(Points), Tangents, Parameters
scale_nu = ScaleNU(Geometry=crv, Plane=PlaneXY(0, 0, 0), ScaleX=1, ScaleY=series_2, ScaleZ=1)  # -> Geometry, Transform
pl = ConstructPlane(Origin=Point(0, 0, 0), XAxis=Vector(1, 0, 0), YAxis=Vector(0, 1, 0))
eval = EvaluateCurve(Curve=reparameterize(flip.Curve), Parameter=graph)  # -> Point, Tangent, Angle
eval_2 = EvaluateCurve(Curve=reparameterize(geo), Parameter=graph)  # -> Point, Tangent, Angle
ln = Line(StartPoint=divide.Points, EndPoint=divide_2.Points)
number_slider_6 = Slider(53.6, range=0..100)
dispatch = Dispatch(List=ln, DispatchPattern=[True, False])  # -> ListA, ListB
orient = Orient(Geometry=scale_nu.Geometry, Source=pl, Target=eval.Point)  # -> Geometry, Transform
divide_3 = DivideCurve(Curve=dispatch.ListB, Count=number_slider_4, Kinks=False)  # -> Points, Tangents, Parameters
mirror = Mirror(Geometry=orient.Geometry, Plane=PlaneYZ(0, 0, 0))  # -> Geometry, Transform
divide_4 = DivideCurve(Curve=dispatch.ListA, Count=number_slider_4, Kinks=False)  # -> Points, Tangents, Parameters
X = UnitX(Factor=number_slider_2)
dispatch_2 = Dispatch(List=orient.Geometry, DispatchPattern=[True, False])  # -> ListA, ListB
Y = UnitY(Factor=number_slider_6)
dispatch_3 = Dispatch(List=divide_3.Points, DispatchPattern=[True, False])  # -> ListA, ListB
dispatch_4 = Dispatch(List=divide_4.Points, DispatchPattern=[True, False])  # -> ListA, ListB
Y_2 = UnitY(Factor=number_slider_6)
move = Move(Geometry=mirror.Geometry, Motion=X)  # -> Geometry, Transform
Y_3 = UnitY(Factor=number_slider_6)
flip_2 = FlipCurve(Curve=dispatch_2.ListA)  # -> Curve, Flag
Y_4 = UnitY(Factor=number_slider_6)
rev = Reverse(Vector=Y_3)
dispatch_5 = Dispatch(List=move.Geometry, DispatchPattern=[True, False])  # -> ListA, ListB
move_2 = Move(Geometry=dispatch_4.ListA, Motion=Y_2)  # -> Geometry, Transform
rev_2 = Reverse(Vector=Y)
move_3 = Move(Geometry=dispatch_4.ListB, Motion=rev_2)  # -> Geometry, Transform
move_4 = Move(Geometry=dispatch_3.ListA, Motion=rev)  # -> Geometry, Transform
weave = Weave(Pattern=[0, 1], Stream0=flip_2.Curve, Stream1=dispatch_2.ListB, NullGaps=False)
move_5 = Move(Geometry=dispatch_3.ListB, Motion=Y_4)  # -> Geometry, Transform
flip_3 = FlipCurve(Curve=dispatch_5.ListA)  # -> Curve, Flag
weave_2 = Weave(Pattern=[0, 1], Stream0=move_2.Geometry, Stream1=move_3.Geometry, NullGaps=False)
weave_3 = Weave(Pattern=[0, 1], Stream0=move_4.Geometry, Stream1=move_5.Geometry, NullGaps=False)
weave_4 = Weave(Pattern=[0, 1], Stream0=flip_3.Curve, Stream1=dispatch_5.ListB, NullGaps=False)
pline = PolyLine(Vertices=weave_2, Closed=False)
pline_2 = PolyLine(Vertices=weave_3, Closed=False)
divide_5 = DivideCurve(Curve=pline, Count=10, Kinks=False)  # -> Points, Tangents, Parameters
merge = Merge(Data1=reverse(weave_4), Data2=weave)
divide_6 = DivideCurve(Curve=pline_2, Count=10, Kinks=False)  # -> reverse(Points), Tangents, Parameters
cp = ControlPoints(Curve=pline)  # -> Points, Weights, Knots
intcrv = Interpolate(Vertices=divide_5.Points, Degree=3, Periodic=False, KnotStyle=1)  # -> Curve, Length, Domain
cp_2 = ControlPoints(Curve=pline_2)  # -> reverse(Points), Weights, Knots
intcrv_2 = Interpolate(Vertices=divide_6.Points, Degree=3, Periodic=False, KnotStyle=1)  # -> Curve, Length, Domain
divide_7 = DivideCurve(Curve=merge, Count=Slider(20, range=0..100), Kinks=False)  # -> Points, Tangents, Parameters
Z = UnitZ(Factor=Slider(20, range=0..100))
item_3 = ListItem(List=divide_7.Points, Index=0, Wrap=True)  # -> Item1, Item
number_slider_7 = Slider(41, range=0..100)
merge_2 = Merge(Data1=cp.Points, Data2=cp_2.Points)  # -> flatten(Result)
move_6 = Move(Geometry=item_3.Item1, Motion=Z)  # -> Geometry, Transform
move_7 = Move(Geometry=item_3.Item, Motion=Z)  # -> Geometry, Transform
data = Data(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)
pline_3 = PolyLine(Vertices=merge_2, Closed=False)
Z_2 = UnitZ(Factor=Slider(1, range=0..1))
panel = Panel("""-1
0""")
merge_3 = Merge(Data1=move_6.Geometry, Data2=move_7.Geometry)
move_8 = Move(Geometry=merge_2, Motion=Z_2)  # -> reverse(Geometry), Transform
bbox = BoundingBox(Content=pline_3, Plane=PlaneXY(0, 0, 0))  # -> Box, Box_2
ins = InsertItems(List=divide_7.Points, Item=merge_3, Indices=panel, Wrap=True)
data_2 = Data([Point(200, 25.8, 0), Point(150, -25.8, 0), Point(100, 25.8, 0), Point(50, -25.8, 0), Point(0, 25.8, 0), Point(0, 24.2, 0), Point(50, 75.8, 0), Point(100, 24.2, 0), Point(150, 75.8, 0), Point(200, 24.2, 0), Point(200, 125.8, 0), Point(150, 74.2, 0), Point(100, 125.8, 0), Point(50, 74.2, 0), Point(0, 125.8, 0), Point(0, 124.2, 0), Point(50, 175.8, 0), Point(100, 124.2, 0), Point(150, 175.8, 0), Point(200, 124.2, 0), Point(200, 225.8, 0), Point(150, 174.2, 0), Point(100, 225.8, 0), Point(50, 174.2, 0), Point(0, 225.8, 0)])
merge_4 = Merge(Data1=merge_2, Data2=move_8.Geometry)
debrep = DeconstructBrep(Brep=bbox.Box)  # -> Faces, Edges, Vertices
pline_4 = PolyLine(Vertices=merge_4, Closed=False)
geo_5 = Geometry(Tree({0;0;0;0}: [Point(200.3343402, 217.6392113, 30), Point(200.3343402, 217.6392113, 0), Point(194.4100794, 231.8920592, 0), Point(188.2786415, 246.05699, 0), Point(181.9218697, 260.1222062, 0), Point(175.3187238, 274.0734099, 0)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], {0;0;1;0}: [Point(200.3343402, 171.9816663, 30), Point(200.3343402, 171.9816663, 0), Point(194.265392, 185.5331842, 0), Point(187.9841356, 198.9875808, 0), Point(181.4722979, 212.3318654, 0), Point(174.708784, 225.5503193, 0)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], {0;0;2;0}: [Point(200.3343402, 131.6943942, 30), Point(200.3343402, 131.6943942, 0), Point(194.0998566, 144.5376321, 0), Point(187.6478201, 157.272934, 0), Point(180.9599939, 169.8859665, 0), Point(174.0154382, 182.3594321, 0)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], {0;0;3;0}: [Point(200.3343402, 96.77739494, 30), Point(200.3343402, 96.77739494, 0), Point(193.9097477, 108.9017108, 0), Point(187.2624915, 120.905356, 0), Point(180.3746132, 132.7725158, 0), Point(173.2256484, 144.4841832, 0)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], {0;0;4;0}: [Point(200.3343402, 67.23066851, 30), Point(200.3343402, 67.23066851, 0), Point(193.690762, 78.62019074, 0), Point(186.8199803, 89.87406748, 0), Point(179.7046839, 100.9749097, 0), Point(172.3253554, 111.9019465, 0)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], {0;0;5;0}: [Point(200.3343402, 43.05421492, 30), Point(200.3343402, 43.05421492, 0), Point(193.4381212, 53.68567374, 0), Point(186.3114682, 64.16401122, 0), Point(178.9382578, 74.47028122, 0), Point(171.3005911, 84.58204933, 0)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]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))
join = JoinCurves(Curves=debrep.Edges, Preserve=False)
geo_6 = Geometry([Point(500, 53.6, 0), Point(437.5, -53.6, 0), Point(375, 53.6, 0), Point(312.5, -53.6, 0), Point(250, 53.6, 0), Point(187.5, -53.6, 0)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])
geo_7 = Geometry(<curve referenced from the Rhino model>)
offset_2 = OffsetCurve(Curve=join, Distance=Slider(2, range=0..10), Plane=PlaneXY(0, 0, 0), Corners=1)
pline_5 = PolyLine(Vertices=flatten(ins), Closed=False)
merge_5 = Merge(Data1=geo_7, Data2=offset_2)  # -> flatten(Result)
cp_3 = ControlPoints(Curve=offset_2)  # -> Points, Weights, Knots
crv_2 = Curve([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])
infill = Data([Point(200, 25.8, 0), Point(150, -25.8, 0), Point(100, 25.8, 0), Point(50, -25.8, 0), Point(0, 25.8, 0), Point(0, 24.2, 0)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])
outedge = Data(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)
crv_3 = Curve(cp_3.Points)
