# Grasshopper definition 070321_first_setup.gh (Grasshopper 1.0.7)

number_slider = Slider(200, range=0..1000)
pt = Point("0,0,0")
python = GhPythonScript(
    origin=pt,
    r_x=number_slider,
    r_y=number_slider,
    element_width=Slider(6.5, range=0..10),
    element_height=Slider(4, range=0..10))  # -> out, rect, joint_cects, cents, c_pts, curves, Breps_m, srf; inputs origin: Point3d
# ---------- python: Python ----------
import Rhino.Geometry as rg
import ghpythonlib.components as gh
import Grasshopper as gs



o_plane = rg.Plane(origin,rg.Vector3d.ZAxis)
rect = rg.Rectangle3d(o_plane,origin,rg.Point3d(r_x,r_y,0))
corners = [rect.Corner(i) for i in range(4)]
c_planes = [rg.Plane(pt,rg.Vector3d.ZAxis) for pt in corners]

domain = gh.ConstructDomain(-element_width/2,element_width/2)
joint_cects = [gh.Rectangle(plns,domain,domain,0)[0] for plns in c_planes]

curves = gh.TrimwithRegions(rect,joint_cects)[1]
off_1 = [gh.OffsetCurve(crv,element_width/2,o_plane,0) for crv in curves]
off_2 = [gh.OffsetCurve(crv,-element_width/2,o_plane,0) for crv in curves]

Breps_m = [gh.EdgeSurface(c1,c2) for c1,c2 in zip(off_1,off_2)]
B_srfs = [Breps_m[1].Faces[0] for i in range(len(Breps_m))]
srfs = [s.ToNurbsSurface(0.001) for s in B_srfs]
domain = rg.Interval(0.00,1.00)


#rg.Extrusion.CreateExtrusion(
# ---------- end python ----------
crv = Curve(python.curves)
