# Grasshopper definition 070321_stripe_test.gh (Grasshopper 1.0.7)

actuator_proportion = Slider(0.5, range=0..1)
passive_components_density = Slider(0.8, range=0..1)

# ---- group: square
number_slider = Slider(10, range=0..10)  # disabled
number_slider_2 = Slider(4, range=0..10)  # disabled
number_slider_3 = Slider(200, range=0..1000)  # disabled
panel = Panel("0,0,0")  # disabled
pt = Point(panel)  # disabled
python = GhPythonScript(origin=pt, r_x=number_slider_3, r_y=number_slider_3, element_width=number_slider, element_height=number_slider_2)  # -> out, rect, joint_cects, cents, c_pts, curves, Breps_m, srf; inputs origin: Point3d; disabled
# ---------- python: Python ----------
import Rhino.Geometry as rg
import ghpythonlib.components as gh




o_plane = rg.Plane(origin,rg.Vector3d.ZAxis)
rect = rg.Rectangle3d(o_plane,origin,rg.Point3d(r_x,r_y,0))
corners = [rect.Corner(i) for i in range(4)]
c_planes = [rg.Plane(pt,rg.Vector3d.ZAxis) for pt in corners]

domain = gh.ConstructDomain(-element_width/2,element_width/2)
joint_cects = [gh.Rectangle(plns,domain,domain,0)[0] for plns in c_planes]

curves = gh.TrimwithRegions(rect,joint_cects)[1]
off_1 = [gh.OffsetCurve(crv,element_width/2,o_plane,0) for crv in curves]
off_2 = [gh.OffsetCurve(crv,-element_width/2,o_plane,0) for crv in curves]

Breps_m = [gh.EdgeSurface(c1,c2) for c1,c2 in zip(off_1,off_2)]
B_srfs = [Breps_m[1].Faces[0] for i in range(len(Breps_m))]
srfs = [s.ToNurbsSurface(0.001) for s in B_srfs]
domain = rg.Interval(0.00,1.00)


#rg.Extrusion.CreateExtrusion(
# ---------- end python ----------
crv = Curve(python.curves)  # disabled

# ----
modulus_number = Slider(2, range=1..5)
list = ValueList({"modulus": 0, "split": 1}, selected="modulus")
crv_2 = Curve(reparameterize(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))
pt_2 = Point("0,0,0")
python_2 = GhPythonScript(
    origin=pt_2,
    nozzle="2",
    crv=crv_2,
    W=Slider(8, range=0..20),
    L=Slider(500, range=300..500),
    H=Slider(6, range=4..10),
    layer_height=".2",
    segment=Slider(3, range=2..10),
    number=modulus_number,
    dens=passive_components_density,
    proportion=actuator_proportion,
    style=list)  # -> out, all_paths, all_way_pts, toggle_all, velocity_all, simplify(block), layer_heights; inputs origin: Point3d, crv: Curve
# ---------- python_2: Python ----------
import Rhino.Geometry as rg
import ghpythonlib.components as gh
from compas.utilities import pairwise as pr
import itertools
import scriptcontext as sc


sc.sticky["nozzle"] = nozzle
sc.sticky["layer_height"] = layer_height


def list_to_tree(input, none_and_holes=True, source=[0]):
    """Transforms nestings of lists or tuples to a Grasshopper DataTree"""
    from Grasshopper import DataTree as Tree
    from Grasshopper.Kernel.Data import GH_Path as Path
    from System import Array
    def proc(input,tree,track):
        path = Path(Array[int](track))
        if len(input) == 0 and none_and_holes: tree.EnsurePath(path); return
        for i,item in enumerate(input):
            if hasattr(item, '__iter__'): #if list or tuple
                track.append(i); proc(item,tree,track); track.pop()
            else:
                if none_and_holes: tree.Insert(item,path,i)
                elif item is not None: tree.Add(item,path)
    if input is not None: t=Tree[object]();proc(input,t,source[:]);return t

class component():
    def __init__(self,c1,c2,nozzle,dir):
        self.c1 = c1
        self.c2 = c2
        self.dir = dir
        self.nozzle = nozzle

    def crv_s_e(self,crv):
        crv.Domain = rg.Interval(0,1)
        s_pt = crv.PointAt(0)
        e_pt = crv.PointAt(1)
        return s_pt,e_pt
    
     # c1:curve1 c2:curve2 n:number of tweencurve s_p:starting point(0,1,2,3) 
    def back_n_forth(self,c1,c2,s_p,nozzle,dir):
        p_a,p_a_1 = self.crv_s_e(self.c1)
        p_b,p_b_1 = self.crv_s_e(self.c2)
        dist = p_a.DistanceTo(p_b)
        if dir == 0:
            n = int(dist/nozzle)-1
        else:
            n = int(dist/nozzle*dens)-1
        crvs= rg.Curve.CreateTweenCurves(self.c1,self.c2,n,0.01)
        p_a,p_a_1 = self.crv_s_e(self.c1)
        p_b,p_b_1 = self.crv_s_e(self.c2)
        out_pts = [p_a,p_a_1,p_b_1,p_b,p_a]
        way_pts = []
        start = [[1,1],[0,1],[1,0],[0,0]]
        s_key = start[s_p]
        for i,c in enumerate(crvs):
            if i % 2 == s_key[0]:
                c.Reverse()
                c.Domain = rg.Interval(0,1)
                l = c.GetLength(rg.Interval(0,1))
                param = nozzle/l
                p_s = c.PointAt(param)
                way_pts.append(p_s)
                p_s = c.PointAt(1-param)
                way_pts.append(p_s)
            else:
                c.Domain = rg.Interval(0,1)
                l = c.GetLength(rg.Interval(0,1))
                param = nozzle/l
                p_s = c.PointAt(param)
                way_pts.append(p_s)
                p_s = c.PointAt(1-param)
                way_pts.append(p_s)
        toggle_v = s_key[1]
        if toggle_v == 0:
            way_pts.reverse()
        elif toggle_v == 1:
            pass 
        path_all = []
        way_pts_all = []
        toggle = []
        path = rg.NurbsCurve.Create(False,1,way_pts)
        outline = rg.NurbsCurve.Create(False,1,out_pts)
        path_all.append(outline)
        path_all.append(path)
        way_pts_all.extend(out_pts)
        for p in out_pts:
            toggle.append(1)
        toggle[-1] = 0
        way_pts_all.extend(way_pts)
        for t in range(len(way_pts)):
            toggle.append(1)
        toggle[-1] = 0
        return path_all,way_pts_all,toggle
    
    def optimized_path(self):
        p_a,_ = self.crv_s_e(self.c1)
        p_b,_ = self.crv_s_e(self.c2)
        dis = p_a.DistanceTo(p_b)
        i = 0 
        while i < 4:
            path,w_pts,toggle = self.back_n_forth(self.c1,self.c2,i,nozzle,dir)
            pt_1,_ = self.crv_s_e(path[1])
            pt_2 = w_pts[0]
            dis_2_pts = pt_1.DistanceTo(pt_2)
            if dis_2_pts < dis/2:
                break 
            i += 1 
        return path,w_pts,toggle

def crv_s_e(crv):
    crv.Domain = rg.Interval(0,1)
    s_pt = crv.PointAt(0)
    e_pt = crv.PointAt(1)
    return s_pt,e_pt

def reparam_crvs(crvs):
    new_crvs = []
    for crv in crvs:
        crv.Domain = rg.Interval(0,1)
        new_crvs.append(crv)
    return new_crvs

def dash_axis(crv,segment,nozzle):
    params = crv.DivideByCount(segment,False)
    crvs = list(crv.Split(params))
    curves = reparam_crvs(crvs)
    l = curves[0].GetLength(rg.Interval(0,1))
    pr = nozzle*0.2/l
    pts = []
    new_crvs = []
    for crv in curves:
        pt_1 = crv.PointAt(pr)
        pts.append(pt_1)
        pt_2 = crv.PointAt(1-pr)
        pts.append(pt_2)
        c1 = crv.Split(pr)[1]
        t_crv = c1.Split(1-pr)[0]
        new_crvs.append(t_crv)
    return pts,new_crvs

def guide_curves(crv,width,dir):
    o_plane = rg.Plane(origin,rg.Vector3d.ZAxis)
    crv_1 = gh.OffsetCurve(crv,width/2,o_plane,0)
    crv_2 = gh.OffsetCurve(crv,-width/2,o_plane,0)
    c1_pt_s,c1_pt_e = crv_s_e(crv_1)
    c2_pt_s,c2_pt_e = crv_s_e(crv_2)
    crv_3 = rg.LineCurve(c1_pt_s,c2_pt_s)
    crv_4 = rg.LineCurve(c1_pt_e,c2_pt_e)
    if dir == 0:
        return crv_1,crv_2
    if dir == 1:
        return crv_3,crv_4

def tween_cnt(c1,c2,nozzle):
    pt_1,_ = crv_s_e(c1)
    pt_2,_ = crv_s_e(c2)
    dist = pt_1.DistanceTo(pt_2)
    n = int(dist/nozzle)

all_paths = []
all_way_pts = []
toggle_all = []
velocity_all = []

temp = []
passive_1 = 15
passive = 20
active_1 = 15
active = 25


test_pts,curves = dash_axis(crv,segment,nozzle)
move_z = int(H/layer_height)
switch = int(move_z*proportion)
for j in range(move_z):
    layer_paths = []
    layer_way_pts = []
    layer_toggle = []
    layer_velocity = []
    t = rg.Transform.Translation(0,0,layer_height*j)
    for i,c in enumerate(curves):
        if i % number == 0:
            if 0<= j <= switch: 
                dir = 0 
                c1 = c.Duplicate()
                c1.Transform(t)
                c_1,c_2 = guide_curves(c1,W,dir)
                C1 = component(c_1,c_2,nozzle,dir)
                path,way_pts,toggle = C1.optimized_path()
                if j == 0 :
                    vel_1 = [active_1 for _ in way_pts]
                    layer_velocity.append(vel_1)
                else :
                    vel_2 = [active for _ in way_pts]
                    layer_velocity.append(vel_2)
                layer_toggle.append(toggle)
                layer_paths.append(path)
                layer_way_pts.append(way_pts)
            elif switch< j < move_z and j%3 == 0:
                dir = 1
                c1 = c.Duplicate()
                c1.Transform(t)
                c_1,c_2 = guide_curves(c1,W,dir)
                C1 = component(c_1,c_2,nozzle,dir)
                path,way_pts,toggle = C1.optimized_path()
                vel_3 = [passive for _ in way_pts]
                layer_velocity.append(vel_3)
                layer_toggle.append(toggle)
                layer_paths.append(path)
                layer_way_pts.append(way_pts)
            elif j == move_z-1:
                dir = 1
                c1 = c.Duplicate()
                c1.Transform(t)
                c_1,c_2 = guide_curves(c1,W,dir)
                C1 = component(c_1,c_2,nozzle,dir)
                path,way_pts,toggle = C1.optimized_path()
                vel_4 = [passive for _ in way_pts]
                layer_velocity.append(vel_4)
                layer_toggle.append(toggle)
                layer_paths.append(path)
                layer_way_pts.append(way_pts)
        else:
            if j == 0:
                dir = 1
                c2 = c.Duplicate()
                c2.Transform(t)
                c_3,c_4 = guide_curves(c2,W,dir)
                C2 = component(c_3,c_4,nozzle,dir)
                path,way_pts,toggle = C2.optimized_path()
                vel_5 = [passive_1 for _ in way_pts]
                layer_velocity.append(vel_5)
                layer_toggle.append(toggle)
                layer_paths.append(path)
                layer_way_pts.append(way_pts)
            elif 0< j < move_z -switch and j%3 == 0 : 
                dir = 1
                c2 = c.Duplicate()
                c2.Transform(t)
                c_3,c_4 = guide_curves(c2,W,dir)
                C2 = component(c_3,c_4,nozzle,dir)
                path,way_pts,toggle = C2.optimized_path()
                vel_6 = [passive for _ in way_pts]
                layer_velocity.append(vel_6)
                layer_toggle.append(toggle)
                layer_paths.append(path)
                layer_way_pts.append(way_pts)
            elif move_z -switch<= j <= move_z:
                dir = 0
                c2 = c.Duplicate()
                c2.Transform(t)
                c_3,c_4 = guide_curves(c2,W,dir)
                C2 = component(c_3,c_4,nozzle,dir)
                path,way_pts,toggle = C2.optimized_path()
                if j == move_z -switch :
                    vel_7 = [active_1 for _ in way_pts]
                    layer_velocity.append(vel_7)
                else :
                    vel_8 = [active for _ in way_pts]
                    layer_velocity.append(vel_8)
                layer_toggle.append(toggle)
                layer_paths.append(path)
                layer_way_pts.append(way_pts)
    if j % 2 != 0:
        layer_paths.reverse()
        layer_way_pts.reverse()
        layer_toggle.reverse()
        layer_velocity.reverse()
        merged_layer_paths = list(itertools.chain.from_iterable(layer_paths))
        merged_way_pts = list(itertools.chain.from_iterable(layer_way_pts))
        merged_toggle = list(itertools.chain.from_iterable(layer_toggle))
        merged_velocity = list(itertools.chain.from_iterable(layer_velocity))
        temp.extend(layer_paths)
        all_paths.extend(merged_layer_paths)
        all_way_pts.extend(merged_way_pts)
        toggle_all.extend(merged_toggle)
        velocity_all.extend(merged_velocity)
        
    else:
        merged_layer_paths = list(itertools.chain.from_iterable(layer_paths))
        merged_way_pts = list(itertools.chain.from_iterable(layer_way_pts))
        merged_toggle = list(itertools.chain.from_iterable(layer_toggle))
        merged_velocity = list(itertools.chain.from_iterable(layer_velocity))
        temp.extend(layer_paths)
        all_paths.extend(merged_layer_paths)
        all_way_pts.extend(merged_way_pts)
        toggle_all.extend(merged_toggle)
        velocity_all.extend(merged_velocity)

block = list_to_tree(temp, none_and_holes=True, source=[0])

"""

if style == 1 :
    if number <= segment:
        for i,crv in enumerate(crvs):
            if 0<= i < number:
                pass
            else :
                pass

"""
# ---------- end python_2 ----------
crv_3 = Curve(python_2.all_paths)
gradient = Gradient(
    LowerLimit="15",
    UpperLimit="25",
    Parameter=python_2.velocity_all,
    stops=[0: RGB(234, 38, 0), 0.25: RGB(234, 126, 0), 0.5: RGB(254, 244, 84), 0.75: RGB(173, 203, 249), 1: RGB(75, 107, 169)])
pline = PolyLine(Vertices=python_2.all_way_pts, Closed=False)
blocktocode = PythonScript(FRAdjust=0.95, machine="0", block=python_2.block)  # -> blockToCode, flatten(code); inputs block: list
# ---------- blocktocode: Python ----------
import math
import rhinoscriptsyntax as rs
import scriptcontext as sc

def blockToCode(block, nozzleDia, fillamentDia, layerHeight, defaultSpeed = 5000):
    result = []
    for i in range(len(block)):
        curve = block[i]
        if(isinstance(defaultSpeed, list)): speed = defaultSpeed[i]
        else: speed = defaultSpeed
        pt = rs.CurveStartPoint(curve)
        if(machine == 1):
            # makerbot
            result += ["G1 E-1.000 F1200\n"]
            result += ["G1 X%.3f Y%.3f F9000\n" % (pt[0], pt[1])]
            result += ["G1 E1.000 F1200\n"]
        else:
            # large printer
            result += ["G92 E0\n"]
            result += ["G1 E-1.000 F1200\n"]
            result += ["G1 X%.3f Y%.3f F9000\n" % (pt[0], pt[1])]
            result += ["G1 E0.000 F1200\n"]
        # extrude along curve
        i = 0
        segments, extSum = rs.ExplodeCurves(curve), 0.
        if(len(segments) == 0):
            segments = [curve]
        for segment in segments:
            volume = nozzleDia * rs.CurveLength(segment) * layerHeight
            extrusion = (volume / (((fillamentDia / 2) ** 2) * math.pi)) * FRAdjust
            extSum += extrusion
            if(machine == 1):
                # makerbot
                E = extrusion
            else:
                # large printer
                E = extSum
            pt = rs.CurveEndPoint(segment)
            if(i == 0):
                string = "G1 X%.3f Y%.3f E%.3f F%d\n" % (pt[0], pt[1], E, int(speed))
            else:
                string = "G1 X%.3f Y%.3f E%.3f\n" % (pt[0], pt[1], E)
            i += 1
            result += [string]
    return "".join(result)
    
layerHeight = sc.sticky["layer_height"]
nozzleDia = sc.sticky["nozzle"]
fillamentDia = 2.85 
print 
if(len(block) > 0):
    code = blockToCode(block, nozzleDia, fillamentDia, layerHeight, 5000)
# ---------- end blocktocode ----------
dots = DotDisplay(Point=python_2.all_way_pts, Colour=gradient, Size=1)
