# Grasshopper definition 071821_ribs.gh (Grasshopper 1.0.7)
# plug-ins: Pufferfish, EdiTree

brep = Brep([<brep referenced from the Rhino model> x7])
debox = DeconstructBox(Box=brep)  # -> Plane, X, Y, Z
number_slider = Slider(14, range=0..15)
int = Integer(debox.Z)
box = EvaluateBox(Box=brep, UParameter=0.5, VParameter=0.5, WParameter="0.5")  # -> Plane, Point, Include
division = Division(A=Slider(0.8, range=0..1), B=int)
subtraction = Subtraction(A=1, B=division)
pt = Point("0,0,0")
python = GhPythonScript(
    origin=pt,
    r_x=Slider(250, range=0..1000),
    r_y=Slider(250, range=0..1000),
    element_width=number_slider,
    element_height=Slider(6, range=0..10))  # -> out, rect, joint_cects, curves, Breps_m, srf; inputs origin: Point3d
# ---------- python: Python ----------
import Rhino.Geometry as rg
import ghpythonlib.components as gh
import Grasshopper as gs



o_plane = rg.Plane(origin,rg.Vector3d.ZAxis)
rect = rg.Rectangle3d(o_plane,origin,rg.Point3d(r_x,r_y,0))
corners = [rect.Corner(i) for i in range(4)]
c_planes = [rg.Plane(pt,rg.Vector3d.ZAxis) for pt in corners]

domain = gh.ConstructDomain(-element_width/2,element_width/2)
joint_cects = [gh.Rectangle(plns,domain,domain,0)[0] for plns in c_planes]

curves = gh.TrimwithRegions(rect,joint_cects)[1]
off_1 = [gh.OffsetCurve(crv,element_width/2,o_plane,0) for crv in curves]
off_2 = [gh.OffsetCurve(crv,-element_width/2,o_plane,0) for crv in curves]

Breps_m = [gh.EdgeSurface(c1,c2) for c1,c2 in zip(off_1,off_2)]
B_srfs = [Breps_m[1].Faces[0] for i in range(len(Breps_m))]
srfs = [s.ToNurbsSurface(0.001) for s in B_srfs]
domain = rg.Interval(0.00,1.00)


#rg.Extrusion.CreateExtrusion(
# ---------- end python ----------
planesrf = PlaneSurface(Plane=box.Plane, XSize=Domain(-20, 20), YSize=Domain(-500, 500))
split = SplitBrep(Brep=brep, Cutter=planesrf)  # -> simplify(Result)
frame = Brep(python.Breps_m)
cap = CapHoles(Brep=split)
crv = Curve(python.rect)
crv_2 = Curve(python.curves)
joint = Brep(python.joint_cects)
item = ListItem(List=cap, Index=0, Wrap=True)  # -> Item, Item1
debrep = DeconstructBrep(Brep=frame)  # -> Faces, flatten(Edges), Vertices
explode = Explode(Curve=crv, Recursive=True)  # -> reparameterize(Segments), Vertices
item_2 = ListItem(List=frame, Index=0, Wrap=True)  # -> Item, Item1, Item2
item_3 = ListItem(List=explode.Segments, Index=0, Wrap=True)  # -> Item, Item1
item_4 = ListItem(List=debrep.Edges, Index=Slider(5, range=0..5), Wrap=True)
brep_2 = Brep(item.Item1)
brep_3 = Brep(item.Item)
divide = DivideCurve(Curve=item_3.Item, Count="6", Kinks=False)  # -> Points, Tangents, Parameters
len = Length(Curve=item_4)
Y = UnitY(Factor=1)
division_2 = Division(A=number_slider, B=2)
Y_2 = UnitY(Factor=division_2)
move = Move(Geometry=divide.Points, Motion=Y_2)  # -> Geometry, Transform
line = LineSDL(Start=move.Geometry, Direction=Y, Length=len)
crv_3 = Curve(reparameterize(line))
slideindom = SlideWithinDomain(Domain=len, Factor=Slider(0.82, range=0..1))
item_5 = ListItem(List=crv_3, Index=0, Wrap=True)
addition = Addition(A="6", B=1)
subtraction_2 = Subtraction(A=len, B=slideindom)
len_2 = Length(Curve=item_5)
series = Series(Start=Slider(0.5, range=0..1), Step=Slider(0, range=0..1), Count=addition)
python_2 = GhPythonScript(x=series)  # -> out, a; inputs x: list
# ---------- python_2: Python ----------
import Rhino.Geometry as rg
a = []
for i in x:
    if i >= 1:
        a.append(0.99)
    else:
        a.append(i)
# ---------- end python_2 ----------
division_3 = Division(A=number_slider, B=2)
dom = ConstructDomain(DomainStart=division_3, DomainEnd=subtraction_2)
slideindom_2 = SlideWithinDomain(Domain=dom, Factor=python_2.a)
division_4 = Division(A=slideindom, B=len_2)
division_5 = Division(A=slideindom_2, B=len_2)

addition_2 = Addition(A=division_4, B=division_5)
subtraction_3 = Subtraction(A=1, B=division_5)

eval = EvaluateCurve(Curve=crv_3, Parameter=division_5)  # -> Point, Tangent, Angle
eval_2 = EvaluateCurve(Curve=crv_3, Parameter=addition_2)  # -> Point, Tangent, Angle
weave = Weave(Pattern=[0, 1], Stream0=eval.Point, Stream1=eval_2.Point, NullGaps=False)
partition = PartitionListAdv(List=weave, Size="2")  # -> Chunk, Remainder
flip = FlipMatrix(Data=partition.Chunk)
crv_cp = CurveClosestPoint(Point=flip, Curve=crv_3)  # -> Point, Parameter, Distance
flip_2 = FlipMatrix(Data=crv_cp.Parameter)
shatter = Shatter(Curve=graft(crv_3), Parameters=flip_2)
simplify = SimplifyTree(Tree=shatter, Front=False)
item_6 = ListItem(List=simplify, Index=0, Wrap=True)  # -> Item, Item1, Item2
multiplication = Multiplication(A=division_3, B=-1)
offset = OffsetCurve(Curve=item_6.Item1, Distance=division_3, Plane=PlaneXY(0, 0, 0), Corners=1)
offset_2 = OffsetCurve(Curve=item_6.Item1, Distance=multiplication, Plane=PlaneXY(0, 0, 0), Corners=1)
offset_3 = OffsetCurve(Curve=item_6.Item, Distance=division_3, Plane=PlaneXY(0, 0, 0), Corners=1)
offset_4 = OffsetCurve(Curve=item_6.Item2, Distance=division_3, Plane=PlaneXY(0, 0, 0), Corners=1)
offset_5 = OffsetCurve(Curve=item_6.Item, Distance=multiplication, Plane=PlaneXY(0, 0, 0), Corners=1)
offset_6 = OffsetCurve(Curve=item_6.Item2, Distance=multiplication, Plane=PlaneXY(0, 0, 0), Corners=1)
number_slider_2 = Slider(7, range=0..10)
number_slider_3 = Slider(4, range=0..10)
edgesrf = EdgeSurface(CurveA=offset_3, CurveB=offset_5)
edgesrf_2 = EdgeSurface(CurveA=offset_4, CurveB=offset_6)
edgesrf_3 = EdgeSurface(CurveA=offset, CurveB=offset_2)
Z = UnitZ(Factor=number_slider_2)
Z_2 = UnitZ(Factor=number_slider_2)
Z_3 = UnitZ(Factor=number_slider_3)
Z_4 = UnitZ(Factor=number_slider_2)
Z_5 = UnitZ(Factor=number_slider_3)
Z_6 = UnitZ(Factor=number_slider_3)
extr = Extrude(Base=joint, Direction=Z_6)
extr_2 = Extrude(Base=edgesrf_2, Direction=Z_2)  # -> flatten(Extrusion)
extr_3 = Extrude(Base=edgesrf, Direction=Z)  # -> flatten(Extrusion)
extr_4 = Extrude(Base=item_2.Item, Direction=Z_5)
extr_5 = Extrude(Base=item_2.Item2, Direction=Z_3)
extr_6 = Extrude(Base=edgesrf_3, Direction=Z_4)  # -> flatten(Extrusion)
addition_3 = Addition(A="6", B=1)
item_7 = ListItem(List=extr, Index=0, Wrap=True)  # -> Item, Item1
sunion = SolidUnion(Breps=extr_4)
panel = Panel("""0.8
0.8
0.8
0.8
0.4
0.4
0.4
0.4""")
sunion_2 = SolidUnion(Breps=extr_5)
sunion_3 = SolidUnion(Breps=extr)
series_2 = Series(Start=Slider(0.07, range=0..1), Step=Slider(0.07, range=0..1), Count=addition_3)
python_3 = GhPythonScript(x=series_2)  # -> out, a; inputs x: list; same code as python_2
brep_4 = Brep([sunion, sunion_2, sunion_3])
brep_5 = Brep([extr_2, extr_3])

# ---- group: test_1_Actuator height
panel_2 = Panel("""4
3.5
3
2.5
2
1.5
1""")

# ----
subtraction_4 = Subtraction(A=1, B=python_3.a)
multiplication_2 = Multiplication(A=python_3.a, B=number_slider_2)
panel_3 = Panel(python_3.a)
sunion_4 = SolidUnion(Breps=[brep_5, brep_4])
box_2 = EvaluateBox(Box=extr_6, UParameter=0.5, VParameter=0.5, WParameter=subtraction_4)  # -> Plane, Point, Include
panel_4 = Panel(multiplication_2)
division_6 = Division(A=panel_2, B="5")
planesrf_2 = PlaneSurface(Plane=box_2.Plane, XSize=Domain(-10, 10), YSize=Domain(-500, 500))
panel_5 = Panel(division_6)
panel_6 = Panel("""4
4
4
4
1
1
1
1""")
split_2 = SplitBrep(Brep=extr_6, Cutter=planesrf_2)
item_8 = ListItem(List=split_2, Index=0, Wrap=True)  # -> Item, Item1
panel_7 = Panel("""6.51
6.02
5.53
5.04
4.55
4.06
3.57""")
sunion_5 = SolidUnion(Breps=[item_7.Item, item_7.Item1, extr_4, extr_3])
cap_2 = CapHoles(Brep=item_8.Item)
panel_8 = Panel("""Line(L:195.76 mm)
Line(L:147.472 mm)
Line(L:99.184 mm)
Line(L:50.896 mm)
Line(L:195.76 mm)
Line(L:147.472 mm)
Line(L:99.184 mm)
Line(L:50.896 mm)

overall 243mm""")
cap_3 = CapHoles(Brep=item_8.Item1)
sunion_6 = SolidUnion(Breps=[sunion_5, extr_2])
