# Grasshopper definition 072521_Strip_test_&_curve_analysis.gh (Grasshopper 1.0.7)
# plug-ins: Human

crv = Curve(reparameterize(<curve referenced from the Rhino model>))  # disabled
cluster = Cluster_2(C=crv, C_2=crv)  # -> L, L_2; disabled
number_slider = Slider(3, range=0..10)  # disabled
number_slider_2 = Slider(7, range=1..10)  # disabled
swatch = ColourSwatch(SwatchColor=RGB(61, 255, 203))  # disabled
swatch_2 = ColourSwatch(SwatchColor=RGB(107, 240, 255))  # disabled
previewlw = CustomPreviewLineweights(Geometry=crv, Shader=swatch_2, Thickness=number_slider_2, Absolute=False)  # disabled
previewlw_2 = CustomPreviewLineweights(Geometry=cluster.L, Shader=swatch, Thickness=number_slider, Absolute=False)  # disabled
previewlw_3 = CustomPreviewLineweights(Geometry=cluster.L_2, Shader=swatch, Thickness=number_slider, Absolute=False)  # disabled

# ---- group: square
number_slider_3 = Slider(10, range=0..10)  # disabled
number_slider_4 = Slider(4, range=0..10)  # disabled
number_slider_5 = Slider(200, range=0..1000)  # disabled
panel = Panel("0,0,0")  # disabled
pt = Point(panel)  # disabled
python = GhPythonScript(origin=pt, r_x=number_slider_5, r_y=number_slider_5, element_width=number_slider_3, element_height=number_slider_4)  # -> out, rect, joint_cects, cents, c_pts, curves, Breps_m, srf; inputs origin: Point3d; disabled
# ---------- python: Python ----------
import Rhino.Geometry as rg
import ghpythonlib.components as gh




o_plane = rg.Plane(origin,rg.Vector3d.ZAxis)
rect = rg.Rectangle3d(o_plane,origin,rg.Point3d(r_x,r_y,0))
corners = [rect.Corner(i) for i in range(4)]
c_planes = [rg.Plane(pt,rg.Vector3d.ZAxis) for pt in corners]

domain = gh.ConstructDomain(-element_width/2,element_width/2)
joint_cects = [gh.Rectangle(plns,domain,domain,0)[0] for plns in c_planes]

curves = gh.TrimwithRegions(rect,joint_cects)[1]
off_1 = [gh.OffsetCurve(crv,element_width/2,o_plane,0) for crv in curves]
off_2 = [gh.OffsetCurve(crv,-element_width/2,o_plane,0) for crv in curves]

Breps_m = [gh.EdgeSurface(c1,c2) for c1,c2 in zip(off_1,off_2)]
B_srfs = [Breps_m[1].Faces[0] for i in range(len(Breps_m))]
srfs = [s.ToNurbsSurface(0.001) for s in B_srfs]
domain = rg.Interval(0.00,1.00)


#rg.Extrusion.CreateExtrusion(
# ---------- end python ----------
crv_2 = Curve(python.curves)  # disabled

# ----
print_bed_ur5 = Geometry(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)

# ----
# Test curvs
crv_test_0 = Curve(reparameterize(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))
crv_test_1 = Curve(reparameterize(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))
crv_test_2 = Curve(reparameterize(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))
crv_test_3 = Curve(reparameterize(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))
crv_test_4 = Curve(reparameterize(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))
crv_max = Curve(reparameterize(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))
crv_min = Curve(reparameterize(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))

# ----
# Generate tool path
passive_components_density = Slider(0.6, range=0..1)
actuator_proportion = Slider(0.5, range=0..1)
modulus_number = Slider(2, range=1..5)
list = ValueList({"modulus": 0, "split": 1}, selected="modulus")
crv_3 = Curve(reparameterize(<curve referenced from the Rhino model>))
pt_2 = Point("0,0,0")
python_2 = GhPythonScript(
    origin=pt_2,
    nozzle="2",
    crv=crv_3,
    W=Slider(10, range=0..20),
    L=Slider(500, range=300..500),
    H=Slider(5, range=4..10),
    layer_height=".25",
    segment=Slider(3, range=2..10),
    number=modulus_number,
    dens=passive_components_density,
    proportion=actuator_proportion,
    style=list)  # -> out, all_way_pts, toggle_all, velocity_all, simplify(block), layer_heights; inputs origin: Point3d, crv: Curve
# ---------- python_2: Python ----------
import Rhino.Geometry as rg
import ghpythonlib.components as gh
from compas.utilities import pairwise as pr
import itertools
import scriptcontext as sc


sc.sticky["nozzle"] = nozzle
sc.sticky["layer_height"] = layer_height

def list_to_tree(input, none_and_holes=True, source=[0]):
    """Transforms nestings of lists or tuples to a Grasshopper DataTree"""
    from Grasshopper import DataTree as Tree
    from Grasshopper.Kernel.Data import GH_Path as Path
    from System import Array
    def proc(input,tree,track):
        path = Path(Array[int](track))
        if len(input) == 0 and none_and_holes: tree.EnsurePath(path); return
        for i,item in enumerate(input):
            if hasattr(item, '__iter__'): #if list or tuple
                track.append(i); proc(item,tree,track); track.pop()
            else:
                if none_and_holes: tree.Insert(item,path,i)
                elif item is not None: tree.Add(item,path)
    if input is not None: t=Tree[object]();proc(input,t,source[:]);return t

class component():
    def __init__(self,c1,c2,nozzle,dir):
        self.c1 = c1
        self.c2 = c2
        self.dir = dir
        self.nozzle = nozzle

    def crv_s_e(self,crv):
        crv.Domain = rg.Interval(0,1)
        s_pt = crv.PointAt(0)
        e_pt = crv.PointAt(1)
        return s_pt,e_pt
    
     # c1:curve1 c2:curve2 n:number of tweencurve s_p:starting point(0,1,2,3) 
    def back_n_forth(self,c1,c2,s_p,nozzle,dir):
        #toggle = []
        p_a,p_a_1 = self.crv_s_e(self.c1)
        p_b,p_b_1 = self.crv_s_e(self.c2)
        dist = p_a.DistanceTo(p_b)
        if dir == 0:
            n = int(dist/nozzle)-1
        else:
            n = int(dist/nozzle*dens)-1
        crvs= rg.Curve.CreateTweenCurves(self.c1,self.c2,n,0.01)
        p_a,p_a_1 = self.crv_s_e(self.c1)
        p_b,p_b_1 = self.crv_s_e(self.c2)
        out_pts = [p_a,p_a_1,p_b_1,p_b,p_a]
        #tg = [1 for _ in out_pts ]
        #toggle.extend(tg)
        way_pts = []
        start = [[1,1],[0,1],[1,0],[0,0]]
        s_key = start[s_p]
        for i,c in enumerate(crvs):
            if i % 2 == s_key[0]:
                c.Reverse()
                c.Domain = rg.Interval(0,1)
                l = c.GetLength(rg.Interval(0,1))
                param = nozzle/l*0.8
                p_s = c.PointAt(param)
                way_pts.append(p_s)
                #toggle.append(1)
                p_s = c.PointAt(1-param)
                way_pts.append(p_s)
                #if dir == 0:
                    #toggle.append(0)
                #else:
                    #toggle.append(1)
            else:
                c.Domain = rg.Interval(0,1)
                l = c.GetLength(rg.Interval(0,1))
                param = nozzle/l*0.8
                p_s = c.PointAt(param)
                way_pts.append(p_s)
                #toggle.append(1)
                p_s = c.PointAt(1-param)
                way_pts.append(p_s)
                #if dir == 0:
                    #toggle.append(0)
                #else:
                    #toggle.append(0)
        toggle_v = s_key[1]
        if toggle_v == 0:
            way_pts.reverse()
        elif toggle_v == 1:
            pass 
        path_all = []
        way_pts_all = []
        toggle = []
        path = rg.NurbsCurve.Create(False,1,way_pts)
        outline = rg.NurbsCurve.Create(False,1,out_pts)
        path_all.append(outline)
        path_all.append(path)
        way_pts_all.extend(out_pts)
        for p in out_pts:
            toggle.append(1)
        toggle[-1] = 0
        way_pts_all.extend(way_pts)
        for t in range(len(way_pts)):
            toggle.append(1)
        toggle[-1] = 0
        return path_all,way_pts_all,toggle
    
    def optimized_path(self):
        p_a,_ = self.crv_s_e(self.c1)
        p_b,_ = self.crv_s_e(self.c2)
        dis = p_a.DistanceTo(p_b)
        i = 0 
        while i < 4:
            path,w_pts,toggle = self.back_n_forth(self.c1,self.c2,i,nozzle,dir)
            pt_1,_ = self.crv_s_e(path[1])
            pt_2 = w_pts[0]
            dis_2_pts = pt_1.DistanceTo(pt_2)
            if dis_2_pts < dis/2:
                break 
            i += 1 
        return path,w_pts,toggle

def crv_s_e(crv):
    crv.Domain = rg.Interval(0,1)
    s_pt = crv.PointAt(0)
    e_pt = crv.PointAt(1)
    return s_pt,e_pt

def reparam_crvs(crvs):
    new_crvs = []
    for crv in crvs:
        crv.Domain = rg.Interval(0,1)
        new_crvs.append(crv)
    return new_crvs

def dash_axis(crv,segment,nozzle):
    params = crv.DivideByCount(segment,False)
    crvs = list(crv.Split(params))
    curves = reparam_crvs(crvs)
    l = curves[0].GetLength(rg.Interval(0,1))
    pr = nozzle*0.5/l
    pts = []
    new_crvs = []
    for crv in curves:
        pt_1 = crv.PointAt(pr)
        pts.append(pt_1)
        pt_2 = crv.PointAt(1-pr)
        pts.append(pt_2)
        c1 = crv.Split(pr)[1]
        t_crv = c1.Split(1-pr)[0]
        new_crvs.append(t_crv)
    return pts,new_crvs

def guide_curves(crv,width,dir):
    o_plane = rg.Plane(origin,rg.Vector3d.ZAxis)
    crv_1 = gh.OffsetCurve(crv,width/2,o_plane,0)
    crv_2 = gh.OffsetCurve(crv,-width/2,o_plane,0)
    c1_pt_s,c1_pt_e = crv_s_e(crv_1)
    c2_pt_s,c2_pt_e = crv_s_e(crv_2)
    crv_3 = rg.LineCurve(c1_pt_s,c2_pt_s)
    crv_4 = rg.LineCurve(c1_pt_e,c2_pt_e)
    if dir == 0:
        return crv_1,crv_2
    if dir == 1:
        return crv_3,crv_4

def tween_cnt(c1,c2,nozzle):
    pt_1,_ = crv_s_e(c1)
    pt_2,_ = crv_s_e(c2)
    dist = pt_1.DistanceTo(pt_2)
    n = int(dist/nozzle)

def add_way_pt(pts_list,height):
    pt_s = pts_list[0].Clone()
    pt_e = pts_list[-1].Clone()
    t_1 = rg.Transform.Translation(0,0,height*2)
    t_2 = rg.Transform.Translation(0,0,height)
    pt_s.Transform(t_1)
    pt_e.Transform(t_2)
    pts_list.insert(0,pt_s)
    pts_list.append(pt_e)
    return pts_list

def add_vel(vel_list,s,e):
    vel_list.insert(0,s)
    vel_list.append(e)
    return vel_list

def add_toggle(toggle_list):
    toggle_list.insert(0,1)
    toggle_list.append(0)
    return toggle_list

all_paths = []
all_way_pts = []
toggle_all = []
velocity_all = []

temp = []
lift_height = 5
passive_1 = 45
passive = 45
active_1 = 45
active = 60


test_pts,curves = dash_axis(crv,segment,nozzle)
move_z = int(H/layer_height)
switch = int(move_z*proportion)
for j in range(move_z):
    layer_paths = []
    layer_way_pts = []
    layer_toggle = []
    layer_velocity = []
    t = rg.Transform.Translation(0,0,layer_height*j)
    for i,c in enumerate(curves):
        if i % number == 0:
            if 0<= j <= switch: 
                dir = 0 
                c1 = c.Duplicate()
                c1.Transform(t)
                c_1,c_2 = guide_curves(c1,W,dir)
                C1 = component(c_1,c_2,nozzle,dir)
                path,way_pts,toggle = C1.optimized_path()
                if j == 0 :
                    vel_1 = [active_1 for _ in way_pts]
                    vel_1_1 = add_vel(vel_1,60,15)
                    layer_velocity.append(vel_1_1)
                else :
                    vel_2 = [active for _ in way_pts]
                    vel_2_1 = add_vel(vel_2,60,15)
                    layer_velocity.append(vel_2_1)
                toggle_1 = add_toggle(toggle)
                layer_toggle.append(toggle_1)
                #layer_paths.append(path)
                way_pts_1 = add_way_pt(way_pts,lift_height)
                layer_way_pts.append(way_pts_1)
            elif switch< j < move_z and j%3 == 0:
                dir = 1
                c1 = c.Duplicate()
                c1.Transform(t)
                c_1,c_2 = guide_curves(c1,W,dir)
                C1 = component(c_1,c_2,nozzle,dir)
                path,way_pts,toggle = C1.optimized_path()
                vel_3 = [passive for _ in way_pts]
                vel_3_1 = add_vel(vel_3,40,15)
                layer_velocity.append(vel_3_1)
                toggle_2 = add_toggle(toggle)
                layer_toggle.append(toggle_2)
                #layer_paths.append(path)
                way_pts_2 = add_way_pt(way_pts,lift_height)
                layer_way_pts.append(way_pts_2)
            elif j == move_z-1:
                dir = 1
                c1 = c.Duplicate()
                c1.Transform(t)
                c_1,c_2 = guide_curves(c1,W,dir)
                C1 = component(c_1,c_2,nozzle,dir)
                path,way_pts,toggle = C1.optimized_path()
                vel_4 = [passive for _ in way_pts]
                vel_4_1 = add_vel(vel_4,60,15)
                layer_velocity.append(vel_4_1)
                toggle_3 = add_toggle(toggle)
                layer_toggle.append(toggle_3)
                layer_paths.append(path)
                way_pts_3 = add_way_pt(way_pts,lift_height)
                layer_way_pts.append(way_pts_3)
        else:
            if j == 0:
                dir = 1
                c2 = c.Duplicate()
                c2.Transform(t)
                c_3,c_4 = guide_curves(c2,W,dir)
                C2 = component(c_3,c_4,nozzle,dir)
                path,way_pts,toggle = C2.optimized_path()
                vel_5 = [passive_1 for _ in way_pts]
                vel_5_1 = add_vel(vel_5,60,15)
                layer_velocity.append(vel_5_1)
                toggle_4 = add_toggle(toggle)
                layer_toggle.append(toggle_4)
                #layer_paths.append(path)
                way_pts_4 = add_way_pt(way_pts,lift_height)
                layer_way_pts.append(way_pts_4)
            elif 0< j < move_z -switch and j%3 == 0 : 
                dir = 1
                c2 = c.Duplicate()
                c2.Transform(t)
                c_3,c_4 = guide_curves(c2,W,dir)
                C2 = component(c_3,c_4,nozzle,dir)
                path,way_pts,toggle = C2.optimized_path()
                vel_6 = [passive for _ in way_pts]
                vel_6_1 = add_vel(vel_6,60,15)
                layer_velocity.append(vel_6_1)
                toggle_5 = add_toggle(toggle)
                layer_toggle.append(toggle_5)
                #layer_paths.append(path)
                way_pts_5 = add_way_pt(way_pts,lift_height)
                layer_way_pts.append(way_pts_5)
            elif move_z -switch<= j <= move_z:
                dir = 0
                c2 = c.Duplicate()
                c2.Transform(t)
                c_3,c_4 = guide_curves(c2,W,dir)
                C2 = component(c_3,c_4,nozzle,dir)
                path,way_pts,toggle = C2.optimized_path()
                if j == move_z -switch :
                    vel_7 = [active_1 for _ in way_pts]
                    vel_7_1 = add_vel(vel_7,60,15)
                    layer_velocity.append(vel_7_1)
                else :
                    vel_8 = [active for _ in way_pts]
                    vel_8_1 = add_vel(vel_8,60,15)
                    layer_velocity.append(vel_8_1)
                toggle_6 = add_toggle(toggle)
                layer_toggle.append(toggle_6)
                #layer_paths.append(path)
                way_pts_6 = add_way_pt(way_pts,lift_height)
                layer_way_pts.append(way_pts_6)
    if j % 2 != 0:
        layer_paths.reverse()
        layer_way_pts.reverse()
        layer_toggle.reverse()
        layer_velocity.reverse()
        merged_layer_paths = list(itertools.chain.from_iterable(layer_paths))
        merged_way_pts = list(itertools.chain.from_iterable(layer_way_pts))
        #pt_add,tog,vel = add_way_pt(merged_way_pts[-1],5,0,15)
        merged_toggle = list(itertools.chain.from_iterable(layer_toggle))
        merged_velocity = list(itertools.chain.from_iterable(layer_velocity))
        #merged_way_pts.append(pt_add)
        #merged_toggle.append(tog)
        #merged_velocity.append(vel)
        temp.extend(layer_paths)
        all_paths.extend(merged_layer_paths)
        all_way_pts.extend(merged_way_pts)
        toggle_all.extend(merged_toggle)
        velocity_all.extend(merged_velocity)
        
    else:
        merged_layer_paths = list(itertools.chain.from_iterable(layer_paths))
        merged_way_pts = list(itertools.chain.from_iterable(layer_way_pts))
        #pt_add,tog,vel = add_way_pt(merged_way_pts[-1],5,0,15)
        merged_toggle = list(itertools.chain.from_iterable(layer_toggle))
        merged_velocity = list(itertools.chain.from_iterable(layer_velocity))
        #merged_way_pts.append(pt_add)
        #merged_toggle.append(tog)
        #merged_velocity.append(vel)
        temp.extend(layer_paths)
        all_paths.extend(merged_layer_paths)
        all_way_pts.extend(merged_way_pts)
        toggle_all.extend(merged_toggle)
        velocity_all.extend(merged_velocity)

block = list_to_tree(temp, none_and_holes=True, source=[0])

"""

if style == 1 :
    if number <= segment:
        for i,crv in enumerate(crvs):
            if 0<= i < number:
                pass
            else :
                pass

"""
# ---------- end python_2 ----------
pline = PolyLine(Vertices=python_2.all_way_pts, Closed=False)

filter = StreamFilter(
    Gate=Slider(0, range=0..6),
    Stream0=crv_max,
    Stream1=crv_min,
    Stream2=crv_test_0,
    Stream3=crv_test_1,
    Stream4=crv_test_2,
    Stream5=crv_test_3,
    Stream6=crv_test_4)

# ----
# Analysis input curve
number_slider_6 = Slider(30, range=0..100)
python_3 = GhPythonScript(curve=filter, resolution=number_slider_6)  # -> out, k_val, pts, reparam_crvs, a_p, crv_id; inputs curve: Curve, resolution: Int32
# ---------- python_3: Python ----------
import Rhino.Geometry as rg
import ghpythonlib.components as gh
from compas.utilities import pairwise as pr
import itertools
import scriptcontext as sc
import math

def bending_radi(crv):
    crv.Domain = rg.Interval(0,1)
    v1 = crv.TangentAt(0)
    v2 = crv.TangentAt(1)
    v_n = rg.Vector3d.CrossProduct(v1,v2)
    radi = rg.Vector3d.VectorAngle(v1,v2,v_n)
    return radi

def reparam_crvs(crvs):
    reparam_crvs = []
    for c in crvs:
        c.Domain = rg.Interval(0,1)
        reparam_crvs.append(c)
    return reparam_crvs

def cur_k(curve, resolution):
    ts = list(curve.DivideByCount(resolution,True))
    pts,k_val,_ = gh.Curvature(curve,ts)
    return pts,k_val,ts
    
def fla_n_seg(curve,res,vec):
    vec.Unitize()
    pts,k_val = cur_k(curve, res)
    len  = curve.GetLength()
    line_crv = gh.LineSDL(pts[0],vec,len)

def math_map_list(values, toMin=0, toMax=1):
    minValue = min(values)
    maxValue = max(values)
    delta = maxValue - minValue
    deltaTarget = toMax - toMin
    newValues = [toMin +(value-minValue)*deltaTarget/delta for value in values]
    return newValues

def round_half_up(n, decimals=0):
    multiplier = 10 ** decimals
    return math.floor(n*multiplier + 0.5) / multiplier

# finding the segmentation points on the curve based on curvature value

pts,k_val,ts = cur_k(curve, resolution)

t_s = []
i_s = [0] 
for i,((k1,k2),t) in enumerate(zip(pr(k_val),ts)):
    if k1[2]*k2[2] < 0 and len(ts)-i>5:
        t_s.append(t)
        i_s.append(i)
i_s.append(len(ts)-1)

if len(t_s)>0:
    crvs = list(curve.Split(t_s))
    reparam_crvs = reparam_crvs(crvs)
elif len(t_s) == 0:
    curve.Domain = rg.Interval(0,1)
    reparam_crvs = curve

# index of segmentation points

indices = []
for i,(n,m) in enumerate(pr(i_s)):
    if i == 0:
        indices.append((n,m))
    else:
        indices.append((n+1,m))

# bending direction of curvs

crv_id = [] # 'a' = arch, 'b'= bend, 'f'= flat
k_2 = [k[2] for k in k_val]
b_list =  [k_2[s:e+1] for s,e in indices]
for s_list in b_list:
    l_temp_a = [abs(l) for l in s_list]
    if s_list[1] > 0:
        crv_id.append("b")
    elif s_list[1] < 0:
        crv_id.append("a")
    elif s_list[1] == 0:
        crv_id.append("f")

# getting bend radius of each curve

bend_radis = [0.5,1.8] # the maximum bending radians is 1.8 the minimum is 0.5
# check if the input curve has segments or not
if reparam_crvs is not curve:
    for crv in reparam_crvs:
        radi = bending_radi(crv)
        if radi >= 1.8:
            bend_radis.append(1.85)
        elif radi <= 0.5:
            bend_radis.append(0.52)
        else:
            bend_radis.append(radi)
elif reparam_crvs is curve:
    radi = bending_radi(reparam_crvs)
    if radi >= 1.8:
        bend_radis.append(1.85)
    elif radi <= 0.5:
        bend_radis.append(0.52)
    else:
        bend_radis.append(radi)

# remap the bend radius value to actuator proportion domain

a_p_t =  [round(i,2) for i in math_map_list(bend_radis, toMin=0.07, toMax=0.49)] # a_p means actuator_proportion 
a_p = a_p_t[2:]

print a_p
# ---------- end python_3 ----------

# ---- group: visualize_crvs
cluster_2 = Cluster_3(crv=python_3.reparam_crvs, R=python_3.a_p, id=python_3.crv_id)  # -> G, D, A, B
tag = TextTag(Location=cluster_2.G, Text=cluster_2.D, Colour=ColourSwatch(SwatchColor=RGB(0, 0, 0)))
previewlw_4 = CustomPreviewLineweights(
    Geometry=cluster_2.A,
    Shader=ColourSwatch(SwatchColor=RGB(66, 255, 230)),
    Thickness=Slider(7, range=1..10),
    Absolute=False)
previewlw_5 = CustomPreviewLineweights(
    Geometry=cluster_2.B,
    Shader=ColourSwatch(SwatchColor=RGB(66, 148, 255)),
    Thickness=Slider(7, range=1..10),
    Absolute=False)

# ---- group: adjust location
pre_extrude_pt = Point(<point referenced from the Rhino model>)

# ----
# UR_Script
cluster_3 = Cluster(G=python_2.all_way_pts, pln=pre_extrude_pt, I=pre_extrude_pt, L=python_2.toggle_all, L_2=python_2.velocity_all)  # -> L_3, a, L_4, L_5
tcp_z = Slider(140, range=0..1000)
blend_radius = GhPythonScript(way_points=cluster_3.L_3)  # -> out, blend_radiuses; inputs way_points: list of Point3d
# ---------- blend_radius: Python ----------
import Rhino.Geometry as rg


def calc_blend_radius(way_pts, buffer=0.005):
    blend_radiuses = []
    
    velocities = []
    
    extrusion_toggle = []
    
    for i in range(len (way_pts)-1):
        pt = way_pts[i]
        pt_1 = way_pts[i+1]
        
        dist = pt.DistanceTo(pt_1)
        blend_radius = dist*buffer
        blend_radiuses.append(blend_radius)

    blend_radiuses.append(blend_radiuses[-1])
    
    return blend_radiuses


blend_radiuses = calc_blend_radius(way_points)
# ---------- end blend_radius ----------
fabrication = GhPythonScript(
    points=cluster_3.L_3,
    blend_radiuses=blend_radius.blend_radiuses,
    extruder_toggles=cluster_3.a,
    velosities=cluster_3.L_5,
    myTCP_z=tcp_z,
    send_to_robot=Toggle(False),
    generate_script=Toggle(False))  # -> out, rhino_base_way_planes, robot_planes, script; inputs points: list, blend_radiuses: list, extruder_toggles: list, velosities: list
# ---------- fabrication: Python ----------
from compas_rhino import unload_modules
unload_modules('simple_ur_script')
unload_modules('simple_comm')

import Rhino.Geometry as rg
import simple_comm as c
import simple_ur_script as ur

import math as m


def tcp(script):
    """ This funktion sets tcp 
    """
    script += ur.set_tcp_by_angles(
        float(0.0), float(0.0), float(myTCP_z), m.radians(0.0), m.radians(180.0), m.radians(90))
    return script

def set_robot_base_plane_from_pts():

    pt_0 = rg.Point3d(350, 230, 0)  # base plane origin
    # point on base plane positive x direction
    pt_1 = rg.Point3d(499, 230, 0)
    pt_2 = rg.Point3d(499, 499, 0)  # point on base plane positive xy

    robot_base = rg.Plane(pt_0, pt_1-pt_0, pt_2-pt_0)
    return robot_base

def rhino_to_robot_space(rhino_plane):
    """ this funktion translates planes from the rhino cordinate system to
    the robot cordinate system 
    """
    robot_plane = rhino_plane.Clone()
    _r_matrix = rg.Transform.PlaneToPlane(
        rg.Plane.WorldXY, set_robot_base_plane_from_pts())
    
    robot_plane.Transform(_r_matrix)
    return robot_plane
    

def point_to_rhino_plane(point):
    rhino_plane = rg.Plane(point, rg.Vector3d.XAxis, rg.Vector3d.YAxis)
    return rhino_plane

def extrude(plane, vel, blend_radi, extr, send_io_command, script): 
    newval = 0
    vel = vel/1000
    blend_radi = blend_radi/1000
    script += ur.move_l_blend(plane, vel, blend_radi)
    
    if extr ==1:
        extr = False
        newval = True
    else:
        extr = True
        newval = False
    
    if send_io_command:                         # only if the extruder needs to change state (from on to off or from off to on) the line is added to the script
        script += ur.set_digital_out(5, extr)
        #script += ur.set_digital_out(6,newval)
        script += ur.set_digital_out(7,newval)
    
    
    return script 


def move_to_safe_plane(plane,script):
    script += ur.set_digital_out(5, True)
    plane.Translate(rg.Vector3d(0, 0, 50))
    script += ur.move_l(plane,0.3, velocity)

    return script 


""" Robotic fabrication procedure
"""
script = ""

script = tcp(script)


"""Create rhino planes
"""

rhino_base_way_planes = []
for point in points:
    rhino_base_way_planes.append(point_to_rhino_plane(point))

"""Translate rhino planes to robot_plabe 
"""

robot_planes = []

for rhino_plane in (rhino_base_way_planes):
    robot_planes.append(rhino_to_robot_space(rhino_plane))
#    print rhino_plane.Origin
    
"""Create comands
"""

cnt = 0
previous_value = 0
for plane, velocity, blend_radi, extruder_toggle in zip(robot_planes, velosities,blend_radiuses, extruder_toggles):
    cnt += 1
    #i = 1600
    i = len(points)-1
    if cnt < i:
        if previous_value == extruder_toggle:           # checks if extruder is changing or the same as the privious
            send_io_command = False
        else:
            send_io_command = True 
        
        script = extrude(plane, velocity, blend_radi, extruder_toggle, send_io_command, script) # added a send_io_command bool to the funktion
        previous_value = extruder_toggle
    elif cnt == i:
        script = move_to_safe_plane(robot_planes[i],script)



if send_to_robot:
    script = c.concatenate_script(script)
    #print script
    c.send_script(script, "192.168.10.10")

if generate_script:
    script = c.concatenate_script(script)
    #print script
# ---------- end fabrication ----------
write_to_file = GhPythonScript(script=fabrication.script)  # -> out
# ---------- write_to_file: Python ----------
f = open("D:/URP/20210722_strip_test_4.txt", "w")   # 'r' for reading and 'w' for writing
f.write(script)  
f.close()                                # Close file 

f = open("D:/URP/20210722_strip_test_4.txt", "r")   # 'r' for reading and 'w' for writing
print f.read()                           # Write inside file 
f.close()                                # Close file
# ---------- end write_to_file ----------
geometry = Geometry(fabrication.robot_planes)

# ---- group: visualize
gradient = Gradient(
    LowerLimit="0",
    UpperLimit="1",
    Parameter=cluster_3.L_4,
    stops=[0: RGB(0, 128, 0), 0.5: RGB(255, 255, 0), 1: RGB(255, 0, 0)])
gradient_2 = Gradient(
    LowerLimit="40",
    UpperLimit="65",
    Parameter=python_2.velocity_all,
    stops=[0: RGB(234, 38, 0), 0.25: RGB(234, 126, 0), 0.5: RGB(254, 244, 84), 0.75: RGB(173, 203, 249), 1: RGB(75, 107, 169)])
dots = DotDisplay(Point=cluster_3.L_3, Colour=gradient, Size=Slider(0.5, range=0..1))
dots_2 = DotDisplay(Point=python_2.all_way_pts, Colour=gradient_2, Size=Slider(0.5, range=0..1))

# ----
# G_code
panel_2 = Panel("0")
blocktocode = PythonScript(FRAdjust=0.95, machine=panel_2, block=python_2.block)  # -> blockToCode, flatten(code); inputs block: list
# ---------- blocktocode: Python ----------
import math
import rhinoscriptsyntax as rs
import scriptcontext as sc

def blockToCode(block, nozzleDia, fillamentDia, layerHeight, defaultSpeed = 5000):
    result = []
    for i in range(len(block)):
        curve = block[i]
        if(isinstance(defaultSpeed, list)): speed = defaultSpeed[i]
        else: speed = defaultSpeed
        pt = rs.CurveStartPoint(curve)
        if(machine == 1):
            # makerbot
            result += ["G1 E-1.000 F1200\n"]
            result += ["G1 X%.3f Y%.3f F9000\n" % (pt[0], pt[1])]
            result += ["G1 E1.000 F1200\n"]
        else:
            # large printer
            result += ["G92 E0\n"]
            result += ["G1 E-1.000 F1200\n"]
            result += ["G1 X%.3f Y%.3f F9000\n" % (pt[0], pt[1])]
            result += ["G1 E0.000 F1200\n"]
        # extrude along curve
        i = 0
        segments, extSum = rs.ExplodeCurves(curve), 0.
        if(len(segments) == 0):
            segments = [curve]
        for segment in segments:
            volume = nozzleDia * rs.CurveLength(segment) * layerHeight
            extrusion = (volume / (((fillamentDia / 2) ** 2) * math.pi)) * FRAdjust
            extSum += extrusion
            if(machine == 1):
                # makerbot
                E = extrusion
            else:
                # large printer
                E = extSum
            pt = rs.CurveEndPoint(segment)
            if(i == 0):
                string = "G1 X%.3f Y%.3f E%.3f F%d\n" % (pt[0], pt[1], E, int(speed))
            else:
                string = "G1 X%.3f Y%.3f E%.3f\n" % (pt[0], pt[1], E)
            i += 1
            result += [string]
    return "".join(result)
    
layerHeight = sc.sticky["layer_height"]
nozzleDia = sc.sticky["nozzle"]
fillamentDia = 2.85 
print 
if(len(block) > 0):
    code = blockToCode(block, nozzleDia, fillamentDia, layerHeight, 5000)
# ---------- end blocktocode ----------

# ==== cluster Cluster
pln = ClusterInput()
G = ClusterInput()
I = ClusterInput()
L = ClusterInput()
L_2 = ClusterInput()
pln_2 = Plane(pln)
pln_3 = Plane(PlaneXY(9.083634441, -103.5459009, 0))
rotate = Rotate(Geometry=pln_2, Angle=1.570796327, Plane=pln_2)  # -> Geometry, Transform
orient = Orient(Geometry=G, Source=pln_3, Target=rotate.Geometry)  # -> Geometry, Transform
ins = InsertItems(List=orient.Geometry, Item=I, Indices=0, Wrap=True)
L_3 = ClusterOutput(ins)
ins_2 = InsertItems(List=L_2, Item="25", Indices=0, Wrap=True)
ins_3 = InsertItems(List=L, Item="1", Indices=1, Wrap=True)
L_4 = ClusterOutput(ins_3)
replace = ReplaceItems(List=ins_2, Item="25", Indices=1, Wrap=False)
L_5 = ClusterOutput(replace)
python = GhPythonScript(x=ins_3)  # -> a; inputs x: list
# ---------- python: Python ----------
import Rhino.Geometry as rg

a = [int(i) for i in x]
# ---------- end python ----------
a = ClusterOutput(python)

# ==== cluster Cluster_2
C = ClusterInput()
C_2 = ClusterInput()
eval = EvaluateCurve(Curve=C_2, Parameter=1)  # -> Point, Tangent, Angle
eval_2 = EvaluateCurve(Curve=C, Parameter=0)  # -> Point, Tangent, Angle
rev = Reverse(Vector=eval.Tangent)
number_slider = Slider(96, range=0..130)
yz = YZPlane(Origin=Point(0, 0, 0))
angle = Angle(VectorA=eval_2.Tangent, VectorB=eval.Tangent, Plane=yz)  # -> Angle, Reflex
deg = Degrees(Radians=angle.Angle)
line = LineSDL(Start=eval_2.Point, Direction=eval_2.Tangent, Length=number_slider)
L = ClusterOutput(line)
line_2 = LineSDL(Start=eval.Point, Direction=rev, Length=number_slider)
L_2 = ClusterOutput(line_2)
panel = Panel(deg)

# ==== cluster Cluster_3
crv = ClusterInput()
id = ClusterInput()
R = ClusterInput()
crv_2 = Curve(crv)
deg = Degrees(Radians=R)
D = ClusterOutput(deg)
python = GhPythonScript(id=id)  # -> out, bool; inputs id: list
# ---------- python: Python ----------
import Rhino.Geometry as rg

bool = []
for i in id:
    if i == 'a':
        bool.append(True)
    else :
        bool.append(False)
# ---------- end python ----------
midpt = CurveMiddle(Curve=crv_2)
dispatch = Dispatch(List=crv_2, DispatchPattern=python.bool)  # -> ListA, ListB
A = ClusterOutput(dispatch.ListA)
B = ClusterOutput(dispatch.ListB)
Z = UnitZ(Factor=Slider(11, range=0..100))
move = Move(Geometry=midpt, Motion=Z)  # -> Geometry, Transform
G = ClusterOutput(move.Geometry)
