# Grasshopper definition 072521_flatten_a_curve.gh (Grasshopper 1.0.7)

passive_components_density = Slider(0.6, range=0..1)
actuator_proportion = Slider(0.5, range=0..1)

# ---- group: square
number_slider = Slider(10, range=0..10)  # disabled
number_slider_2 = Slider(4, range=0..10)  # disabled
number_slider_3 = Slider(200, range=0..1000)  # disabled
panel = Panel("0,0,0")  # disabled
pt = Point(panel)  # disabled
python = GhPythonScript(origin=pt, r_x=number_slider_3, r_y=number_slider_3, element_width=number_slider, element_height=number_slider_2)  # -> out, rect, joint_cects, cents, c_pts, curves, Breps_m, srf; inputs origin: Point3d; disabled
# ---------- python: Python ----------
import Rhino.Geometry as rg
import ghpythonlib.components as gh




o_plane = rg.Plane(origin,rg.Vector3d.ZAxis)
rect = rg.Rectangle3d(o_plane,origin,rg.Point3d(r_x,r_y,0))
corners = [rect.Corner(i) for i in range(4)]
c_planes = [rg.Plane(pt,rg.Vector3d.ZAxis) for pt in corners]

domain = gh.ConstructDomain(-element_width/2,element_width/2)
joint_cects = [gh.Rectangle(plns,domain,domain,0)[0] for plns in c_planes]

curves = gh.TrimwithRegions(rect,joint_cects)[1]
off_1 = [gh.OffsetCurve(crv,element_width/2,o_plane,0) for crv in curves]
off_2 = [gh.OffsetCurve(crv,-element_width/2,o_plane,0) for crv in curves]

Breps_m = [gh.EdgeSurface(c1,c2) for c1,c2 in zip(off_1,off_2)]
B_srfs = [Breps_m[1].Faces[0] for i in range(len(Breps_m))]
srfs = [s.ToNurbsSurface(0.001) for s in B_srfs]
domain = rg.Interval(0.00,1.00)


#rg.Extrusion.CreateExtrusion(
# ---------- end python ----------
crv = Curve(python.curves)  # disabled

# ----
number_slider_4 = Slider(30, range=0..100)
crv_2 = Curve(reparameterize(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))
modulus_number = Slider(2, range=1..5)
crv_3 = Curve(reparameterize(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))
print_bed_ur5 = Geometry(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)
list = ValueList({"modulus": 0, "split": 1}, selected="modulus")
python_2 = GhPythonScript(curve=crv_2, resolution=Slider(30, range=0..100))  # -> out, k_val, pts, crvs; inputs curve: Curve, resolution: Int32
# ---------- python_2: Python ----------
import Rhino.Geometry as rg
import ghpythonlib.components as gh
from compas.utilities import pairwise as pr
import itertools
import scriptcontext as sc

#crv.Domain = rg.Interval(0,1)

def cur_k(curve, resolution):
    ts = list(curve.DivideByCount(resolution,True))
    pts,k_val,_ = gh.Curvature(curve,ts)
    return pts,k_val,ts
    
def fla_n_seg(curve,res,vec):
    vec.Unitize()
    pts,k_val = cur_k(curve, res)
    len  = curve.GetLength()
    line_crv = gh.LineSDL(pts[0],vec,len)
    
        


pts,k_val,ts = cur_k(curve, resolution)
t_s = [] 
for (k1,k2),t in zip(pr(k_val),ts):
    if k1[2]*k2[2] < 0:
        t_s.append(t)
crvs = list(curve.Split(t_s))
# ---------- end python_2 ----------
crv_4 = Curve(reparameterize(<curve referenced from the Rhino model>))
pt_2 = Point("0,0,0")
divide = DivideCurve(Curve=crv_3, Count=number_slider_4, Kinks=False)  # -> Points, Tangents, Parameters
crv_5 = Curve(python_2.crvs)
python_3 = GhPythonScript(
    origin=pt_2,
    nozzle="2",
    crv=crv_4,
    W=Slider(10, range=0..20),
    L=Slider(500, range=300..500),
    H=Slider(5, range=4..10),
    layer_height=".25",
    segment=Slider(3, range=2..10),
    number=modulus_number,
    dens=passive_components_density,
    proportion=actuator_proportion,
    style=list)  # -> out, all_way_pts, toggle_all, velocity_all, simplify(block), layer_heights; inputs origin: Point3d, crv: Curve
# ---------- python_3: Python ----------
import Rhino.Geometry as rg
import ghpythonlib.components as gh
from compas.utilities import pairwise as pr
import itertools
import scriptcontext as sc


sc.sticky["nozzle"] = nozzle
sc.sticky["layer_height"] = layer_height

def list_to_tree(input, none_and_holes=True, source=[0]):
    """Transforms nestings of lists or tuples to a Grasshopper DataTree"""
    from Grasshopper import DataTree as Tree
    from Grasshopper.Kernel.Data import GH_Path as Path
    from System import Array
    def proc(input,tree,track):
        path = Path(Array[int](track))
        if len(input) == 0 and none_and_holes: tree.EnsurePath(path); return
        for i,item in enumerate(input):
            if hasattr(item, '__iter__'): #if list or tuple
                track.append(i); proc(item,tree,track); track.pop()
            else:
                if none_and_holes: tree.Insert(item,path,i)
                elif item is not None: tree.Add(item,path)
    if input is not None: t=Tree[object]();proc(input,t,source[:]);return t

class component():
    def __init__(self,c1,c2,nozzle,dir):
        self.c1 = c1
        self.c2 = c2
        self.dir = dir
        self.nozzle = nozzle

    def crv_s_e(self,crv):
        crv.Domain = rg.Interval(0,1)
        s_pt = crv.PointAt(0)
        e_pt = crv.PointAt(1)
        return s_pt,e_pt
    
     # c1:curve1 c2:curve2 n:number of tweencurve s_p:starting point(0,1,2,3) 
    def back_n_forth(self,c1,c2,s_p,nozzle,dir):
        #toggle = []
        p_a,p_a_1 = self.crv_s_e(self.c1)
        p_b,p_b_1 = self.crv_s_e(self.c2)
        dist = p_a.DistanceTo(p_b)
        if dir == 0:
            n = int(dist/nozzle)-1
        else:
            n = int(dist/nozzle*dens)-1
        crvs= rg.Curve.CreateTweenCurves(self.c1,self.c2,n,0.01)
        p_a,p_a_1 = self.crv_s_e(self.c1)
        p_b,p_b_1 = self.crv_s_e(self.c2)
        out_pts = [p_a,p_a_1,p_b_1,p_b,p_a]
        #tg = [1 for _ in out_pts ]
        #toggle.extend(tg)
        way_pts = []
        start = [[1,1],[0,1],[1,0],[0,0]]
        s_key = start[s_p]
        for i,c in enumerate(crvs):
            if i % 2 == s_key[0]:
                c.Reverse()
                c.Domain = rg.Interval(0,1)
                l = c.GetLength(rg.Interval(0,1))
                param = nozzle/l*0.8
                p_s = c.PointAt(param)
                way_pts.append(p_s)
                #toggle.append(1)
                p_s = c.PointAt(1-param)
                way_pts.append(p_s)
                #if dir == 0:
                    #toggle.append(0)
                #else:
                    #toggle.append(1)
            else:
                c.Domain = rg.Interval(0,1)
                l = c.GetLength(rg.Interval(0,1))
                param = nozzle/l*0.8
                p_s = c.PointAt(param)
                way_pts.append(p_s)
                #toggle.append(1)
                p_s = c.PointAt(1-param)
                way_pts.append(p_s)
                #if dir == 0:
                    #toggle.append(0)
                #else:
                    #toggle.append(0)
        toggle_v = s_key[1]
        if toggle_v == 0:
            way_pts.reverse()
        elif toggle_v == 1:
            pass 
        path_all = []
        way_pts_all = []
        toggle = []
        path = rg.NurbsCurve.Create(False,1,way_pts)
        outline = rg.NurbsCurve.Create(False,1,out_pts)
        path_all.append(outline)
        path_all.append(path)
        way_pts_all.extend(out_pts)
        for p in out_pts:
            toggle.append(1)
        toggle[-1] = 0
        way_pts_all.extend(way_pts)
        for t in range(len(way_pts)):
            toggle.append(1)
        toggle[-1] = 0
        return path_all,way_pts_all,toggle
    
    def optimized_path(self):
        p_a,_ = self.crv_s_e(self.c1)
        p_b,_ = self.crv_s_e(self.c2)
        dis = p_a.DistanceTo(p_b)
        i = 0 
        while i < 4:
            path,w_pts,toggle = self.back_n_forth(self.c1,self.c2,i,nozzle,dir)
            pt_1,_ = self.crv_s_e(path[1])
            pt_2 = w_pts[0]
            dis_2_pts = pt_1.DistanceTo(pt_2)
            if dis_2_pts < dis/2:
                break 
            i += 1 
        return path,w_pts,toggle

def crv_s_e(crv):
    crv.Domain = rg.Interval(0,1)
    s_pt = crv.PointAt(0)
    e_pt = crv.PointAt(1)
    return s_pt,e_pt

def reparam_crvs(crvs):
    new_crvs = []
    for crv in crvs:
        crv.Domain = rg.Interval(0,1)
        new_crvs.append(crv)
    return new_crvs

def dash_axis(crv,segment,nozzle):
    params = crv.DivideByCount(segment,False)
    crvs = list(crv.Split(params))
    curves = reparam_crvs(crvs)
    l = curves[0].GetLength(rg.Interval(0,1))
    pr = nozzle*0.5/l
    pts = []
    new_crvs = []
    for crv in curves:
        pt_1 = crv.PointAt(pr)
        pts.append(pt_1)
        pt_2 = crv.PointAt(1-pr)
        pts.append(pt_2)
        c1 = crv.Split(pr)[1]
        t_crv = c1.Split(1-pr)[0]
        new_crvs.append(t_crv)
    return pts,new_crvs

def guide_curves(crv,width,dir):
    o_plane = rg.Plane(origin,rg.Vector3d.ZAxis)
    crv_1 = gh.OffsetCurve(crv,width/2,o_plane,0)
    crv_2 = gh.OffsetCurve(crv,-width/2,o_plane,0)
    c1_pt_s,c1_pt_e = crv_s_e(crv_1)
    c2_pt_s,c2_pt_e = crv_s_e(crv_2)
    crv_3 = rg.LineCurve(c1_pt_s,c2_pt_s)
    crv_4 = rg.LineCurve(c1_pt_e,c2_pt_e)
    if dir == 0:
        return crv_1,crv_2
    if dir == 1:
        return crv_3,crv_4

def tween_cnt(c1,c2,nozzle):
    pt_1,_ = crv_s_e(c1)
    pt_2,_ = crv_s_e(c2)
    dist = pt_1.DistanceTo(pt_2)
    n = int(dist/nozzle)

def add_way_pt(pts_list,height):
    pt_s = pts_list[0].Clone()
    pt_e = pts_list[-1].Clone()
    t_1 = rg.Transform.Translation(0,0,height*2)
    t_2 = rg.Transform.Translation(0,0,height)
    pt_s.Transform(t_1)
    pt_e.Transform(t_2)
    pts_list.insert(0,pt_s)
    pts_list.append(pt_e)
    return pts_list

def add_vel(vel_list,s,e):
    vel_list.insert(0,s)
    vel_list.append(e)
    return vel_list

def add_toggle(toggle_list):
    toggle_list.insert(0,1)
    toggle_list.append(0)
    return toggle_list

all_paths = []
all_way_pts = []
toggle_all = []
velocity_all = []

temp = []
lift_height = 5
passive_1 = 45
passive = 45
active_1 = 45
active = 60


test_pts,curves = dash_axis(crv,segment,nozzle)
move_z = int(H/layer_height)
switch = int(move_z*proportion)
for j in range(move_z):
    layer_paths = []
    layer_way_pts = []
    layer_toggle = []
    layer_velocity = []
    t = rg.Transform.Translation(0,0,layer_height*j)
    for i,c in enumerate(curves):
        if i % number == 0:
            if 0<= j <= switch: 
                dir = 0 
                c1 = c.Duplicate()
                c1.Transform(t)
                c_1,c_2 = guide_curves(c1,W,dir)
                C1 = component(c_1,c_2,nozzle,dir)
                path,way_pts,toggle = C1.optimized_path()
                if j == 0 :
                    vel_1 = [active_1 for _ in way_pts]
                    vel_1_1 = add_vel(vel_1,60,15)
                    layer_velocity.append(vel_1_1)
                else :
                    vel_2 = [active for _ in way_pts]
                    vel_2_1 = add_vel(vel_2,60,15)
                    layer_velocity.append(vel_2_1)
                toggle_1 = add_toggle(toggle)
                layer_toggle.append(toggle_1)
                #layer_paths.append(path)
                way_pts_1 = add_way_pt(way_pts,lift_height)
                layer_way_pts.append(way_pts_1)
            elif switch< j < move_z and j%3 == 0:
                dir = 1
                c1 = c.Duplicate()
                c1.Transform(t)
                c_1,c_2 = guide_curves(c1,W,dir)
                C1 = component(c_1,c_2,nozzle,dir)
                path,way_pts,toggle = C1.optimized_path()
                vel_3 = [passive for _ in way_pts]
                vel_3_1 = add_vel(vel_3,40,15)
                layer_velocity.append(vel_3_1)
                toggle_2 = add_toggle(toggle)
                layer_toggle.append(toggle_2)
                #layer_paths.append(path)
                way_pts_2 = add_way_pt(way_pts,lift_height)
                layer_way_pts.append(way_pts_2)
            elif j == move_z-1:
                dir = 1
                c1 = c.Duplicate()
                c1.Transform(t)
                c_1,c_2 = guide_curves(c1,W,dir)
                C1 = component(c_1,c_2,nozzle,dir)
                path,way_pts,toggle = C1.optimized_path()
                vel_4 = [passive for _ in way_pts]
                vel_4_1 = add_vel(vel_4,60,15)
                layer_velocity.append(vel_4_1)
                toggle_3 = add_toggle(toggle)
                layer_toggle.append(toggle_3)
                layer_paths.append(path)
                way_pts_3 = add_way_pt(way_pts,lift_height)
                layer_way_pts.append(way_pts_3)
        else:
            if j == 0:
                dir = 1
                c2 = c.Duplicate()
                c2.Transform(t)
                c_3,c_4 = guide_curves(c2,W,dir)
                C2 = component(c_3,c_4,nozzle,dir)
                path,way_pts,toggle = C2.optimized_path()
                vel_5 = [passive_1 for _ in way_pts]
                vel_5_1 = add_vel(vel_5,60,15)
                layer_velocity.append(vel_5_1)
                toggle_4 = add_toggle(toggle)
                layer_toggle.append(toggle_4)
                #layer_paths.append(path)
                way_pts_4 = add_way_pt(way_pts,lift_height)
                layer_way_pts.append(way_pts_4)
            elif 0< j < move_z -switch and j%3 == 0 : 
                dir = 1
                c2 = c.Duplicate()
                c2.Transform(t)
                c_3,c_4 = guide_curves(c2,W,dir)
                C2 = component(c_3,c_4,nozzle,dir)
                path,way_pts,toggle = C2.optimized_path()
                vel_6 = [passive for _ in way_pts]
                vel_6_1 = add_vel(vel_6,60,15)
                layer_velocity.append(vel_6_1)
                toggle_5 = add_toggle(toggle)
                layer_toggle.append(toggle_5)
                #layer_paths.append(path)
                way_pts_5 = add_way_pt(way_pts,lift_height)
                layer_way_pts.append(way_pts_5)
            elif move_z -switch<= j <= move_z:
                dir = 0
                c2 = c.Duplicate()
                c2.Transform(t)
                c_3,c_4 = guide_curves(c2,W,dir)
                C2 = component(c_3,c_4,nozzle,dir)
                path,way_pts,toggle = C2.optimized_path()
                if j == move_z -switch :
                    vel_7 = [active_1 for _ in way_pts]
                    vel_7_1 = add_vel(vel_7,60,15)
                    layer_velocity.append(vel_7_1)
                else :
                    vel_8 = [active for _ in way_pts]
                    vel_8_1 = add_vel(vel_8,60,15)
                    layer_velocity.append(vel_8_1)
                toggle_6 = add_toggle(toggle)
                layer_toggle.append(toggle_6)
                #layer_paths.append(path)
                way_pts_6 = add_way_pt(way_pts,lift_height)
                layer_way_pts.append(way_pts_6)
    if j % 2 != 0:
        layer_paths.reverse()
        layer_way_pts.reverse()
        layer_toggle.reverse()
        layer_velocity.reverse()
        merged_layer_paths = list(itertools.chain.from_iterable(layer_paths))
        merged_way_pts = list(itertools.chain.from_iterable(layer_way_pts))
        #pt_add,tog,vel = add_way_pt(merged_way_pts[-1],5,0,15)
        merged_toggle = list(itertools.chain.from_iterable(layer_toggle))
        merged_velocity = list(itertools.chain.from_iterable(layer_velocity))
        #merged_way_pts.append(pt_add)
        #merged_toggle.append(tog)
        #merged_velocity.append(vel)
        temp.extend(layer_paths)
        all_paths.extend(merged_layer_paths)
        all_way_pts.extend(merged_way_pts)
        toggle_all.extend(merged_toggle)
        velocity_all.extend(merged_velocity)
        
    else:
        merged_layer_paths = list(itertools.chain.from_iterable(layer_paths))
        merged_way_pts = list(itertools.chain.from_iterable(layer_way_pts))
        #pt_add,tog,vel = add_way_pt(merged_way_pts[-1],5,0,15)
        merged_toggle = list(itertools.chain.from_iterable(layer_toggle))
        merged_velocity = list(itertools.chain.from_iterable(layer_velocity))
        #merged_way_pts.append(pt_add)
        #merged_toggle.append(tog)
        #merged_velocity.append(vel)
        temp.extend(layer_paths)
        all_paths.extend(merged_layer_paths)
        all_way_pts.extend(merged_way_pts)
        toggle_all.extend(merged_toggle)
        velocity_all.extend(merged_velocity)

block = list_to_tree(temp, none_and_holes=True, source=[0])

"""

if style == 1 :
    if number <= segment:
        for i,crv in enumerate(crvs):
            if 0<= i < number:
                pass
            else :
                pass

"""
# ---------- end python_3 ----------
item = ListItem(List=divide.Points, Index=0, Wrap=True)
len = Length(Curve=crv_3)
curvature = Curvature(Curve=crv_3, Parameter=divide.Parameters)  # -> P, K, C
number_slider_5 = Slider(24, range=0..30)
item_2 = ListItem(List=python_2.crvs, Index=Slider(2, range=0..3), Wrap=True)
line = LineSDL(Start=item, Direction=Vector(0, 1, 0), Length=len)
pre_extrude_pt = Point(<point referenced from the Rhino model>)
divide_2 = DivideCurve(Curve=line, Count=number_slider_4, Kinks=False)  # -> Points, Tangents, Parameters
panel_2 = Panel(curvature.K)
item_3 = ListItem(List=curvature.P, Index=number_slider_5, Wrap=True)
pln = Plane(pre_extrude_pt)
item_4 = ListItem(List=curvature.C, Index=number_slider_5, Wrap=True)
pln_2 = Plane(PlaneXY(9.083634441, -103.5459009, 0))
item_5 = ListItem(List=curvature.K, Index=number_slider_5, Wrap=True)
pline = PolyLine(Vertices=python_3.all_way_pts, Closed=False)
rotate = Rotate(Geometry=pln, Angle=1.570796327, Plane=pln)  # -> Geometry, Transform
panel_3 = Panel(item_5)
gradient = Gradient(
    LowerLimit="40",
    UpperLimit="65",
    Parameter=python_3.velocity_all,
    stops=[0: RGB(234, 38, 0), 0.25: RGB(234, 126, 0), 0.5: RGB(254, 244, 84), 0.75: RGB(173, 203, 249), 1: RGB(75, 107, 169)])
orient = Orient(Geometry=python_3.all_way_pts, Source=pln_2, Target=rotate.Geometry)  # -> Geometry, Transform
shatter = Shatter()
blocktocode = PythonScript(FRAdjust=0.95, machine="0", block=python_3.block)  # -> blockToCode, flatten(code); inputs block: list
# ---------- blocktocode: Python ----------
import math
import rhinoscriptsyntax as rs
import scriptcontext as sc

def blockToCode(block, nozzleDia, fillamentDia, layerHeight, defaultSpeed = 5000):
    result = []
    for i in range(len(block)):
        curve = block[i]
        if(isinstance(defaultSpeed, list)): speed = defaultSpeed[i]
        else: speed = defaultSpeed
        pt = rs.CurveStartPoint(curve)
        if(machine == 1):
            # makerbot
            result += ["G1 E-1.000 F1200\n"]
            result += ["G1 X%.3f Y%.3f F9000\n" % (pt[0], pt[1])]
            result += ["G1 E1.000 F1200\n"]
        else:
            # large printer
            result += ["G92 E0\n"]
            result += ["G1 E-1.000 F1200\n"]
            result += ["G1 X%.3f Y%.3f F9000\n" % (pt[0], pt[1])]
            result += ["G1 E0.000 F1200\n"]
        # extrude along curve
        i = 0
        segments, extSum = rs.ExplodeCurves(curve), 0.
        if(len(segments) == 0):
            segments = [curve]
        for segment in segments:
            volume = nozzleDia * rs.CurveLength(segment) * layerHeight
            extrusion = (volume / (((fillamentDia / 2) ** 2) * math.pi)) * FRAdjust
            extSum += extrusion
            if(machine == 1):
                # makerbot
                E = extrusion
            else:
                # large printer
                E = extSum
            pt = rs.CurveEndPoint(segment)
            if(i == 0):
                string = "G1 X%.3f Y%.3f E%.3f F%d\n" % (pt[0], pt[1], E, int(speed))
            else:
                string = "G1 X%.3f Y%.3f E%.3f\n" % (pt[0], pt[1], E)
            i += 1
            result += [string]
    return "".join(result)
    
layerHeight = sc.sticky["layer_height"]
nozzleDia = sc.sticky["nozzle"]
fillamentDia = 2.85 
print 
if(len(block) > 0):
    code = blockToCode(block, nozzleDia, fillamentDia, layerHeight, 5000)
# ---------- end blocktocode ----------
ins = InsertItems(List=python_3.toggle_all, Item="1", Indices=1, Wrap=True)
ins_2 = InsertItems(List=orient.Geometry, Item=pre_extrude_pt, Indices=0, Wrap=True)
ins_3 = InsertItems(List=python_3.velocity_all, Item="15", Indices=0, Wrap=True)
dots = DotDisplay(Point=python_3.all_way_pts, Colour=gradient, Size=1)
replace = ReplaceItems(List=ins_3, Item="15", Indices=1, Wrap=False)
tcp_z = Slider(140, range=0..1000)
gradient_2 = Gradient(
    LowerLimit="0",
    UpperLimit="1",
    Parameter=ins,
    stops=[0: RGB(234, 38, 0), 0.25: RGB(234, 126, 0), 0.5: RGB(254, 244, 84), 0.75: RGB(173, 203, 249), 1: RGB(75, 107, 169)])
python_4 = GhPythonScript(x=ins)  # -> a; inputs x: list
# ---------- python_4: Python ----------
import Rhino.Geometry as rg

a = [int(i) for i in x]
# ---------- end python_4 ----------
blend_radius = GhPythonScript(way_points=ins_2)  # -> out, blend_radiuses; inputs way_points: list of Point3d
# ---------- blend_radius: Python ----------
import Rhino.Geometry as rg


def calc_blend_radius(way_pts, buffer=0.005):
    blend_radiuses = []
    
    velocities = []
    
    extrusion_toggle = []
    
    for i in range(len (way_pts)-1):
        pt = way_pts[i]
        pt_1 = way_pts[i+1]
        
        dist = pt.DistanceTo(pt_1)
        blend_radius = dist*buffer
        blend_radiuses.append(blend_radius)

    blend_radiuses.append(blend_radiuses[-1])
    
    return blend_radiuses


blend_radiuses = calc_blend_radius(way_points)
# ---------- end blend_radius ----------
dots_2 = DotDisplay(Point=ins_2, Colour=gradient_2, Size=Slider(0.5, range=0..1))
fabrication = GhPythonScript(
    points=ins_2,
    blend_radiuses=blend_radius.blend_radiuses,
    extruder_toggles=python_4,
    velosities=replace,
    myTCP_z=tcp_z,
    send_to_robot=Toggle(False),
    generate_script=Toggle(False))  # -> out, rhino_base_way_planes, robot_planes, script; inputs points: list, blend_radiuses: list, extruder_toggles: list, velosities: list
# ---------- fabrication: Python ----------
from compas_rhino import unload_modules
unload_modules('simple_ur_script')
unload_modules('simple_comm')

import Rhino.Geometry as rg
import simple_comm as c
import simple_ur_script as ur

import math as m


def tcp(script):
    """ This funktion sets tcp 
    """
    script += ur.set_tcp_by_angles(
        float(0.0), float(0.0), float(myTCP_z), m.radians(0.0), m.radians(180.0), m.radians(90))
    return script

def set_robot_base_plane_from_pts():

    pt_0 = rg.Point3d(350, 230, 0)  # base plane origin
    # point on base plane positive x direction
    pt_1 = rg.Point3d(499, 230, 0)
    pt_2 = rg.Point3d(499, 499, 0)  # point on base plane positive xy

    robot_base = rg.Plane(pt_0, pt_1-pt_0, pt_2-pt_0)
    return robot_base

def rhino_to_robot_space(rhino_plane):
    """ this funktion translates planes from the rhino cordinate system to
    the robot cordinate system 
    """
    robot_plane = rhino_plane.Clone()
    _r_matrix = rg.Transform.PlaneToPlane(
        rg.Plane.WorldXY, set_robot_base_plane_from_pts())
    
    robot_plane.Transform(_r_matrix)
    return robot_plane
    

def point_to_rhino_plane(point):
    rhino_plane = rg.Plane(point, rg.Vector3d.XAxis, rg.Vector3d.YAxis)
    return rhino_plane

def extrude(plane, vel, blend_radi, extr, send_io_command, script): 
    newval = 0
    vel = vel/1000
    blend_radi = blend_radi/1000
    script += ur.move_l_blend(plane, vel, blend_radi)
    
    if extr ==1:
        extr = False
        newval = True
    else:
        extr = True
        newval = False
    
    if send_io_command:                         # only if the extruder needs to change state (from on to off or from off to on) the line is added to the script
        script += ur.set_digital_out(5, extr)
        #script += ur.set_digital_out(6,newval)
        script += ur.set_digital_out(7,newval)
    
    
    return script 


def move_to_safe_plane(plane,script):
    script += ur.set_digital_out(5, True)
    plane.Translate(rg.Vector3d(0, 0, 50))
    script += ur.move_l(plane,0.3, velocity)

    return script 


""" Robotic fabrication procedure
"""
script = ""

script = tcp(script)


"""Create rhino planes
"""

rhino_base_way_planes = []
for point in points:
    rhino_base_way_planes.append(point_to_rhino_plane(point))

"""Translate rhino planes to robot_plabe 
"""

robot_planes = []

for rhino_plane in (rhino_base_way_planes):
    robot_planes.append(rhino_to_robot_space(rhino_plane))
#    print rhino_plane.Origin
    
"""Create comands
"""

cnt = 0
previous_value = 0
for plane, velocity, blend_radi, extruder_toggle in zip(robot_planes, velosities,blend_radiuses, extruder_toggles):
    cnt += 1
    #i = 1600
    i = len(points)-1
    if cnt < i:
        if previous_value == extruder_toggle:           # checks if extruder is changing or the same as the privious
            send_io_command = False
        else:
            send_io_command = True 
        
        script = extrude(plane, velocity, blend_radi, extruder_toggle, send_io_command, script) # added a send_io_command bool to the funktion
        previous_value = extruder_toggle
    elif cnt == i:
        script = move_to_safe_plane(robot_planes[i],script)



if send_to_robot:
    script = c.concatenate_script(script)
    #print script
    c.send_script(script, "192.168.10.10")

if generate_script:
    script = c.concatenate_script(script)
    #print script
# ---------- end fabrication ----------
write_to_file = GhPythonScript(script=fabrication.script)  # -> out
# ---------- write_to_file: Python ----------
f = open("D:/URP/20210722_strip_test_4.txt", "w")   # 'r' for reading and 'w' for writing
f.write(script)  
f.close()                                # Close file 

f = open("D:/URP/20210722_strip_test_4.txt", "r")   # 'r' for reading and 'w' for writing
print f.read()                           # Write inside file 
f.close()                                # Close file
# ---------- end write_to_file ----------
geometry = Geometry(fabrication.robot_planes)
