# Grasshopper definition 080321_surface_subd_test.gh (Grasshopper 1.0.7)
# plug-ins: Human, Sasquatch

srf = Surface()

# ----
# Test curvs
crv_test_2 = Curve(reparameterize(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))
crv_test_0 = Curve(reparameterize(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))
crv_test_1 = Curve(reparameterize(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))
crv_test_3 = Curve(reparameterize(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))
crv_test_4 = Curve(reparameterize(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))
crv_max = Curve(reparameterize(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))
crv_min = Curve(reparameterize(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))

crv = Curve(reparameterize(<curve referenced from the Rhino model>))

# ----
# Analysis input curve
functions = GhPythonScript()  # -> list_to_tree, block_dict, frame_dict, crv_segment_n_analysis, flatten_segmented_crvs
# ---------- functions: Python ----------
import Rhino.Geometry as rg
import ghpythonlib.components as gh
from compas.utilities import pairwise as pr
import itertools
import scriptcontext as sc
import math

def bending_radi(crv):
    crv.Domain = rg.Interval(0,1)
    v1 = crv.TangentAt(0)
    v2 = crv.TangentAt(1)
    v_n = rg.Vector3d.CrossProduct(v1,v2)
    radi = rg.Vector3d.VectorAngle(v1,v2,v_n)
    return radi

def list_to_tree(input, none_and_holes=True, source=[0]):
    """Transforms nestings of lists or tuples to a Grasshopper DataTree"""
    from Grasshopper import DataTree as Tree
    from Grasshopper.Kernel.Data import GH_Path as Path
    from System import Array
    def proc(input,tree,track):
        path = Path(Array[int](track))
        if len(input) == 0 and none_and_holes: tree.EnsurePath(path); return
        for i,item in enumerate(input):
            if hasattr(item, '__iter__'): #if list or tuple
                track.append(i); proc(item,tree,track); track.pop()
            else:
                if none_and_holes: tree.Insert(item,path,i)
                elif item is not None: tree.Add(item,path)
    if input is not None: t=Tree[object]();proc(input,t,source[:]);return t

def tree_to_list(input, retrieve_base = lambda x: x[0]):
    """Returns a list representation of a Grasshopper DataTree"""
    def extend_at(path, index, simple_input, rest_list):
        target = path[index]
        if len(rest_list) <= target: rest_list.extend([None]*(target-len(rest_list)+1))
        if index == path.Length - 1:
            rest_list[target] = list(simple_input)
        else:
            if rest_list[target] is None: rest_list[target] = []
            extend_at(path, index+1, simple_input, rest_list[target])
    all = []
    for i in range(input.BranchCount):
        path = input.Path(i)
        extend_at(path, 0, input.Branch(path), all)
    return retrieve_base(all)

def cur_k(curve, resolution):
    ts = list(curve.DivideByCount(resolution,True))
    pts,k_val,_ = gh.Curvature(curve,ts)
    return pts,k_val,ts


def math_map_list(values, toMin=0, toMax=1):
    minValue = min(values)
    maxValue = max(values)
    delta = maxValue - minValue
    deltaTarget = toMax - toMin
    newValues = [toMin +(value-minValue)*deltaTarget/delta for value in values]
    return newValues

def round_half_up(n, decimals=0):
    multiplier = 10 ** decimals
    return math.floor(n*multiplier + 0.5) / multiplier

def flatten_segmented_crvs(input_crv,origin,dir,segments_t):
    input_crv.Domain = rg.Interval(0,1)
    length = input_crv.GetLength(rg.Interval(0,1))
    line = gh.LineSDL(origin,dir,length)
    line_crv = rg.LineCurve(line)
    line_crv.Domain = rg.Interval(0,1)
    if len(segments_t)>0:
        flat_crvs = line_crv.Split(segments_t)
    elif len(segments_t) == 0 :
        flat_crvs = line_crv
    return flat_crvs

def crv_segment_n_analysis(curve, resolution):

    # finding the segmentation points on the curve based on curvature value
    
    pts,k_val,ts = cur_k(curve, resolution)
    reparam_crvs = []
    t_s = []
    i_s = [0] 
    for i,((k1,k2),t) in enumerate(zip(pr(k_val),ts)):
        if k1[2]*k2[2] < 0 and len(ts)-i>10:
            t_s.append(t)
            i_s.append(i)
    i_s.append(len(ts)-1)
    
    if len(t_s)>0:
        crvs = list(curve.Split(t_s))
        for c in crvs:
            c.Domain = rg.Interval(0,1)
            reparam_crvs.append(c)
    elif len(t_s) == 0:
        curve.Domain = rg.Interval(0,1)
        reparam_crvs = curve
    
    # index of segmentation points
    
    indices = []
    for i,(n,m) in enumerate(pr(i_s)):
        if i == 0:
            indices.append((n,m))
        else:
            indices.append((n+1,m))
    
    # bending direction of curvs
    
    crv_id = [] # 'a' = arch, 'b'= bend, 'f'= flat
    k_2 = [k[2] for k in k_val]
    b_list =  [k_2[s:e+1] for s,e in indices]
    for s_list in b_list:
        l_temp_a = [abs(l) for l in s_list]
        if s_list[1] > 0:
            crv_id.append("b")
        elif s_list[1] < 0:
            crv_id.append("a")
        elif s_list[1] == 0:
            crv_id.append("f")
    
    # getting bend radius of each curve
    
    bend_radis = [0.5,1.8] # the maximum bending radians is 1.8 the minimum is 0.5
    # check if the input curve has segments or not
    if reparam_crvs is not curve:
        for crv in reparam_crvs:
            radi = bending_radi(crv)
            if radi >= 1.8:
                bend_radis.append(1.85)
            elif radi <= 0.5:
                bend_radis.append(0.52)
            else:
                bend_radis.append(radi)
    elif reparam_crvs is curve:
        radi = bending_radi(reparam_crvs)
        if radi >= 1.8:
            bend_radis.append(1.85)
        elif radi <= 0.5:
            bend_radis.append(0.52)
        else:
            bend_radis.append(radi)
    
    # remap the bend radius value to actuator proportion domain
    
    a_p_t =  [round(i,2) for i in math_map_list(bend_radis, toMin=0.07, toMax=0.49)] # a_p means actuator_proportion 
    a_p = a_p_t[2:]
    radius = bend_radis[2:]
    
    
    return reparam_crvs,crv_id,radius,t_s,a_p

def frame_dict(crvs,crv_id,radius,a_p):
    frame_data_dict = {}
    if 'list' in str(type(crvs)) :
        for i,(crv,id,r,a) in enumerate(zip(crvs,crv_id,radius,a_p)):
            if not frame_data_dict.get(i):
                frame_data_dict[i] = {'line_crv':[],'crv_id':[],'radius':[],'a_p':[]}
            frame_data_dict[i]['line_crv']= crv
            frame_data_dict[i]['crv_id']= id 
            frame_data_dict[i]['radius']= r
            frame_data_dict[i]['a_p']= a
    else:
        frame_data_dict[0] = {'line_crv':[crvs],'crv_id':[crv_id],'radius':[radius],'a_p':[a_p]}
    return frame_data_dict

def block_dict(blocks,layerHeight_list,Height_list,directions):
    block_data_dict = {}
    if 'list' in str(type(crvs)) :
        for i,(block,layer_height,height,dir) in enumerate(zip(blocks,layerHeight_list,Height_list,directions)):
            if not block_data_dict.get(i):
                block_data_dict[i] = {'block':[],'layer_height':[],'height':[],'dir':[]}
            block_data_dict[i]['block'] = block
            block_data_dict[i]['layer_height'] = layer_height
            block_data_dict[i]['height'] = height
            block_data_dict[i]['dir'] = dir
    else:
        block_data_dict[0] = {'block':[blocks],'layer_height':[layerHeight_list],'height':[Height_list],'dir':[directions]}
    return block_data_dict
# ---------- end functions ----------
X = UnitX(Factor=1)
pt = Point(Point(50, 50, 0))
flatten_crv = GhPythonScript(
    frame_dict=functions.frame_dict,
    crv_segment_n_analysis=functions.crv_segment_n_analysis,
    flatten_segmented_crvs=functions.flatten_segmented_crvs,
    resolution=Slider(30, range=0..100),
    input_crv=crv,
    origin=pt,
    dir=X)  # -> reparam_crvs, radius, crv_id, flat_crvs; inputs resolution: Int32, input_crv: Curve, origin: Point3d, dir: Vector3d
# ---------- flatten_crv: Python ----------
import scriptcontext as sc

reparam_crvs,crv_id,radius,t_s,a_p = crv_segment_n_analysis(input_crv,resolution)
flat_crvs = flatten_segmented_crvs(input_crv,origin,dir,t_s)
frame_data_dict = frame_dict(flat_crvs,crv_id,radius,a_p)

sc.sticky["frame_data_dict"] = frame_data_dict

print frame_data_dict
# ---------- end flatten_crv ----------

# ---- group: visualize_crvs
cluster = Cluster(crv=flatten_crv.reparam_crvs, R=flatten_crv.radius, id=flatten_crv.crv_id)  # -> G, D, A, B
tag = TextTag(Location=cluster.G, Text=cluster.D, Colour=ColourSwatch(SwatchColor=RGB(0, 0, 0)))
previewlw = CustomPreviewLineweights(Geometry=cluster.A, Shader=ColourSwatch(SwatchColor=RGB(66, 255, 230)), Thickness=Slider(7, range=1..10), Absolute=False)
previewlw_2 = CustomPreviewLineweights(Geometry=cluster.B, Shader=ColourSwatch(SwatchColor=RGB(66, 148, 255)), Thickness=Slider(7, range=1..10), Absolute=False)

# ----
filter = StreamFilter(
    Gate=Slider(5, range=0..6),
    Stream0=crv_max,
    Stream1=crv_min,
    Stream2=crv_test_0,
    Stream3=crv_test_1,
    Stream4=crv_test_2,
    Stream5=crv_test_3,
    Stream6=crv_test_4)
crv_2 = Curve(flatten_crv.flat_crvs)

# ----
# Get a SubD panel
number_slider = Slider(2, range=1..5)
srf_2 = Surface(reparameterize(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))
subd_surface = GhPythonScript(list_to_tree=functions.list_to_tree, srf=srf_2, U=number_slider, V=Slider(1, range=1..5))  # -> simplify(All_srfs); inputs srf: Surface, U: Int32, V: Int32
# ---------- subd_surface: Python ----------
import Rhino.Geometry as rg
import ghpythonlib.components as gh
import scriptcontext as sc

sc.sticky["U"] = U
sc.sticky["V"] = V

edge_crv_u = srf.IsoCurve(0,0)
edge_crv_v = srf.IsoCurve(1,0)
edge_crv_u.Domain = rg.Interval(0,1)
edge_crv_v.Domain = rg.Interval(0,1)

F_crv_u = list(edge_crv_u.DivideByCount(U,True))
F_u = F_crv_u[1:-1]
F_crv_v = list(edge_crv_v.DivideByCount(V,True))
F_v = F_crv_v[1:-1]

crvs_u = [srf.IsoCurve(1,f) for f in F_u]
crvs_v = [srf.IsoCurve(0,f) for f in F_v]

srfs = gh.SurfaceSplit(srf,crvs_u)

if 'list' in str(type(srfs)) :
    all_srfs = [gh.SurfaceSplit(s,crvs_v) for s in srfs]
    All_srfs = list_to_tree(all_srfs, none_and_holes=True, source=[0])
else:
    all_srfs = gh.SurfaceSplit(srfs,crvs_v)
    All_srfs = all_srfs
# ---------- end subd_surface ----------

# ---- group: Auto_slider
panel_index = Slider(0, range=0..1)
lng = ListLength(List=flatten(subd_surface))  # -> expr("x-1", Length)
c_script = CSharpScript(Panel_index=panel_index, len=lng)  # -> out, A; inputs Panel_index: Int32, len: Int32
# ---------- c_script: C# ----------
    {
      var input = Component.Params.Input[0].Sources[0]; //get the first thing connected to the first input of this component
      var slider = input as Grasshopper.Kernel.Special.GH_NumberSlider; //try to cast that thing as a slider

      if(slider != null) //if the component was successfully cast as a slider
      {
        slider.Slider.Minimum = 0;
        slider.Slider.Maximum = y;
      }
    }
# ---------- end c_script ----------

# ----
item = ListItem(List=flatten(subd_surface), Index=panel_index, Wrap=True)
srf_3 = Surface(reparameterize(item))

srf_4 = Surface(srf_3)
debrep = DeconstructBrep(Brep=srf_4)  # -> Faces, Edges, Vertices
python = GhPythonScript(crvs=debrep.Edges)  # -> crv_1, crv_2, crv_3, crv_4; inputs crvs: list of Curve
# ---------- python: Python ----------
import Rhino.Geometry as rg

print len(crvs[1:])
Crvs = crvs[1:]

for i,c in enumerate(Crvs):
    event = rg.Intersect.Intersection.CurveCurve(crvs[0],c,0.001,0.001)
    if not event:
        crv_2 = c
        Crvs.pop(i)

crv_1 = crvs[0]
crv_3,crv_4 = Crvs
# ---------- end python ----------
debrep_2 = DeconstructBrep(Brep=srf_4)  # -> Faces, Edges, Vertices
end = EndPoints(Curve=python.crv_1)  # -> Start, End
end_2 = EndPoints(Curve=python.crv_2)  # -> Start, End
crv_3 = Curve(python.crv_2)
crv_4 = Curve(python.crv_4)
crv_5 = Curve(python.crv_1)
crv_6 = Curve(python.crv_3)
box = Box(debrep_2.Faces)
ln = Line(StartPoint=end.End, EndPoint=end_2.End)
len = Length(Curve=crv_5)
len_2 = Length(Curve=crv_3)
len_3 = Length(Curve=crv_6)
len_4 = Length(Curve=crv_4)
offsetbrep = OffsetBrep(Brep=box, OffsetDistance="50", Solid=False, SharpEdges=True, Tolerance=0.001)
project = Project(Curve=ln, Brep=srf_4, Direction=Vector(0, 0, 1))
subtraction = Subtraction(A=end_2.End, B=end.End)
len_5 = Length(Curve=project)
devec = DeconstructVector(Vector=subtraction)  # -> XComponent, YComponent, ZComponent
vec = VectorXYZ(XComponent=devec.XComponent, YComponent=devec.YComponent, ZComponent=0)  # -> unitize(Vector), Length
line = LineSDL(Start=end.End, Direction=vec.Vector, Length=len_5)
line_2 = Line(line)
end_3 = EndPoints(Curve=line_2)  # -> Start, End
pt_2 = Point(end_3.Start)
cir = Circle(Plane=end_3.Start, Radius=len_4)
cir_2 = Circle(Plane=end_3.Start, Radius=len)
cir_3 = Circle(Plane=end_3.End, Radius=len_3)
cir_4 = Circle(Plane=end_3.End, Radius=len_2)
ccx = CurveCurve(CurveA=cir, CurveB=cir_4)  # -> Points, ParamsA, ParamsB
ccx_2 = CurveCurve(CurveA=cir_2, CurveB=cir_3)  # -> Points, ParamsA, ParamsB
merge = Merge(Data1=ccx_2.Points, Data2=ccx.Points)
python_2 = GhPythonScript(brep=offsetbrep, pts=merge, pts_a=ccx_2.Points, pts_b=ccx.Points, length=len)  # -> out, corner_pts; inputs brep: Brep, pts: list of Point3d, pts_a: list of Point3d, pts_b: list of Point3d
# ---------- python_2: Python ----------
import Rhino.Geometry as rg
import ghpythonlib.components as gh
import scriptcontext as sc

U = sc.sticky["U"]
V = sc.sticky["V"]
corner_pts = []

if U != V:
    for pt in pts:
        if brep.IsPointInside(pt,0.001,True):
            corner_pts.append(pt)
else:
    for p in pts_b:
        dis = pts_a[0].DistanceTo(p)
        if dis > length:
            corner_pts.append(p)
            corner_pts.append(pts_a[0])
# ---------- end python_2 ----------
item_2 = ListItem(List=python_2.corner_pts, Index=0, Wrap=True)  # -> Item, Item1
srf4pt = _4PointSurface(CornerA=item_2.Item, CornerB=end_3.End, CornerC=item_2.Item1, CornerD=end_3.Start)
debrep_3 = DeconstructBrep(Brep=srf4pt)  # -> Faces, reparameterize(Edges), Vertices

# ==== cluster Cluster
crv = ClusterInput()
R = ClusterInput()
crv_2 = Curve(crv)
id = ClusterInput()
deg = Degrees(Radians=R)
python = GhPythonScript(id=id)  # -> out, bool; inputs id: list
# ---------- python: Python ----------
import Rhino.Geometry as rg

bool = []
for i in id:
    if i == 'a':
        bool.append(True)
    else :
        bool.append(False)
# ---------- end python ----------
midpt = CurveMiddle(Curve=crv_2)
D = ClusterOutput(deg)
dispatch = Dispatch(List=crv_2, DispatchPattern=python.bool)  # -> ListA, ListB
Z = UnitZ(Factor=Slider(11, range=0..100))
A = ClusterOutput(dispatch.ListA)
B = ClusterOutput(dispatch.ListB)
move = Move(Geometry=midpt, Motion=Z)  # -> Geometry, Transform
G = ClusterOutput(move.Geometry)
