# Grasshopper definition 082321_Frame_Pipeline_diagram_temp.gh (Grasshopper 1.0.7)
# plug-ins: Human, Pufferfish, Human UI

pan = Panel("Pick")  # disabled
toggle = BooleanToggle(True)  # disabled
toggle_2 = BooleanToggle(True)  # disabled
button = CreateButton(ButtonName=pan, ButtonStyle=0)  # disabled
values = ValueListener(Elements=button, SomeProperty=True)  # -> Values, Indices; disabled
toggle_3 = BooleanToggle(True)  # disabled
object_picker = CSharpScript(run=values.Values, allowMultiple=toggle, allowNone=toggle_2, msg=pan, clear=False)  # -> pickedGeometry; inputs run: Boolean, allowMultiple: Boolean, allowNone: Boolean, msg: String, clear: Boolean; disabled
# ---------- object_picker: C# ----------
    if(run) getNewGeometry(msg, allowMultiple, allowNone);
    pickedGeometry = objIDs;
    if(clear) objIDs.Clear();
# ---------- object_picker: C# additional code ----------
  static List<Guid> objIDs = new List<Guid>();


  void getNewGeometry(string msg, bool allowMultiple, bool allowNone){
    ObjectType filter = ObjectType.AnyObject;

    ObjRef[] rhObjects = new ObjRef[1];


    try{
      Rhino.Commands.Result result = Rhino.Commands.Result.Cancel;
      if(!allowMultiple) {
        ObjRef rhObject;
        result = Rhino.Input.RhinoGet.GetOneObject(msg, allowNone, filter, out rhObject);
        rhObjects[0] = rhObject;

      } else {
        result = Rhino.Input.RhinoGet.GetMultipleObjects(msg, allowNone, filter, out rhObjects);
      }

      if(result == Rhino.Commands.Result.Cancel){

      } else if(result == Rhino.Commands.Result.Success){
        objIDs = rhObjects.Select(o => o.ObjectId).ToList();
        return;
      }
    } catch {

    }
  }
# ---------- end object_picker ----------
merge = Merge(Data1=button)  # disabled
launchwin = LaunchWindow(Show=toggle_3, Name="Control Window", Width=370, Height=400, ChildStatus=0, EnableHorizScroll=False)  # disabled
series = Series(Start=0, Step=1, Count=Slider(14, range=0..21))
geo = Geometry(object_picker)  # disabled
addelems = AddElements(Window=launchwin, Elements=flatten(merge), DoVLChecking=True)  # -> AddedElements, ElementNames; disabled
bnd = Bounds(Numbers=series)
srf = Surface(reparameterize(geo))  # disabled
srf_colum = Surface(reparameterize(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))
remap = RemapNumbers(Value=series, Source=bnd, Target=Domain(0, 1))  # -> Mapped, Clipped
graph = GraphMapper(
    remap.Mapped,
    x0=0,
    x1=1,
    y0=0,
    y1=1,
    container_name="Bezier2",
    pt=[Point(0, 0, 0), Point(0.1598249823, 0.009182691574, 0), Point(0.3652051985, 0.1903819442, 0), Point(0.4922901094, 0.4855399728, 0), Point(0.6562488931, 0.8663385351, 0), Point(1, 1, 0), Point(1, 1, 0)])
loft = Loft(Options={Adjust=False, Closed=False, LoftEnds=0, LoftSimp=0, LoftType=0, Rebuild=10, Refit=0.01})
move = Move(Geometry=srf_colum, Motion="0,0,-15")  # -> Geometry, Transform
material = CreateMaterial(
    Diffuse=ColourSwatch(SwatchColor=RGB(207, 207, 207)),
    Specular=RGB(255, 255, 255),
    Emission=RGB(0, 0, 0),
    Transparency=0,
    Shine=Slider(15, range=0..100))
srf_colum_2 = Surface(reparameterize(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))
srf_colum_3 = Surface(reparameterize(<surface referenced from the Rhino model>))
material_2 = CreateMaterial(
    Diffuse=ColourSwatch(SwatchColor=RGB(46, 46, 46)),
    Specular=RGB(255, 255, 255),
    Emission=RGB(0, 0, 0),
    Transparency=0,
    Shine=Slider(15, range=0..100))
paramsrfiso = ParameterSurfaceIsocurve(Surface=srf_colum, Parameter=graph, Direction=True)
crv = Curve(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)
preview = CustomPreview(Geometry=move.Geometry, Material=material_2)  # disabled

# ----
# manually adjust the shape
number_slider = Slider(0.08, range=-0.5..0.5)
length = Slider(-6.22, range=-100..100)

srf_2 = Surface(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)
previewlw = CustomPreviewLineweights(
    Geometry=paramsrfiso,
    Shader=ColourSwatch(SwatchColor=RGB(227, 227, 227)),
    Thickness=Slider(4, range=1..15),
    Absolute=False)
project = Project(Curve=paramsrfiso, Brep=srf_2, Direction=Vector(0, 0, 1))  # -> flatten(Curve)
end = EndPoints(Curve=project)  # -> Start, End
len = Length(Curve=paramsrfiso)
len_2 = Length(Curve=project)  # -> flatten(Length)
subtraction = Subtraction(A=len, B=len_2)  # -> flatten(Result)
pt = Point(end.End)
cull_i = CullIndex(List=project, Indices=-1, Wrap=True)
cull_i_2 = CullIndex(List=subtraction, Indices=-1, Wrap=True)
colour_swatch = ColourSwatch(SwatchColor=RGBA(255, 255, 0, 63))  # disabled
item = ListItem(List=project, Index=-1, Wrap=True)
number_slider_2 = Slider(1, range=0..7)  # disabled
ext = ExtendCurve(Curve=cull_i, Type=2, Start=cull_i_2, End="0")
merge_2 = Merge(Data1=ext, Data2=item)
previewlw_2 = CustomPreviewLineweights(Geometry=merge_2, Shader=ColourSwatch(SwatchColor=RGB(13, 13, 13)), Thickness=Slider(6, range=1..15), Absolute=False)
crv_2 = Curve([<curve referenced from the Rhino model> x24])
previewlw_3 = CustomPreviewLineweights(Geometry=crv_2, Shader=ColourSwatch(SwatchColor=RGB(13, 13, 13)), Thickness=Slider(4, range=1..15), Absolute=False)
xy = XYPlane(Origin=Point(0, 0, 0))  # disabled
W = Slider(25, range=0..30)

# ----
# 3. press "BUTTON" or "F5" after changes
button_2 = Button()
python = GhPythonScript(recompute=button_2)
# ---------- python: Python ----------
import Rhino.Geometry as rg

def ghSolutionRecompute():
    
    """ Recomputes the Grasshopper solution (ala pressing F5) """
    
    def expireAllComponentsButThis(e):
        for obj in ghenv.Component.OnPingDocument().Objects:
            if not obj.InstanceGuid == ghenv.Component.InstanceGuid:
                obj.ExpireSolution(False)
                
    ghenv.Component.OnPingDocument().ScheduleSolution(1000,expireAllComponentsButThis)

if recompute:
     ghSolutionRecompute()
# ---------- end python ----------

series_2 = Series(Start=0, Step=1, Count=9)

# ---- group: FileName
toggle_4 = BooleanToggle(False)
rec = DataRecorder(toggle_4, DataLimit=-10, RecordData=True)
filepath = Panel("C:\Users\Chengyuan Wei\Documents\GitHub\4D_P\03_4D_theromplastic\grasshopper\data\G_code_files")
int = Integer(0)
lng = ListLength(List=flatten([rec, int]))  # -> expr("Max(0, (x-1)\2)", Length)
panel = Panel(lng)
python_2 = GhPythonScript(filepath=filepath, name="Big_Frame_test", num=panel)  # -> save_as; inputs num: Int32
# ---------- python_2: Python ----------
import Rhino.Geometry as rg
from datetime import datetime
import os

date = datetime.today().strftime('%m%d%Y')
filename = '%s_%s_%i.gcode'%(date,name,num)
save_as = os.path.join(filepath,filename)

print save_as
# ---------- end python_2 ----------

# ----
# 2. Generate flat curves
functions = GhPythonScript()  # -> list_to_tree, frame_dict, crv_segment_n_analysis, segmented_flat_crvs
# ---------- functions: Python ----------
import Rhino.Geometry as rg
import ghpythonlib.components as gh
from compas.utilities import pairwise as pr
import itertools
import scriptcontext as sc
import math


def bending_radi(crv):
    crv.Domain = rg.Interval(0,1)
    v1 = crv.TangentAt(0)
    v2 = crv.TangentAt(1)
    v_n = rg.Vector3d.CrossProduct(v1,v2)
    radi = rg.Vector3d.VectorAngle(v1,v2,v_n)
    return radi

def list_to_tree(input, none_and_holes=True, source=[0]):
    """Transforms nestings of lists or tuples to a Grasshopper DataTree"""
    from Grasshopper import DataTree as Tree
    from Grasshopper.Kernel.Data import GH_Path as Path
    from System import Array
    def proc(input,tree,track):
        path = Path(Array[int](track))
        if len(input) == 0 and none_and_holes: tree.EnsurePath(path); return
        for i,item in enumerate(input):
            if hasattr(item, '__iter__'): #if list or tuple
                track.append(i); proc(item,tree,track); track.pop()
            else:
                if none_and_holes: tree.Insert(item,path,i)
                elif item is not None: tree.Add(item,path)
    if input is not None: t=Tree[object]();proc(input,t,source[:]);return t

def tree_to_list(input, retrieve_base = lambda x: x[0]):
    """Returns a list representation of a Grasshopper DataTree"""
    def extend_at(path, index, simple_input, rest_list):
        target = path[index]
        if len(rest_list) <= target: rest_list.extend([None]*(target-len(rest_list)+1))
        if index == path.Length - 1:
            rest_list[target] = list(simple_input)
        else:
            if rest_list[target] is None: rest_list[target] = []
            extend_at(path, index+1, simple_input, rest_list[target])
    all = []
    for i in range(input.BranchCount):
        path = input.Path(i)
        extend_at(path, 0, input.Branch(path), all)
    return retrieve_base(all)

def cur_k(curve, resolution):
    if not rg.Curve.IsLinear(curve): 
        ts = list(curve.DivideByCount(resolution,True))
        pts,k_val,_ = gh.Curvature(curve,ts)
    else:
        ts = list(curve.DivideByCount(resolution,True))
        pts = [curve.PointAt(t) for t in ts]
        k_val = [0 for _ in pts]
    return pts,k_val,ts


def math_map_list(values, toMin=0, toMax=1):
    minValue = min(values)
    maxValue = max(values)
    delta = maxValue - minValue
    deltaTarget = toMax - toMin
    newValues = [toMin +(value-minValue)*deltaTarget/delta for value in values]
    return newValues

def round_half_up(n, decimals=0):
    multiplier = 10 ** decimals
    return math.floor(n*multiplier + 0.5) / multiplier

def flatten_segmented_crvs(input_crv,origin,dir,segments_t):
    input_crv.Domain = rg.Interval(0,1)
    length = input_crv.GetLength(rg.Interval(0,1))
    line = gh.LineSDL(origin,dir,length)
    line_crv = rg.LineCurve(line)
    line_crv.Domain = rg.Interval(0,1)
    if len(segments_t)>0:
        flat_crvs = line_crv.Split(segments_t)
    elif len(segments_t) == 0 :
        flat_crvs = line_crv
    return flat_crvs

def segmented_flat_crvs(crv,segments_t):
    crv.Domain = rg.Interval(0,1)
    if len(segments_t)>0:
        flat_crvs = crv.Split(segments_t)
    elif len(segments_t) == 0 :
        flat_crvs = crv
    return flat_crvs

def crv_segment_n_analysis(curve, resolution):

    # finding the segmentation points on the curve based on curvature value
    pts,k_val,ts = cur_k(curve, resolution)
    if k_val[0] != 0:
        reparam_crvs = []
        t_s = []
        i_s = [0] 
        for i,((k1,k2),t) in enumerate(zip(pr(k_val),ts)):
            if k1[2]*k2[2] < 0 and len(ts)-i>5:
                t_s.append(t)
                i_s.append(i)
        i_s.append(len(ts)-1)
        
        if len(t_s)>0:
            crvs = list(curve.Split(t_s))
            for c in crvs:
                c.Domain = rg.Interval(0,1)
                reparam_crvs.append(c)
        elif len(t_s) == 0:
            curve.Domain = rg.Interval(0,1)
            reparam_crvs = curve
        
        # index of segmentation points
        
        indices = []
        for i,(n,m) in enumerate(pr(i_s)):
            if i == 0:
                indices.append((n,m))
            else:
                indices.append((n+1,m))
        
        # bending direction of curvs
        
        crv_id = [] # 'a' = arch, 'b'= bend, 'f'= flat
        k_2 = [k[2] for k in k_val]
        b_list =  [k_2[s:e+1] for s,e in indices]
        for s_list in b_list:
            l_temp_a = [abs(l) for l in s_list]
            if s_list[1] > 0:
                crv_id.append("b")
            elif s_list[1] < 0:
                crv_id.append("a")
            elif s_list[1] == 0:
                crv_id.append("f")
        
        # getting bend radius of each curve
        
        bend_radis = [0.5,1.8] # the maximum bending radians is 1.8 the minimum is 0.5
        # check if the input curve has segments or not
        if reparam_crvs is not curve:
            for crv in reparam_crvs:
                radi = bending_radi(crv)
                if radi >= 1.8:
                    bend_radis.append(1.8)
                elif radi <= 0.5:
                    bend_radis.append(0.5)
                else:
                    bend_radis.append(radi)
        elif reparam_crvs is curve:
            radi = bending_radi(reparam_crvs)
            if radi >= 1.8:
                bend_radis.append(1.8)
            elif radi <= 0.5:
                bend_radis.append(0.5)
            else:
                bend_radis.append(radi)
        
        # remap the bend radius value to actuator proportion domain
        
        a_p_t =  [round(i,2) for i in math_map_list(bend_radis, toMin=0.1, toMax=0.5)] # a_p means actuator_proportion 
        a_p = a_p_t[2:]
        radius = bend_radis[2:]
    else:
        reparam_crvs,crv_id,radius,t_s,a_p = curve,['f'],[0],[],[0]
    return reparam_crvs,crv_id,radius,t_s,a_p

def frame_dict(crvs,crv_id,radius,a_p):
    frame_data_dict = {}
    if 'list' in str(type(crvs)) :
        for j,(crv,id,r,a) in enumerate(zip(crvs,crv_id,radius,a_p)):
            if not frame_data_dict.get(j):
                frame_data_dict[j] = {'line_crv':[],'crv_id':[],'radius':[],'a_p':[]}
            frame_data_dict[j]['line_crv']= crv
            frame_data_dict[j]['crv_id']= id 
            frame_data_dict[j]['radius']= r
            frame_data_dict[j]['a_p']= a
    else:
        frame_data_dict[0] = {'line_crv':crvs,'crv_id':crv_id[0],'radius':radius[0],'a_p':a_p[0]}
    return frame_data_dict
# ---------- end functions ----------

# ----
# 1.Get a SubD panel
number_slider_3 = Slider(3, range=1..5)
srf_3 = Surface(reparameterize(<surface referenced from the Rhino model>))
subd_surface = GhPythonScript(list_to_tree=functions.list_to_tree, srf=srf_colum_2, U=number_slider_3, V=Slider(1, range=1..5))  # -> simplify(All_srfs); inputs srf: Surface, U: Int32, V: Int32
# ---------- subd_surface: Python ----------
import Rhino.Geometry as rg
import ghpythonlib.components as gh
import scriptcontext as sc

sc.sticky["U"] = U
sc.sticky["V"] = V

edge_crv_u = srf.IsoCurve(0,0)
edge_crv_v = srf.IsoCurve(1,0)
edge_crv_u.Domain = rg.Interval(0,1)
edge_crv_v.Domain = rg.Interval(0,1)

F_crv_u = list(edge_crv_u.DivideByCount(U,True))
F_u = F_crv_u[1:-1]
F_crv_v = list(edge_crv_v.DivideByCount(V,True))
F_v = F_crv_v[1:-1]

crvs_u = [srf.IsoCurve(1,f) for f in F_u]
crvs_v = [srf.IsoCurve(0,f) for f in F_v]

srfs = gh.SurfaceSplit(srf,crvs_u)

if 'list' in str(type(srfs)) :
    all_srfs = [gh.SurfaceSplit(s,crvs_v) for s in srfs]
    All_srfs = list_to_tree(all_srfs, none_and_holes=True, source=[0])
else:
    all_srfs = gh.SurfaceSplit(srfs,crvs_v)
    All_srfs = all_srfs
# ---------- end subd_surface ----------

# ---- group: Auto_slider
panel_index = Slider(1, range=0..2)
lng_2 = ListLength(List=flatten(subd_surface))  # -> expr("x-1", Length)
c_script = CSharpScript(Panel_index=panel_index, len=lng_2)  # -> out, A; inputs Panel_index: Int32, len: Int32
# ---------- c_script: C# ----------
    {
      var input = Component.Params.Input[0].Sources[0]; //get the first thing connected to the first input of this component
      var slider = input as Grasshopper.Kernel.Special.GH_NumberSlider; //try to cast that thing as a slider

      if(slider != null) //if the component was successfully cast as a slider
      {
        slider.Slider.Minimum = 0;
        slider.Slider.Maximum = len;
      }
    }
# ---------- end c_script ----------

# ----
item_2 = ListItem(List=flatten(subd_surface), Index=panel_index, Wrap=True)
srf_4 = Surface(reparameterize(item_2))

# ---- group: re-orient
md_slider = MDSlider(
    SliderMode=0,
    slider_value=Point(0.5028495078, 0.4970866878, 0.5),
    x_domain=Domain(0, 1),
    y_domain=Domain(0, 1),
    z_domain=Domain(0, 1))
panel_2 = Panel("1,0,0")
panel_3 = Panel("0,1,0")

# ----
flatten_edge_crvs = Flatten_edge_crvs(srf=srf_4, W=W, A=number_slider, B=length)  # -> edge_crvs, trimed_flat_crvs
trimed_flat_crvs = Curve(reparameterize(flatten_edge_crvs.trimed_flat_crvs))
edge_crvs = Curve(reparameterize(flatten_edge_crvs.edge_crvs))

crv_3 = Curve(edge_crvs)
flip = FlipCurve(Curve=crv_3, Guide=<geometry referenced from the Rhino model>)  # -> Curve, Flag
pframe = PerpFrame(Curve=flip.Curve, Parameter=0)
rectangle = Rectangle(Plane=pframe, XSize=Slider(10, range=5..20), YSize=Slider(25, range=0..100), Radius=0)  # -> Rectangle, Length
swp1 = Sweep1(Rail=graft(crv_3), Sections=graft(rectangle.Rectangle), Miter=1)
preview_2 = CustomPreview(Geometry=swp1, Material=material)  # disabled
join = JoinCurves(Curves=edge_crvs, Preserve=False)
merge_3 = Merge(Data1=join)  # disabled
python_script = PythonScript(input=merge_3)  # -> out, box; disabled
# ---------- python_script: Python ----------
#Quick and rough Min Bounding Box Calculation 
#Author Ilja Asanovic

import rhinoscriptsyntax as rs
import math


def volume(bb):
    length = rs.Distance(bb[0], bb[1])
    width = rs.Distance(bb[0], bb[3])
    height = rs.Distance(bb[0], bb[4])
    volume = length * width * height
    return volume


obj = input
init_plane = rs.WorldXYPlane()
init_bb = rs.BoundingBox(obj, init_plane)
init_vol = volume(init_bb)

#print init_vol

new_vol_x = [] #ROT X /0 to 180 degrees
for i in range(0,180+1):
    new_plane = rs.RotatePlane(init_plane, i, [1,0,0])
    new_bb = rs.BoundingBox(obj, new_plane)
    new_vol_x.append(int(volume(new_bb)))


rot_x = new_vol_x.index(min(new_vol_x))+1 #degrees
plane_x = rs.RotatePlane(init_plane, rot_x, [1,0,0])
#addpoints = rs.AddPoints(rs.BoundingBox(obj, plane_x))

new_vol_y = [] #ROT Y  /0 to 180 degrees
for i in range(0,180+1):
    new_plane = rs.RotatePlane(plane_x, i, [0,1,0])
    new_bb = rs.BoundingBox(obj, new_plane)
    new_vol_y.append(int(volume(new_bb)))

rot_y = new_vol_y.index(min(new_vol_y))+1 #degrees
plane_y = rs.RotatePlane(plane_x, rot_y, [0,1,0])
#addpoints = rs.AddPoints(rs.BoundingBox(obj, plane_y))

new_vol_z = [] #ROT Z  /0 to 180 degrees
for i in range(0,180+1):
    new_plane = rs.RotatePlane(plane_y, i, [0,0,1])
    new_bb = rs.BoundingBox(obj, new_plane)
    new_vol_z.append(int(volume(new_bb)))

rot_z = new_vol_z.index(min(new_vol_z))+1 #degrees
plane_z = rs.RotatePlane(plane_y, rot_z, [0,0,1])
#addpoints = rs.AddPoints(rs.BoundingBox(obj, plane_z))

pts = rs.BoundingBox(obj, plane_z)
#local axes
ref_axis1 = rs.VectorCreate(pts[0], pts[1])
ref_axis2 = rs.VectorCreate(pts[0], pts[3])
ref_axis3 = rs.VectorCreate(pts[0], pts[4])

new_vol_ref_axis1 = []
for i in range(0,180+1):  
    new_plane = rs.RotatePlane(plane_z, i, ref_axis1)
    new_bb = rs.BoundingBox(obj, new_plane)
    new_vol_ref_axis1.append(int(volume(new_bb)))

rot_ref_axis1 = new_vol_ref_axis1.index(min(new_vol_ref_axis1))+1
plane_ref_axis1 = rs.RotatePlane(plane_z, rot_ref_axis1, ref_axis1)
#addpoints = rs.AddPoints(rs.BoundingBox(obj, plane_ref_axis1))

new_vol_ref_axis2 = []
for i in range(0,180+1):
    new_plane = rs.RotatePlane(plane_ref_axis1, i, ref_axis2)
    new_bb = rs.BoundingBox(obj, new_plane)
    new_vol_ref_axis2.append(int(volume(new_bb)))

rot_ref_axis2 = new_vol_ref_axis2.index(min(new_vol_ref_axis2))+1
plane_ref_axis2 = rs.RotatePlane(plane_ref_axis1, rot_ref_axis2, ref_axis2)
#addpoints = rs.AddPoints(rs.BoundingBox(obj, plane_ref_axis2))

new_vol_ref_axis3 = []
for i in range(0,180+1):
    new_plane = rs.RotatePlane(plane_ref_axis2, i, ref_axis3)
    new_bb = rs.BoundingBox(obj, new_plane)
    new_vol_ref_axis3.append(int(volume(new_bb)))

rot_ref_axis3 = new_vol_ref_axis3.index(min(new_vol_ref_axis3))+1
plane_ref_axis3 = rs.RotatePlane(plane_ref_axis2, rot_ref_axis3, ref_axis3)
box = rs.AddBox(rs.AddPoints(rs.BoundingBox(obj, plane_ref_axis3)))
# ---------- end python_script ----------
debrep = DeconstructBrep(Brep=python_script.box)  # -> Faces, Edges, Vertices; disabled
custom_preview = CustomPreview(Geometry=python_script.box, Shader=colour_swatch)  # disabled
volume = Volume(Geometry=python_script.box)  # -> Volume, Centroid; disabled
item_3 = ListItem(List=debrep.Faces, Index=number_slider_2, Wrap=True)  # disabled
panel_4 = Panel(volume.Volume)  # disabled
area = Area(Geometry=item_3)  # -> Area, Centroid; disabled
srf_cp = SurfaceClosestPoint(Point=area.Centroid, Surface=item_3)  # -> Point, UVPoint, Distance; disabled
evalsrf = EvaluateSurface(Surface=item_3, Point=srf_cp.UVPoint)  # -> Point, Normal, UDirection, VDirection, Frame; disabled
orient = Orient(Geometry=[merge_3, python_script.box], Source=evalsrf.Frame, Target=xy)  # -> Geometry, Transform; disabled

# ---- group: re-orient (continued)
brec = BoundingRectangle(Geometry=trimed_flat_crvs, Plane=PlaneXY(0, 0, 0), Axis=0, Slide=0, Union=True)  # -> Bounding, DimensionX, DimensionY
area_2 = Area(Geometry=brec.Bounding)  # -> Area, Centroid
pl = ConstructPlane(Origin=area_2.Centroid, XAxis=Vector(1, 0, 0), YAxis=Vector(0, 1, 0))

# ----
# Generate tool path
passive_components_density = Slider(0.3, range=0..1)
actuator_proportion = Slider(0.5, range=0..1)
modulus_number = Slider(2, range=1..5)
list = ValueList({"G_code": 0, "UR_sccript": 1}, selected="G_code")
pt_2 = Point("0,0,0")

# ---- group: visualize_crvs
number_slider_4 = Slider(15, range=1..15)

# ----
# 4. G_code
list_2 = ValueList({"Raise3D": 1, "BigRep ONE": 0}, selected="BigRep ONE")
machine = Integer(list_2)
machine_prm = PythonScript(machine=machine)  # -> buildShift, platform, FRA
# ---------- machine_prm: Python ----------
import rhinoscriptsyntax as rs
if(machine == 1):
    # Raise3D
    w , h = 305, 305
    buildShift = rs.AddPoint(0, 0, 0)
    platform = rs.AddRectangle(rs.PlaneFromFrame([-w / 2, -h / 2, 0], [1, 0, 0], [0, 1, 0]), w, h)
    FRA = 0.95
else:
    # BigRep ONE
    w, h = 1005, 1005 # 520, 320
    xShift, yShift = 5, 5
    buildShift = rs.AddPoint(w / 2 + xShift, h / 2 + yShift, 0)
    platform = rs.AddRectangle(rs.PlaneFromFrame([xShift, yShift, 0], [1, 0, 0], [0, 1, 0]), w, h)
    FRA = 1.1
# ---------- end machine_prm ----------

# ---- group: visualize_3D printer_platform
platform = Curve(reparameterize(machine_prm.platform))
offset = Offset(Curve=platform, Distance=3, Plane=PlaneXY(0, 0, 0), Corners=1)
merge_4 = Merge(Data1=platform, Data2=offset)  # -> flatten(Result)
boundary = BoundarySurfaces(Edges=platform)  # -> reparameterize(Surfaces)
boundary_2 = BoundarySurfaces(Edges=merge_4)
preview_3 = CustomPreview(Geometry=boundary_2, Shader=ColourSwatch(SwatchColor=RGB(107, 107, 107)))
area_3 = Area(Geometry=boundary_2)  # -> Area, Centroid

# ---- group: re-orient (continued)
evalsrf_2 = EvaluateSurface(Surface=boundary, Point=md_slider)  # -> Point, Normal, UDirection, VDirection, Frame
pt_3 = Point(evalsrf_2.Point)
pl_2 = ConstructPlane(Origin=pt_3, XAxis="0,-1,0", YAxis="1,0,0")
orient_2 = Orient(Geometry=trimed_flat_crvs, Source=pl, Target=pl_2)  # -> Geometry, Transform

# ----
crv_data_dict = GhPythonScript(
    list_to_tree=functions.list_to_tree,
    frame_dict=functions.frame_dict,
    crv_segment_n_analysis=functions.crv_segment_n_analysis,
    segmented_flat_crvs=functions.segmented_flat_crvs,
    resolution=Slider(60, range=0..100),
    edge_crvs=edge_crvs,
    trimed_flat_crvs=orient_2.Geometry)  # -> reparam_crvs_flat, radius, crv_id; inputs resolution: Int32, edge_crvs: list, trimed_flat_crvs: list of Curve
# ---------- crv_data_dict: Python ----------
import scriptcontext as sc
from compas_ghpython.utilities import list_to_ghtree
import itertools


reparam_crvs_all,crv_id_all,radius_all,c,a_p_all,t_s_all = [],[],[],[],[],[]
for e_crv in edge_crvs:
    c,crv_id,radius,t_s,a_p = crv_segment_n_analysis(e_crv,resolution)
    reparam_crvs_all.append(c)
    crv_id_all.append(crv_id)
    radius_all.append(radius)
    a_p_all.append(a_p)
    t_s_all.append(t_s)


flat_crvs_all = []
for f_crv,t_s in zip(trimed_flat_crvs,t_s_all):
    if len(t_s)!= 0:
        flat_crvs = list(segmented_flat_crvs(f_crv,t_s))
    else :
        flat_crvs = segmented_flat_crvs(f_crv,t_s)
    flat_crvs_all.append(flat_crvs)


frame_data_dicts = []
for i,(crvs,crv_id,radius,a_p) in enumerate(zip(flat_crvs_all,crv_id_all,radius_all,a_p_all)):
    frame_data_dicts.append(frame_dict(crvs,crv_id,radius,a_p))

print reparam_crvs_all

#reparam_crvs = list_to_ghtree(reparam_crvs_all)
#reparam_crvs = list(itertools.chain.from_iterable(reparam_crvs_all))
reparam_crvs_flat = []
for c in reparam_crvs_all:
    print type(c)
    if 'list' in str(type(c)) :
        reparam_crvs_flat.extend(c)
    else:
        reparam_crvs_flat.append(c)
        
radius = list(itertools.chain.from_iterable(radius_all))
crv_id = list(itertools.chain.from_iterable(crv_id_all))

sc.sticky["frame_data_dicts"] = frame_data_dicts

#print frame_data_dicts
# ---------- end crv_data_dict ----------

# ----
# Generate joint tool path
cluster = Cluster_2(nozzle="1", trimed_flat_crvs=orient_2.Geometry, W=W)  # -> joint_a_2, joint_b_2

# ---- group: visualize_crvs (continued)
cluster_2 = Cluster(crv=crv_data_dict.reparam_crvs_flat, R=crv_data_dict.radius, id=crv_data_dict.crv_id)  # -> G, D, arch, bend, line
previewlw_4 = CustomPreviewLineweights(Geometry=cluster_2.line, Shader=ColourSwatch(SwatchColor=RGB(255, 79, 66)), Thickness=number_slider_4, Absolute=False)
tag = TextTag(Location=cluster_2.G, Text=cluster_2.D, Colour=ColourSwatch(SwatchColor=RGB(0, 0, 0)))
previewlw_5 = CustomPreviewLineweights(Geometry=cluster_2.arch, Shader=ColourSwatch(SwatchColor=RGB(30, 250, 221)), Thickness=number_slider_4, Absolute=False)
previewlw_6 = CustomPreviewLineweights(Geometry=cluster_2.bend, Shader=ColourSwatch(SwatchColor=RGB(66, 148, 255)), Thickness=number_slider_4, Absolute=False)

# ----
generate_printing_path = GhPythonScript(
    list_to_tree=functions.list_to_tree,
    origin=pt_2,
    nozzle="1",
    W=W,
    H=Slider(10, range=4..10),
    layer_height=".2",
    number=modulus_number,
    dens=passive_components_density,
    proportion=actuator_proportion,
    send_to=list,
    joint_a=cluster.joint_a_2,
    joint_b=cluster.joint_b_2)  # -> blocks, layerHeight_list_all, Height_list_all, directions; inputs origin: Point3d, joint_a: tree of Curve, joint_b: tree of Curve
# ---------- generate_printing_path: Python ----------
import Rhino.Geometry as rg
import ghpythonlib.components as gh
from compas.utilities import pairwise as pr
import itertools
import scriptcontext as sc
import json 
import os 
from datetime import datetime as dt
import math as m
from compas_ghpython.utilities import ghtree_to_list

from json import encoder
encoder.FLOAT_REPR = lambda o: format(o, '.2f')

sc.sticky["nozzle"] = nozzle
sc.sticky["layer_height"] = layer_height
frame_data_dicts = sc.sticky["frame_data_dicts"]

class component():
    def __init__(self,c1,c2,nozzle,dir):
        self.c1 = c1
        self.c2 = c2
        self.dir = dir
        self.nozzle = nozzle

    def crv_s_e(self,crv):
        crv.Domain = rg.Interval(0,1)
        s_pt = crv.PointAt(0)
        e_pt = crv.PointAt(1)
        return s_pt,e_pt
    
     # c1:curve1 c2:curve2 n:number of tweencurve s_p:starting point(0,1,2,3) 
    def back_n_forth(self,c1,c2,s_p,nozzle,dir):
        #toggle = []
        p_a,p_a_1 = self.crv_s_e(self.c1)
        p_b,p_b_1 = self.crv_s_e(self.c2)
        dist = p_a.DistanceTo(p_b)
        if dir == 0:
            n = int(dist/nozzle*0.3)-1
        else:
            n = int(dist/nozzle*dens)-1
        crvs= rg.Curve.CreateTweenCurves(self.c1,self.c2,n,0.01)
        p_a,p_a_1 = self.crv_s_e(self.c1)
        p_b,p_b_1 = self.crv_s_e(self.c2)
        out_pts = [p_a,p_a_1,p_b_1,p_b,p_a]
        #tg = [1 for _ in out_pts ]
        #toggle.extend(tg)
        way_pts = []
        start = [[1,1],[0,1],[1,0],[0,0]]
        s_key = start[s_p]
        for i,c in enumerate(crvs):
            if i % 2 == s_key[0]:
                c.Reverse()
                c.Domain = rg.Interval(0,1)
                l = c.GetLength(rg.Interval(0,1))
                if dir == 0: 
                    param = nozzle/l*0.8
                else :
                    param = nozzle/l*0.8
                p_s = c.PointAt(param)
                way_pts.append(p_s)
                p_s = c.PointAt(1-param)
                way_pts.append(p_s)
                
            else:
                c.Domain = rg.Interval(0,1)
                l = c.GetLength(rg.Interval(0,1))
                if dir == 0: 
                    param = nozzle/l*0.8
                else :
                    param = nozzle/l*0.8
                p_s = c.PointAt(param)
                way_pts.append(p_s)
                p_s = c.PointAt(1-param)
                way_pts.append(p_s)
                
        toggle_v = s_key[1]
        if toggle_v == 0:
            way_pts.reverse()
        elif toggle_v == 1:
            pass 
        path_all = []
        way_pts_all = []
        toggle = []
        path = rg.NurbsCurve.Create(False,1,way_pts)
        outline = rg.NurbsCurve.Create(False,1,out_pts)
        path_all.append(outline)
        path_all.append(path)
        way_pts_all.extend(out_pts)
        for p in out_pts:
            toggle.append(1)
        toggle[-1] = 0
        way_pts_all.extend(way_pts)
        for t in range(len(way_pts)):
            toggle.append(1)
        toggle[-1] = 0
        return path_all,way_pts_all,toggle
    
    def optimized_path(self):
        p_a,_ = self.crv_s_e(self.c1)
        p_b,_ = self.crv_s_e(self.c2)
        dis = p_a.DistanceTo(p_b)
        i = 0 
        while i < 4:
            path,w_pts,toggle = self.back_n_forth(self.c1,self.c2,i,nozzle,dir)
            pt_1,_ = self.crv_s_e(path[1])
            pt_2 = w_pts[0]
            dis_2_pts = pt_1.DistanceTo(pt_2)
            if dis_2_pts < dis/2:
                break 
            i += 1 
        return path,w_pts,toggle

def crv_s_e(crv):
    crv.Domain = rg.Interval(0,1)
    s_pt = crv.PointAt(0)
    e_pt = crv.PointAt(1)
    return s_pt,e_pt

def trim_crv(crv,nozzle):
    crv.Domain = rg.Interval(0,1)
    l = crv.GetLength(rg.Interval(0,1))
    pr = nozzle*0.5/l
    c1 = crv.Split(pr)[1]
    t_crv = c1.Split(1-pr)[0]
    return t_crv

def guide_curves(crv,width,dir):
    o_plane = rg.Plane(origin,rg.Vector3d.ZAxis)
    crv_1 = gh.OffsetCurve(crv,width/2,o_plane,0)
    crv_2 = gh.OffsetCurve(crv,-width/2,o_plane,0)
    c1_pt_s,c1_pt_e = crv_s_e(crv_1)
    c2_pt_s,c2_pt_e = crv_s_e(crv_2)
    crv_3 = rg.LineCurve(c1_pt_s,c2_pt_s)
    crv_4 = rg.LineCurve(c1_pt_e,c2_pt_e)
    if dir == 0:
        return crv_1,crv_2
    if dir == 1:
        return crv_3,crv_4

def iter_by_layers(crv,t,dir):
    c1 = crv.Duplicate()
    c1.Transform(t)
    c_1,c_2 = guide_curves(c1,W,dir)
    C1 = component(c_1,c_2,nozzle,dir)
    path,way_pts,toggle = C1.optimized_path()
    return path,way_pts,toggle

def add_way_pt(pts_list,height):
    pt_s = pts_list[0].Clone()
    pt_e = pts_list[-1].Clone()
    t_1 = rg.Transform.Translation(0,0,height*2)
    t_2 = rg.Transform.Translation(0,0,height)
    pt_s.Transform(t_1)
    pt_e.Transform(t_2)
    pts_list.insert(0,pt_s)
    pts_list.append(pt_e)
    return pts_list

def add_vel(vel_list,s,e):
    vel_list.insert(0,s)
    vel_list.append(e)
    return vel_list

def add_toggle(toggle_list):
    toggle_list.insert(0,1)
    toggle_list.append(0)
    return toggle_list

def writeDictToJson(filename, data):
    with open(filename, 'w') as fp:
        encoder.FLOAT_REPR = lambda o: format(o, '.2f')
        json.dump(data, fp, sort_keys=True, indent=2)

all_paths,all_way_pts,toggle_all,velocity_all = [],[],[],[]
layerHeight_list_all,Height_list_all,directions,temp = [],[],[],[]
joint_switch = []

lift_height,passive_1,passive,active_1,active = 5,45,45,45,60

move_z = int(m.ceil(H/layer_height))

joint_a = ghtree_to_list(joint_a)
joint_b =  ghtree_to_list(joint_b)
joint_dirs = [1 for _ in joint_a]

for j in range(move_z):
    layer_paths,layer_way_pts,layer_toggle,layer_velocity,layer_dirs = [],[],[],[],[]
    layerHeight_list,Height_list = [],[]
    t = rg.Transform.Translation(0,0,layer_height*j)
    for frame_data_dict in frame_data_dicts:
        for i in range(len(frame_data_dict)):
            data = frame_data_dict[i]
            crv,id,pr = data['line_crv'],data['crv_id'],data['a_p']
            c = trim_crv(crv,nozzle)
            switch = int(move_z*pr)
            if id == 'a':
                if 0< j <= switch: 
                    dir = 0
                    path,way_pts,toggle =iter_by_layers(c,t,dir)
                    if send_to == 0:
                        layer_dirs.append(0)
                        layer_paths.append(path)
                        layerHeight_list.append(layer_height)
                        Height_list.append(layer_height*j)
                    else:
                        if j == 0 :
                            vel_1 = [active_1 for _ in way_pts]
                            vel_1_1 = add_vel(vel_1,60,15)
                            layer_velocity.append(vel_1_1)
                        else :
                            vel_2 = [active for _ in way_pts]
                            vel_2_1 = add_vel(vel_2,60,15)
                            layer_velocity.append(vel_2_1)
                        toggle_1 = add_toggle(toggle)
                        layer_toggle.append(toggle_1)
                        way_pts_1 = add_way_pt(way_pts,lift_height)
                        layer_way_pts.append(way_pts_1)
                elif switch< j < move_z and j%3 == 0:
                    dir = 1
                    path,way_pts,toggle =iter_by_layers(c,t,dir)
                    if send_to == 0 :
                        layer_dirs.append(1)
                        layer_paths.append(path)
                        layerHeight_list.append(layer_height*3)
                        Height_list.append(layer_height*j)
                    else:
                        vel_3 = [passive for _ in way_pts]
                        vel_3_1 = add_vel(vel_3,40,15)
                        layer_velocity.append(vel_3_1)
                        toggle_2 = add_toggle(toggle)
                        layer_toggle.append(toggle_2)
                        way_pts_2 = add_way_pt(way_pts,lift_height)
                        layer_way_pts.append(way_pts_2)
                elif j == move_z-1:
                    dir = 1
                    path,way_pts,toggle =iter_by_layers(c,t,dir)
                    if send_to == 0:
                        layer_dirs.append(1)
                        layerHeight_list.append(layer_height*3)
                        Height_list.append(layer_height*j)
                        layer_paths.append(path)
                    else:
                        vel_4 = [passive for _ in way_pts]
                        vel_4_1 = add_vel(vel_4,60,15)
                        layer_velocity.append(vel_4_1)
                        way_pts_3 = add_way_pt(way_pts,lift_height)
                        layer_way_pts.append(way_pts_3)
                        toggle_3 = add_toggle(toggle)
                        layer_toggle.append(toggle_3)

            elif id == 'b':
                if 0< j < move_z -switch and j%3 == 0 : 
                    dir = 1
                    path,way_pts,toggle =iter_by_layers(c,t,dir)
                    if send_to == 0 :
                        layer_paths.append(path)
                        layer_dirs.append(1)
                        layerHeight_list.append(layer_height*3)
                        Height_list.append(layer_height*j)
                    else :
                        toggle_5 = add_toggle(toggle)
                        layer_toggle.append(toggle_5)
                        way_pts_5 = add_way_pt(way_pts,lift_height)
                        layer_way_pts.append(way_pts_5)
                        vel_6 = [passive for _ in way_pts]
                        vel_6_1 = add_vel(vel_6,60,15)
                        layer_velocity.append(vel_6_1)
                elif move_z -switch<= j <= move_z:
                    dir = 0
                    path,way_pts,toggle =iter_by_layers(c,t,dir)
                    if send_to == 0 :
                        layer_paths.append(path)
                        layer_dirs.append(0)
                        layerHeight_list.append(layer_height)
                        Height_list.append(layer_height*j)
                    else:
                        if j == move_z -switch :
                            vel_7 = [active_1 for _ in way_pts]
                            vel_7_1 = add_vel(vel_7,60,15)
                            layer_velocity.append(vel_7_1)
                        else :
                            vel_8 = [active for _ in way_pts]
                            vel_8_1 = add_vel(vel_8,60,15)
                            layer_velocity.append(vel_8_1)
                        toggle_6 = add_toggle(toggle)
                        layer_toggle.append(toggle_6)
                        way_pts_6 = add_way_pt(way_pts,lift_height)
                        layer_way_pts.append(way_pts_6)
                        
            elif id == 'f':
                if  j%3 == 0 and j>0  : 
                    dir = 1
                    path,way_pts,toggle =iter_by_layers(c,t,dir)
                    if send_to == 0 :
                        layer_paths.append(path)
                        layer_dirs.append(1)
                        layerHeight_list.append(layer_height*3)
                        Height_list.append(layer_height*j)
                    else :
                        toggle_7 = add_toggle(toggle)
                        layer_toggle.append(toggle_7)
                        way_pts_7 = add_way_pt(way_pts,lift_height)
                        layer_way_pts.append(way_pts_7)
                        vel_9 = [passive for _ in way_pts]
                        vel_9_1 = add_vel(vel_6,60,15)
                        layer_velocity.append(vel_9_1)

    if send_to == 1:
        merged_way_pts = list(itertools.chain.from_iterable(layer_way_pts))
        merged_toggle = list(itertools.chain.from_iterable(layer_toggle))
        merged_velocity = list(itertools.chain.from_iterable(layer_velocity))
        all_way_pts.extend(merged_way_pts)
        toggle_all.extend(merged_toggle)
        velocity_all.extend(merged_velocity)
    else:
        #merged_layer_paths = list(itertools.chain.from_iterable(layer_paths))
        #all_paths.extend(merged_layer_paths)
        directions.extend(layer_dirs)
        layerHeight_list_all.extend(layerHeight_list)
        Height_list_all.extend(Height_list)
        temp.extend(layer_paths) 
        if j < int(0.8*move_z):
            if j> 0 and j%3 == 0 and j/3%2 != 0:
                temp.extend(joint_a)
                joint_layerHeight_list = [layer_height*3 for _ in joint_a]
                layerHeight_list_all.extend(joint_layerHeight_list)
                joint_Height_list = [j*layer_height for _ in joint_a]
                Height_list_all.extend(joint_Height_list)
                directions.extend(joint_dirs)
            elif j> 0 and j%3 == 0 and j/3%2 == 0:
                temp.extend(joint_b)
                joint_layerHeight_list = [layer_height*3 for _ in joint_a]
                layerHeight_list_all.extend(joint_layerHeight_list)
                joint_Height_list = [j*layer_height for _ in joint_a]
                Height_list_all.extend(joint_Height_list)
                directions.extend(joint_dirs)



blocks = list_to_tree(temp, none_and_holes=True, source=[0])

#block_data_dict = block_dict(temp,layerHeight_list_all,Height_list_all,directions)
#sc.sticky["block_data_dict"] = block_data_dict


#HERE = ghenv.LocalScope.ghdoc.Path
#dir_path = os.path.dirname(HERE)

#if to_json:
#    print 'done !!!'
#    date = dt.now().strftime("%Y%m%d")
#    writeDictToJson((dir_path + "\\data\\" + date + "fabrication_data.json"), block_data_dict)
# ---------- end generate_printing_path ----------
crv_4 = Curve(reparameterize(simplify(generate_printing_path.blocks)))

branch = TreeBranch(Tree=crv_4, Path=series_2, MaintainPaths=True)

blocktocode = PythonScript(
    FRAdjust=machine_prm.FRA,
    machine=machine,
    fillamentDia="2.85",
    blocks=generate_printing_path.blocks,
    layerHeight_list_all=generate_printing_path.layerHeight_list_all,
    Height_list_all=generate_printing_path.Height_list_all,
    directions=generate_printing_path.directions)  # -> blockToCode, GenerateCode, flatten(Code); inputs blocks: tree, layerHeight_list_all: list, Height_list_all: list, directions: list
# ---------- blocktocode: Python ----------
import ghpythonlib.treehelpers as th
import Rhino.Geometry as rg
import os
import json
import math
import rhinoscriptsyntax as rs
import scriptcontext as sc
from datetime import datetime as dt


layerHeight = sc.sticky["layer_height"]
nozzleDia = sc.sticky["nozzle"]
#block_data_dict = sc.sticky["block_data_dict"] 

#HERE = ghenv.LocalScope.ghdoc.Path
#dir_path = os.path.dirname(HERE)
#date = dt.now().strftime("%Y%m%d")
#filename = dir_path + "\\data\\" + date  + json_name
#
#with open(filename, 'r') as f:
#    block_data_dict = json.load(f)


def GenerateCode(block, nozzleDia, fillamentDia,layerHeight,height,direction,defaultSpeed = 5000):
    result = []
    for i in range(len(block)):
        curve = block[i]
        pt = rs.CurveStartPoint(curve)
        if(isinstance(defaultSpeed, list)): speed = defaultSpeed[i]
        elif layerHeight == height and i == 1 and dir == 1 : speed = defaultSpeed*0.3
        elif layerHeight == height and i == 0 : speed = defaultSpeed*0.3
        elif layerHeight != height and dir == 1 and i == 1: speed = defaultSpeed*0.6
        elif layerHeight != height and dir == 1 and i == 0: speed = defaultSpeed*0.45
        else: speed = defaultSpeed
        if(machine == 1):
            # Raise3D
            result += ["G1 E-1.000 F1200\n"]
            result += ["G1 X%.3f Y%.3f F5000\n" % (pt[0], pt[1])]
            result += ["G1 E1.000 F1200\n"]
        else:
            # BigRep ONE
            if i == 0 :
                result += ["G92 E0\n"]
                result += ["G1 E-1.000 F1200\n"]
                result += ["; feature outer perimeter\n"]
                result += ["G1 Z%.3f F1000\n"% (height+0.8)]
                result += ["G1 X%.3f Y%.3f F5000\n" % (pt[0], pt[1])]
                result += ["G1 Z%.3f F1000\n"% height]
                result += ["G1 E0.000 F1800\n"]
                result += ["G92 E0\n"]
                if layerHeight == height:
                    result += ["G1 X%.3f Y%.3f E1.000\n" % (pt[0], pt[1])]
            else:
                result += ["; feature infill\n"]
                result += ["G1 X%.3f Y%.3f F5000\n" % (pt[0], pt[1])]
                result += ["G92 E0\n"]
        # extrude along curve
        i = 0
        segments, extSum = rs.ExplodeCurves(curve), 0.
        new_segments = []
        for segment in segments:
            #l = rs.CurveLength(segment)
            rg_segment = rs.coercecurve(segment)
            rg_segment.Domain = rg.Interval(0,1)
            length = rg.Curve.GetLength(rg_segment)
            if length > 300:
                segs = list(rg_segment.Split([0.25,0.5,0.75]))
                for s in segs:
                    s.Domain = rg.Interval(0,1)
                new_segments.extend(segs)
            else:
                new_segments.append(rg_segment)
#        if(len(segments) == 0):
#            segments = [curve]
        for n,seg in enumerate(new_segments):
            crv_l = rg.Curve.GetLength(seg)
            volume = nozzleDia * crv_l * layerHeight
            extrusion = (volume / (((fillamentDia / 2) ** 2) * math.pi)) * FRAdjust + 1.000
            extSum += extrusion
            if(machine == 1):
                # Raise3D
                E = extrusion
            else:
                # BigRep ONE
                E = extSum
            pt = seg.PointAt(1)
            if(i == 0):
                if n == 0:
                    string = "G1 X%.3f Y%.3f E%.3f F%d\n" % (pt[0], pt[1], E*1.5, int(speed))
                elif n!=0 :
                    string = "G1 X%.3f Y%.3f E%.3f F%d\n" % (pt[0], pt[1], E, int(speed))
            else:
                string = "G1 X%.3f Y%.3f E%.3f\n" % (pt[0], pt[1], E)
            i += 1
            result += [string]
    return "".join(result)

block_list = th.tree_to_list(blocks)

Code = []

for block,layerheight,height,dir in zip(block_list,layerHeight_list_all,Height_list_all,directions):
    if(len(block) > 0):
        code = GenerateCode(block,nozzleDia,fillamentDia,layerheight,height,dir, 5000)
        Code += code
"".join(Code)

#for i in range(len(block_data_dict)):
#    data = block_data_dict[i]
#    block,layerheight,height,dir = data['block'],data['layer_height'],data['height'],data['dir']
#    if(len(block) > 0):
#        code = GenerateCode(block,nozzleDia,fillamentDia,layerheight,height,dir, 5000)
#        Code += code
#"".join(Code)
# ---------- end blocktocode ----------
outskirt = Outskirt(
    platform=machine_prm.platform,
    everything=generate_printing_path.blocks,
    nozzlediameter="1",
    width=W,
    fillamentdia="2.85",
    blocktocode=blocktocode.GenerateCode,
    constraintlayerheight="0.6")  # -> plotboundary_2, outskirtcode_2
header_footer = HeaderFooter(machine=machine, d3=outskirt.outskirtcode_2)  # -> machine_3, code, code_2
gcodecompiler = PythonScript(
    code=blocktocode.Code,
    machine=header_footer.machine_3,
    header=header_footer.code,
    footer=header_footer.code_2,
    filename=python_2,
    run=toggle_4)  # -> gcode; inputs blockOutline: list, startingHeight: list, layerHeight: list, height: list, code: list, header: list, footer: list
# ---------- gcodecompiler: Python ----------
import rhinoscriptsyntax as rs

if(run):
    gcode = "".join(header + code + footer)
    # wrtie code
    with open(filename, "wt") as file:
        file.write(gcode)
# ---------- end gcodecompiler ----------

# ==== cluster Outskirt
constraintlayerheight = ClusterInput()
nozzlediameter = ClusterInput()
blocktocode = ClusterInput()
fillamentdia = ClusterInput()
everything = ClusterInput()
platform = ClusterInput()
width = ClusterInput()

width_2 = Number(width)
platform_2 = Curve(platform)
everything_2 = Curve(everything)
blocktocode_2 = Data(blocktocode)
nozzlediameter_2 = Number(nozzlediameter)
fillamentdia_2 = Number(fillamentdia)
constraintlayerheight_2 = Number(constraintlayerheight)

multiplication = Multiplication(A=nozzlediameter_2, B=0)
C = Count(2)
series = Series(Start=multiplication, Step=nozzlediameter_2, Count=C)
neg = Negative(Value=series)

repeat = RepeatData(Data=[True, False], Length=C)  # -> graft(Data)

bbox = BoundingBox(Content=everything_2, Plane=PlaneXY(0, 0, 0), UnionBox=True)  # -> Box, Box_2
debox = DeconstructBox(Box=bbox.Box)  # -> Plane, X, Y, Z
multiplication_2 = Multiplication(A=nozzlediameter_2, B=5)
neg_2 = Negative(Value=multiplication_2)
rectangle = Rectangle(Plane=debox.Plane, XSize=debox.X, YSize=debox.Y, Radius=0)  # -> Rectangle, Length
offset = Offset(Curve=platform_2, Distance=expr("x*0", neg_2), Plane=PlaneXY(0, 0, 0), Corners=1)

brec = BoundingRectangle(Geometry=flatten(rectangle.Rectangle), Plane=PlaneXY(0, 0, 0), Axis=0, Slide=0, Union=True)  # -> Bounding, DimensionX, DimensionY
area = Area(Geometry=brec.Bounding)  # -> Area, Centroid
xy = XYPlane(Origin=area.Centroid)
scale_nu = ScaleNU(Geometry=rectangle.Rectangle, Plane=xy, ScaleX=1, ScaleY=Slider(1.1, range=0..5), ScaleZ=1)  # -> Geometry, Transform

rint = RegionIntersection(CurvesA=offset, CurvesB=scale_nu.Geometry)
bbox_2 = BoundingBox(Content=flatten(rint), Plane=PlaneXY(0, 0, 0), UnionBox=True)  # -> Box, Box_2
debox_2 = DeconstructBox(Box=bbox_2.Box)  # -> Plane, X, Y, Z
rectangle_2 = Rectangle(Plane=debox_2.Plane, XSize=debox_2.X, YSize=debox_2.Y, Radius=0)  # -> Rectangle, Length

offset_2 = Offset(Curve=rectangle_2.Rectangle, Distance=neg, Plane=PlaneXY(0, 0, 0), Corners=1)  # -> flatten(Curve)
explode = Explode(Curve=offset_2, Recursive=True)  # -> Segments, Vertices
curvepoint = PointOnCurve(explode.Segments, parameter=0.5)
pdecon = Deconstruct(Point=curvepoint)  # -> XComponent, YComponent, ZComponent
sort = SortList(Keys=pdecon.YComponent, ValuesA=explode.Segments)  # -> Keys, ValuesA
item = ListItem(List=sort.ValuesA, Index=0, Wrap=True)
dispatch = Dispatch(List=item, DispatchPattern=repeat)  # -> ListA, ListB
flip = FlipCurve(Curve=dispatch.ListA)  # -> Curve, Flag
merge = Merge(Data1=flip.Curve, Data2=dispatch.ListB)
cp = ControlPoints(Curve=merge)  # -> flatten(Points), Weights, Knots
pline = PolyLine(Vertices=cp.Points, Closed=False)
outskirt = PythonScript(
    curve=pline,
    width=width_2,
    nozzleDia=nozzlediameter_2,
    fillamentDia=fillamentdia_2,
    GenerateCode=blocktocode_2,
    layerheight=constraintlayerheight_2,
    dir="0")  # -> code; inputs curve: list
# ---------- outskirt: Python ----------
import rhinoscriptsyntax as rs
import math
if(curve):
    block = curve
    height = layerheight
    blockOutline = block[0]
    everything = block
    code = GenerateCode(block, nozzleDia, fillamentDia,layerheight,height,dir, 5000)
    startingHeight = 0.
# ---------- end outskirt ----------
item_2 = ListItem(List=reverse(offset_2), Index=0, Wrap=True)
offset_3 = Offset(Curve=item_2, Distance=expr("-x", nozzlediameter_2), Plane=PlaneXY(0, 0, 0), Corners=1)  # -> flatten(Curve)
plotboundary = Curve(offset_3)
outskirtcode = Data(outskirt)
plotboundary_2 = ClusterOutput(plotboundary)
outskirtcode_2 = ClusterOutput(outskirtcode)

# ==== cluster HeaderFooter
machine = ClusterInput()
panel = Panel("""G90
M82
M106 S0
; 02.2019 - BigRep ONE Standard Extruder - PLA - 1 mm nozzle
M800
M104 S205 H0
M104 S0 H1
M109 S205 H0
;M109 S205 H1
T0
G28 ; home all axes
T1 ; solve firmware bug
G92 E0 ; solve firmware bug
T0 ; solve firmware bug
G92 E0 ; solve firmware bug
; process Constrain_bigx
; layer 1, Z = 0.200
T0
; tool H0.200 W1.200""")
machine_2 = Integer(machine)
panel_2 = Panel("""G90
M83
; **** Replicator 2X start.gcode ****
M73 P0 ; Enable build progress
G162 X Y F3000 ; Home XY maximum
G161 Z F1200 ; Home Z minimum
G92 Z-5 ; Set Z to -5
G1 Z0 ; Move Z to 0
G161 Z F100 ; Home Z slowly
M132 X Y Z A B ; Recall home offsets
M135 T0 ; Load right extruder offsets
G1 X-130 Y-75 Z30 F5000 ; Move to wait position off table
G130 X20 Y20 Z20 A20 B20 ; Lower stepper Vrefs while heating
M127 ; Set fan speed
M140 S0 T0 ; Heat buildplate
M104 S210 T0 ; Heat right extruder
M133 T0 ; Stabilize extruder temperature
G130 X127 Y127 Z40 A127 B127 ; Default stepper Vref
G92 A0 B0 ; Zero extruders
G1 X100 Y-70 F9000 ; Move to front right corner of bed
G1 Z0.3 F6000 ; Move down to purge
G1 X-90 Y-70 E24 F2000 ; Extrude a line of filament across the front edge of the bed
G1 X-100 Y-70 F180 ; Wait for ooze
G1 X-110 Y-70 F5000 ; Fast wipe
G1 Z0.5 F100 ; Lift
G92 A0 B0 ; Zero extruders
M73 P1 ;@body (notify GPX body has started)
; **** end of start.gcode ****""")
machine_3 = ClusterOutput(machine_2)
panel_3 = Panel("""G92 E0.0000
G1 E-1.0000 F1800
; layer end
G92 E0
G1 E-5.0000 F1800 ; Reatract Filament
G91
G1 Z10 F4000 ; Lift Extruders
G90
G1 X5 F4000
G1 Y1000 F4000
T0
M104 S0 H0 ; turn off T0
M104 S0 H1 ; turn off T1
M107 P0
M107 P1
M140 S0 ; turn off bed
M84 ; disable motors
M801""")
panel_4 = Panel("""; **** Replicator 2X end.gcode ****
M73 P100 ; end build progress
G1 Z155 F1000 ; send Z axis to bottom of machine
M140 S0 T0 ; cool down HBP
M104 S0 T0 ; cool down right extruder
M104 S0 T1 ; cool down left extruder
M127 ; stop blower fan
G162 X Y F3000 ; home XY maximum
M18 ; disable stepper
M72 P1 ; play Ta-Da song
; **** end of end.gcode ****""")
p_n_c = PickNChoose(Pattern=machine_2, Stream0=panel, Stream1=panel_2)
d3 = ClusterInput()
merge = Merge(Data1=flatten(p_n_c), Data2=flatten("G1 Z0.600 F1200"), Data3=flatten(d3))
p_n_c_2 = PickNChoose(Pattern=machine_2, Stream0=panel_3, Stream1=panel_4)
header = PythonScript(codes=merge)  # -> code; inputs codes: list
# ---------- header: Python ----------
temp = []
for code in codes:
    if(code):
        temp += code.splitlines()
code = "\n".join(temp) + "\n"
# ---------- end header ----------
footer = PythonScript(codes=p_n_c_2)  # -> code; inputs codes: list
# ---------- footer: Python ----------
temp = []
for code in codes:
    temp += code.splitlines()
code = "\n".join(temp)
# ---------- end footer ----------
code = ClusterOutput(header)
code_2 = ClusterOutput(footer)

# ==== cluster Flatten_edge_crvs
srf = ClusterInput()
srf_2 = Surface(srf)
debrep = DeconstructBrep(Brep=srf_2)  # -> Faces, Edges, Vertices
python = GhPythonScript(crvs=debrep.Edges)  # -> crv_1, crv_2, crv_3, crv_4; inputs crvs: list of Curve
# ---------- python: Python ----------
import Rhino.Geometry as rg

print len(crvs[1:])
Crvs = crvs[1:]

for i,c in enumerate(Crvs):
    event = rg.Intersect.Intersection.CurveCurve(crvs[0],c,0.001,0.001)
    if not event:
        crv_2 = c
        Crvs.pop(i)

crv_1 = crvs[0]
crv_3,crv_4 = Crvs
# ---------- end python ----------
debrep_2 = DeconstructBrep(Brep=srf_2)  # -> Faces, Edges, Vertices
end = EndPoints(Curve=python.crv_1)  # -> Start, End
end_2 = EndPoints(Curve=python.crv_2)  # -> Start, End
crv = Curve(python.crv_1)
crv_2 = Curve(python.crv_4)
crv_3 = Curve(python.crv_2)
crv_4 = Curve(python.crv_3)
box = Box(debrep_2.Faces)
ln = Line(StartPoint=end.End, EndPoint=end_2.End)
len = Length(Curve=crv)
len_2 = Length(Curve=crv_3)
len_3 = Length(Curve=crv_4)
len_4 = Length(Curve=crv_2)
offsetbrep = OffsetBrep(Brep=box, OffsetDistance="220", Solid=False, SharpEdges=True, Tolerance=0.001)
project = Project(Curve=ln, Brep=srf_2, Direction=Vector(0, 0, 1))
A = ClusterInput()
B = ClusterInput()
subtraction = Subtraction(A=end_2.End, B=end.End)
merge = Merge(Data1=crv, Data2=crv_3, Data3=crv_4, Data4=crv_2)
area = Area(Geometry=offsetbrep)  # -> Area, Centroid
number_slider = Slider(-31, range=-100..50)
len_5 = Length(Curve=project)
devec = DeconstructVector(Vector=subtraction)  # -> XComponent, YComponent, ZComponent
vec = VectorXYZ(XComponent=devec.XComponent, YComponent=devec.YComponent, ZComponent=0)  # -> unitize(Vector), Length
addition = Addition(A=len_5, B=Slider(-16, range=-100..50))
scale_nu = ScaleNU(Geometry=offsetbrep, Plane=area.Centroid, ScaleX=1, ScaleY=Slider(0.8, range=0..1), ScaleZ=1)  # -> Geometry, Transform
number_slider_2 = Slider(-0.044, range=-1..1)
number_slider_3 = Slider(-0.062, range=-1..1)
line = LineSDL(Start=end.End, Direction=vec.Vector, Length=addition)
line_2 = Line(line)
rotate = Rotate(Geometry=line_2, Angle=Slider(0.064, range=-1..1), Plane=end.End)  # -> Geometry, Transform
end_3 = EndPoints(Curve=rotate.Geometry)  # -> Start, End
pt = Point(end_3.Start)
cir = Circle(Plane=end_3.Start, Radius=len)
cir_2 = Circle(Plane=end_3.Start, Radius=len_3)
cir_3 = Circle(Plane=end_3.End, Radius=len_4)
cir_4 = Circle(Plane=end_3.End, Radius=len_2)
flip = FlipCurve(Curve=rotate.Geometry)  # -> Curve, Flag
ccx = CurveCurve(CurveA=cir, CurveB=cir_3)  # -> Points, ParamsA, ParamsB
ccx_2 = CurveCurve(CurveA=cir_2, CurveB=cir_4)  # -> Points, ParamsA, ParamsB
merge_2 = Merge(Data1=ccx.Points, Data2=ccx_2.Points)
python_2 = GhPythonScript(brep=scale_nu.Geometry, pts=merge_2, pts_a=ccx.Points, pts_b=ccx_2.Points, length=len)  # -> out, corner_pts; inputs brep: Brep, pts: list of Point3d, pts_a: list of Point3d, pts_b: list of Point3d
# ---------- python_2: Python ----------
import Rhino.Geometry as rg
import ghpythonlib.components as gh
import scriptcontext as sc

U = sc.sticky["U"]
V = sc.sticky["V"]
corner_pts = []

if U != V:
    for pt in pts:
        if brep.IsPointInside(pt,0.001,True):
            corner_pts.append(pt)
else:
    for p in pts_b:
        dis = pts_a[0].DistanceTo(p)
        if dis > length:
            corner_pts.append(p)
            corner_pts.append(pts_a[0])
# ---------- end python_2 ----------
item = ListItem(List=python_2.corner_pts, Index=0, Wrap=True)  # -> Item, Item1
W = ClusterInput()
srf4pt = _4PointSurface(CornerA=item.Item, CornerB=end_3.End, CornerC=item.Item1, CornerD=end_3.Start)
W_2 = Data(W)
debrep_3 = DeconstructBrep(Brep=srf4pt)  # -> Faces, reparameterize(Edges), Vertices
addition_2 = Addition(A=W_2, B="5")
python_3 = GhPythonScript(line_crvs=debrep_3.Edges, crvs=merge, w=addition_2, edge_crvs=merge)  # -> trimed_flat_crvs_sorted, edge_crvs_sorted; inputs line_crvs: list of Curve, crvs: list of Curve, edge_crvs: list of Curve
# ---------- python_3: Python ----------
import Rhino.Geometry as rg
import ghpythonlib.components as gh
import scriptcontext as sc

def trim_crv(crv,w):
    crv.Domain = rg.Interval(0,1)
    l = crv.GetLength(rg.Interval(0,1))
    pr = w*0.8/l
    c1 = crv.Split(pr)[1]
    t_crv = c1.Split(1-pr)[0]
    return t_crv

trimed_flat_crvs = [trim_crv(l,w) for l in line_crvs]
len_crves = [crv.GetLength() for crv in edge_crvs]
len_f_crves = [crv.GetLength() for crv in trimed_flat_crvs]
print len_f_crves
len_crves, edge_crvs_sorted = zip(*sorted(zip(len_crves, edge_crvs)))
len_f_crves, trimed_flat_crvs_sorted = zip(*sorted(zip(len_f_crves, trimed_flat_crvs)))
l = [c.GetLength() for c in trimed_flat_crvs_sorted]
print l
# ---------- end python_3 ----------
number_slider_4 = Slider(0, range=0..3)
flip_2 = FlipCurve(Curve=python_3.trimed_flat_crvs_sorted)  # -> Curve, Flag
item_2 = ListItem(List=python_3.edge_crvs_sorted, Index=number_slider_4, Wrap=True)
trimed_flat_crvs = ClusterOutput(flip_2.Curve)
edge_crvs = ClusterOutput(python_3.edge_crvs_sorted)
item_3 = ListItem(List=flip_2.Curve, Index=number_slider_4, Wrap=True)

# ==== cluster Cluster
crv = ClusterInput()
R = ClusterInput()
crv_2 = Curve(crv)
id = ClusterInput()
deg = Degrees(Radians=R)
python = GhPythonScript(id=id, crvs=crv_2)  # -> arch, bend, line; inputs id: list, crvs: list of Curve
# ---------- python: Python ----------
import Rhino.Geometry as rg

bool = []
arch = []
bend = []
line = []
for i,c in zip(id,crvs):
    if i == 'a':
        arch.append(c)
    elif i == 'b' :
        bend.append(c)
    else :
        line.append(c)
# ---------- end python ----------
midpt = CurveMiddle(Curve=crv_2)
D = ClusterOutput(deg)
Z = UnitZ(Factor=Slider(100, range=0..100))
line = ClusterOutput(python.line)
arch = ClusterOutput(python.arch)
bend = ClusterOutput(python.bend)
move = Move(Geometry=midpt, Motion=Z)  # -> Geometry, Transform
G = ClusterOutput(move.Geometry)

# ==== cluster Cluster_2
trimed_flat_crvs = ClusterInput()
W = ClusterInput()
trimed_flat_crvs_2 = Data(trimed_flat_crvs)
nozzle = ClusterInput()
W_2 = Data(W)
nozzle_2 = Data(nozzle)
offcrv = OffsetCurve(Curve=trimed_flat_crvs_2, Plane=PlaneXY(0, 0, 0), Distance=expr("x/2", W_2), BothSides=True, Kinks=0, CapType=1)
explode = Explode(Curve=offcrv, Recursive=True)  # -> simplify(flatten(Segments)), Vertices
python = GhPythonScript(crvs=explode.Segments)  # -> out, sorted_lines; inputs crvs: list of Curve
# ---------- python: Python ----------
import Rhino.Geometry as rg
import ghpythonlib.components as gh


lines = [c for c in crvs if  c.GetLength() <50 ]
sorted_lines = []


for l in lines:
    lines.remove(l)
    dis = []
    i = 0
    while i < len(lines):
        m1 = gh.CurveMiddle(l)
        m2 = gh.CurveMiddle(lines[i])
        d = m1.DistanceTo(m2)
        dis.append(d)
        i += 1
    dis,s_lines = zip(*sorted(zip(dis,lines)))
    sorted_lines.append(l)
    sorted_lines.append(s_lines[0])
# ---------- end python ----------
divide_list = DivideList(List=python.sorted_lines, Number=4)  # -> Chunk, Remainder
item = ListItem(List=divide_list.Chunk, Index=0, Wrap=True)  # -> Item, Item1
edgesrf = EdgeSurface(CurveA=item.Item, CurveB=item.Item1)
offset = OffsetCurve(Curve=edgesrf, Distance=expr("-x*0", nozzle_2), Corners=1)
offset_2 = OffsetCurve(Curve=offset, Distance=expr("-x", nozzle_2), Corners=1)  # -> simplify(Curve)
explode_2 = Explode(Curve=offset_2, Recursive=True)  # -> Segments, Vertices
patch = Patch(Curves=offset_2, Spans=20, Flexibility=1, Trim=True)  # -> simplify(Patch)
item_2 = ListItem(List=explode_2.Segments, Index=0, Wrap=True)  # -> Item, Item1, Item2, Item3
end = EndPoints(Curve=item_2.Item2)  # -> Start, End
end_2 = EndPoints(Curve=item_2.Item)  # -> Start, End
subtraction = Subtraction(A=end.Start, B=end.End)
subtraction_2 = Subtraction(A=end_2.Start, B=end_2.End)
contour = Contour(Curve=patch, Point=Point(0, 0, 0), Direction=subtraction, Distance="2.5")  # -> Contours, Parameters
contour_2 = Contour(Curve=patch, Point=Point(0, 0, 0), Direction=subtraction_2, Distance="2.5")  # -> Contours, Parameters
pline = PolyLine(Vertices=contour_2.Contours, Closed=False)
pline_2 = PolyLine(Vertices=contour.Contours, Closed=False)
trim = TrimTree(Tree=pline, Depth=1)
trim_2 = TrimTree(Tree=pline_2, Depth=1)
item_3 = ListItem(List=trim, Index=0, Wrap=True)
item_4 = ListItem(List=trim_2, Index=0, Wrap=True)
flip = FlipCurve(Curve=trim, Guide=item_3)  # -> Curve, Flag
flip_2 = FlipCurve(Curve=trim_2, Guide=item_4)  # -> Curve, Flag
cull = CullPattern(List=flip.Curve, CullPattern=[False, True])
cull_2 = CullPattern(List=flip_2.Curve, CullPattern=[False, True])
item_5 = ListItem(List=cull, Index=-1, Wrap=True)
cull_3 = CullPattern(List=flip.Curve, CullPattern=[True, False])
item_6 = ListItem(List=cull_2, Index=-1, Wrap=True)
cull_4 = CullPattern(List=flip_2.Curve, CullPattern=[True, False])
flip_3 = FlipCurve(Curve=cull_3)  # -> Curve, Flag
flip_4 = FlipCurve(Curve=cull, Guide=item_5)  # -> Curve, Flag
flip_5 = FlipCurve(Curve=cull_4)  # -> Curve, Flag
flip_6 = FlipCurve(Curve=cull_2, Guide=item_6)  # -> Curve, Flag
weave = Weave(Pattern=[1, 0, 1, 0], Stream0=flip_4.Curve, Stream1=flip_3.Curve, NullGaps=False)
weave_2 = Weave(Pattern=[1, 0, 1, 0], Stream0=flip_6.Curve, Stream1=flip_5.Curve, NullGaps=False)
explode_3 = Explode(Curve=weave, Recursive=True)  # -> Segments, Vertices
explode_4 = Explode(Curve=weave_2, Recursive=True)  # -> Segments, Vertices
trim_3 = TrimTree(Tree=explode_3.Vertices, Depth=1)
trim_4 = TrimTree(Tree=explode_4.Vertices, Depth=1)
pline_3 = PolyLine(Vertices=trim_3, Closed=False)
pline_4 = PolyLine(Vertices=trim_4, Closed=False)
merge = Merge(Data1=simplify(offset), Data2=simplify(pline_3))
merge_2 = Merge(Data1=simplify(offset), Data2=simplify(pline_4))
joint_a = Data(merge)
joint_b = Data(merge_2)
joint_a_2 = ClusterOutput(joint_a)
joint_b_2 = ClusterOutput(joint_b)
