# Grasshopper definition chebychev_WIP.gh (Grasshopper 1.0.7)
# plug-ins: Human

# ----
# Direction of u
u = Slider(0.5, range=0..1)

# ----
# Surface
srf = Surface(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)

# ----
# Starting point
pt = Point(Point(0, 0, 0))

# ----
# Diff in angle bwtn u and v
number_slider = Slider(0.5, range=0..1)

# ----
# Length between neighbouring curves in the same family
number_slider_2 = Slider(74.617, range=0..300)

srf_cp = SurfaceClosestPoint(Point=pt, Surface=srf)  # -> Point, UVPoint, Distance
X = UnitX(Factor=1)
pi = Pi(Factor=u)
pi_2 = Pi(Factor=number_slider)
rotate = Rotate(Geometry=X, Angle=pi, Plane=PlaneXY(0, 0, 0))  # -> Geometry, Transform
rotate_2 = Rotate(Geometry=rotate.Geometry, Angle=pi_2, Plane=PlaneXY(0, 0, 0))  # -> Geometry, Transform
vec = Vector([rotate.Geometry, rotate_2.Geometry])
python = GhPythonScript(initP=srf_cp.Point, dir=vec, L=number_slider_2, bSrf=srf)  # -> UV, pUV; inputs initP: Point3d, dir: list, bSrf: Brep
#   port initP: Starting point
# ---------- python: Python ----------
import ghpythonlib.treehelpers as th
import rhinoscriptsyntax as rs
import math
import Rhino.Geometry as rg

def linearMap(initP, dir1, dir2, L):
    pList=[]
    pList.append(initP)
    prevP=initP
    first=True
    while True:
        cirPlane = rg.Plane(prevP,dir2) # Create a plane orthogonal to dir2
        cirCrv = rg.Circle(cirPlane,L) # Create a circle on that plane
        c_crv = cirCrv.ToNurbsCurve(5,12)
        _,intPara_arr = rg.Intersect.Intersection.CurveBrep(c_crv ,bSrf,0.001,0.00)# Comput the intersection between the circle and the surface
        intPara = list(intPara_arr)
        intP = [c_crv.PointAt(param) for param in intPara]
        if first==True: # The first circle may have two equidistant intersection points
            first=False
            testP_ID=rs.CopyObject(initP,dir1*2)
            testP = rs.coerce3dpoint(testP_ID)# Create a test point in the positive dir1 direction
            if len(intP)>1: # if there are two intersections, that means there's a point on either side of the initP
                if testP.DistanceTo(intP[0])>testP.DistanceTo(intP[1]):# The one that's closer to the test point is retained
                    tempP=intP[0]
                else:
                    tempP=intP[1]
            elif len(intP)==1: # if there's one point then pick that point, this happens when the initP is close to the edge of the surface
                if testP.DistanceTo(intP[0])>initP.DistanceTo(intP[0]):
                    tempP=intP[0]
                else:
                    break
            else: # else there is no intersection
                break
        else: # subsequent circles
            if len(intP)>1: # If there are two intersecting points, so it hasn't fallen off the surface
                if initP.DistanceTo(intP[0])>initP.DistanceTo(intP[1]):# retain the point that's not already on the list
                    tempP=intP[0]
                else:
                    tempP=intP[1]
            else:
                break
                
        prevP=tempP
        pList.append(tempP) 
    return pList

pTreeU=[]
pTreeV=[]
        
numQuad=4

idx=[[1,1],[-1,1]]
for i in idx:
    pTreeU.append(linearMap(initP,i[0]*dir[0],i[1]*dir[1],L))

pTreeU.append(pTreeU[1])
pTreeU.append(pTreeU[0])

idx=[[1,1],[-1,-1]]

for i in idx:
    pTreeV.append(linearMap(initP,i[0]*dir[1],i[1]*dir[0],L))

pTreeV=[val for val in pTreeV for _ in (0, 1)]

pUV=th.list_to_tree([pTreeU,pTreeV])
UV=th.list_to_tree([[len(pTreeU[k]) for k in range(numQuad)],[len(pTreeV[k]) for k in range(numQuad)]])
# ---------- end python ----------
pt_2 = Point(python.pUV)
item = ListItem(List=pt_2, Index=0, Wrap=True)
python_2 = GhPythonScript(UVi=python.UV)  # -> pId, GridId, BinId; inputs UVi: tree
# ---------- python_2: Python ----------
"""Create an diagonally incrementing matrix, and the two previous IDs each ID is associated with

    Inputs:
        UVi: Number of points in UV directions in the four quadrants
    Output:
        pId: Tuples of (n0, n1, n2) n1 and n2 are origins of the sphere, 
        n0 is one intersection between the circle and the surface
        gridId: The diagonally incrementing matrix"""
                
__author__ = "Tim Chen"
__version__ = "2018.05.10"
        
import ghpythonlib.treehelpers as th
import rhinoscriptsyntax as rs

numQuad=4

diaGridIdTree=[]
diaBinIdTree=[]
pIdTree=[]

nU=UVi.Branches[0]   
nV=UVi.Branches[1]

# Trim a tree row wise then column wise
def trimTree(listIn):
    listOut=[]
    for i in range(len(listIn)):
        for j in range(len(listIn[0])):
                listOut.append(listIn[i][j])
                
    return listOut
    
# Sort a list based on foreign keys using dictionary
def sortList(key,value):
    sortedList=[]
    for i in range(len(key)):
        testDic=dict(zip(key[i],value[i]))
        sortedList.append(testDic.values())
    return sortedList

for i in range(numQuad): # Loop through each of the four quadrants
    diaGridId=[]
    diaBinId=[]
    pId=[]
    pCoord=[]

    diaGridId=[range(nV[i]) for x in  range(nU[i])]
    diaBinId=[range(nV[i]) for x in  range(nU[i])]
                    
    # Create a diagonally incrementing matrix       
    m=0
    for p in range(nU[i]+nV[i]-1):
        for q in range(max(p-nU[i]+1,0),min(p+1,nV[i])):
            diaGridId[p-q][q]=m
            m=m+1

    # For woven fabric, create a matrix of 1 and -1, so that the weft and warp can move "up" and "down"
    m=-1
        
    for p in range(nU[i]):
        if p>0:
            if nV[i]%2==0: # Even
                m=-diaBinId[p-1][0]
        for q in range(nV[i]):
            diaBinId[p][q]=m
            m=-m
    
    # Calculate the id of the neigbouring quads
    for j in range(nU[i]):
        for k in range(nV[i]):
            pId.append([diaGridId[j-1][k-1],diaGridId[j][k-1],diaGridId[j-1][k]])
    diaGridIdTree.append(trimTree(diaGridId))
    diaBinIdTree.append(trimTree(diaBinId))
    pIdTree.append(pId)

pId         =   th.list_to_tree(sortList(diaGridIdTree,pIdTree))
GridId      =   th.list_to_tree(diaGridIdTree)
BinId       =   th.list_to_tree(diaBinIdTree)
# ---------- end python_2 ----------
python_3 = GhPythonScript(
    UVi=python.UV,
    pUVi=python.pUV,
    pId=python_2.pId,
    GridId=python_2.GridId,
    BinId=python_2.BinId,
    bSrf=srf,
    L=number_slider_2,
    wPD=Slider(0, range=0..10))  # -> pCoord, orthoLines, weftLine, warpLine; inputs UVi: tree, pUVi: tree, pId: tree, GridId: tree of Int32, BinId: tree
# ---------- python_3: Python ----------
"""Generate Chebychev net on the given surface
    Inputs:
        x: The x script variable
        y: The y script variable
    Output:
        a: The a output variable"""
                
import ghpythonlib.treehelpers as th
import rhinoscriptsyntax as rs
import math


# trim a tree down one level
def trimTree(listIn):
    listOut=[]
    for i in range(len(listIn)):
        for j in range(len(listIn[0])):
                listOut.append(listIn[i][j])
    return listOut
    
# sort a list using a dictionary
def sortList(key,value):
    testDic=dict(zip(key,value))
    return testDic.values()

# flatten a matrix into a list
def truncMat(mat,i,l):
    temp=zip(*[iter(list(mat))]*l)
    temp2=[sortedId[i:] for sortedId in temp[i:]]
    return [item for sublist in temp2 for item in sublist]

# Calculate the centroid of given list of points
def avgPtFun(p):
    X=0
    Y=0
    Z=0
    numPt=len(p)
    for pi in p:
        i=rs.coerce3dpoint(pi)
        X=X+i.X
        Y=Y+i.Y
        Z=Z+i.Z
    return rs.AddPoint([X/numPt,Y/numPt,Z/numPt])

# Number of points in each of the principles directions in each quadrants
nU=UVi.Branches[0]
nV=UVi.Branches[1]

# Points along the two principle directions
pU=[pUVi.Branch(0,0,x) for x in range(4)]
pV=[pUVi.Branch(0,1,x) for x in range(4)]

orthoLines=[]
weftLine=[]
warpLine=[]

numQuad=4 # Number of quadrants to compute for

pListID=[1,0,2,3] # Numbering of the vertices in a quad

pCoord=[]
pCoordW=[]

pId=th.tree_to_list(pId)
pTemp=rs.AddPoint([0,0,0])

QuadOrder=[[1,0,2,3],[0,1,3,2],[2,3,1,0],[3,2,0,1]]

for i in range(numQuad): # For the four quadrant

    pCoordQuad=[[pTemp for j in range(nV[i])] for k in range(nU[i])]
    
    for j in range(nU[i]):
        pCoordQuad[j][0]=pU[i][j]
                
    for j in range(nV[i]):
        pCoordQuad[0][j]=pV[i][j]

    pCoord.append(sortList(GridId.Branch(i),trimTree(pCoordQuad)))
    
for i in range(numQuad): # For the four quadrant

    pCoordList=pCoord[i]
    pIdList=pId[i]
    quadOrderI=QuadOrder[i]
    
    subGridIdList=truncMat(GridId.Branch(i), 1, nV[i])
    
    subBinIdList=sortList(GridId.Branch(i),BinId.Branch(i))
    
    p=[0,0,0,0]
    
    # loop through all the points that are not on the principle direction
    for subGridId in subGridIdList:
        
        exist=0
        [pID0,pID1,pID2]=pIdList[subGridId]
        
        p[0]=pCoordList[int(pID0)]
        p[1]=pCoordList[int(pID1)]
        p[2]=pCoordList[int(pID2)]
        
        d=rs.Distance(p[1],p[2])
        
        r=L
        
        if d!=0:
            
            x = d/2 # Angle of intersecting spheres http://mathworld.wolfram.com/Sphere-SphereIntersection.html
            
            dLine=rs.AddLine(p[1],p[2]) # Add a diagonal line
            dVec=rs.VectorCreate(p[2],p[1]) # Create vector
            
            cP=rs.CurveMidPoint(dLine) # Find the mid point of the diagonal line
            a=rs.Distance(p[0],cP) # Distance between p[0] and intersection
            pP=rs.PlaneFromNormal(cP,dVec) # create plane to 
            cir=rs.AddCircle(pP,a) #Create the circle
                    
            intP=rs.CurveBrepIntersect(cir,bSrf) # Find the intersection between the circle and the surface
                    
            if intP!=None: #If there is intersection
                intP=intP[1]
                        
                if len(intP)>1: # If both vertices are on the surface
                    if rs.Distance(p[0],intP[0])>rs.Distance(p[0],intP[1]): # Retain the vertex that is not overlapping with original vertex
                        p[3]=intP[0]
                    else:
                        p[3]=intP[1]
                        
                    testDis=[abs(rs.Distance(p[pListID[i-1]],p[pListID[i]])-L)>0.001 for i in range(4)] # if the vertices aren't overlapping
                    
                    if any(testDis)!=True: 
                        # Record the new vertices
                        pCoordList[subGridId]=p[3]
                        
                        avgPt=avgPtFun(p) # average vertices
                        
                        # Create quad polyline
                        lines=[rs.AddLine(p[pListID[i-1]],p[pListID[i]]) for i in range(4)]
                        orthoLines.append(rs.JoinCurves(lines))
                        
                        # Find normal at all four vertices
                        normal = [rs.BrepClosestPoint(bSrf, p[i])[3] for i in range(4)]
                         
                        #weft lines
                        weftSign=[subBinIdList[int(pID0)],subBinIdList[int(pID1)],subBinIdList[int(pID2)],subBinIdList[int(subGridId)]]
                        weftP=[rs.CopyObject(p[i],wPD*normal[i]*x) for i,x in enumerate(weftSign)]
                        
                        # move up and down and store
                        weftLine.append(rs.AddLine(weftP[quadOrderI[1]],weftP[quadOrderI[2]]))
                        weftLine.append(rs.AddLine(weftP[quadOrderI[0]],weftP[quadOrderI[3]]))
                        
                        #warp lines
                        warpSign=[-subBinIdList[int(pID0)],-subBinIdList[int(pID1)],-subBinIdList[int(pID2)],-subBinIdList[int(subGridId)]]
                        warpP=[rs.CopyObject(p[i],wPD*normal[i]*x) for i,x in enumerate(warpSign)]
                        
                        # move up and down and store
                        warpLine.append(rs.AddLine(warpP[quadOrderI[1]],warpP[quadOrderI[0]]))
                        warpLine.append(rs.AddLine(warpP[quadOrderI[2]],warpP[quadOrderI[3]]))
                        
                        exist=1
                        
        if exist==0: # If intersection cannot be found, add a None so datastructure is preserved
            weftLine.append(None)
            weftLine.append(None)
            warpLine.append(None)
            warpLine.append(None)
            orthoLines.append([None])
            
pCoord=th.list_to_tree(pCoord)
orthoLines=th.list_to_tree(orthoLines)

weftLine=th.list_to_tree(weftLine)
warpLine=th.list_to_tree(warpLine)
# ---------- end python_3 ----------
multiplication = Multiplication(A=vec, B=Slider(20, range=20..50))
pt_3 = Point(Point(0, 0, 0))
crv = Curve(reparameterize(simplify(python_3.orthoLines)))
preview = CustomPreview(
    Geometry=python_3.warpLine,
    Material={diffuse=RGB(31, 64, 122), emission=RGB(9, 19, 37), shine=0.5, specular=RGB(255, 255, 255), transparency=1})
preview_2 = CustomPreview(
    Geometry=python_3.orthoLines,
    Material={diffuse=RGB(168, 50, 45), emission=RGB(50, 15, 14), shine=0.5, specular=RGB(255, 255, 255), transparency=1})
vdis = VectorDisplay(Anchor=pt_3, Vector=multiplication)
project = Project(Curve=crv, Brep=srf, Direction=Vector(0, 0, 1))
previewlw = CustomPreviewLineweights(Geometry=project, Shader=ColourSwatch(SwatchColor=RGB(98, 149, 227)), Thickness=Slider(9, range=0..100), Absolute=False)
panel = Panel(python_2.BinId)
