# Grasshopper definition chebyshev_4D_mesh.gh (Grasshopper 1.0.7)
# plug-ins: Human UI

crv = Curve([<curve referenced from the Rhino model> x6])
pipe = Pipe(Curve=crv, Radius=2, Caps=2)

preview = Panel("""3D surface
Mesh
Flattened Mesh
Bending Representation Top
Bending Representation Bottom
Printing Path
Obj Model""")
toggle = CreateToggle(Default=[True, True, False, False, False, False, False])  # -> graft(Toggle)
label = CreateLabel(LabelText=preview, LabelSize=18, Justification=0)  # -> graft(Label)
merge = Merge(Data1=toggle, Data2=label)
stack = CreateStack(UIElements=merge, Horizontal=True)  # -> flatten(Stack)
values = ValueListener(Elements=stack, SomeProperty=True)  # -> flatten(Values), Indices
cull = CullPattern(List=values.Values, CullPattern=[True, False])
item = ListItem(List=cull, Index=0, Wrap=True)  # -> Item, Item1, Item2, Item3, Item4, Item5, Item6
shrinkage_rep_top_preview = Boolean(item.Item3)
flattened_mesh_preview = Boolean(item.Item2)
printing_path_preview = Boolean(item.Item5)
surface_preview = Boolean(item.Item)
mesh_preview = Boolean(item.Item1)
obj_preview = Boolean(item.Item6)
ui_elements = Data(stack)

print_parameters = Panel("""Actuator Layer Height
Passive Unit Layer Height
Infill Rate
Element Width
Element Height""")
label_2 = CreateLabel(LabelText=print_parameters, LabelSize=12, Justification=0)
slider = CreateSlider(
    Slider=[Slider(0.2, range=0..1), Slider(0.4, range=0..1), Slider(0.5, range=0..1), Slider(7.3, range=4..10), Slider(4, range=0..5)],
    SnapValue=0.1,
    ShowBounds=True,
    ShowTicks=True,
    ShowTooltip=False,
    ShowValLabel=True,
    showLabel=False)
weave = Weave(Pattern=[0, 1], Stream0=label_2, Stream1=slider, NullGaps=False)
values_2 = ValueListener(Elements=slider, SomeProperty=True)  # -> flatten(Values), Indices
item_2 = ListItem(List=values_2.Values, Index=0, Wrap=True)  # -> Item, Item1, Item2, Item3, Item4
constraintlayerheight = Number(item_2.Item1)
actuatorlayerheight = Number(item_2.Item)
ui_elements_2 = Data(weave)
height = Number(item_2.Item4)
infill = Number(item_2.Item2)
width = Number(item_2.Item3)

preview_2 = Panel("""Save G-code File
Save obj File""")
filepicker = CreateFilePicker(ButtonLabelText="Browse...", DialogType=1, MustExist=True, Filter=["G-code|*.gcode", "object|*.obj"])  # -> graft(FilePicker)
button = CreateButton(ButtonName=["save", "save"], ButtonStyle=0)  # -> graft(Button)
label_3 = CreateLabel(LabelText=preview_2, LabelSize=18, Justification=0)
merge_2 = Merge(Data1=filepicker, Data2=button)
stack_2 = CreateStack(UIElements=merge_2, Horizontal=False)  # -> flatten(Stack)
textbox = CreateTextBox(Label="Area to Plot(0 to plot all)", DefaultText="0", UpdateButton=False, showLabel=True)
values_3 = ValueListener(Elements=stack_2, SomeProperty=True)  # -> flatten(Values), Indices
values_4 = ValueListener(Elements=textbox, SomeProperty=True)  # -> flatten(Values), Indices
weave_2 = Weave(Pattern=[0, 1], Stream0=label_3, Stream1=stack_2, NullGaps=False)
item_3 = ListItem(List=values_3.Values, Index=0, Wrap=True)  # -> Item, Item1, Item2, Item3
ins = InsertItems(List=weave_2, Item=textbox, Indices=1, Wrap=True)
save_g_code = Boolean(item_3.Item1)
g_code_path = Text(item_3.Item)
ui_elements_3 = Data(ins)
obj_path = Text(item_3.Item2)
save_obj = Boolean(item_3.Item3)
area = Integer(values_4.Values)

brep = Brep(pipe)

method_parameters = Panel("""Center U Parameter
Center V Parameter
Segment Length
Tessellation Count
Switch UV
Flip Surface
Extend Edge""")
switchuv = BooleanToggle(False)
flip = BooleanToggle(False)
ext = BooleanToggle(True)
slider_2 = CreateSlider(
    Slider=[Slider(0.5, range=0..1), Slider(0.5, range=0..1), Slider(80, range=30..120), Slider(2, range=1..4)],
    SnapValue=[0.1, 0.1, 1, 1],
    ShowBounds=True,
    ShowTicks=True,
    ShowTooltip=False,
    ShowValLabel=True,
    showLabel=False)
label_4 = CreateLabel(LabelText=method_parameters, LabelSize=18, Justification=0)
toggle_2 = CreateToggle(Default=[switchuv, flip, ext])
merge_3 = Merge(Data1=slider_2, Data2=toggle_2)
values_5 = ValueListener(Elements=merge_3, SomeProperty=True)  # -> flatten(Values), Indices
weave_3 = Weave(Pattern=[0, 1], Stream0=label_4, Stream1=merge_3, NullGaps=False)
item_4 = ListItem(List=values_5.Values, Index=0, Wrap=True)  # -> Item, Item1, Item2, Item3, Item4, Item5, Item6
segmentlength = Number(item_4.Item2)
extendedge = Boolean(item_4.Item6)
ui_elements_4 = Data(weave_3)
tessellation = Integer(item_4.Item3)
flipsurface = Boolean(item_4.Item5)
switchuv_2 = Boolean(item_4.Item4)
U = Number(item_4.Item)
V = Number(item_4.Item1)

preview_3 = CustomPreview(Geometry=brep, Shader=ColourSwatch(SwatchColor=RGB(26, 26, 26)))

machine_parameters = Panel("""Nozzle Diameter
Fillament Diameter""")
label_5 = CreateLabel(LabelText=machine_parameters, LabelSize=12, Justification=0)
slider_3 = CreateSlider(
    Slider=[Slider(0.8, range=0..1), Slider(1.75, range=1..3)],
    SnapValue=[0.1, 0.01],
    ShowBounds=True,
    ShowTicks=True,
    ShowTooltip=False,
    ShowValLabel=True,
    showLabel=False)
weave_4 = Weave(Pattern=[0, 1], Stream0=label_5, Stream1=slider_3, NullGaps=False)
values_6 = ValueListener(Elements=slider_3, SomeProperty=True)  # -> flatten(Values), Indices
item_5 = ListItem(List=values_6.Values, Index=0, Wrap=True)  # -> Item, Item1
fillamentdia = Number(item_5.Item1)
ui_elements_5 = Data(weave_4)
nozzledia = Number(item_5.Item)

toggle_to_reset_interfacr = BooleanToggle(True)
shrinkage_rep_bot_preview = Boolean(item.Item4)
list = ValueList({"original with overkill": 0, "clamped": 1, "5000 everything": 2, "test": 3}, selected="original with overkill")
number = Slider(1, range=0.5..20)
panel = Panel("-130")
panel_2 = Panel("-70")
list_2 = ValueList({"Maker Bot": 1, "Large Printer": 0}, selected="Large Printer")
geo_3 = Surface(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)

srf = Surface(geo_3)
surface_preview_2 = Boolean(surface_preview)
mesh = Mesh(srf)
dispatch = Dispatch(List=mesh, DispatchPattern=surface_preview_2)  # -> ListA, ListB
swatch = ColourSwatch(SwatchColor=RGBA(207, 207, 207, 181))
preview_4 = CustomPreview(Geometry=dispatch.ListA, Shader=swatch)

geo_2 = Surface(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)
geo_1 = Surface(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)

# ---- group: gcode viewer
path = FilePath("C:\Users\Chengyuan Wei\Documents\12_4D_print_mesh\SOURCE\data\G_code_files\Printed\06292021_grid_8X8_half_g3_S3D.gcode")
gcode_viewer = PythonScript(path=path, run=Toggle(True))  # -> out, lines, dist, extrusion, speeds, movement, movementSpeed, time
# ---------- gcode_viewer: Python ----------
import rhinoscriptsyntax as rs
import time
if(run):
    try:
        with open(path, "rt") as code:
            file = code.read().splitlines()
    except:
        file = None
    if(file != None):
        xLast, yLast, zLast, speed, ext = None, None, None, None, None
        xNew, yNew, zNew = None, None, None
        lines, dist, extrusion, speeds, movement, movementSpeed = [], [], [], [], [], []
        for line in file:
            arguments = line.split(" ")
            if(len(arguments)>= 0 and arguments[0] == "G1"):
                # parse info
                for arg in arguments[1:]:
                    if(arg[0] == "X"):
                        xNew = arg[1:]
                    elif(arg[0] == "Y"):
                        yNew = arg[1:]
                    elif(arg[0] == "Z"):
                        zNew = arg[1:]
                    elif(arg[0] == "F" and arg[1:].isalnum()):
                        speed = arg[1:]
                    elif(arg[0] == "E"):
                        ext = arg[1:]
                    elif(arg[0] == ";"):
                        break
               # add to result
                if(xLast != None and xNew != None and \
                   yLast != None and yNew != None and \
                   zLast != None and zNew != None):
                      try:
                          if("E" in line):
                              lines.append(rs.AddLine([xLast, yLast, zLast], [xNew, yNew, zNew]))
                              dist.append(rs.Distance([xLast, yLast, zLast], [xNew, yNew, zNew]))
                              extrusion.append(ext)
                              speeds.append(float(speed))
                          else:
                              movement.append(rs.AddLine([xLast, yLast, zLast], [xNew, yNew, zNew]))
                              movementSpeed.append(float(speed))
                      except:
                          print([xLast, yLast, zLast], [xNew, yNew, zNew])
               # dump new into old
                xLast, yLast, zLast = xNew, yNew, zNew
        time = sum([dist[i] / speeds[i] for i in range(min(len(dist), len(speeds)))]) +\
               sum([rs.CurveLength(movement[i]) / movementSpeed[i] for i in range(min(len(movement), len(movementSpeed)))])
        time *= 2
        time = "%d hours %d minutes" % (time // 60, int(round(time % 60)))
# ---------- end gcode_viewer ----------
num = Number(gcode_viewer.speeds)
division = Division(A=num, B=30)
time = Panel(gcode_viewer.time)
rgb = ColourRGB(Alpha=255, Red=division, Green=division, Blue=255)
preview_5 = CustomPreview(Geometry=gcode_viewer.lines, Shader=rgb)

# ---- group: obj viewer
path_2 = FilePath("C:\Users\humph_000\Desktop\shoulderArmor.obj")
obj_viewer = PythonScript(path=path_2, run=Toggle(True))  # -> out, vertices, edges
# ---------- obj_viewer: Python ----------
import rhinoscriptsyntax as rs

def readFile(path):
    with open(path, "rt") as file:
        text = file.read()
    return text

def objToEdges(file, mode):
    scalar = 1
    file = file.splitlines()
    vCounter, pts = 0, {}
    for line in file:
        if(line[:1] == "v"):
            vCounter += 1
            coor = line.split(" ")[1:]
            if(mode == "F"):
                pts[vCounter] = rs.AddPoint(float(coor[0]) * scalar,
                                            float(coor[2]) * scalar,
                                            float(coor[1]) * scalar)
            elif(mode == "O"):
                pts[vCounter] = rs.AddPoint(float(coor[0]) * scalar,
                                            float(coor[1]) * scalar,
                                            float(coor[2]) * scalar)
    edges = {}
    for line in file:
        valid = line != ""
        if(valid and line[0] == "f"):
            vertices = line.split(" ")[1:]
            for i in range(len(vertices)):
                pt1, pt2 = int(vertices[i % len(vertices)]), int(vertices[(i + 1) % len(vertices)])
                if(pt1 > pt2): coor = pt2, pt1
                else: coor = pt1, pt2
                edges[coor] = rs.AddLine(pts[pt1], pts[pt2])
        elif(valid and line[0] == "l"):
            vertices = line.split(" ")[1:]
            for i in range(len(vertices) - 1):
                pt1, pt2 = int(vertices[i]), int(vertices[i + 1])
                if(pt1 > pt2): coor = pt2, pt1
                else: coor = pt1, pt2
                edges[coor] = rs.AddLine(pts[pt1], pts[pt2])
    return pts, edges

def getScalar(original, flattened):
    scalarMax = 0
    for coor in flattened:
        scalar = rs.CurveLength(original[coor]) / rs.CurveLength(flattened[coor])
        if(scalar > scalarMax):
            scalarMax = scalar
    return scalarMax

def scaleEdges(points, edges, scalar):
    for index in points:
        point = rs.coerce3dpoint(points[index])
        points[index] = rs.AddPoint(point[0] * scalar,
                                    point[1] * scalar,
                                    point[2] * scalar)
    for coor in edges:
        edges[coor] = rs.AddLine(points[coor[0]], points[coor[1]])

def count(file):
    frequency = {}
    file = file.splitlines()
    for line in file:
        if(line != "" and line[0] == "f"):
            vertices = line.split(" ")[1:]
            for i in range(len(vertices)):
                pt1, pt2 = int(vertices[i % 3]), int(vertices[(i + 1) % 3])
                if(pt1 > pt2): coor = pt2, pt1
                else: coor = pt1, pt2
                frequency[coor] = frequency.get(coor, 0) + 1
    result = []
    for edge in frequency:
        if(frequency[edge] == 1): result += [edge]
    return result
file = readFile(path)
vertices, edges = objToEdges(file, "O")
vertices = [vertices[coor] for coor in vertices]
edges = [edges[coor] for coor in edges]
# ---------- end obj_viewer ----------

# ----
area_to_print = Panel(area)
pt = ConstructPoint(XCoordinate="0", YCoordinate="0", ZCoordinate=0)
expander = CreateExpander(UIElements=ui_elements_5, Header="Machine Parameters", Open=True)
expander_2 = CreateExpander(UIElements=ui_elements_2, Header="Print Paramters", Open=True)
expander_3 = CreateExpander(UIElements=ui_elements_4, Header="Method Parameters", Open=True)
expander_4 = CreateExpander(UIElements=ui_elements, Header="Preview Selection", Open=True)
expander_5 = CreateExpander(UIElements=ui_elements_3, Header="Save Files", Open=True)
int = Integer(370)
filename = Panel(g_code_path)
segmentlength_2 = Number(flatten(segmentlength))
switchuv_3 = Boolean(flatten(switchuv_2))
extendedge_2 = Boolean(flatten(extendedge))
pt_2 = ConstructPoint(XCoordinate=flatten(U), YCoordinate=flatten(V), ZCoordinate=0)
flipsurface_2 = Boolean(flatten(flipsurface))
width_2 = Number(flatten(width))
height_2 = Number(flatten(height))
infill_2 = Number(flatten(infill))
shift = Point(pt)
tessellation_2 = Integer(flatten(tessellation))
nozzlediameter = Number(flatten(nozzledia))
save_g_code_2 = Boolean(flatten(save_g_code))
fillamentdia_2 = Number(flatten(fillamentdia))
angleoverkill = Number(flatten(number))
actuatorlayerheight_2 = Number(flatten(actuatorlayerheight))
constraintlayerheight_2 = Number(flatten(constraintlayerheight))
speedmode = Integer(list)
multiplication = Multiplication(A=int, B=2)
multiplication_2 = Multiplication(A=int, B=2.5)
machine = Integer(list_2)
merge_4 = Merge(Data1=expander, Data2=expander_2, Data3=expander_3, Data4=expander_4, Data5=expander_5)
merge_5 = Merge(Data1=flatten(expander), Data2=flatten(expander_2), Data3=flatten(expander_4))  # -> flatten(Result)
merge_6 = Merge(Data1=flatten(expander_3), Data2=flatten(expander_5))  # -> flatten(Result)
adjustpos = AdjustElementPositioning(ElementsToAdjust=[expander, expander_2, expander_3, expander_4, expander_5], AbsolutePositioning=False, Width=int)
accent_colors = ValueList({"Amber", "Blue", "Brown", "Cobalt", "Crimson", "Cyan", "Emerald", "Green", "Indigo", "Lime", "Magenta", "Mauve", "Olive", "Orange", "Pink", "Purple", "Red", "Sienna", "Steel", "Taupe", "Teal", "Violet", "Yellow"}, selected="Steel")
launchwin = LaunchWindow(
    Show=toggle_to_reset_interfacr,
    Name="4DMesh",
    Width=multiplication,
    Height=multiplication_2,
    ChildStatus=1,
    EnableHorizScroll=False)
srf_2 = Surface(geo_3)

bendingjoints = ValueList({"All": 0, "U": 2, "V": 1}, selected="U")
chamferjoints = BooleanToggle(False)
rotatejoint = BooleanToggle(False)
diagen = BooleanToggle(False)
bendingjoints_2 = Integer(bendingjoints)
diagen_2 = Boolean(diagen)
rotatejoint_2 = Boolean(rotatejoint)
chamferjoints_2 = Boolean(chamferjoints)

uv = Point(pt_2)
untrim = Untrim(Surface=srf_2)
machine_prm = PythonScript(machine=machine)  # -> buildShift, platform, FRA
# ---------- machine_prm: Python ----------
import rhinoscriptsyntax as rs
if(machine == 1):
    # makerbot
    w , h = 246, 152
    buildShift = rs.AddPoint(0, 0, 0)
    platform = rs.AddRectangle(rs.PlaneFromFrame([-w / 2, -h / 2, 0], [1, 0, 0], [0, 1, 0]), w, h)
    FRA = 0.95
else:
    # large
    w, h = 304, 304 # 520, 320
    xShift, yShift = 5, 5
    buildShift = rs.AddPoint(w / 2 + xShift, h / 2 + yShift, 0)
    platform = rs.AddRectangle(rs.PlaneFromFrame([xShift, yShift, 0], [1, 0, 0], [0, 1, 0]), w, h)
    FRA = 0.97
# ---------- end machine_prm ----------
path_mapper = PathMapper(merge_5, source="{A}", target="{0}")
path_mapper_2 = PathMapper(merge_6, source="{A}", target="{1}")
nozzlediameter_2 = Number(nozzlediameter)
tessellation_3 = Integer(tessellation_2)
width_3 = Number(width_2)
evalsrf = EvaluateSurface(Surface=reparameterize(untrim), Point=uv)  # -> Point, Normal, UDirection, VDirection, Frame

# ---- group: platform and center
platform = Curve(machine_prm.platform)
offset = Offset(Curve=platform, Distance=3, Plane=PlaneXY(0, 0, 0), Corners=1)
merge_7 = Merge(Data1=platform, Data2=offset)  # -> flatten(Result)
sph = Sphere(Base=evalsrf.Point, Radius=nozzlediameter_2)
boundary = BoundarySurfaces(Edges=merge_7)
preview_6 = CustomPreview(Geometry=sph, Shader=ColourSwatch(SwatchColor=RGB(85, 0, 255)))
preview_7 = CustomPreview(Geometry=boundary, Shader=ColourSwatch(SwatchColor=RGB(107, 107, 107)))  # disabled

# ----
stack_3 = CreateStack(UIElements=path_mapper, Horizontal=False)
stack_4 = CreateStack(UIElements=path_mapper_2, Horizontal=False)
winprops = SetWindowProperties(
    Window=launchwin,
    Theme=1,
    AccentColor=accent_colors,
    ShowTitleBar=True,
    BackgroundColor=ColourSwatch(SwatchColor=RGB(76, 76, 76)),
    ScaleFactor=1)
merge_8 = Merge(Data1=stack_3, Data2=stack_4)  # -> flatten(Result)
chebyshev_net = PythonScript(
    srf=srf_2,
    srfUnt=untrim,
    uv=uv,
    segLenDefault=segmentlength_2,
    switchUV=switchuv_3,
    flipSrf=flipsurface_2,
    buildShift=machine_prm.buildShift,
    platform=machine_prm.platform,
    extendEdge=extendedge_2,
    bendingJoints=bendingjoints_2,
    diaGen=diagen_2,
    rotate=rotatejoint_2,
    nozzleDia=nozzlediameter_2,
    width=width_3,
    tessellation=tessellation_3,
    angleOverkill=angleoverkill)  # -> bending, bendingOnSrf, bendingInfo, chamfer, constraint, constraintOnSrf, joints, actuated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
# ---------- chebyshev_net: Python ----------
import System
import math
import Rhino
import rhinoscriptsyntax as rs
import Grasshopper as gh
from Grasshopper.Kernel.Data import GH_Path

def roundTo(num, degree):
    a = int(num / (10 ** degree))
    b = num % (10 ** degree)
    if(b >= .5): a += 1
    return a * (10 ** degree)

class segment(object):
    def __init__(self, onSrf, onPlane, start, end, length, form, performance = None):
        self.onSrf, self.onPlane = onSrf, onPlane
        self.start, self.end = start, end
        self.length, self.form, self.performance = length, form, performance
        self.inside, self.intersect = "all", None

    def __str__(self):
        msg =  "type:%s segment lng:%f start:%s end:%s" % (self.form, self.length, self.start, self.end)
        if(self.performance):
            msg += " actuation:%f"%self.performance
        return msg

    def startsOnFrame(self, cPath):
        onFrame = self.start.Indices[0] == cPath.Indices[0] or \
                  self.start.Indices[1] == cPath.Indices[1]
        return onFrame

    def endsOnFrame(self, cPath):
        onFrame = self.end.Indices[0] == cPath.Indices[0] or \
                  self.end.Indices[1] == cPath.Indices[1]
        return onFrame

class modify(object):
    def __init__(self, start, end, targetLen):
        self.start, self.end, self.targetLen = start, end, targetLen

def getSrfUV(srf, uv):
    srfUDomain, srfVDomain = rs.SurfaceDomain(srf, 0), rs.SurfaceDomain(srf, 1)
    uv= rs.coerce3dpoint(uv)[0], rs.coerce3dpoint(uv)[1]
    uv = srfUDomain[0] + (srfUDomain[1] - srfUDomain[0]) * uv[0], \
         srfVDomain[0] + (srfVDomain[1] - srfVDomain[0]) * uv[1]
    return uv

def curveDivision(curves, dist):
    result = []
    for i in range(len(curves)):
        if(i % 2 == 0):
            rs.ReverseCurve(curves[i])
        temp = rs.DivideCurveEquidistant(curves[i], dist, True)
        if(i % 2 == 0):
            temp = temp[::-1]
        result.append(temp)
    center = len(result[0]) - 1
    if(i >= 1): result = result[0] + result[1][1:]
    else: result = result[0]
    return result, center

def getFramePoints(srf, uv, segLen):
    srfPoints = {}
    # get frame points
    uv = getSrfUV(srf, uv)
    frame = rs.SurfaceFrame(srf, uv)
    frame = rs.ExtractIsoCurve(srf, uv, 2)
    uFrame, vFrame = rs.SplitCurve(frame[0], uv[0], False), rs.SplitCurve(frame[1], uv[1], False)
    if(not uFrame): uFrame = [frame[0]]
    if(not vFrame): vFrame = [frame[1]]
    uFrame, uCen = curveDivision(uFrame, segLen)
    vFrame, vCen = curveDivision(vFrame, segLen)
    for i in range(len(uFrame)):
        srfPoints[(str(i), str(vCen))] = rs.AddPoint(uFrame[i])
    for i in range(len(vFrame)):
        if(i != vCen):
            srfPoints[(str(uCen), str(i))] = rs.AddPoint(vFrame[i])
    return frame, srfPoints, (str(uCen), str(vCen))

def mesher(surface, cPath, initialPoints, distance, segLen=None):
    isPlane = str(type(surface)) == "<type 'Plane'>"
    uCen, vCen = int(cPath[0]), int(cPath[1])
    result = {}
    for path in initialPoints:
        result[path] = initialPoints[path]
    # using a while loop to solve indefinite loop, loop terminates when the surface
    # cannot be furthur subdivided
    quadrants = [[1, 1], [-1, 1], [-1,-1], [1, -1]]
    run, depth = True, 1
    while(run):
        depth += 1
        success = 0
        for uOffset in range(1, depth):
            # u,v offsets are complementary
            vOffset = depth - uOffset
            for quadrant in quadrants:
                # get new path/pos
                uDir, vDir = quadrant[0], quadrant[1]
                uIndex, vIndex = uOffset * uDir + uCen, vOffset * vDir + vCen
                ptIndex = str(uIndex), str(vIndex)
                pt1Index = str(uIndex - uDir), str(vIndex)
                pt2Index = str(uIndex), str(vIndex - vDir)
                # solve intersection
                pt1 = result.get(pt1Index, None)
                pt2 = result.get(pt2Index, None)
                # if the new point can be interpolated with two existing points
                if(pt1 and pt2):
                    if(not segLen):
                        ptMid = rs.PointDivide(rs.PointAdd(pt1, pt2), 2)
                        circleNormal = rs.PointSubtract(pt1, pt2)
                        circlePlane = rs.PlaneFromNormal(ptMid, circleNormal)
                        circleRadius = (distance ** 2 - 
                                       (rs.Distance(pt1, pt2) * .5) ** 2) ** .5
                        intCrv = rs.AddCircle(circlePlane, circleRadius)
                    else:
                        sph1Coor = str(min(int(ptIndex[0]), int(pt1Index[0]))) + ".5", \
                                   ptIndex[1]
                        sph2Coor = ptIndex[0], \
                                   str(min(int(ptIndex[1]), int(pt2Index[1]))) + ".5"
                        if(sph1Coor[0] == "0.5"): sph1Coor = ".5", sph1Coor[1]
                        if(sph2Coor[1] == "0.5"): sph2Coor = sph2Coor[0], ".5"
                        rad1 = segLen.get(sph1Coor, segLenDefault)
                        rad2 = segLen.get(sph2Coor, segLenDefault)
                        sphere1 = rs.AddSphere(pt1, rad1)
                        sphere2 = rs.AddSphere(pt2, rad2)
                        pln1 = rs.PlaneFromFrame(pt1, [1, 0, 0], [0, 1, 0])
                        pln2 = rs.PlaneFromFrame(pt2, [1, 0, 0], [0, 1, 0])
                        intCrv = rs.IntersectSpheres(pln1, rad1, pln2, rad2)
                        if(not intCrv): continue
                        intCrv = rs.AddCircle(intCrv[1], intCrv[2])
                    # returns a list, get the first item
                    # returns a tuple, get the second item:
                    # list of intersection points
                    if(isPlane):
                        intPt = rs.PlaneCurveIntersection(surface, intCrv)
                    else:
                        intPt = rs.CurveBrepIntersect(intCrv, surface)[1]
                    if(intPt and len(intPt) > 1):
                        # find interpolated point by uv distance
                        # get intersection uv 
                        refPath = str(uIndex - uDir), str(vIndex - vDir)
                        if(isPlane):
                            ptRef = result.get((refPath), None)
                        else:
                            ptRef = rs.SurfaceClosestPoint(surface,
                                                      result.get(refPath, None))
                        temp = {}
                        for point in intPt:
                            # get uv distance
                            if(isPlane):
                                # plane, sort by distance
                                plannarDist = float("%.5f" % rs.Distance(point[1], ptRef))
                                temp[plannarDist] = rs.AddPoint(point[1][0],
                                                                point[1][1],
                                                                point[1][2])
                            else:
                                # surface, sort by uv distance
                                uvTemp = rs.SurfaceClosestPoint(surface, point)
                                uvDistance = float("%.5f" % ((uvTemp[0] - ptRef[0]) ** 2 +
                                                             (uvTemp[1] - ptRef[1]) ** 2) ** .5)
                                temp[uvDistance] = point
                        pt = temp[sorted(temp.keys())[1]]
                        # sort points using uvDistance, the first point is skipped
                        # for that it is the exact same point as reference point
                        result[(str(uIndex), str(vIndex))] = pt
                        success += 1
        # if no points are developed in current iteration, the surface is done for
        if(success == 0):
            run = False
    return result

def generateSegments(points, genDia = False, mode = 0):
    segments = {}
    for path in points:
        # get rectangle vertice pt coordinance
        if(mode == 0):
            # coor format int, int
            pt0Coor = path
            pt1Coor = path[0], str(int(path[1]) + 1)
            pt2Coor = str(int(path[0]) + 1), str(int(path[1]) + 1)
            pt3Coor = str(int(path[0]) + 1), path[1]
        else:
            # coor format int.shift, int.shift
            uIndex, uShift = str(path[0]).split(".")
            vIndex, vShift = str(path[1]).split(".")
            uShift, vShift = int(uShift), int(vShift)
            pt0Coor = path
            pt1Coor = uIndex + "." + str(uShift), vIndex + "." + str(vShift + 1)
            pt2Coor = uIndex + "." + str(uShift + 1), vIndex + "." + str(vShift + 1)
            pt3Coor = uIndex + "." + str(uShift + 1), vIndex + "." + str(vShift)
        # get Branch
        pt0 = points.get(pt0Coor, None)
        pt1 = points.get(pt1Coor, None)
        pt2 = points.get(pt2Coor, None)
        pt3 = points.get(pt3Coor, None)
        # get orthogonal segments
        if(pt1):
            line = rs.AddLine(pt0, pt1)
            length = rs.Distance(pt0, pt1)
            if(mode == 0):
                segCoor = pt0Coor[0], \
                          str((int(pt0Coor[1]) + int(pt1Coor[1])) * 5)[:-1] + ".5"
            else:
                alpha, shift0 = pt0Coor[1].split(".")
                alpha, shift1 = pt1Coor[1].split(".")
                segCoor = pt0Coor[0], \
                          alpha + "." + str((int(shift0) + int(shift1)) * 5)
            segments[segCoor] = segment(line, None, pt0Coor, pt1Coor, length, "C")
        if(pt3):
            line = rs.AddLine(pt0, pt3)
            length = rs.Distance(pt0, pt3)
            if(mode == 0):
                segCoor = str((int(pt0Coor[0]) + int(pt3Coor[0])) * 5)[:-1] + ".5", \
                          pt0Coor[1]
            else:
                alpha, shift0 = pt0Coor[0].split(".")
                alpha, shift3 = pt3Coor[0].split(".")
                segCoor = alpha + "." + str((int(shift0) + int(shift3)) * 5), \
                          pt0Coor[1]
            segments[segCoor] = segment(line, None, pt0Coor, pt3Coor, length, "C")
        # check for branch validity
        if(diaGen and pt1 and pt2 and pt3):
            pt0, pt1, pt2, pt3 = pt0[0], pt1[0], pt2[0], pt3[0]
            # get length of 2 diagonal line
            dist1, dist2 = rs.Distance(pt0, pt2), rs.Distance(pt1, pt3)
            if(dist1 < dist2):
                line = rs.AddLine(pt0, pt2)
                length = rs.Distance(pt0, pt2)
                segCoor = str(int(pt0Coor[0]) + int(pt2Coor[0]) * 5)[:-1] + ".5", \
                          str(int(pt0Coor[0]) + int(pt2Coor[0]) * 5)[:-1] + ".5"
                segments[segCoor] = segment(line, None, pt0Coor, pt2Coor, length, "S")
            else:
                line = rs.AddLine(pt1, pt3)
                length = rs.Distance(pt1, pt3)
                segCoor = str(int(pt1Coor[0]) + int(pt3Coor[0]) * 5)[:-1] + ".5", \
                          str(int(pt1Coor[0]) + int(pt3Coor[0]) * 5)[:-1] + ".5"
                segments[segCoor] = segment(line, None, pt1Coor, pt3Coor, length, "S")
    return segments

def updateSegmentsPlaneCrv(segments, pointsOnPlane):
    for segCoor in segments:
        segment = segments[segCoor]
        ptStart = pointsOnPlane[segment.start]
        ptEnd = pointsOnPlane[segment.end]
        bone = rs.AddLine(ptStart, ptEnd)
        segment.onPlane = bone
        if(segment.form == "S"):
            shrinkage = 1 - (segment.length / rs.CurveLength(bone))
            segment.performance = float("%.3f"%(shrinkage))

def cleanJoints(pointsOnSrf, pointsOnPlane):
    result = {}
    for path in pointsOnSrf:
       point = pointsOnPlane[path]
       result[path] = point
    return result

def trimEdge(srf, pointsOnSrf, segments, width):
    pointsToMove, targetPoints, out = [], [], []
    preserve = set() # points to preserve
    outlines = rs.DuplicateEdgeCurves(srf)
    epsilon = 0.0001
    modifications = []
    for segCoor in segments:
        seg = segments[segCoor]
        start = pointsOnSrf[seg.start]
        end = pointsOnSrf[seg.end]
        distStart = rs.Distance(rs.BrepClosestPoint(srf, start)[0], start)
        distEnd = rs.Distance(rs.BrepClosestPoint(srf, end)[0], end)
        startsOnSrf = distStart < epsilon
        endsOnSrf = distEnd < epsilon
        validInput = (startsOnSrf and not endsOnSrf) or (not startsOnSrf and endsOnSrf)
        line = seg.onSrf
        outline, outlineCP, _ = rs.CurveClosestObject(line, outlines)
        curveCPUV = rs.CurveClosestPoint(outline, outlineCP)
        outlineTangent = rs.CurveTangent(outline, curveCPUV)
        curveVector = rs.VectorUnitize(rs.PointSubtract(end, start))
        inner = abs(rs.VectorDotProduct(curveVector, outlineTangent))
        if(inner > math.cos(math.radians(44))):
            validInput = False
        elif(startsOnSrf and rs.Distance(start, outlineCP) < width):
            validInput = False
        elif(endsOnSrf and rs.Distance(end, outlineCP) < width):
            validInput = False
        if((startsOnSrf and endsOnSrf) or validInput):
            preserve.add(seg.start)
            preserve.add(seg.end)
        # check modification status
        if(validInput):
            outlineCP = rs.AddPoint(outlineCP[0], outlineCP[1], outlineCP[2])
            if(distStart <= distEnd):
                targetLen = rs.Distance(outlineCP, start)
                modifications.append(modify(seg.end, seg.start, targetLen))
                pointsToMove += [seg.end]
                targetPoints += [outlineCP]
                out += [seg.end]
            else:
                targetLen = rs.Distance(outlineCP, end)
                modifications.append(modify(seg.start, seg.end, targetLen))
                pointsToMove += [seg.start]
                targetPoints += [outlineCP]
                out += [seg.start]
    for i in range(len(pointsToMove)):
        pointsOnSrf[pointsToMove[i]] = targetPoints[i]
    result = {}
    for path in preserve:
        result[path] = pointsOnSrf[path]
    return result, modifications, out

def modPlannarPts(pointsOnPlane, mods):
    for modEvent in mods:
        start = pointsOnPlane[modEvent.start]
        end = pointsOnPlane[modEvent.end]
        vec = rs.VectorUnitize(rs.PointSubtract(end, start))
        vec = rs.VectorScale(vec, rs.Distance(start, end) - modEvent.targetLen)
        newPt = rs.PointAdd(start, vec)
        newPt = rs.AddPoint(newPt[0], newPt[1], newPt[2])
        pointsOnPlane[modEvent.start] = newPt

def onSrfLineToArc(segments, srf, out, segLenDefault, angleOverkill, flipSrf):
    segLen, segAng = {}, {}
    for segCoor in segments:
        seg, flag = segments[segCoor], True
        if(seg.start in out and seg.end in out): flag = False
        curve = seg.onSrf
        start,end = rs.CurveStartPoint(curve), rs.CurveEndPoint(curve)
        mid = rs.CurveMidPoint(curve)
        startUV = rs.SurfaceClosestPoint(srf, start)
        endUV = rs.SurfaceClosestPoint(srf, end)
        # ray method
        """
        startNormal = rs.SurfaceNormal(srf, startUV)
        endNormal = rs.SurfaceNormal(srf, endUV)
        rayVector = rs.VectorUnitize(rs.VectorAdd(startNormal, endNormal))
        rayStart = rs.PointAdd(mid, rs.VectorScale(rayVector, segLenDefault))
        rayEnd = rs.PointAdd(mid, rs.VectorScale(rayVector, -segLenDefault))
        ray = rs.AddLine(rayStart, rayEnd)
        intersections = rs.CurveSurfaceIntersection(ray, srf)
        intersections = [intersections[i][1] for i in range(len(intersections)) if intersections[i][0] == 1]
        midSrf = sorted(intersections, key = lambda x: rs.Distance(mid, x))[0]
        midUV = rs.SurfaceClosestPoint(srf, midSrf)
        """
        # uv method
        midUV = (startUV[0] + endUV[0]) * .5, (startUV[1] + endUV[1]) * .5
        midSrf = rs.EvaluateSurface(srf, midUV[0], midUV[1])
        try:
            arc = rs.AddArc3Pt(start, end, midSrf)
            # compare normal with circle vecotr to get direction
            arcCen = rs.ArcCenterPoint(arc)
            arcVec = rs.PointSubtract(arcCen, mid)
            srfNormal = rs.SurfaceNormal(srf, midUV)
            direction = rs.VectorDotProduct(rs.VectorUnitize(arcVec), 
                                        rs.VectorUnitize(srfNormal))
            angle, length = rs.ArcAngle(arc), rs.CurveLength(arc)
            if(direction > 0): angle *= -1
            if(flipSrf): angle *= -1
            angle *= angleOverkill
        except:
            arc = rs.AddLine(start, end)
            angle, length = 0., rs.CurveLength(arc)
        segments[segCoor].onSrf = arc
        segments[segCoor].length = length
        segments[segCoor].performance = angle
        if(angle != 0. and flag): segments[segCoor].form = "B"
        segLen[segCoor], segAng[segCoor] = length, angle
    return segLen, segAng

def getInitOnPlane(segLen, cPath, buildShift, switchUV):
    # get shift values
    shiftPt = rs.coerce3dpoint(buildShift)
    xShift, yShift, zShift = shiftPt[0], shiftPt[1], shiftPt[2]
    result = {}
    result[cPath] = rs.AddPoint(xShift, yShift, zShift)
    # shiftVectors
    vectors = [(0, 1), (1, 0), (0, -1), (-1, 0)]
    for vector in vectors:
        run, i, sum = True, 0, 0
        while(run):
            # targetU
            target = [None, None]
            if(vector[0] == 0): target[0] = cPath[0]
            elif(vector[0] == 1): target[0] = str(int(cPath[0]) + i) + ".5"
            else: target[0] = str(int(cPath[0]) - (i + 1)) + ".5"
            # targetV
            if(vector[1] == 0): target[1] = cPath[1]
            elif(vector[1] == 1): target[1] = str(int(cPath[1]) + i) + ".5"
            else: target[1] = str(int(cPath[1]) - (i + 1)) + ".5"
            # target
            if(target[0] == "0.5"): target[0] = ".5"
            if(target[1] == "0.5"): target[1] = ".5"
            target = target[0], target[1]
            distance = segLen.get(target, False)
            if(not distance):
                run = False
                continue
            sum += distance
            if(switchUV):
                pt = rs.AddPoint(xShift + vector[1] * sum,
                                 yShift + vector[0] * sum,
                                 0)
            else:
                pt = rs.AddPoint(xShift + vector[0] * sum,
                                 yShift + vector[1] * sum,
                                 0)
            i += 1
            ptCoor = str(int(cPath[0]) + i * vector[0]), str(int(cPath[1]) + i * vector[1])
            result[ptCoor] = pt
    return result

def getCells(segments, pointsOnPlane):
    segVectors = [(0, .5), (.5, 0), (-.5, 0), (0, -.5)]
    # get range
    uMin, vMin, uMax, vMax = None, None, None, None
    for segCoor in segments:
        u, v = float(segCoor[0]), float(segCoor[1])
        if(uMin == None or u < uMin): uMin = u
        if(uMax == None or u > uMax): uMax = u
        if(vMin == None or v < vMin): vMin = v
        if(vMax == None or v > vMax): vMax = v
    cells = {}
    for u in range(int(float(uMin)), int(round(float(uMax))) + 1):
        for v in range(int(float(vMin)), int(round(float(vMax))) + 1):
            coor = str(u) + ".5", str(v) + ".5"
            valid = True
            for vec in segVectors:
                # get target
                if(vec[0] == 0):
                    if(vec[1] == -.5): target = coor[0], coor[1].split(".")[0]
                    else: target = coor[0], str(int(coor[1].split(".")[0]) + 1)
                else:
                    if(vec[0] == -.5): target = coor[0].split(".")[0], coor[1]
                    else: target = str(int(coor[0].split(".")[0]) + 1), coor[1]
                if(target[0] == "0.5"): target = ".5", target[1]
                elif(target[1] == "0.5"): target = target[0], ".5"
                if(not target in segments):
                    valid = False
                    break
            if(coor[0] == "0.5"): coor = ".5", coor[1]
            if(coor[1] == "0.5"): coor = coor[0], ".5"
            if(valid):
                cells[coor] = 1
    return cells

def tessellate(pt0, pt1, pt2, pt3, tes, shift):
    # get points
    isGuid = not isinstance(pt0, tuple)
    if(isGuid):
        # real points
        pt0 = rs.coercegeometry(pt0).Location
        pt1 = rs.coercegeometry(pt1).Location
        pt2 = rs.coercegeometry(pt2).Location
        pt3 = rs.coercegeometry(pt3).Location
    # get vectors
    vec01 = pt1[0] - pt0[0], pt1[1] - pt0[1]
    vec03 = pt3[0] - pt0[0], pt3[1] - pt0[1]
    vec12 = pt2[0] - pt1[0], pt2[1] - pt1[1]
    vec32 = pt2[0] - pt3[0], pt2[1] - pt3[1]
    uLines, vLines = [], []
    # u lines
    for i in range(tes[0] + 1):
        ratio = i / tes[0]
        uLines += [rs.AddLine([pt0[0] + ratio * vec01[0],
                               pt0[1] + ratio * vec01[1], 0],
                              [pt3[0] + ratio * vec32[0],
                               pt3[1] + ratio * vec32[1], 0])]
    # v lines
    for i in range(tes[1] + 1):
        ratio = i / tes[1]
        vLines += [rs.AddLine([pt0[0] + ratio * vec03[0],
                               pt0[1] + ratio * vec03[1], 0],
                              [pt1[0] + ratio * vec12[0],
                               pt1[1] + ratio * vec12[1], 0])]
    tempGrid = {}
    for i in range(len(uLines)):
        uLine = uLines[i]
        for j in range(len(vLines)):
            vLine = vLines[j]
            coor = "%s.%d" % (shift[0], i), "%s.%d" % (shift[1], j)
            intersection = rs.LineLineIntersection(uLine, vLine)[0]
            if(isGuid): tempGrid[coor] = rs.AddPoint(intersection[0], intersection[1], intersection[2])
            else: tempGrid[coor] = (intersection[0], intersection[1], intersection[2])
    return tempGrid

def tessellateCells(pointsOnSrf, pointsOnPlane, srf, cells, segments, tes, segLenDefault):
    idealLength = .95 * segLenDefault / tes
    # add segments on surface
    for cell in cells:
        cellKey = cell
        # get points UV grid
        if(cell[0] == ".5" and cell[1] == ".5"): cell = 0, 0
        elif(cell[0] == ".5"): cell = 0, int(cell[1].split(".")[0])
        elif(cell[1] == ".5"): cell = int(cell[0].split(".")[0]), 0
        else: cell = int(cell[0].split(".")[0]), int(cell[1].split(".")[0])
        pt0Coor = str(cell[0]), str(cell[1])
        pt1Coor = str(cell[0] + 1), str(cell[1])
        pt2Coor = str(cell[0] + 1), str(cell[1] + 1)
        pt3Coor = str(cell[0]), str(cell[1] + 1)
        # get points respective surface UV
        pt0 = pointsOnSrf[pt0Coor]
        pt1 = pointsOnSrf[pt1Coor]
        pt2 = pointsOnSrf[pt2Coor]
        pt3 = pointsOnSrf[pt3Coor]
        pt0UV = rs.SurfaceClosestPoint(srf, pt0)
        pt1UV = rs.SurfaceClosestPoint(srf, pt1)
        pt2UV = rs.SurfaceClosestPoint(srf, pt2)
        pt3UV = rs.SurfaceClosestPoint(srf, pt3)
        # get edges
        if(cell[0] == 0):
            edge0Coor = ".5", str(cell[1])
            edge2Coor = ".5", str(cell[1] + 1)
        else:
            edge0Coor = str(cell[0]) + ".5", str(cell[1])
            edge2Coor = str(cell[0]) + ".5", str(cell[1] + 1)
        if(cell[1] == 0):
            edge1Coor = str(cell[0]), ".5"
            edge3Coor = str(cell[0] + 1),".5"
        else:
            edge1Coor = str(cell[0]), str(cell[1]) + ".5"
            edge3Coor = str(cell[0] + 1), str(cell[1]) + ".5"
        edge0 = segments[edge0Coor].onSrf
        edge1 = segments[edge1Coor].onSrf
        edge2 = segments[edge2Coor].onSrf
        edge3 = segments[edge3Coor].onSrf
        # divide based on length
        uDiv = min(round(rs.CurveLength(edge0) / idealLength), round(rs.CurveLength(edge2) / idealLength), tes)
        vDiv = min(round(rs.CurveLength(edge1) / idealLength), round(rs.CurveLength(edge3) / idealLength), tes)
        div = (int(uDiv), int(vDiv))
        if(div[0] == 0): div = 1, div[1]
        if(div[1] == 0): div = div[0], 1
        cells[cellKey] = div
        grid = tessellate(pt0UV, pt1UV, pt2UV, pt3UV, div, pt0Coor)
        # convert uv point to points on surface
        for coor in grid:
            grid[coor] = rs.EvaluateSurface(srf, grid[coor][0], grid[coor][1])
            pointsOnSrf[coor] = grid[coor]
        # generate new segments
        newSegs = generateSegments(grid, mode = 1)
        # selectively add new segments
        for coor in newSegs:
            uShift, vShift = int(str(coor[0]).split(".")[1]), int(str(coor[1]).split(".")[1])
            valid = not ((uShift == 0 or uShift == div[0]) or (vShift == 0 or vShift == div[1]))
            if(valid): segments[coor] = newSegs[coor]
        # get points on plane
        pt0F = pointsOnPlane[pt0Coor]
        pt1F = pointsOnPlane[pt1Coor]
        pt2F = pointsOnPlane[pt2Coor]
        pt3F = pointsOnPlane[pt3Coor]
        gridFlat = tessellate(pt0F, pt1F, pt2F, pt3F, div, pt0Coor)
        for coor in gridFlat:
            pointsOnPlane[coor] = gridFlat[coor]

def findOutline(segments):
    uBound, uList, vBound, vList= set(), set(), set(), set()
    edgePointsU, edgePointsV = [], []
    for segCoor in segments:
        # testing only bending actuators, those has the format of which
        # one of u, v has a tailing ".5" and the other a interger
        flag = False
        if(("." not in segCoor[0]) and ("." in segCoor[1]) and (segCoor[1].split(".")[1] == "5")):
            flag = True
            mid = int(segCoor[0]) * 10, int(float(segCoor[1]) * 10)
        if(("." not in segCoor[1]) and ("." in segCoor[0]) and (segCoor[0].split(".")[1] == "5")):
            flag = True
            mid = int(float(segCoor[0]) * 10), int(segCoor[1]) *10
        if(flag):
            if(mid[0] % 10 != 0): uBound.add(mid[0])
            elif(mid[0] % 10 == 0): uList.add(mid[0])
            if(mid[1] % 10 != 0): vBound.add(mid[1])
            elif(mid[1] % 10 == 0): vList.add(mid[1])
    # sort
    uBound, vBound = sorted(list(uBound)), sorted(list(vBound))
    uList, vList = sorted(list(uList)), sorted(list(vList))
    outlines, uLines, vLines = [], [], []
    # handle u outlines
    for uVal in uBound:
        val = str(uVal)[:-1] + ".5"
        min, max = 999999, 0
        minSeg, maxSeg = None, None
        counter = 0
        for segmentCoor in segments:
            segment = segments[segmentCoor]
            if(segmentCoor[0] == val and "." not in segmentCoor[1]):
                counter += 1
                # if in same row
                if(float(segmentCoor[1]) > max):
                    max = float(segmentCoor[1])
                    maxSeg = segment.onPlane
                if(float(segmentCoor[1]) < min):
                    min = float(segmentCoor[1])
                    minSeg = segment.onPlane
        if(counter >= 2): outlines += [minSeg, maxSeg]
    # handle v outlines
    for vVal in vBound:
        val = str(vVal)[:-1] + ".5"
        min, max = 999999, 0
        minSeg, maxSeg = None, None
        counter = 0
        for segmentCoor in segments:
            segment = segments[segmentCoor]
            if(segmentCoor[1] == val and "." not in segmentCoor[0]):
                counter += 1
                # if in same column
                if(float(segmentCoor[0]) > max):
                    max = float(segmentCoor[0])
                    maxSeg = segment.onPlane
                if(float(segmentCoor[0]) < min):
                    min = float(segmentCoor[0])
                    minSeg = segment.onPlane
        if(counter >= 2): outlines += [minSeg, maxSeg]
    # handle u frames
    for uVal in uList:
        val = str(uVal)[:-1]
        if(val == ""): val = "0"
        temp = []
        for segmentCoor in segments:
            if(segmentCoor[0] == val):
                temp += [segments[segmentCoor].onPlane]
        uLine = temp
        if(len(temp) == 1): uLine = temp
        elif(len(temp) > 1): uLine = rs.JoinCurves(temp)
        uLines += uLine
        edgePointsU += [rs.CurveStartPoint(uLine[0]), rs.CurveEndPoint(uLine[0])]
    # handle v frames
    for vVal in vList:
        val = str(vVal)[:-1]
        if(val == ""): val = "0"
        temp = []
        for segmentCoor in segments:
            if(segmentCoor[1] == val):
                temp += [segments[segmentCoor].onPlane]
        if(len(temp) == 1): vLine = temp
        elif(len(temp) > 1): vLine = rs.JoinCurves(temp)
        vLines += vLine
        edgePointsV += [rs.CurveStartPoint(vLine[0]), rs.CurveEndPoint(vLine[0])]
    return [rs.JoinCurves(outlines)] + [uLines] + [vLines], [edgePointsU, edgePointsV]

def minDist(testPt, pts):
    min = None
    for pt in pts:
        dist = rs.Distance(testPt, pt)
        if(min == None or dist < min):
            min = dist
    return min

def trimFrame(curve, edgePoints, width, trim, continuousTrim, epsilon, mode):
    if(mode == "U"): bending = 2
    else: bending = 1
    if(not bendingJoints == bending):
        # not continuous
        chamfer = True
        curve = rs.ExtendCurveLength(curve, 0, 0, trim)
        curve = rs.ExtendCurveLength(curve, 0, 1, trim)
        segment.onPlane = curve
        segment.length = rs.CurveLength(curve)
    else:
        # continuous
        chamfer = False
        # start
        if(minDist(rs.CurveStartPoint(curve), edgePoints) <= epsilon):
            # on edge
            curve = rs.ExtendCurveLength(curve, 0, 0, .5 * width)
        else:
            # not on dege
            curve = rs.ExtendCurveLength(curve, 0, 0, continuousTrim)
        if(minDist(rs.CurveEndPoint(curve), edgePoints) <= epsilon):
            # on edge
            curve = rs.ExtendCurveLength(curve, 0, 1, .5 * width)
        else:
            # not on edge
            curve = rs.ExtendCurveLength(curve, 0, 1, continuousTrim)
    return curve, chamfer

def trimSegments(segments, width, nozzleDia, cells, edgePoints, bendingJoints):
    # get frame min, max
    epsilon = 0.001
    bendingChamfer = []
    trim = -1 * (.5 * width - nozzleDia)
    frameTrim = trim - nozzleDia
    continuousTrim = .75 * nozzleDia
    secondConTrim = trim + .5 * nozzleDia
    for coor in segments:
        segment = segments[coor]
        if("." in coor[0] and "." not in coor[1]):
            # u bending frame
            curve = segment.onPlane
            curve, chamfer = trimFrame(curve, edgePoints[1], width, trim, \
                                       continuousTrim, epsilon, "U")
            segment.onPlane = curve
            segment.length = rs.CurveLength(curve)
            bendingChamfer += [chamfer]
        elif("." not in coor[0] and "." in coor[1]):
            # v bending frame
            curve = segment.onPlane
            curve, chamfer = trimFrame(curve, edgePoints[0], width, trim, \
                                       continuousTrim, epsilon, "V")
            segment.onPlane = curve
            segment.length = rs.CurveLength(curve)
            bendingChamfer += [chamfer]
        else:
            # constraint
            curve = segment.onPlane
            uIndex = segment.start[0].split(".")[0]
            vIndex = segment.start[1].split(".")[0]
            uShiftStart = int(segment.start[0].split(".")[1])
            vShiftStart = int(segment.start[1].split(".")[1])
            uShiftEnd = int(segment.end[0].split(".")[1])
            vShiftEnd = int(segment.end[1].split(".")[1])
            # get cell division number
            cellIndex = (uIndex + ".5", vIndex + ".5")
            if(cellIndex[0] == "0.5"): cellIndex = ".5", cellIndex[1]
            if(cellIndex[1] == "0.5"): cellIndex = cellIndex[0], ".5"
            div = cells[cellIndex]
            if(uShiftStart == 0 or uShiftStart == div[0] or vShiftStart == 0 or vShiftStart == div[1]):
                curve = rs.ExtendCurveLength(curve, 0, 0, frameTrim)
            else:
                curve = rs.ExtendCurveLength(curve, 0, 0, trim - nozzleDia)
            if(uShiftEnd == 0 or uShiftEnd == div[0] or vShiftEnd == 0 or vShiftEnd == div[1]):
                curve = rs.ExtendCurveLength(curve, 0, 1, frameTrim)
            else:
                curve = rs.ExtendCurveLength(curve, 0, 1, trim - nozzleDia)
            segment.onPlane = curve
            segment.length = rs.CurveLength(curve)
    return bendingChamfer

def retrieveSegments(segments, form):
    onPlane, onSrf, info = [], [], []
    for coor in segments:
        segment = segments[coor]
        if(segment.form == form):
            onPlane += [segment.onPlane]
            onSrf += [segment.onSrf]
            info += [segment.performance]
    return onPlane, onSrf, info

def jointsToCurve(points, tes, cells, rotate, bendingJoints):
    joints, lines = [], []
    for coor in points:
        if("." not in coor[0] and "." not in coor[0]):
            # bending frame joints
            if(bendingJoints == 0): joints += [points[coor]]
            else: continue
        else:
            # constraint extra joints
            uIndex, vIndex = int(coor[0].split(".")[0]), int(coor[1].split(".")[0])
            uShift, vShift = int(coor[0].split(".")[1]), int(coor[1].split(".")[1])
            targetCell = str(uIndex) + ".5", str(vIndex) + ".5"
            if(targetCell[0] == "0.5") : targetCell = ".5", targetCell[1]
            if(targetCell[1] == "0.5") : targetCell = targetCell[0], ".5"
            div = cells[targetCell]
            if(0 < uShift < div[0] and 0 < vShift < div[1]):
                joints += [points[coor]]
    # convert pts into lines
    for pt in joints:
        ptA = rs.PointAdd(pt,  [.5 * width, 0, 0])
        ptB = rs.PointAdd(pt, [-.5 * width, 0, 0])
        line = rs.AddLine(ptA, ptB)
        if(rotate): rs.RotateObject(line, pt, 45)
        lines += [line]
    return lines

def getBounds(box):
    vertices = rs.BoundingBox(box)
    xMin, xMax, yMin, yMax, zMin, zMax = None, None, None, None, None, None
    for vertex in vertices:
        if(vertex[0] < xMin or xMin == None):
            xMin = vertex[0]
        if(vertex[0] > xMax or xMax == None):
            xMax = vertex[0]
        if(vertex[1] < yMin or yMin == None):
            yMin = vertex[1]
        if(vertex[1] > yMax or yMax == None):
            yMax = vertex[1]
        if(vertex[2] < zMin or zMin == None):
            zMin = vertex[2]
        if(vertex[2] > zMax or zMax == None):
            zMax = vertex[2]
    return xMin, xMax, yMin, yMax, zMin, zMax

def getRatio(plotExtend, platformExtend):
    try:
        ratioX = (plotExtend[1] - plotExtend[0]) / (platformExtend[1] - platformExtend[0])
    except:
        ratioX = 1
    try:
        ratioY = (plotExtend[3] - plotExtend[2]) / (platformExtend[3] - platformExtend[2])
    except:
        ratioY = 1
    try:
        ratioZ = (plotExtend[5] - plotExtend[4]) / (platformExtend[5] - platformExtend[4])
    except:
        ratioZ = 1
    return [ratioX, ratioY, ratioZ]

def plotter(frames, platform, buildShift, nozzleDia, switchUV, segLenDefault):
    outline = frames[0]
    uLines, vLines = frames[1], frames[2]
    platform = rs.OffsetCurve(platform, buildShift, nozzleDia * 10)
    plotExtend, platformExtend = getBounds(outline), getBounds(platform)
    ratio = getRatio(plotExtend, platformExtend)
    for i in range(len(ratio)):
        if(ratio[i] % 1. > 0.001): ratio[i] = int(ratio[i]) + 1
        else: ratio[i] = int(ratio[i])
    if(switchUV):
        step = int((len(vLines) - 1) / ratio[0]), int((len(uLines) - 1) / ratio[1])
        splitters = vLines[step[0]::step[0]][:-1] + uLines[step[1]::step[1]][:-1]
    else:
        step = int((len(uLines) - 1) / ratio[0]), int((len(vLines) - 1) / ratio[1])
        splitters = uLines[step[0]::step[0]][:-1] + vLines[step[1]::step[1]][:-1]
    splitterBreps = []
    for i in range(len(splitters)):
        splitters[i] = rs.ExtendCurveLength(splitters[i], 0, 0, segLenDefault * 2)
        splitters[i] = rs.ExtendCurveLength(splitters[i], 0, 1, segLenDefault * 2)
        splitterZ = rs.CopyObject(splitters[i], [0, 0, 1])
        splitterBreps += [rs.AddEdgeSrf([splitters[i], splitterZ])]
    plotArea = rs.AddRectangle(rs.PlaneFromFrame([plotExtend[0], plotExtend[2], 0],
                                                 [1, 0, 0], [0, 1, 0]), 
                                                 plotExtend[1] - plotExtend[0],
                                                 plotExtend[3] - plotExtend[2])
    return [plotArea] + splitters

if(not extendEdge): srfUnt = srf
if(srf):
    frame, initialPoints, cPath = getFramePoints(srfUnt, uv, segLenDefault)
    pointsOnSrf = mesher(srfUnt, cPath, initialPoints, segLenDefault)
    
    segmentsTemp = generateSegments(pointsOnSrf)
    pointsOnSrf, mods, out = trimEdge(srf, pointsOnSrf, segmentsTemp, width)
    debug = [pointsOnSrf[coor] for coor in pointsOnSrf]
    segments = generateSegments(pointsOnSrf)
    segLen, segAng = onSrfLineToArc(segments, srf, out, segLenDefault, angleOverkill, flipSrf)
    debug2 = [segments[coor].onSrf for coor in segments]
    initOnPlanePts = getInitOnPlane(segLen, cPath, buildShift, switchUV)
    pointsOnPlane = mesher(rs.WorldXYPlane(), cPath, initOnPlanePts, segLenDefault, segLen)
    pointsOnPlane = cleanJoints(pointsOnSrf, pointsOnPlane)
    
    modPlannarPts(pointsOnPlane, mods)
    cells = getCells(segments, pointsOnPlane)
    tessellateCells(pointsOnSrf, pointsOnPlane, srf, cells,
                        segments, tessellation, segLenDefault)
    updateSegmentsPlaneCrv(segments, pointsOnPlane)
    vertices = [pointsOnSrf[coor] for coor in pointsOnSrf]
    onPlane = [rs.CopyObject(segments[coor].onPlane) for coor in segments if segments[coor].form == "B"] + \
              [rs.CopyObject(segments[coor].onPlane) for coor in segments if segments[coor].form == "C"]
    debug3 = [segments[coor].onPlane for coor in segments]
    frames, edgePoints = findOutline(segments)
    chamfer = trimSegments(segments, width, nozzleDia, cells, edgePoints, bendingJoints)
    bending, bendingOnSrf, bendingInfo = retrieveSegments(segments, "B")
    constraint, constraintOnSrf, _ = retrieveSegments(segments, "C")
    joints = jointsToCurve(pointsOnPlane, tessellation, cells, rotate, bendingJoints)
    plot = plotter(frames, platform, buildShift, nozzleDia, switchUV, segLenDefault)
    actuated = [segments[segCoor].onSrf for segCoor in segments]
# ---------- end chebyshev_net ----------
pipe_2 = Pipe(Curve=chebyshev_net.actuated, Radius=2, Caps=2)
boundary_2 = BoundarySurfaces(Edges=chebyshev_net.onPlane)

crv_2 = Curve(chebyshev_net.onPlane)
flattened_mesh_preview_2 = Boolean(flattened_mesh_preview)
srf_3 = Surface(boundary_2)
mesh_2 = Mesh(srf_3)
dispatch_2 = Dispatch(List=crv_2, DispatchPattern=flattened_mesh_preview_2)  # -> ListA, ListB
dispatch_3 = Dispatch(List=mesh_2, DispatchPattern=flattened_mesh_preview_2)  # -> ListA, ListB
preview_8 = CustomPreview(Geometry=dispatch_3.ListA, Shader=swatch)
preview_9 = CustomPreview(Geometry=dispatch_2.ListA, Shader=ColourSwatch(SwatchColor=RGB(0, 0, 0)))

brep_2 = Brep(pipe_2)
mesh_preview_2 = Boolean(mesh_preview)
dispatch_4 = Dispatch(List=brep_2, DispatchPattern=mesh_preview_2)  # -> ListA, ListB
preview_10 = CustomPreview(Geometry=dispatch_4.ListA, Shader=ColourSwatch(SwatchColor=RGB(26, 26, 26)))

curvepoint = PointOnCurve(chebyshev_net.debug2, parameter=0.5)
stack_5 = CreateStack(UIElements=merge_8, Horizontal=True)
addelems = AddElements(Window=launchwin, Elements=flatten(stack_5), DoVLChecking=True)  # -> AddedElements, ElementNames
machine_2 = Integer(machine)

end = EndPoints(Curve=chebyshev_net.actuated)  # -> Start, End
ln = Line(StartPoint=end.Start, EndPoint=end.End)

blocktocode = PythonScript(FRAdjust=machine_prm.FRA, machine=machine_2)  # -> blockToCode
# ---------- blocktocode: Python ----------
import math
import rhinoscriptsyntax as rs

def blockToCode(block, nozzleDia, fillamentDia, layerHeight, defaultSpeed = 5000):
    result = []
    for i in range(len(block)):
        curve = block[i]
        if(isinstance(defaultSpeed, list)): speed = defaultSpeed[i]
        else: speed = defaultSpeed
        pt = rs.CurveStartPoint(curve)
        if(machine == 1):
            # makerbot
            result += ["G1 E-1.000 F1200\n"]
            result += ["G1 X%.3f Y%.3f F9000\n" % (pt[0], pt[1])]
            result += ["G1 E1.000 F1200\n"]
        else:
            # large printer
            result += ["G92 E0\n"]
            result += ["G1 E-1.000 F1200\n"]
            result += ["G1 X%.3f Y%.3f F9000\n" % (pt[0], pt[1])]
            result += ["G1 E0.000 F1200\n"]
        # extrude along curve
        i = 0
        segments, extSum = rs.ExplodeCurves(curve), 0.
        if(len(segments) == 0):
            segments = [curve]
        for segment in segments:
            volume = nozzleDia * rs.CurveLength(segment) * layerHeight
            extrusion = (volume / (((fillamentDia / 2) ** 2) * math.pi)) * FRAdjust
            extSum += extrusion
            if(machine == 1):
                # makerbot
                E = extrusion
            else:
                # large printer
                E = extSum
            pt = rs.CurveEndPoint(segment)
            if(i == 0):
                string = "G1 X%.3f Y%.3f E%.3f F%d\n" % (pt[0], pt[1], E, int(speed))
            else:
                string = "G1 X%.3f Y%.3f E%.3f\n" % (pt[0], pt[1], E)
            i += 1
            result += [string]
    return "".join(result)
# ---------- end blocktocode ----------

# ---- group: chamfer
division_2 = Division(A=width_3, B=3.41421)
p_n_c = PickNChoose(Pattern=chamferjoints_2, Stream0=False, Stream1=division_2)

# ---- group: obj handling
pt_3 = Point(chebyshev_net.vertices)
crv_3 = Curve(chebyshev_net.actuated)
cullpt = CullDuplicates(Points=pt_3, Tolerance=0.1, CullMode=3)  # -> Points, Indices, Valence
crv_cp = CurveClosestPoint(Point=cullpt.Points, Curve=graft(crv_3))  # -> Point, Parameter, Distance
lng = ListLength(List=cullpt.Points)
smaller = SmallerThan(FirstNumber=crv_cp.Distance, SecondNumber=1)  # -> SmallerThan, OrEqualTo
series = Series(Start=0, Step=1, Count=lng)
dispatch_5 = Dispatch(List=cullpt.Points, DispatchPattern=smaller.SmallerThan)  # -> ListA, ListB
dispatch_6 = Dispatch(List=series, DispatchPattern=smaller.SmallerThan)  # -> ListA, ListB
alongcrv = SortAlongCurve(Points=dispatch_5.ListA, Curve=graft(crv_3))  # -> Points, Indices
item_6 = ListItem(List=dispatch_6.ListA, Index=alongcrv.Indices, Wrap=True)
pline = PolyLine(Vertices=alongcrv.Points, Closed=False)
int_2 = Integer(item_6)
explode = Explode(Curve=pline, Recursive=True)  # -> flatten(Segments), Vertices
obj_writter = PythonScript(vertices=flatten(cullpt.Points), edges=int_2, filename=obj_path, run=save_obj)  # inputs vertices: list, edges: tree
# ---------- obj_writter: Python ----------
import System
import rhinoscriptsyntax as rs
import Grasshopper as gh
if(run):
    obj = ""
    # save vertices
    for v in vertices:
        pt = rs.coerce3dpoint(v)
        obj += "v %f %f %f\n"%(pt[0], pt[1], pt[2])
    # save lines
    for path in edges.Paths:
        edge = edges.Branch(path)
        if(len(edge) < 2): continue
        for i in range(len(edge) - 1):
            obj += "l %d %d\n"%(edge[i] + 1, edge[i+1] + 1)
    print(obj)
    with open(filename, "wt") as file:
        file.write(obj)
# ---------- end obj_writter ----------
obj_mesh = Curve(explode.Segments)

# ----
crv_4 = Curve(obj_mesh)
obj_preview_2 = Boolean(obj_preview)
dispatch_7 = Dispatch(List=crv_4, DispatchPattern=obj_preview_2)  # -> ListA, ListB
preview_11 = CustomPreview(Geometry=dispatch_7.ListA, Shader=ColourSwatch(SwatchColor=RGB(0, 255, 213)))

crv_5 = Curve([<curve referenced from the Rhino model> x2])

width_4 = Number(width_3)
height_3 = Number(height_2)
infill_3 = Number(infill_2)
chamfer = Data(p_n_c)
nozzlediameter_3 = Number(nozzlediameter_2)
blocktocode_2 = Data(blocktocode)
fillamentdia_3 = Number(fillamentdia_2)
constraintlayerheight_3 = Number(constraintlayerheight_2)

item_7 = ListItem(List=crv_5, Index=0, Wrap=True)  # -> Item, Item1
crvprox = CurveProximity(CurveA=item_7.Item, CurveB=item_7.Item1)  # -> PointA, PointB, Distance
plotter = Plotter(plot=chebyshev_net.plot, width=width_4)

# ---- group: plotAreaPreivew
shift_2 = Point(shift)
plotareas = Surface(plotter)
segmentlength_3 = Number(segmentlength_2)
nozzlediameter_4 = Number(nozzlediameter_2)
move = Move(Geometry=plotareas, Motion=shift_2)  # -> Geometry, Transform
offset_2 = Offset(Curve=move.Geometry, Distance=expr("x*.5", nozzlediameter_4), Plane=PlaneXY(0, 0, 0), Corners=1)
offset_3 = Offset(Curve=move.Geometry, Distance=expr("-.5*x", nozzlediameter_4), Plane=PlaneXY(0, 0, 0), Corners=1)
merge_9 = Merge(Data1=offset_2, Data2=offset_3)
lng_2 = ListLength(List=plotareas)
len = Length(Curve=merge_9)
series_2 = Series(Start=1, Step=1, Count=lng_2)
sort = SortList(Keys=len, ValuesA=merge_9)  # -> Keys, ValuesA
swatch_2 = ColourSwatch(SwatchColor=RGBA(117, 117, 117, 126))
area_2 = Area(Geometry=move.Geometry)  # -> Area, Centroid
int_3 = Integer(series_2)
item_8 = ListItem(List=sort.ValuesA, Index=0, Wrap=True)
crv_6 = Curve(move.Geometry)
tag = TextTag3D(Location=area_2.Centroid, Text=int_3, Size=segmentlength_3, Colour=swatch_2, Justification=5)
merge_10 = Merge(Data1=graft(crv_6), Data2=item_8)
boundary_3 = BoundarySurfaces(Edges=merge_10)
preview_12 = CustomPreview(Geometry=boundary_3, Shader=swatch_2)  # disabled

# ----
upmultiplier = Slider(1, range=1..3)
largetop_2_layers = PythonScript()  # -> function
# ---------- largetop_2_layers: Python ----------
import rhinoscriptsyntax as rs

angleMax, angleMin = 0.46, 0.45
speedMax, speedMin = 5000, 5000

def unitAngleToSpeed(x):
    return 5000

function = (unitAngleToSpeed, angleMax, angleMin, speedMax, speedMin)
# ---------- end largetop_2_layers ----------
largebottom_2layers = PythonScript()  # -> function
# ---------- largebottom_2layers: Python ----------
import rhinoscriptsyntax as rs

angleMax, angleMin = 0.716, 0.715
speedMax, speedMin = 5000, 5000

def unitAngleToSpeed(x):
    return 5000

function = (unitAngleToSpeed, angleMax, angleMin, speedMax, speedMin)
# ---------- end largebottom_2layers ----------

larger = LargerThan(FirstNumber=chebyshev_net.bendingInfo, SecondNumber=0)  # -> LargerThan, OrEqualTo
dispatch_8 = Dispatch(List=graft(chebyshev_net.bendingInfo), DispatchPattern=graft(larger.OrEqualTo))  # -> ListA, ListB

largetop_4_layers = PythonScript()  # -> function
# ---------- largetop_4_layers: Python ----------
import rhinoscriptsyntax as rs

angleMax, angleMin = 1.181, 1.180
speedMax, speedMin = 5000, 5000

def unitAngleToSpeed(x):
    return 5000

function = (unitAngleToSpeed, angleMax, angleMin, speedMax, speedMin)
# ---------- end largetop_4_layers ----------

makerbot_0_4 = PythonScript()  # -> function
# ---------- makerbot_0_4: Python ----------
import rhinoscriptsyntax as rs

angleMax, angleMin = 2.2918, 0.941
speedMax, speedMin = 9000, 1000

def unitAngleToSpeed(x):
    pts = [[0.9410084034, 1.000],
           [1.469915966, 2.000],
           [1.734285714, 3.000],
           [1.892268908, 4.000],
           [1.977478992, 5.000],
           [2.057815126, 6.000],
           [2.11394958, 7.000],
           [2.201008403, 8.000],
           [2.217983193, 9.000]]
    # get curve
    temp = []
    for pt in pts:
        temp += [rs.AddPoint(pt[0], pt[1], 0)]
    curve = rs.AddInterpCurve(temp)
    # get intersection
    line = rs.AddLine([x, 0, 0], [x, 1000, 0])
    intersection = rs.CurveCurveIntersection(curve, line)[0][1][1]
    return intersection * 1000

function = (unitAngleToSpeed, angleMax, angleMin, speedMax, speedMin)
# ---------- end makerbot_0_4 ----------
makerbot_0_6 = PythonScript()  # -> function
# ---------- makerbot_0_6: Python ----------
angleMax, angleMin = 3.2598, 2.1890
speedMax, speedMin = 9000, 1000

def unitAngleToSpeed(x):
    speed = (-91520.91064 * (x ** 5)) + (1255455.527 * (x ** 4)) - \
            (6851183.281 * (x ** 3)) + (18598024.56 * (x ** 2)) - \
            (25115407.13 * x) + 13498580.56
    if(speed > speedMax): speed = speedMax
    elif(speed < speedMin): speed = speedMin
    return int(speed)

def speedToUnitAngle(x):
    return  ((-1.846198946 * (10 ** -8)) * (x ** 2)) + \
            ((3.00026057 * (10 ** -4)) * x) + 1.989590255
function = (unitAngleToSpeed, angleMax, angleMin, speedMax, speedMin)
# ---------- end makerbot_0_6 ----------
largetop_7_3_60_4 = PythonScript()  # -> function
# ---------- largetop_7_3_60_4: Python ----------
import rhinoscriptsyntax as rs

angleMax, angleMin = 4.668, 2.913
speedMax, speedMin = 5000, 2000

def unitAngleToSpeed(x):
    pts = [[2.912699183, 2.000],
           [3.18333685, 3.000],
           [3.962253067, 4.000],
           [4.6682116, 5.000]]
    temp = []
    # get curve
    for pt in pts:
        temp += [rs.AddPoint(pt[0], pt[1], 0)]
    curve = rs.AddInterpCurve(temp)
    # get intersection
    line = rs.AddLine([x, 0, 0], [x, 1000, 0])
    intersection = rs.CurveCurveIntersection(curve, line)[0][1][1]
    return intersection * 1000

function = (unitAngleToSpeed, angleMax, angleMin, speedMax, speedMin)
# ---------- end largetop_7_3_60_4 ----------
largebottom_7_3_60_4 = PythonScript()  # -> function
# ---------- largebottom_7_3_60_4: Python ----------
import rhinoscriptsyntax as rs

angleMax, angleMin = 4.396, 0.739
speedMax, speedMin = 8000, 5000

def unitAngleToSpeed(x):
    pts = [[4.396175367,5.000],
           [4.263084067,6.000],
           [4.117284944,6.200],
           [3.834648083,6.400],
           [3.689057033,6.600],
           [3.422404289,6.800],
           [2.806341497,7.000],
           [0.738780767,8.000]]
    # get curve
    temp = []
    for pt in pts:
        temp += [rs.AddPoint(pt[0], pt[1], 0)]
    curve = rs.AddInterpCurve(temp)
    # get intersection
    line = rs.AddLine([x, 0, 0], [x, 1000, 0])
    intersection = rs.CurveCurveIntersection(curve, line)[0][1][1]
    return intersection * 1000

function = (unitAngleToSpeed, angleMax, angleMin, speedMax, speedMin)
# ---------- end largebottom_7_3_60_4 ----------
switch = PythonScript(machine=machine_2, makerbot=makerbot_0_4, stackerTop=largetop_4_layers, stackerBot=largebottom_2layers)  # -> bot, top
# ---------- switch: Python ----------
if(machine == 1):
    top = makerbot
    bot = makerbot
else:
    top = stackerTop
    bot = stackerBot
# ---------- end switch ----------

multiplication_3 = Multiplication(A=dispatch_8.ListB, B=upmultiplier)
toggle_3 = BooleanToggle(True)
merge_11 = Merge(Data1=dispatch_8.ListA, Data2=multiplication_3)  # -> flatten(Result)
tag_2 = TextTag(Location=curvepoint, Text=merge_11, Colour=ColourSwatch(SwatchColor=RGB(255, 255, 255)))
selectarea = PythonScript(
    bending=chebyshev_net.bending,
    bendingOnSrf=chebyshev_net.bendingOnSrf,
    bendingInfo=merge_11,
    constraint=chebyshev_net.constraint,
    constraintOnSrf=chebyshev_net.constraintOnSrf,
    joints=chebyshev_net.joints,
    buildShift=machine_prm.buildShift,
    plotAreas=plotter,
    areaToPlot=area_to_print)  # -> out, area, bending, bendingOnSrf, bendingInfo, constraint, constraintOnSrf, joints, shift; inputs bending: list, bendingOnSrf: list, bendingInfo: list, constraint: list, constraintOnSrf: list, joints: list, plotAreas: list
# ---------- selectarea: Python ----------
import rhinoscriptsyntax as rs
try:
    areaToPlot = int(areaToPlot)
except:
    areaToPlot = 0
b, bOS, bI, c, cOS, j = [], [], [], [], [], []
if(areaToPlot != 0 and areaToPlot <= len(plotAreas)):
    areaOutline = plotAreas[areaToPlot - 1]
    area = areaOutline
    plotCenter = rs.CurveAreaCentroid(rs.DuplicateSurfaceBorder(areaOutline)[0])[0]
    shift = rs.VectorSubtract(buildShift, plotCenter)
    # bending actuators
    for i in range(len(bending)):
        segPt = rs.CurveMidPoint(bending[i])
        segCP = rs.BrepClosestPoint(areaOutline, segPt)[0]
        if(rs.Distance(segPt, segCP) <= 0.001):
            b += [bending[i]]
            bOS += [bendingOnSrf[i]]
            bI += [bendingInfo[i]]
    # constraints
    for i in range(len(constraint)):
        segPt = rs.CurveMidPoint(constraint[i])
        segCP = rs.BrepClosestPoint(areaOutline, segPt)[0]
        if(rs.Distance(segPt, segCP) <= 0.001):
            c += [constraint[i]]
            cOS += [constraintOnSrf[i]]
    # joints
    for i in range(len(joints)):
        segPt = rs.CurveMidPoint(joints[i])
        segCP = rs.BrepClosestPoint(areaOutline, segPt)[0]
        if(rs.Distance(segPt, segCP) <= 0.001):
            j += [joints[i]]
    # handling
    bending, bendingOnSrf, bendingInfo = b, bOS, bI
    constraint, constraintOnSrf = c, cOS
    joints = j
elif(len(plotAreas) > 0):
    shift = rs.AddPoint(0, 0, 0)
    if(len(plotAreas) > 1): area = rs.BooleanUnion(plotAreas)
    else: area = plotAreas[0]
# ---------- end selectarea ----------
shifttocenter = PythonScript(
    area=selectarea.area,
    bending=selectarea.bending,
    bendingOnSrf=selectarea.bendingOnSrf,
    bendingInfo=selectarea.bendingInfo,
    constraint=selectarea.constraint,
    constraintOnSrf=selectarea.constraintOnSrf,
    joints=selectarea.joints,
    shift=selectarea.shift,
    extraShift=shift)  # -> out, area, bending, bendingOnSrf, bendingInfo, constraint, constraintOnSrf, joints; inputs bending: list, bendingOnSrf: list, bendingInfo: list, constraint: list, constraintOnSrf: list, joints: list
# ---------- shifttocenter: Python ----------
import rhinoscriptsyntax as rs

if(area != None):
    shift = rs.PointAdd(shift, extraShift)
    bending, bendingOnSrf, bendingInfo = rs.MoveObjects(bending, shift), bendingOnSrf, bendingInfo
    constraint, constraintOnSrf = rs.MoveObjects(constraint, shift), constraintOnSrf
    joints = rs.MoveObjects(joints, shift)
    area = rs.MoveObjects(area, shift)
# ---------- end shifttocenter ----------

constraintlayerheight_4 = Number(constraintlayerheight_3)
actuaotrslayerheight = Number(actuatorlayerheight_2)
nozzlediameter_5 = Number(nozzlediameter_3)
blocktocode_3 = Data(blocktocode_2)
fillamentdia_4 = Number(fillamentdia_3)
chamfer_2 = Data(chamfer)
bot = Data(switch.bot)
top = Data(switch.top)
width_5 = Number(width_4)
height_4 = Number(height_3)
infill_4 = Number(infill_3)

p_n_c_2 = PickNChoose(Pattern=graft(chebyshev_net.chamfer), Stream0=False, Stream1=chamfer_2)  # -> flatten(Result)
dispatcher = PythonScript(curves=shifttocenter.bending, angles=shifttocenter.bendingInfo, width=width_5, bot=bot, top=top, run=toggle_3)  # -> actuators, bend, aRespective, constraintsHalf, constraintsHalfAngle, cHRespective, constraints, constraintsAngle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; inputs curves: list, angles: list, bot: list, top: list
# ---------- dispatcher: Python ----------
import rhinoscriptsyntax as rs
cutoff = width
cutoff = 0
actuators, bend, aRespective = [], [], []
constraints, constraintsAngle, cRespective = [], [], []
constraintsHalf, constraintsHalfAngle, cHRespective = [], [], []
constraintsDouble, constraintsDoubleAngle, cDRespective = [], [], []
if(run):
    for i in range(len(curves)):
        curve, angle = curves[i], angles[i]
        length = rs.CurveLength(curve)
        unitAngle = abs(angle / length)
        if(angle >= 0):
            # bottom
            angleMin = bot[2]
            if(unitAngle < angleMin):
                # smaller than range
                requiredLength = abs(angle) / angleMin
                if(requiredLength < 10.): requiredLength = 10
                if(requiredLength <= cutoff):
                    # smaller than cutoff
                    constraintsDouble += [curve]
                    constraintsDoubleAngle += [angle]
                    bend += ["NA"]
                
                else:
                    start = rs.CurveStartPoint(curve)
                    end = rs.CurveEndPoint(curve)
                    mid = rs.CurveMidPoint(curve)
                    vec = rs.VectorUnitize(rs.PointSubtract(start, mid))
                    ptA = rs.PointAdd(mid, rs.VectorScale(vec, .5 * requiredLength))
                    ptB = rs.PointAdd(mid, rs.VectorScale(vec, -.5 * requiredLength))
                    actuators += [rs.AddLine(ptA, ptB)]
                    constraints += [rs.AddLine(start, ptA), rs.AddLine(end, ptB)]
                    constraintsAngle += [angle, angle]
                    constraintsHalf += [curve]
                    constraintsHalfAngle += [angle]
                    bend += [angle]
                    aRespective += [i]
                    cRespective += [i, i]
                    cHRespective += [i]
            else:
                # within range
                actuators += [curve]
                bend += [angle]
                constraintsHalf += [curve]
                constraintsHalfAngle += [angle]
                aRespective += [i]
                cHRespective += [i]
        else:
            # top
            angleMin = top[2]
            if(unitAngle < angleMin):
                # smaller than range
                requiredLength = abs(angle) / angleMin
                if(requiredLength < 10.): requiredLength = 10
                if(requiredLength <= cutoff):
                    constraintsDouble += [curve]
                    constraintsDoubleAngle += [angle]
                    bend += ["NA"]
                else:
                    start = rs.CurveStartPoint(curve)
                    end = rs.CurveEndPoint(curve)
                    mid = rs.CurveMidPoint(curve)
                    vec = rs.VectorUnitize(rs.PointSubtract(start, mid))
                    ptA = rs.PointAdd(mid, rs.VectorScale(vec, .5 * requiredLength))
                    ptB = rs.PointAdd(mid, rs.VectorScale(vec, -.5 * requiredLength))
                    actuators += [rs.AddLine(ptA, ptB)]
                    constraints += [rs.AddLine(start, ptA), rs.AddLine(end, ptB)]
                    constraintsAngle += [angle, angle]
                    constraintsHalf += [curve]
                    constraintsHalfAngle += [angle]
                    bend += [angle]
                    aRespective += [i]
                    cRespective += [i, i]
                    cHRespective += [i]
            else:
                # within range
                actuators += [curve]
                bend += [angle]
                constraintsHalf += [curve]
                constraintsHalfAngle += [angle]
                aRespective += [i]
                cHRespective += [i]
# ---------- end dispatcher ----------
shell = Shell(curve=shifttocenter.bending, area=shifttocenter.area, width=width_5, nozzlediameter=nozzlediameter_5, chamfer=p_n_c_2)  # -> outline_2, shell_2, raster_2
joints = Joints(
    curve=shifttocenter.joints,
    area=shifttocenter.area,
    width=width_5,
    nozzlediameter=nozzlediameter_5,
    fillamentdia=fillamentdia_4,
    chamfer=chamfer_2,
    infill=infill_4,
    run=toggle_3)  # -> blockoutline_2, jointa, jointb
actuators = Actuators(
    outline=shell.outline_2,
    shell=shell.shell_2,
    raster=shell.raster_2,
    actuators=dispatcher.actuators,
    angle=dispatcher.bend,
    arespective=dispatcher.aRespective,
    chalf=dispatcher.constraintsHalf,
    chalfrespective=dispatcher.cHRespective,
    constraints=dispatcher.constraints,
    crespective=dispatcher.cRespective,
    bot=bot,
    top=top,
    width=width_5,
    nozzlediameter=nozzlediameter_5,
    speedmode=speedmode)  # -> outline_4, actuator_2, angle_4, speed_2, constraint_2
actuatorlayers = Integer(2)
actuatorconstraints = PythonScript(
    blockOutline=actuators.outline_4,
    block=actuators.constraint_2,
    angle=actuators.angle_4,
    blockToCode=blocktocode_3,
    nozzleDia=nozzlediameter_5,
    fillamentDia=fillamentdia_4,
    layerHeightActuators=actuaotrslayerheight,
    layerHeightConstraints=constraintlayerheight_4,
    height=height_4,
    actuatorLayers=actuatorlayers)  # -> blockOutline, startingHeight, layerHeight, height, code; inputs blockOutline: list, block: list, angle: list
# ---------- actuatorconstraints: Python ----------
bond = 2

if(len(block) > 0):
    layerHeight = layerHeightConstraints
    if(angle[0] > 0.):
        code = blockToCode(block, nozzleDia, fillamentDia, layerHeight, 3000)
        startingHeight = layerHeightActuators * actuatorLayers
        height = height - layerHeightActuators * actuatorLayers
    else:
        actuatorLayers = 4
        blockOutline = [blockOutline[0], blockOutline[0]]
        code = [blockToCode(block, nozzleDia, fillamentDia, layerHeight * .5), 
                blockToCode(block, nozzleDia, fillamentDia, layerHeight, 3000)]
        startingHeight = [0., layerHeight * .5 * bond]
        height = [layerHeight * .5 * bond, height - layerHeightActuators * actuatorLayers - layerHeight * .5 * bond]
        layerHeight = [layerHeight * .5, layerHeight]
else:
    startingHeight = []
    layerHeight = []
    height = []
    code = []
# ---------- end actuatorconstraints ----------
actuators_2 = PythonScript(
    blockOutline=actuators.outline_4,
    block=actuators.actuator_2,
    angle=actuators.angle_4,
    speeds=actuators.speed_2,
    blockToCode=blocktocode_3,
    nozzleDia=nozzlediameter_5,
    fillamentDia=fillamentdia_4,
    layerHeightActuators=actuaotrslayerheight,
    height=height_4,
    actuatorLayers=actuatorlayers)  # -> blockOutline, startingHeight, layerHeight, height, code; inputs blockOutline: list, block: list, angle: list, speeds: list
# ---------- actuators_2: Python ----------
if(len(block) > 0):
    layerHeight= layerHeightActuators
    code = blockToCode(block, nozzleDia, fillamentDia, layerHeight, speeds)
    if(angle[0] > 0.):
        startingHeight = 0.
        height = layerHeightActuators * actuatorLayers
    else:
        actuatorLayers = 4
        startingHeight = height - layerHeightActuators * actuatorLayers
        height = layerHeightActuators * actuatorLayers
else:
    startingHeight = []
    layerHeight = []
    height = []
    code = []
# ---------- end actuators_2 ----------
diamondconstraint = PythonScript(
    curve=shifttocenter.constraint,
    width=width_5,
    nozzleDia=nozzlediameter_5,
    fillamentDia=fillamentdia_4,
    blockToCode=blocktocode_3,
    height=height_4,
    layerHeight=constraintlayerheight_4,
    chamfer=chamfer_2,
    infill=infill_4)  # -> blockOutline, startingHeight, layerHeight, height, code, everything
# ---------- diamondconstraint: Python ----------
import rhinoscriptsyntax as rs
import math
if(curve and rs.CurveLength(curve) > nozzleDia * 2):
    # constrain parameter
    theta = 45
    if(theta < 1): theta = 1
    theta = math.radians(theta)
    if(infill < 0.01): infill = 0.01
    elif(infill > 1): infill = 1.
    # generate outline
    ptStart, ptEnd = rs.CurveStartPoint(curve), rs.CurveEndPoint(curve)
    lineVec = rs.VectorUnitize(rs.PointSubtract(ptEnd, ptStart))
    nVec = [lineVec[1] * -1, lineVec[0], 0.]
    outerOffset = (width - 1.5 * nozzleDia) / 2
    outerVertices = [rs.PointAdd(ptStart, rs.VectorScale(nVec, outerOffset)),
                     rs.PointAdd(ptEnd, rs.VectorScale(nVec, outerOffset)),
                     rs.PointAdd(ptEnd, rs.VectorScale(nVec, -outerOffset)),
                     rs.PointAdd(ptStart, rs.VectorScale(nVec, -outerOffset))]
    temp = []
    # chamfer outline
    if(chamfer):
        if(rs.CurveLength(curve) <= chamfer * 2):
            # too short
            temp = [rs.PointAdd(ptStart, rs.VectorScale(nVec, .5 * outerOffset)),
                    rs.PointAdd(ptEnd, rs.VectorScale(nVec, .5 * outerOffset)),
                    rs.PointAdd(ptEnd, rs.VectorScale(nVec, -.5 * outerOffset)),
                    rs.PointAdd(ptStart, rs.VectorScale(nVec, -.5 * outerOffset))]
        elif(chamfer):
            for i in range(len(outerVertices)):
                firstLine = rs.AddLine(outerVertices[i],
                                       outerVertices[(i - 1) % len(outerVertices)])
                secondLine = rs.AddLine(outerVertices[i],
                                        outerVertices[(i + 1) % len(outerVertices)])
                circle = rs.AddCircle(outerVertices[i], chamfer)
                firstPt = rs.CurveCurveIntersection(firstLine, circle)[0][1]
                secondPt = rs.CurveCurveIntersection(secondLine, circle)[0][1]
                temp.extend([firstPt, secondPt])
    else:
        if(rs.CurveLength(curve) <= chamfer * 2):
            # too short
            temp = [rs.PointAdd(ptStart, rs.VectorScale(nVec, .5 * outerOffset)),
                    rs.PointAdd(ptEnd, rs.VectorScale(nVec, .5 * outerOffset)),
                    rs.PointAdd(ptEnd, rs.VectorScale(nVec, -.5 * outerOffset)),
                    rs.PointAdd(ptStart, rs.VectorScale(nVec, -.5 * outerOffset))]
        else:
            temp = outerVertices
    # generate polyline
    temp = temp + [temp[0]]
    blockA = [rs.AddPolyline(temp)]
    
    # trim curve
    curve = rs.ExtendCurveLength(curve, 0, 0, -nozzleDia)
    curve = rs.ExtendCurveLength(curve, 0, 1, -nozzleDia)
    offsetP = float("%.3f"%((width / 2) - 1.5 * nozzleDia))
    offsetL = float("%.3f"%((1 / math.tan(theta)) * offsetP))
    ptStart, ptEnd = rs.CurveStartPoint(curve), rs.CurveEndPoint(curve)
    length = float("%.3f"%(rs.CurveLength(curve)))
    prmStart, prmEnd = -offsetL, length + offsetL
    period = float("%.3f"%((nozzleDia * ( 1 / math.sin(theta))) / infill))
    residual = length % period
    vectorA = rs.VectorAdd(rs.VectorScale(lineVec, offsetL),
                           rs.VectorScale(nVec, offsetP))
    vectorB = rs.VectorAdd(rs.VectorScale(lineVec, offsetL),
                           rs.VectorScale(nVec, -offsetP))
    i, run = 0, True
    resultA, resultB = [], []
    while (run):
        i += 1
        # get parameters
        prmCur = prmStart + residual * .5 + i * period
        ptOnCrv = rs.PointAdd(ptStart, rs.VectorScale(lineVec, prmCur))
        prm1, prm2 = prmCur + offsetL, prmCur - offsetL
        # trim vector
        amp1, amp2 = 1, 1
        if(prm1 > length): amp1 = 1 - ((prm1 - length) / offsetL)
        if(prm2 < 0): amp2 =  1 + ((prm2 - 0) / offsetL)
        # add points
        ptA1, ptA2 = rs.PointAdd(ptOnCrv, vectorA * amp1), rs.PointAdd(ptOnCrv, -vectorA * amp2)
        if(rs.Distance(ptA1, ptA2) >= nozzleDia * 3):
            if(i % 2 == 0):
                resultA += [ptA1, ptA2]
            else:
                # alternate flip
                resultA += [ptA2, ptA1]
        # check run status
        if(prmCur + period >= prmEnd):
            run = False
    if(len(resultA) > 2):
        blockA.append(rs.AddPolyline(resultA))
    blockB = rs.MirrorObjects(blockA, ptStart, ptEnd, True)
    # bond, regular, bond, regular
    code = [blockToCode(blockA, nozzleDia, fillamentDia, layerHeight * .5),
            blockToCode(blockA, nozzleDia, fillamentDia, layerHeight, 3000),
            blockToCode(blockB, nozzleDia, fillamentDia, layerHeight * .5),
            blockToCode(blockB, nozzleDia, fillamentDia, layerHeight, 3000)]
    blockOutline = [blockA[0], blockA[0], blockB[0], blockB[0]]
    everything = blockA + blockB
    startingHeight = [0., 0., layerHeight * .5, layerHeight]
    height = [layerHeight * .5, height, layerHeight * .5, height - layerHeight]
    layerHeight = [layerHeight * .5, layerHeight * 2, layerHeight * .5, layerHeight * 2]
else:
    startingHeight = []
    layerHeight = []
    height = []
    code = []
# ---------- end diamondconstraint ----------
jointa = PythonScript(
    blockOutline=joints.blockoutline_2,
    block=joints.jointa,
    blockToCode=blocktocode_3,
    nozzleDia=nozzlediameter_5,
    fillamentDia=fillamentdia_4,
    height=height_4,
    layerHeight=constraintlayerheight_4)  # -> blockOutline, startingHeight, layerHeight, height, code, everything; inputs blockOutline: list, block: list
# ---------- jointa: Python ----------
if(len(block) != 0 and block[0] != None):
    blockOutline = [blockOutline[0], blockOutline[0]]
    code = [blockToCode(block, nozzleDia, fillamentDia, layerHeight * .5),
            blockToCode(block, nozzleDia, fillamentDia, layerHeight, 3000)]
    startingHeight = [0., 0.]
    height = [layerHeight * .5, height]
    layerHeight = [layerHeight * .5, layerHeight * 2]
    everything = block
else:
    startingHeight = []
    layerHeight = []
    height = []
    code = []
# ---------- end jointa ----------
jointb = PythonScript(
    blockOutline=joints.blockoutline_2,
    block=joints.jointb,
    blockToCode=blocktocode_3,
    nozzleDia=nozzlediameter_5,
    fillamentDia=fillamentdia_4,
    height=height_4,
    layerHeight=constraintlayerheight_4)  # -> blockOutline, startingHeight, layerHeight, height, code, everything; inputs blockOutline: list, block: list
# ---------- jointb: Python ----------
if(len(block) != 0 and block[0] != None):
    blockOutline = [blockOutline[0], blockOutline[0]]
    code = [blockToCode(block, nozzleDia, fillamentDia, layerHeight * .5),
            blockToCode(block, nozzleDia, fillamentDia, layerHeight, 3000)]
    startingHeight = [layerHeight * .5, layerHeight]
    height = [layerHeight * .5, height - layerHeight]
    layerHeight = [layerHeight * .5, layerHeight * 2]
    everything = block
else:
    startingHeight = []
    layerHeight = []
    height = []
    code = []
# ---------- end jointb ----------
layerheight = Merge(
    Data1=flatten(actuators_2.layerHeight),
    Data2=flatten(actuatorconstraints.layerHeight),
    Data3=flatten(diamondconstraint.layerHeight),
    Data4=flatten(jointa.layerHeight),
    Data5=flatten(jointb.layerHeight))  # -> flatten(Result)
outlines = Merge(
    Data1=flatten(actuators_2.blockOutline),
    Data2=flatten(actuatorconstraints.blockOutline),
    Data3=flatten(diamondconstraint.blockOutline),
    Data4=flatten(jointa.blockOutline),
    Data5=flatten(jointb.blockOutline))  # -> flatten(Result)
startingheights = Merge(
    Data1=flatten(actuators_2.startingHeight),
    Data2=flatten(actuatorconstraints.startingHeight),
    Data3=flatten(diamondconstraint.startingHeight),
    Data4=flatten(jointa.startingHeight),
    Data5=flatten(jointb.startingHeight))  # -> flatten(Result)
height_5 = Merge(
    Data1=flatten(actuators_2.height),
    Data2=flatten(actuatorconstraints.height),
    Data3=flatten(diamondconstraint.height),
    Data4=flatten(jointa.height),
    Data5=flatten(jointb.height))  # -> flatten(Result)
code = Merge(
    Data1=flatten(actuators_2.code),
    Data2=flatten(actuatorconstraints.code),
    Data3=flatten(diamondconstraint.code),
    Data4=flatten(jointa.code),
    Data5=flatten(jointb.code))  # -> flatten(Result)
nozzlediameter_6 = Number(nozzlediameter_5)
everything = Merge(
    Data1=flatten(actuators.actuator_2),
    Data2=flatten(diamondconstraint.everything),
    Data3=flatten(jointa.everything),
    Data4=flatten(jointb.everything))  # -> flatten(Result)
data = Data(everything)

crv_7 = Curve(data)
g_code_preview = Boolean(printing_path_preview)
dispatch_9 = Dispatch(List=crv_7, DispatchPattern=g_code_preview)  # -> ListA, ListB
preview_13 = CustomPreview(Geometry=dispatch_9.ListA, Shader=ColourSwatch(SwatchColor=RGB(138, 138, 138)))

outskirt = Outskirt(
    platform=machine_prm.platform,
    everything=data,
    nozzlediameter=nozzlediameter_6,
    width=width_5,
    fillamentdia=fillamentdia_4,
    blocktocode=blocktocode_3,
    constraintlayerheight=constraintlayerheight_4)  # -> plotboundary_2, outskirtcode_2

panel_3 = Panel("""G90
M83
; **** Replicator 2X start.gcode ****
M73 P0 ; Enable build progress
G162 X Y F3000 ; Home XY maximum
G161 Z F1200 ; Home Z minimum
G92 Z-5 ; Set Z to -5
G1 Z0 ; Move Z to 0
G161 Z F100 ; Home Z slowly
M132 X Y Z A B ; Recall home offsets
M135 T0 ; Load right extruder offsets
G1 X-130 Y-75 Z30 F9000 ; Move to wait position off table
G130 X20 Y20 Z20 A20 B20 ; Lower stepper Vrefs while heating
M127 ; Set fan speed
M140 S0 T0 ; Heat buildplate
M104 S210 T0 ; Heat right extruder
M133 T0 ; Stabilize extruder temperature
G130 X127 Y127 Z40 A127 B127 ; Default stepper Vref
G92 A0 B0 ; Zero extruders
G1 X100 Y-70 F9000 ; Move to front right corner of bed
G1 Z0.3 F6000 ; Move down to purge
G1 X-90 Y-70 E24 F2000 ; Extrude a line of filament across the front edge of the bed
G1 X-100 Y-70 F180 ; Wait for ooze
G1 X-110 Y-70 F5000 ; Fast wipe
G1 Z0.5 F100 ; Lift
G92 A0 B0 ; Zero extruders
M73 P1 ;@body (notify GPX body has started)
; **** end of start.gcode ****""")
panel_4 = Panel("""G90
M82
M106 S0
M140 S0
M104 S210 T0
M109 S210 T0
G21; set mm units
G28 ;home all axis
G90; set absolute coordinates
G92 E0; reset extruder distance
G92 E0
G1 E-4.4000 F1200
G1 Z0.200 F1000
; process Constrain_bigx
; layer 1, Z = 0.200
T0
; tool H0.200 W0.800""")
machine_3 = Integer(machine_2)
p_n_c_3 = PickNChoose(Pattern=machine_3, Stream0=panel_4, Stream1=panel_3)
panel_5 = Panel("""G28 X0 Y0
G1 E-50
M104 S0 ; turn off extruder
M140 S0 ; turn off bed
M84 ; disable motors""")
panel_6 = Panel("""; **** Replicator 2X end.gcode ****
M73 P100 ; end build progress
G1 Z155 F1000 ; send Z axis to bottom of machine
M140 S0 T0 ; cool down HBP
M104 S0 T0 ; cool down right extruder
M104 S0 T1 ; cool down left extruder
M127 ; stop blower fan
G162 X Y F3000 ; home XY maximum
M18 ; disable stepper
M72 P1 ; play Ta-Da song
; **** end of end.gcode ****""")
merge_12 = Merge(Data1=flatten(p_n_c_3), Data2=flatten("G1 Z0.200 F1200"), Data3=flatten(outskirt.outskirtcode_2))
p_n_c_4 = PickNChoose(Pattern=machine_3, Stream0=panel_5, Stream1=panel_6)
header = PythonScript(codes=merge_12)  # -> code; inputs codes: list
# ---------- header: Python ----------
temp = []
for code in codes:
    if(code):
        temp += code.splitlines()
code = "\n".join(temp) + "\n"
# ---------- end header ----------
footer = PythonScript(codes=p_n_c_4)  # -> code; inputs codes: list
# ---------- footer: Python ----------
temp = []
for code in codes:
    temp += code.splitlines()
code = "\n".join(temp)
# ---------- end footer ----------

validation = Validation(outlines=outlines, plotboundary=outskirt.plotboundary_2)
height_6 = ListItem(List=height_5, Index=validation, Wrap=True)
list_item = ListItem(List=outlines, Index=validation, Wrap=True)
list_item_2 = ListItem(List=startingheights, Index=validation, Wrap=True)
list_item_3 = ListItem(List=layerheight, Index=validation, Wrap=True)
code_2 = ListItem(List=code, Index=validation, Wrap=True)
gcodecompiler = PythonScript(
    blockOutline=list_item,
    startingHeight=list_item_2,
    layerHeight=list_item_3,
    height=height_6,
    code=code_2,
    machine=machine_3,
    header=header,
    footer=footer,
    filename=filename,
    run=save_g_code_2)  # inputs blockOutline: list, startingHeight: list, layerHeight: list, height: list, code: list, header: list, footer: list
# ---------- gcodecompiler: Python ----------
import rhinoscriptsyntax as rs

if(run):
    result = {}
    outlines = {}
    # convert curves into dictionary by height
    for i in range(len(blockOutline)):
        if(blockOutline[i] and height[i] and layerHeight[i]):
            repeat = int(float(height[i]) / float(layerHeight[i]))
            for level in range(1, repeat + 1):
                z = startingHeight[i] + level * layerHeight[i]
                result[z] = result.get(z, []) + [code[i]]
                outlines[z] = outlines.get(z, []) + [blockOutline[i]]
    # from bottom to top, block by block compile
    heights = sorted(result.keys())
    gcode = []
    for i in range(len(heights)):
        key = heights[i]
        # move z
        if(machine == 1):
            # makerbot
            temp = ["G1 E-1.000 F1200\n", "G1 Z%.3f F1200\n" % (key), "G1 E1.000 F1200\n"]
        else:
            # large
            temp = ["G92 E0\n", "G1 E-1.000 F1200\n", "G1 Z%.3f F1200\n" % (key), "G1 E0.000 F1200\n"]
            if(i == 1):
                temp += ["M106 S255\n"]
        # initialize first point
        lastCrv = outlines[key].pop(0)
        temp += [result[key].pop(0)]
        # get next curve until all done
        while(len(result[key]) > 0 ):
            nextCurveGuid = rs.CurveClosestObject(lastCrv, outlines[key])[0]
            for i in range(len(outlines[key])):
                if(outlines[key][i] == nextCurveGuid):
                    lastCrv = outlines[key].pop(i)
                    temp += [result[key].pop(i)]
                    break
        gcode += ["".join(temp)]
    gcode = "".join(header + gcode + footer)
    # wrtie code
    with open(filename, "wt") as file:
        file.write(gcode)
# ---------- end gcodecompiler ----------

bending_top_preview = Boolean(shrinkage_rep_top_preview)

bending_bot_preview = Boolean(shrinkage_rep_bot_preview)

# ---- group: segementsPreview
constraintlayerheight_5 = Number(constraintlayerheight_3)
nozzlediameter_7 = Number(nozzlediameter_3)
blocktocode_4 = Data(blocktocode_2)
fillamentdia_5 = Number(fillamentdia_3)
plotareas_2 = Surface(plotter)
chamfer_3 = Data(p_n_c_2)
width_6 = Number(width_4)
height_7 = Number(height_3)
infill_5 = Number(infill_3)
shift_3 = Point(shift)
move_2 = Move(Geometry=chebyshev_net.bending, Motion=shift_3)  # -> Geometry, Transform
move_3 = Move(Geometry=chebyshev_net.constraint, Motion=shift_3)  # -> Geometry, Transform
move_4 = Move(Geometry=chebyshev_net.joints, Motion=shift_3)  # -> Geometry, Transform
diamondconstraint_2 = PythonScript(
    curve=move_3.Geometry,
    width=width_6,
    nozzleDia=nozzlediameter_7,
    fillamentDia=fillamentdia_5,
    blockToCode=blocktocode_4,
    height=height_7,
    layerHeight=constraintlayerheight_5,
    chamfer=chamfer_3,
    infill=infill_5)  # -> blockOutline, startingHeight, layerHeight, height, code, everything
# ---------- diamondconstraint_2: Python ----------
import rhinoscriptsyntax as rs
import math
if(curve and rs.CurveLength(curve) > nozzleDia * 2):
    # constrain parameter
    theta = 45
    if(theta < 1): theta = 1
    theta = math.radians(theta)
    if(infill < 0.01): infill = 0.01
    elif(infill > 1): infill = 1.
    # generate outline
    ptStart, ptEnd = rs.CurveStartPoint(curve), rs.CurveEndPoint(curve)
    lineVec = rs.VectorUnitize(rs.PointSubtract(ptEnd, ptStart))
    nVec = [lineVec[1] * -1, lineVec[0], 0.]
    outerOffset = (width - 1.5 * nozzleDia) / 2
    outerVertices = [rs.PointAdd(ptStart, rs.VectorScale(nVec, outerOffset)),
                     rs.PointAdd(ptEnd, rs.VectorScale(nVec, outerOffset)),
                     rs.PointAdd(ptEnd, rs.VectorScale(nVec, -outerOffset)),
                     rs.PointAdd(ptStart, rs.VectorScale(nVec, -outerOffset))]
    temp = []
    # chamfer outline
    if(chamfer):
        if(rs.CurveLength(curve) <= chamfer * 2):
            # too short
            temp = [rs.PointAdd(ptStart, rs.VectorScale(nVec, .5 * outerOffset)),
                    rs.PointAdd(ptEnd, rs.VectorScale(nVec, .5 * outerOffset)),
                    rs.PointAdd(ptEnd, rs.VectorScale(nVec, -.5 * outerOffset)),
                    rs.PointAdd(ptStart, rs.VectorScale(nVec, -.5 * outerOffset))]
        elif(chamfer):
            for i in range(len(outerVertices)):
                firstLine = rs.AddLine(outerVertices[i],
                                       outerVertices[(i - 1) % len(outerVertices)])
                secondLine = rs.AddLine(outerVertices[i],
                                        outerVertices[(i + 1) % len(outerVertices)])
                circle = rs.AddCircle(outerVertices[i], chamfer)
                firstPt = rs.CurveCurveIntersection(firstLine, circle)[0][1]
                secondPt = rs.CurveCurveIntersection(secondLine, circle)[0][1]
                temp.extend([firstPt, secondPt])
    else:
        if(rs.CurveLength(curve) <= chamfer * 2):
            # too short
            temp = [rs.PointAdd(ptStart, rs.VectorScale(nVec, .5 * outerOffset)),
                    rs.PointAdd(ptEnd, rs.VectorScale(nVec, .5 * outerOffset)),
                    rs.PointAdd(ptEnd, rs.VectorScale(nVec, -.5 * outerOffset)),
                    rs.PointAdd(ptStart, rs.VectorScale(nVec, -.5 * outerOffset))]
        else:
            temp = outerVertices
    # generate polyline
    temp = temp + [temp[0]]
    blockA = [rs.AddPolyline(temp)]
    
    # trim curve
    curve = rs.ExtendCurveLength(curve, 0, 0, -nozzleDia)
    curve = rs.ExtendCurveLength(curve, 0, 1, -nozzleDia)
    offsetP = float("%.3f"%((width / 2) - 1.5 * nozzleDia))
    offsetL = float("%.3f"%((1 / math.tan(theta)) * offsetP))
    ptStart, ptEnd = rs.CurveStartPoint(curve), rs.CurveEndPoint(curve)
    length = float("%.3f"%(rs.CurveLength(curve)))
    prmStart, prmEnd = -offsetL, length + offsetL
    period = float("%.3f"%((nozzleDia * ( 1 / math.sin(theta))) / infill))
    residual = length % period
    vectorA = rs.VectorAdd(rs.VectorScale(lineVec, offsetL),
                           rs.VectorScale(nVec, offsetP))
    vectorB = rs.VectorAdd(rs.VectorScale(lineVec, offsetL),
                           rs.VectorScale(nVec, -offsetP))
    i, run = 0, True
    resultA, resultB = [], []
    while (run):
        i += 1
        # get parameters
        prmCur = prmStart + residual * .5 + i * period
        ptOnCrv = rs.PointAdd(ptStart, rs.VectorScale(lineVec, prmCur))
        prm1, prm2 = prmCur + offsetL, prmCur - offsetL
        # trim vector
        amp1, amp2 = 1, 1
        if(prm1 > length): amp1 = 1 - ((prm1 - length) / offsetL)
        if(prm2 < 0): amp2 =  1 + ((prm2 - 0) / offsetL)
        # add points
        ptA1, ptA2 = rs.PointAdd(ptOnCrv, vectorA * amp1), rs.PointAdd(ptOnCrv, -vectorA * amp2)
        if(rs.Distance(ptA1, ptA2) >= nozzleDia * 3):
            if(i % 2 == 0):
                resultA += [ptA1, ptA2]
            else:
                # alternate flip
                resultA += [ptA2, ptA1]
        # check run status
        if(prmCur + period >= prmEnd):
            run = False
    if(len(resultA) > 2):
        blockA.append(rs.AddPolyline(resultA))
    blockB = rs.MirrorObjects(blockA, ptStart, ptEnd, True)
    
    code = [blockToCode(blockA, nozzleDia, fillamentDia, layerHeight),
            blockToCode(blockB, nozzleDia, fillamentDia, layerHeight)]
    
    blockOutline = [blockA[0], blockB[0]]
    everything = blockA + blockB
    startingHeight = [-layerHeight, 0.]
    layerHeight = [layerHeight * 2, layerHeight * 2]
    height = [height, height]
# ---------- end diamondconstraint_2 ----------

# ----
move_5 = Move(Geometry=plotareas_2, Motion=shift)  # -> Geometry, Transform

# ---- group: segementsPreview (continued)
runion = RegionUnion(Curves=move_5.Geometry)
merge_13 = Merge(Data1=flatten(runion), Data2=flatten(plotareas_2))
item_9 = ListItem(List=merge_13, Index=0, Wrap=True)
joints_2 = Joints(
    curve=move_4.Geometry,
    area=item_9,
    width=width_6,
    nozzlediameter=nozzlediameter_7,
    fillamentdia=fillamentdia_5,
    chamfer=chamfer,
    infill=infill_5,
    run=True)  # -> blockoutline_2, jointa, jointb
shell_2 = Shell(curve=move_2.Geometry, area=item_9, width=width_6, nozzlediameter=nozzlediameter_7, chamfer=chamfer_3)  # -> outline_2, shell_2, raster_2
merge_14 = Merge(Data1=shell_2.outline_2, Data2=diamondconstraint_2.everything, Data3=joints_2.blockoutline_2)  # -> flatten(Result)

# ----
num_2 = Number(chebyshev_net.bendingInfo)
crv_8 = Curve(chebyshev_net.onPlane)
len_2 = Length(Curve=crv_8)
lng_3 = ListLength(List=crv_8)
lng_4 = ListLength(List=num_2)
short = ShortestList(ListA=num_2, ListB=len_2, TrimMode=2)  # -> ListA, ListB
item_10 = ListItem(List=largetop_4_layers, Index=2, Wrap=True)
len_3 = Length(Curve=crv_8)
division_3 = Division(A=short.ListA, B=short.ListB)

subtraction = Subtraction(A=lng_3, B=lng_4)
multiplication_4 = Multiplication(A=item_10, B=len_3)

repeat = RepeatData(Data=0, Length=subtraction)
merge_15 = Merge(Data1=flatten(division_3), Data2=flatten(repeat))
division_4 = Division(A=merge_15, B=item_10)

eval = Evaluate(F="(x + 1) / 2", x=division_4)

gradient = Gradient(
    LowerLimit=0,
    UpperLimit=1,
    Parameter=eval,
    stops=[0: RGB(0, 219, 0), 0.162: RGB(0, 187, 255), 0.409: RGB(0, 84, 252), 0.502: RGB(133, 133, 133), 0.584: RGB(214, 0, 230), 0.795: RGB(255, 0, 0), 1: RGB(252, 185, 0)])
python = PythonScript(color=gradient, curve=crv_8, angle=merge_15, default=ColourSwatch(SwatchColor=RGB(138, 138, 138)))  # -> out, topCrv, topClr, botCrv, botClr; inputs color: list, curve: list, angle: list
# ---------- python: Python ----------
topCrv, topClr, botCrv, botClr = [], [], [], []
for i in range(len(angle)):
    if(angle[i]>=0):
        topCrv += [curve[i]]
        topClr += [color[i]]
        botCrv += [curve[i]]
        botClr += [default]
    elif(angle[i]<0):
        topCrv += [curve[i]]
        topClr += [default]
        botCrv += [curve[i]]
        botClr += [color[i]]
# ---------- end python ----------

crv_9 = Curve(python.topCrv)
pipe_3 = Pipe(Curve=crv_9, Radius=2, Caps=2)  # -> flatten(Pipe)
dispatch_10 = Dispatch(List=pipe_3, DispatchPattern=bending_top_preview)  # -> ListA, ListB
preview_14 = CustomPreview(Geometry=dispatch_10.ListA, Shader=python.topClr)

crv_10 = Curve(python.botCrv)
pipe_4 = Pipe(Curve=crv_10, Radius=2, Caps=2)  # -> flatten(Pipe)
dispatch_11 = Dispatch(List=pipe_4, DispatchPattern=bending_bot_preview)  # -> ListA, ListB
preview_15 = CustomPreview(Geometry=dispatch_11.ListA, Shader=python.botClr)

# ==== cluster Joints
nozzlediameter = ClusterInput()
fillamentdia = ClusterInput()
chamfer = ClusterInput()
width = ClusterInput()
curve = ClusterInput()
area = ClusterInput()
infill = ClusterInput()
run = ClusterInput()
curve_2 = Curve(curve)
area_2 = Curve(area)
width_2 = Number(width)
infill_2 = Number(infill)
run_2 = Boolean(run)
chamfer_2 = Data(chamfer)
nozzlediameter_2 = Number(nozzlediameter)
fillamentdia_2 = Number(fillamentdia)
dispatch = Dispatch(List=curve_2, DispatchPattern=run_2)  # -> ListA, ListB

end = EndPoints(Curve=dispatch.ListA)  # -> Start, End
ln = Line(StartPoint=end.Start, EndPoint=end.End)
offset = Offset(Curve=ln, Distance=expr("x*.5", width_2), Plane=PlaneXY(0, 0, 0), Corners=1)
offset_2 = Offset(Curve=ln, Distance=expr("x*-.5", width_2), Plane=PlaneXY(0, 0, 0), Corners=1)
edgesrf = EdgeSurface(CurveA=offset, CurveB=offset_2)

dispatch_2 = Dispatch(List=edgesrf, DispatchPattern=chamfer_2)  # -> ListA, ListB

cp = ControlPoints(Curve=dispatch_2.ListA)  # -> Points, Weights, Knots
cull_i = CullIndex(List=cp.Points, Indices=0, Wrap=True)
cir = Circle(Plane=cull_i, Radius=chamfer_2)
ccx = CurveCurve(CurveA=dispatch_2.ListA, CurveB=cir)  # -> Points, ParamsA, ParamsB
trim = TrimTree(Tree=ccx.Points, Depth=1)
alongcrv = SortAlongCurve(Points=trim, Curve=dispatch_2.ListA)  # -> Points, Indices
pline = PolyLine(Vertices=alongcrv.Points, Closed=True)

rint = RegionIntersection(CurvesA=pline, CurvesB=area_2)
match = MatchTree(Tree=rint, Guide=dispatch_2.ListB)
clean = CleanTree(RemoveNulls=True, RemoveInvalid=True, RemoveEmpty=True, Tree=match)
merge = Merge(Data1=clean, Data2=dispatch_2.ListB)
offset_3 = Offset(Curve=merge, Distance=expr("-.5 * x", nozzlediameter_2), Plane=PlaneXY(0, 0, 0), Corners=1)
offset_4 = Offset(Curve=merge, Distance=expr(".5 * x", nozzlediameter_2), Plane=PlaneXY(0, 0, 0), Corners=1)
offset_5 = Offset(Curve=merge, Distance=expr("-1.35 * x", nozzlediameter_2), Plane=PlaneXY(0, 0, 0), Corners=1)
offset_6 = Offset(Curve=merge, Distance=expr("1.35 * x", nozzlediameter_2), Plane=PlaneXY(0, 0, 0), Corners=1)
merge_2 = Merge(Data1=offset_3, Data2=offset_4)
merge_3 = Merge(Data1=offset_5, Data2=offset_6)
len = Length(Curve=merge_2)
X = UnitX(Factor=1)
sort = SortList(Keys=len, ValuesA=merge_2, ValuesB=merge_3)  # -> Keys, ValuesA, ValuesB
curvepoint = PointOnCurve(ln, parameter=0.5)
item = ListItem(List=sort.ValuesA, Index=0, Wrap=True)
item_2 = ListItem(List=sort.ValuesB, Index=0, Wrap=True)
division = Division(A=nozzlediameter_2, B=infill_2)
Y = UnitY(Factor=1)
boundary = BoundarySurfaces(Edges=item_2)
contour = Contour(Shape=boundary, Point=graft(curvepoint), Direction=X, Distance=division)
contour_2 = Contour(Shape=boundary, Point=graft(curvepoint), Direction=Y, Distance=division)

trim_2 = TrimTree(Tree=contour, Depth=1)
lng = ListLength(List=trim_2)
repeat = RepeatData(Data=[True, False], Length=lng)  # -> graft(Data)
dispatch_3 = Dispatch(List=contour, DispatchPattern=repeat)  # -> ListA, ListB
flip = FlipCurve(Curve=dispatch_3.ListA)  # -> Curve, Flag
merge_4 = Merge(Data1=flip.Curve, Data2=dispatch_3.ListB)
end_2 = EndPoints(Curve=merge_4)  # -> Start, End
merge_5 = Merge(Data1=end_2.Start, Data2=end_2.End)
trim_3 = TrimTree(Tree=merge_5, Depth=1)
pline_2 = PolyLine(Vertices=trim_3, Closed=False)  # -> simplify(Polyline)

trim_4 = TrimTree(Tree=contour_2, Depth=1)
lng_2 = ListLength(List=trim_4)
repeat_2 = RepeatData(Data=[True, False], Length=lng_2)  # -> graft(Data)
dispatch_4 = Dispatch(List=contour_2, DispatchPattern=repeat_2)  # -> ListA, ListB
flip_2 = FlipCurve(Curve=dispatch_4.ListA)  # -> Curve, Flag
merge_6 = Merge(Data1=flip_2.Curve, Data2=dispatch_4.ListB)
end_3 = EndPoints(Curve=merge_6)  # -> Start, End
merge_7 = Merge(Data1=end_3.Start, Data2=end_3.End)
trim_5 = TrimTree(Tree=merge_7, Depth=1)
pline_3 = PolyLine(Vertices=trim_5, Closed=False)  # -> simplify(Polyline)

trim_6 = TrimTree(Tree=pline_2, Depth=1)
trim_7 = TrimTree(Tree=pline_3, Depth=1)
merge_8 = Merge(Data1=simplify(item), Data2=trim_6)
merge_9 = Merge(Data1=simplify(item), Data2=trim_7)
blockoutline = Curve(simplify(item))
blockoutline_2 = ClusterOutput(blockoutline)
jointa = ClusterOutput(merge_8)
jointb = ClusterOutput(merge_9)

# ==== cluster Actuators
chalfrespective = ClusterInput()
nozzlediameter = ClusterInput()
speedmode = ClusterInput()
arespective = ClusterInput()
crespective = ClusterInput()
constraints = ClusterInput()
actuators = ClusterInput()
outline = ClusterInput()
raster = ClusterInput()
angle = ClusterInput()
width = ClusterInput()
shell = ClusterInput()
chalf = ClusterInput()
bot = ClusterInput()
top = ClusterInput()
outline_2 = Curve(outline)
chalf_2 = Curve(chalf)
bot_2 = Data(bot)
top_2 = Data(top)
width_2 = Number(width)
shell_2 = Curve(shell)
raster_2 = Curve(raster)
actuators_2 = Curve(actuators)
angle_2 = Number(angle)
speedmode_2 = Integer(speedmode)
arespective_2 = Integer(arespective)
constraints_2 = Curve(constraints)
crespective_2 = Integer(crespective)
chalfrespective_2 = Integer(chalfrespective)
nozzlediameter_2 = Number(nozzlediameter)

len = Length(Curve=constraints_2)
larger = LargerThan(FirstNumber=len, SecondNumber=expr("x*.5", nozzlediameter_2))  # -> LargerThan, OrEqualTo
dispatch = Dispatch(List=graft(constraints_2), DispatchPattern=graft(larger.LargerThan))  # -> ListA, ListB
ext = ExtendCurve(Curve=dispatch.ListA, Type=0, Start=0, End=expr("-.5*x", nozzlediameter_2))
merge = Merge(Data1=ext, Data2=dispatch.ListB)  # -> flatten(Result)

offset = Offset(Curve=actuators_2, Distance=expr("x*.5", width_2), Plane=PlaneXY(0, 0, 0), Corners=1)
offset_2 = Offset(Curve=actuators_2, Distance=expr("x*-.5", width_2), Plane=PlaneXY(0, 0, 0), Corners=1)
offset_3 = Offset(Curve=merge, Distance=expr("x*.5", width_2), Plane=PlaneXY(0, 0, 0), Corners=1)
offset_4 = Offset(Curve=merge, Distance=expr("x*-.5", width_2), Plane=PlaneXY(0, 0, 0), Corners=1)
edgesrf = EdgeSurface(CurveA=offset, CurveB=offset_2)  # -> flatten(Surface)
edgesrf_2 = EdgeSurface(CurveA=offset_3, CurveB=offset_4)  # -> flatten(Surface)
item = ListItem(List=raster_2, Index=arespective_2, Wrap=True)
item_2 = ListItem(List=raster_2, Index=crespective_2, Wrap=True)
crv = Curve(edgesrf_2)
rint = RegionIntersection(CurvesA=graft(item_2), CurvesB=graft(crv))
rint_2 = RegionIntersection(CurvesA=graft(item), CurvesB=graft(edgesrf))  # -> flatten(Result)
item_3 = ListItem(List=raster_2, Index=chalfrespective_2, Wrap=True)

lng = ListLength(List=rint)
larger_2 = LargerThan(FirstNumber=lng, SecondNumber=0)  # -> LargerThan, OrEqualTo
dispatch_2 = Dispatch(List=graft(merge), DispatchPattern=larger_2.LargerThan)  # -> flatten(ListA), ListB
dispatch_3 = Dispatch(List=graft(crespective_2), DispatchPattern=larger_2.LargerThan)  # -> flatten(ListA), ListB
flatten = FlattenTree(Tree=rint, Path="{0}")

end = EndPoints(Curve=chalf_2)  # -> Start, End
vec2pt = Vector2Pt(PointA=end.Start, PointB=end.End, Unitize=False)  # -> Vector, Length
curvepoint = PointOnCurve(chalf_2, parameter=0.436)

item_4 = ListItem(List=shell_2, Index=arespective_2, Wrap=True)
item_5 = ListItem(List=outline_2, Index=arespective_2, Wrap=True)  # -> graft(Item)

end_2 = EndPoints(Curve=actuators_2)  # -> Start, End
vec2pt_2 = Vector2Pt(PointA=end_2.Start, PointB=end_2.End, Unitize=False)  # -> Vector, Length
vrot = Rotate(Vector=vec2pt_2.Vector, Axis=Vector(0, 0, 1), Angle=degrees(90))
curvepoint_2 = PointOnCurve(actuators_2, parameter=0.491)

end_3 = EndPoints(Curve=dispatch_2.ListA)  # -> Start, End
curvepoint_3 = PointOnCurve(dispatch_2.ListA, parameter=0.5)
vec2pt_3 = Vector2Pt(PointA=end_3.Start, PointB=end_3.End, Unitize=False)  # -> Vector, Length

speedtoangle = PythonScript(curve=actuators_2, angle=angle_2, bottom=bot_2, top=top_2)  # -> speed; inputs curve: list, angle: list, bottom: list, top: list
# ---------- speedtoangle: Python ----------
import rhinoscriptsyntax as rs
speed = []
j = 0
for i in range(len(angle)):
    if(angle[i] != "NA"):
        print(angle[i])
        unitAngle = abs(angle[i]) / rs.CurveLength(curve[j])
        j += 1
        # choose method
        if(angle[i] >= 0):
            print("bot")
            function = bottom[0]
            angleMax = bottom[1]
            angleMin = bottom[2]
            speedMax = bottom[3]
            speedMin = bottom[4]
        elif(angle[i] < 0):
            print("top")
            function = top[0]
            angleMax = top[1]
            angleMin = top[2]
            speedMax = top[3]
            speedMin = top[4]
        # clamp within range
        if(unitAngle < angleMin):
            unitAngle = angleMin
        elif(unitAngle > angleMax):
            unitAngle = angleMax
        speed += [function(unitAngle)]
        print(function(unitAngle))
    else:
        speed += ["NA"]
# ---------- end speedtoangle ----------
clamped = PythonScript(curve=actuators_2, angle=angle_2, bottom=bot_2, top=top_2)  # -> speed; inputs curve: list, angle: list, bottom: list, top: list
# ---------- clamped: Python ----------
import rhinoscriptsyntax as rs
if(curve != [] and curve[0] != None):
    topMin, topMax, botMin, botMax = None, None, None, None
    unitAngles, sign, speed, = [], [], []
    angleTemp = []
    for i in range(len(angle)):
        if(angle[i] != "NA"): angleTemp += [angle[i]]
    # get unitAngles
    for i in range(len(angleTemp)):
        unitAngles += [abs(angleTemp[i]) / rs.CurveLength(curve[i])]
        sign += [angleTemp[i] / abs(angleTemp[i])]
    # get top, bot min and max
    for i in range(len(unitAngles)):
        if(sign[i] >= 0):
            if(not botMax or unitAngles[i] > botMax):
                botMax = unitAngles[i]
            if(not botMin or unitAngles[i] < botMin):
                botMin = unitAngles[i]
        else:
            if(not topMax or unitAngles[i] > topMax):
                topMax = unitAngles[i]
            if(not topMin or unitAngles[i] < topMin):
                topMin = unitAngles[i]
    # remap
    temp = []
    for i in range(len(angleTemp)):
        if(angleTemp[i] != "NA"):
            if(angleTemp[i] >= 0):
                function = bottom[0]
                angleMax = bottom[1]
                angleMin = bottom[2]
                speedMax = bottom[3]
                speedMin = bottom[4]
                max, min = botMax, botMin
            else:
                function = top[0]
                angleMax = top[1]
                angleMin = top[2]
                speedMax = top[3]
                speedMin = top[4]
                max, min = topMax, topMin
            unitAngle = abs(angleTemp[i]) / rs.CurveLength(curve[i])
            unitAngle = ((unitAngle - min) / (max - min)) * (angleMax - angleMin) + angleMin
            temp += [function(unitAngle)]
    
    i = 0
    for item in angle:
        if(item == "NA"):
            speed += ["NA"]
        else:
            speed += [temp[i]]
            i += 1
# ---------- end clamped ----------
_5000_everything = PythonScript(curve=actuators_2, angle=angle_2, bottom=bot_2, top=top_2)  # -> speed; inputs curve: list, angle: list, bottom: list, top: list
# ---------- _5000_everything: Python ----------
speed = []
for i in range(len(angle)):
    if(angle[i] != "NA"):speed += [5000]
    else: speed += [None]
# ---------- end _5000_everything ----------
modelselecter = PythonScript(speedMode=speedmode_2, functional=speedtoangle, clamped=clamped, FTEverything=_5000_everything)  # -> simplify(graft(speed)); inputs functional: list, clamped: list, FTEverything: list
# ---------- modelselecter: Python ----------
if(speedMode == 0):
    speed = functional
elif(speedMode == 1):
    speed = clamped
else:
    speed = FTEverything
# ---------- end modelselecter ----------
contour = Contour(Shape=rint_2, Point=curvepoint_2, Direction=vrot, Distance=nozzlediameter_2)
contour_2 = Contour(Shape=item_3, Point=curvepoint, Direction=vec2pt.Vector, Distance=nozzlediameter_2)
contour_3 = Contour(Shape=flatten, Point=curvepoint_3, Direction=vec2pt_3.Vector, Distance=nozzlediameter_2)
crv_2 = Curve(contour)
crv_3 = Curve(contour_3)
crv_4 = Curve(contour_2)

trim = TrimTree(Tree=crv_2, Depth=1)
lng_2 = ListLength(List=trim)
repeat = RepeatData(Data=[True, False], Length=lng_2)  # -> graft(Data)
dispatch_4 = Dispatch(List=crv_2, DispatchPattern=repeat)  # -> ListA, ListB
flip = FlipCurve(Curve=dispatch_4.ListA)  # -> Curve, Flag
merge_2 = Merge(Data1=flip.Curve, Data2=dispatch_4.ListB)
end_4 = EndPoints(Curve=merge_2)  # -> Start, End
merge_3 = Merge(Data1=end_4.Start, Data2=end_4.End)
trim_2 = TrimTree(Tree=merge_3, Depth=1)
pline = PolyLine(Vertices=trim_2, Closed=False)  # -> simplify(Polyline)

trim_3 = TrimTree(Tree=crv_4, Depth=1)
lng_3 = ListLength(List=trim_3)
repeat_2 = RepeatData(Data=[True, False], Length=lng_3)  # -> graft(Data)
dispatch_5 = Dispatch(List=crv_4, DispatchPattern=repeat_2)  # -> ListA, ListB
flip_2 = FlipCurve(Curve=dispatch_5.ListA)  # -> Curve, Flag
merge_4 = Merge(Data1=flip_2.Curve, Data2=dispatch_5.ListB)
end_5 = EndPoints(Curve=merge_4)  # -> Start, End
merge_5 = Merge(Data1=end_5.Start, Data2=end_5.End)
trim_4 = TrimTree(Tree=merge_5, Depth=1)
pline_2 = PolyLine(Vertices=trim_4, Closed=False)  # -> simplify(Polyline)

trim_5 = TrimTree(Tree=crv_3, Depth=1)
lng_4 = ListLength(List=trim_5)
repeat_3 = RepeatData(Data=[True, False], Length=lng_4)  # -> graft(Data)
dispatch_6 = Dispatch(List=crv_3, DispatchPattern=repeat_3)  # -> ListA, ListB
flip_3 = FlipCurve(Curve=dispatch_6.ListA)  # -> Curve, Flag
merge_6 = Merge(Data1=flip_3.Curve, Data2=dispatch_6.ListB)
end_6 = EndPoints(Curve=merge_6)  # -> Start, End
merge_7 = Merge(Data1=end_6.Start, Data2=end_6.End)
trim_6 = TrimTree(Tree=merge_7, Depth=1)
pline_3 = PolyLine(Vertices=trim_6, Closed=False)  # -> simplify(Polyline)

item_6 = ListItem(List=shell_2, Index=chalfrespective_2, Wrap=True)  # -> simplify(graft(Item))
path = ConstructPath(Indices=graft(dispatch_3.ListA))  # -> flatten(Branch)
path_2 = ConstructPath(Indices=graft(arespective_2))  # -> flatten(Branch)
merge_8 = Merge(Data1=item_6, Data2=pline_2)
tstat = TreeStatistics(Tree=pline_3)  # -> Paths, Length, Count
tstat_2 = TreeStatistics(Tree=pline)  # -> Paths, Length, Count
path_3 = ConstructPath(Indices=graft(chalfrespective_2))  # -> flatten(Branch)
tstat_3 = TreeStatistics(Tree=merge_8)  # -> Paths, Length, Count
replace = ReplacePaths(Data=pline_3, Search=tstat.Paths, Replace=path)
replace_2 = ReplacePaths(Data=pline, Search=tstat_2.Paths, Replace=path_2)
replace_3 = ReplacePaths(Data=merge_8, Search=tstat_3.Paths, Replace=path_3)
item_7 = ListItem(List=replace, Index=0, Wrap=True)  # -> Item, Item1
match = MatchTree(Tree=item_5, Guide=replace_2)
graft = GraftTree(Tree=graft(item_4), IncludeEmptyLists=True, IncludeNullItems=True)  # -> simplify(Tree)
merge_9 = Merge(Data1=item_7.Item, Data2=replace_2, Data3=item_7.Item1)

replace_4 = ReplaceItems(List=item_7.Item, Item=5000, Indices=0, Wrap=False)
replace_5 = ReplaceItems(List=replace_2, Item=modelselecter, Indices=0, Wrap=False)
replace_6 = ReplaceItems(List=item_7.Item1, Item=5000, Indices=0, Wrap=False)
merge_10 = Merge(Data1=replace_4, Data2=replace_5, Data3=replace_6)  # -> simplify(Result)

sort = PythonScript(shell=graft, curves=merge_9, speeds=merge_10)  # -> resultCurves, resultSpeed; inputs shell: list, curves: list, speeds: list
# ---------- sort: Python ----------
import rhinoscriptsyntax as rs
if(shell != [] and curves != [] and speeds != []):
    resultCurves, resultSpeed = [shell[0]], [5000]
    last = rs.CurveEndPoint(shell[0])
    while(len(curves) != 0):
        minDist, index = None, None
        for i in range(len(curves)):
            curve = curves[i]
            cpUV = rs.CurveClosestPoint(curve, last, 0)
            cp = rs.EvaluateCurve(curve, cpUV, 0)
            dist = rs.Distance(last, cp)
            if(minDist == None or dist < minDist):
                minDist, index = dist, i
        curve = curves.pop(index)
        speed = speeds.pop(index)
        startDist = rs.Distance(rs.CurveStartPoint(curve), last)
        endDist = rs.Distance(rs.CurveEndPoint(curve), last)
        if(startDist > endDist): rs.ReverseCurve(curve)
        last = rs.CurveEndPoint(curve)
        resultCurves += [curve]
        resultSpeed += [speed]
# ---------- end sort ----------
round = Round(Number=sort.resultSpeed)  # -> Nearest, Floor, Ceiling
match_2 = MatchTree(Tree=graft(angle_2), Guide=round.Nearest)
match_3 = MatchTree(Tree=sort.resultCurves, Guide=merge_9)
outline_3 = Curve(match)
constraint = Curve(replace_3)
actuator = Curve(match_3)
angle_3 = Number(match_2)
speed = Number(round.Nearest)
constraint_2 = ClusterOutput(constraint)
outline_4 = ClusterOutput(outline_3)
actuator_2 = ClusterOutput(actuator)
speed_2 = ClusterOutput(speed)
angle_4 = ClusterOutput(angle_3)

# ==== cluster Shell
nozzlediameter = ClusterInput()
chamfer = ClusterInput()
width = ClusterInput()
curve = ClusterInput()
area = ClusterInput()
curve_2 = Curve(curve)
area_2 = Curve(area)
width_2 = Number(width)
chamfer_2 = Data(chamfer)
nozzlediameter_2 = Number(nozzlediameter)

ext = ExtendCurve(Curve=curve_2, Type=0, Start=expr("-.5*x", nozzlediameter_2), End=expr("-.5*x", nozzlediameter_2))
end = EndPoints(Curve=ext)  # -> Start, End
ln = Line(StartPoint=end.Start, EndPoint=end.End)
offset = Offset(Curve=ln, Distance=expr("x*.5", width_2), Plane=PlaneXY(0, 0, 0), Corners=1)
offset_2 = Offset(Curve=ln, Distance=expr("x*-.5", width_2), Plane=PlaneXY(0, 0, 0), Corners=1)
edgesrf = EdgeSurface(CurveA=offset, CurveB=offset_2)

bool = Boolean(chamfer_2)
dispatch = Dispatch(List=graft(chamfer_2), DispatchPattern=graft(bool))  # -> ListA, ListB
dispatch_2 = Dispatch(List=edgesrf, DispatchPattern=graft(bool))  # -> ListA, ListB

cp = ControlPoints(Curve=dispatch_2.ListA)  # -> Points, Weights, Knots
cull_i = CullIndex(List=cp.Points, Indices=0, Wrap=True)
cir = Circle(Plane=cull_i, Radius=dispatch.ListA)
ccx = CurveCurve(CurveA=dispatch_2.ListA, CurveB=cir)  # -> Points, ParamsA, ParamsB
trim = TrimTree(Tree=ccx.Points, Depth=1)
alongcrv = SortAlongCurve(Points=trim, Curve=dispatch_2.ListA)  # -> Points, Indices
pline = PolyLine(Vertices=alongcrv.Points, Closed=True)

crv = Curve(dispatch_2.ListB)
rint = RegionIntersection(CurvesA=crv, CurvesB=area_2)
rint_2 = RegionIntersection(CurvesA=pline, CurvesB=area_2)
match = MatchTree(Tree=rint_2, Guide=dispatch_2.ListB)
clean = CleanTree(RemoveNulls=True, RemoveInvalid=True, RemoveEmpty=True, Tree=match)
merge = Merge(Data1=clean, Data2=rint)  # -> flatten(Result)
crv_2 = Curve(merge)
crv_3 = Curve(merge)
offset_3 = Offset(Curve=crv_2, Distance=expr("1.35*x", nozzlediameter_2), Plane=PlaneXY(0, 0, 0), Corners=1)
offset_4 = Offset(Curve=crv_2, Distance=expr("-1.35*x", nozzlediameter_2), Plane=PlaneXY(0, 0, 0), Corners=1)
offset_5 = Offset(Curve=crv_3, Distance=expr(".5*x", nozzlediameter_2), Plane=PlaneXY(0, 0, 0), Corners=1)
offset_6 = Offset(Curve=crv_3, Distance=expr("-.5*x", nozzlediameter_2), Plane=PlaneXY(0, 0, 0), Corners=1)
merge_2 = Merge(Data1=offset_3, Data2=offset_4)
merge_3 = Merge(Data1=offset_5, Data2=offset_6)
len = Length(Curve=merge_2)
len_2 = Length(Curve=merge_3)
sort = SortList(Keys=len, ValuesA=merge_2)  # -> Keys, ValuesA
sort_2 = SortList(Keys=len_2, ValuesA=merge_3)  # -> Keys, ValuesA
item = ListItem(List=sort.ValuesA, Index=0, Wrap=True)  # -> flatten(Item)
item_2 = ListItem(List=sort_2.ValuesA, Index=0, Wrap=True)  # -> flatten(Item)
outline = Curve(merge)
shell = Curve(item_2)
raster = Curve(item)
outline_2 = ClusterOutput(outline)
shell_2 = ClusterOutput(shell)
raster_2 = ClusterOutput(raster)

# ==== cluster Plotter
plot = ClusterInput()
width = ClusterInput()
plot_2 = Curve(plot)
width_2 = Number(width)
item = ListItem(List=plot_2, Index=0, Wrap=True)
offset = Offset(Curve=item, Distance=expr(".5*x", width_2), Plane=PlaneXY(0, 0, 0), Corners=1)
offset_2 = Offset(Curve=item, Distance=expr("-.5*x", width_2), Plane=PlaneXY(0, 0, 0), Corners=1)
merge = Merge(Data1=offset, Data2=offset_2)
len = Length(Curve=merge)
sort = SortList(Keys=len, ValuesA=merge)  # -> Keys, ValuesA
item_2 = ListItem(List=reverse(sort.ValuesA), Index=0, Wrap=True)
cull_i = CullIndex(List=plot_2, Indices=0, Wrap=True)
srfsplit = SurfaceSplit(Surface=item_2, Curves=cull_i)
plotareas = Brep(srfsplit)
plotareas_2 = ClusterOutput(plotareas)

# ==== cluster Outskirt
constraintlayerheight = ClusterInput()
nozzlediameter = ClusterInput()
blocktocode = ClusterInput()
fillamentdia = ClusterInput()
everything = ClusterInput()
platform = ClusterInput()
width = ClusterInput()

width_2 = Number(width)
platform_2 = Curve(platform)
everything_2 = Curve(everything)
blocktocode_2 = Data(blocktocode)
nozzlediameter_2 = Number(nozzlediameter)
fillamentdia_2 = Number(fillamentdia)
constraintlayerheight_2 = Number(constraintlayerheight)

bbox = BoundingBox(Content=everything_2, Plane=PlaneXY(0, 0, 0), UnionBox=True)  # -> Box, Box_2
debox = DeconstructBox(Box=bbox.Box)  # -> Plane, X, Y, Z
multiplication = Multiplication(A=nozzlediameter_2, B=5)
neg = Negative(Value=multiplication)
rectangle = Rectangle(Plane=debox.Plane, XSize=debox.X, YSize=debox.Y, Radius=0)  # -> Rectangle, Length
offset = Offset(Curve=platform_2, Distance=expr("x*0", neg), Plane=PlaneXY(0, 0, 0), Corners=1)
offset_2 = Offset(Curve=rectangle.Rectangle, Distance=multiplication, Plane=PlaneXY(0, 0, 0), Corners=1)
rint = RegionIntersection(CurvesA=offset, CurvesB=offset_2)
bbox_2 = BoundingBox(Content=flatten(rint), Plane=PlaneXY(0, 0, 0), UnionBox=True)  # -> Box, Box_2
debox_2 = DeconstructBox(Box=bbox_2.Box)  # -> Plane, X, Y, Z
rectangle_2 = Rectangle(Plane=debox_2.Plane, XSize=debox_2.X, YSize=debox_2.Y, Radius=0)  # -> Rectangle, Length

multiplication_2 = Multiplication(A=nozzlediameter_2, B=0)
C = Count(2)
series = Series(Start=multiplication_2, Step=nozzlediameter_2, Count=C)
neg_2 = Negative(Value=series)

offset_3 = Offset(Curve=rectangle_2.Rectangle, Distance=neg_2, Plane=PlaneXY(0, 0, 0), Corners=1)  # -> flatten(Curve)
explode = Explode(Curve=offset_3, Recursive=True)  # -> Segments, Vertices
curvepoint = PointOnCurve(explode.Segments, parameter=0.5)
pdecon = Deconstruct(Point=curvepoint)  # -> XComponent, YComponent, ZComponent
sort = SortList(Keys=pdecon.YComponent, ValuesA=explode.Segments)  # -> Keys, ValuesA
repeat = RepeatData(Data=[True, False], Length=C)  # -> graft(Data)
item = ListItem(List=sort.ValuesA, Index=0, Wrap=True)
dispatch = Dispatch(List=item, DispatchPattern=repeat)  # -> ListA, ListB
flip = FlipCurve(Curve=dispatch.ListA)  # -> Curve, Flag
merge = Merge(Data1=flip.Curve, Data2=dispatch.ListB)
cp = ControlPoints(Curve=merge)  # -> flatten(Points), Weights, Knots
pline = PolyLine(Vertices=cp.Points, Closed=False)
outskirt = PythonScript(
    curve=pline,
    width=width_2,
    nozzleDia=nozzlediameter_2,
    fillamentDia=fillamentdia_2,
    blockToCode=blocktocode_2,
    layerHeight=constraintlayerheight_2)  # -> code; inputs curve: list
# ---------- outskirt: Python ----------
import rhinoscriptsyntax as rs
import math
if(curve):
    block = curve
    height = layerHeight
    blockOutline = block[0]
    everything = block
    code = blockToCode(block, nozzleDia, fillamentDia, layerHeight)
    startingHeight = 0.
# ---------- end outskirt ----------
item_2 = ListItem(List=reverse(offset_3), Index=0, Wrap=True)
offset_4 = Offset(Curve=item_2, Distance=expr("-x", nozzlediameter_2), Plane=PlaneXY(0, 0, 0), Corners=1)  # -> flatten(Curve)
plotboundary = Curve(offset_4)
outskirtcode = Data(outskirt)
plotboundary_2 = ClusterOutput(plotboundary)
outskirtcode_2 = ClusterOutput(outskirtcode)

# ==== cluster Validation
outlines = ClusterInput()
plotboundary = ClusterInput()
outlines_2 = Curve(outlines)
plotboundary_2 = Curve(plotboundary)

ccx = CurveCurve(CurveA=outlines_2, CurveB=plotboundary_2)  # -> Points, ParamsA, ParamsB
lng = ListLength(List=ccx.Points)
smaller = SmallerThan(FirstNumber=lng, SecondNumber=1)  # -> flatten(SmallerThan), OrEqualTo

pcen = PolygonCenter(Polyline=outlines_2)  # -> CenterV, CenterE, CenterA
incurve = PointInCurve(Point=pcen.CenterV, Curve=plotboundary_2)  # -> Relationship, Point
lng_2 = ListLength(List=outlines_2)
series = Series(Start=0, Step=1, Count=lng_2)
equals = Equality(FirstNumber=incurve.Relationship, SecondNumber=2)  # -> Equality, Inequality

and = GateAnd(A=smaller.SmallerThan, B=equals.Equality)

dispatch = Dispatch(List=series, DispatchPattern=and)  # -> ListA, ListB

validids = Integer(dispatch.ListA)
validids_2 = ClusterOutput(validids)
