# Grasshopper definition Column_lines_4Dprint.ghx (Grasshopper 1.0.7)
# plug-ins: Pufferfish

final_lines = Geometry([<curve referenced from the Rhino model> x38])
offcrv = OffsetCurve(Curve=final_lines, Plane=PlaneXY(0, 0, 0), Distance=Slider(1.5, range=0..10), BothSides=True, Kinks=0, CapType=1)

number_slider = Slider(9, range=0..10)
geo = Geometry(<brep referenced from the Rhino model>)
geo_2 = Geometry(<brep referenced from the Rhino model>)
extrusion = Slider(6, range=0..10)
offset = Slider(3, range=0..10)

neg = Negative(Value=Slider(8, range=0..100))

line_build = Line_build(S_2=geo_2, S=geo, A=neg, data=Slider(12, range=0..100))  # -> L, L_2
print_lines = Print_lines(F=extrusion, data=offset, geo=line_build.L, geo_2=line_build.L_2)  # -> M, M_2
geo_3 = Geometry(print_lines.M_2)
geo_4 = Geometry(print_lines.M)

geo_5 = Geometry(line_build.L_2)
geo_6 = Geometry(line_build.L)
Z = UnitZ(Factor=extrusion)
extr = Extrude(Base=flatten(offcrv), Direction=Z)
tri = Triangulate(Mesh=extr)  # -> Mesh, Count
geo_7 = Geometry(tri.Mesh)

# ==== cluster Line_build
A = ClusterInput()
data = ClusterInput()
expression = Expression(x=data, Expression="x*2")
S = ClusterInput()
S_2 = ClusterInput()
data_2 = Data(data)
sdivide = DivideSurface(Surface=S, UCount=10, VCount=data_2)  # -> Points, Normals, Parameters
sdivide_2 = DivideSurface(Surface=S_2, UCount=10, VCount=data_2)  # -> Points, Normals, Parameters
amp = Amplitude(Vector=sdivide_2.Normals, Amplitude=A)
devec = DeconstructVector(Vector=amp)  # -> XComponent, YComponent, ZComponent
vec = VectorXYZ(XComponent=0, YComponent=devec.YComponent, ZComponent=0)  # -> Vector, Length
move = Move(Geometry=sdivide.Points, Motion=vec.Vector)  # -> Geometry, Transform
vlen = VectorLength(Vector=vec.Vector)
number_slider = Slider(2, range=0..10)
number_slider_2 = Slider(8, range=0..10)
flip = FlipMatrix(Data=move.Geometry)
panel = Panel(vlen)
intcrv = Interpolate(Vertices=flip, Degree=3, Periodic=False, KnotStyle=1)  # -> Curve, Length, Domain
repeat = RepeatData(Data=[Slider(0.31, range=0..1), Slider(0.76, range=0..1)], Length=expr("(x+1)*2", number_slider_2))
repeat_2 = RepeatData(Data=[Slider(0.44, range=0..1), Slider(0.62, range=0..1)], Length=expr("(x+1)*2", number_slider_2))
dispatch = Dispatch(List=flatten(intcrv.Curve), DispatchPattern=[True, False])  # -> ListA, ListB
partition = PartitionList(List=repeat_2, Size=number_slider)
partition_2 = PartitionList(List=repeat, Size=number_slider)
geo = Geometry(dispatch.ListB)
geo_2 = Geometry(dispatch.ListA)
shatter = Shatter(Curve=reparameterize(graft(geo)), Parameters=partition_2)  # -> simplify(Segments)
shatter_2 = Shatter(Curve=reparameterize(graft(geo_2)), Parameters=partition)  # -> simplify(Segments)
divlength = DivideLength(Curve=shatter_2, Length=Slider(10, range=0..100))  # -> Points, Tangents, Parameters
cull_i = CullIndex(List=divlength.Points, Indices=-1, Wrap=True)
intcrv_2 = Interpolate(Vertices=cull_i, Degree=3, Periodic=False, KnotStyle=1)  # -> simplify(Curve), Length, Domain
path_mapper = PathMapper(intcrv_2.Curve, source="{A;B}", target="{A}")
end = EndPoints(Curve=shatter)  # -> Start, End
geo_3 = Geometry(shatter_2)
geo_4 = Geometry(shatter)
end_2 = EndPoints(Curve=shatter_2)  # -> Start, End
cull = CullPattern(List=geo_3, CullPattern=[True, False, True])
cull_2 = CullPattern(List=geo_4, CullPattern=[False, True, False])
L = ClusterOutput(cull)
L_2 = ClusterOutput(cull_2)

# ==== cluster Print_lines
F = ClusterInput()
data = ClusterInput()
Z = UnitZ(Factor=F)
geo = ClusterInput()
geo_2 = ClusterInput()
data_2 = Data(Z)
data_3 = Data(data)
geo_3 = Geometry(geo)
geo_4 = Geometry(geo_2)
offcrv = OffsetCurve(Curve=geo_3, Plane=PlaneXY(0, 0, 0), Distance=data_3, BothSides=False, Kinks=0, CapType=1)
offcrv_2 = OffsetCurve(Curve=geo_4, Plane=PlaneXY(0, 0, 0), Distance=data_3, BothSides=False, Kinks=0, CapType=1)
extr = Extrude(Base=offcrv, Direction=data_2)
extr_2 = Extrude(Base=offcrv_2, Direction=data_2)
tri = Triangulate(Mesh=extr)  # -> Mesh, Count
tri_2 = Triangulate(Mesh=extr_2)  # -> Mesh, Count
M = ClusterOutput(tri.Mesh)
M_2 = ClusterOutput(tri_2.Mesh)
