# Grasshopper definition partical_move.gh (Grasshopper 1.0.7)

# ---- group: replace_with_your_pts
crv = Curve([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])
crv_2 = Curve([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])
flip = FlipCurve(Curve=crv_2)  # -> Curve, Flag
weave = Weave(Pattern=[0, 1], Stream0=crv, Stream1=flip.Curve, NullGaps=False)
divide = DivideCurve(Curve=weave, Count=5, Kinks=False)  # -> simplify(Points), Tangents, Parameters

# ----
brep = Brep(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)
mesh = Mesh(brep)
crv_3 = Curve(<curve referenced from the Rhino model>)
move = Move(Geometry=mesh, Motion="0,0,30")  # -> Geometry, Transform
python = GhPythonScript(
    points=divide.Points,
    bounday_curve=crv_3,
    mesh=move.Geometry,
    iterations=Slider(15, range=1..20),
    move=Slider(3, range=1..10))  # -> out, new_pts, flatten(test); inputs points: list of Point3d, bounday_curve: Curve, mesh: Mesh, iterations: Int32
# ---------- python: Python ----------
import Rhino.Geometry as rg
import ghpythonlib.components as gh
from copy import deepcopy
from compas_ghpython.utilities import ghtree_to_list

def Project_pts_on_mesh(mesh,points,vector):
    lines = [rg.Line(pt,vector) for pt in points]
    pts_on_mesh = []
    distance = []
    normals = []
    
    for l,pt in zip(lines,points):
        t = rg.Intersect.Intersection.MeshLine(mesh,l)
        if len(list(t))!= 0:
            pts_on_mesh.append(t[0])
            _,index,_ = gh.MeshClosestPoint(t[0],mesh)
            index,_= rg.Mesh.ClosestPoint(mesh,t[0],1000)
            vector = rg.Mesh.NormalAt(mesh,index,0.5,0.5,0.5,0.5)
            normals.append(vector)
            d = rg.Point3d.DistanceTo(t[0],pt)
            distance.append(d)
        else:
            _,c_pt= rg.Mesh.ClosestPoint(mesh,pt,1000)
            pts_on_mesh.append(c_pt)
    return pts_on_mesh,distance,normals

def particle_move(pts_on_mesh,normals,mesh,move,iterations):
    mesh_pts = deepcopy(pts_on_mesh)
    for i in range(iterations):
        pts = [] 
        test = []
        for pt,normal in zip(mesh_pts,normals):
            t = rg.Transform.Translation(normal*move)
            pt.Transform(t)
            pt_contain = bounday_curve.Contains(pt, rg.Plane.WorldXY, 0.001)
            pts.append(pt)
        new_pts,_,_= Project_pts_on_mesh(mesh,pts,rg.Vector3d(0,0,-1000))
        mesh_pts = new_pts 
    return new_pts,test


pts_on_mesh,distance,normals = Project_pts_on_mesh(mesh,points,rg.Vector3d(0,0,1000))
new_pts,test = particle_move(pts_on_mesh,normals,mesh,move,iterations)
# ---------- end python ----------
pt = Point(python.new_pts)
intcrv = Interpolate(Vertices=pt, Degree=3, Periodic=False, KnotStyle=0)  # -> Curve, Length, Domain
